# Grasshopper definition test_component_with_package.ghx (Grasshopper 1.0.8)
# plug-ins: RhinoCodePluginGH

# ---- group: CPython PIP
rhinocode = RhinoCode()  # -> out, a
# ---------- rhinocode: Python ----------
"""Python 3 with Numpy"""
# requirements: numpy

import numpy as np

# numpy array with random values
a = list(np.random.rand(7))

print(a)
# ---------- end rhinocode ----------
panel = Panel(rhinocode.a)

# ---- group: C# Nuget
rhinocode_2 = RhinoCode()  # -> out, a
# ---------- rhinocode_2: C# ----------
// Default C# Script with Nuget package

#r "nuget: RestSharp, 106.11.7"

using System;
using System.Collections.Generic;
using Rhino;

using RestSharp;
using RestSharp.Authenticators;

var client = new RestClient("https://httpbin.org");
var request = new RestRequest("get", DataFormat.Json);
var response = client.Get(request);

Console.WriteLine(response.Content);

a = response.Content;
# ---------- end rhinocode_2 ----------
panel_2 = Panel(rhinocode_2.a)

# ----
context_print = ContextPrint(Restsharp=rhinocode_2.a)
context_print_2 = ContextPrint(Numpy=rhinocode.a)
