# Grasshopper definition test_hops_main.ghx (Grasshopper 1.0.8)
# plug-ins: Hops

hops = Hops(
    CacheResultsInMemory=True,
    CacheSolveResults=True,
    RemoteDefinitionLocation="C:\Users\ein\gits\rhino\src4\rhino4\Plug-ins\RhinoCodePlugins\tests_rhinocompute\test_component_with_package.ghx",
    RemoteSolveVersion=(0, 1, 0),
    ShowInput_Enabled=False,
    ShowInput_Path=False,
    SynchronousSolve=True)  # -> Numpy, Restsharp
hops_2 = Hops(
    GetInteger=Slider(12, range=0..100),
    CacheResultsInMemory=True,
    CacheSolveResults=True,
    RemoteDefinitionLocation="C:\Users\ein\gits\rhino\src4\rhino4\Plug-ins\RhinoCodePlugins\tests_rhinocompute\test_python_hops.ghx",
    RemoteSolveVersion=(0, 1, 0),
    ShowInput_Enabled=False,
    ShowInput_Path=False,
    SynchronousSolve=True)
hops_3 = Hops(
    GetInteger=Slider(12, range=0..100),
    CacheResultsInMemory=True,
    CacheSolveResults=True,
    RemoteDefinitionLocation="C:\Users\ein\gits\rhino\src4\rhino4\Plug-ins\RhinoCodePlugins\tests_rhinocompute\test_csharp_hops.ghx",
    RemoteSolveVersion=(0, 1, 0),
    ShowInput_Enabled=False,
    ShowInput_Path=False,
    SynchronousSolve=True)
panel = Panel(hops_2)
panel_2 = Panel(hops_3)
panel_3 = Panel(hops.Numpy)
panel_4 = Panel(hops.Restsharp)
