# Grasshopper definition test_python_hops.ghx (Grasshopper 1.0.8)
# plug-ins: RhinoCodePluginGH

get_integer = GetInteger(Slider(12, range=0..100), AtLeast=1, AtMost=1, Maximum=2147483647, Minimum=-2147483648, TreeAccess=False)
py3 = Python3Script(x=get_integer, y=get_integer)  # -> out, a
# ---------- py3: Python ----------
a = x + y
# ---------- end py3 ----------
context_print = ContextPrint(Text=py3.a)
