# Grasshopper definition test_interface_type_check.ghx (Grasshopper 1.0.8)
# plug-ins: RhinoCodePluginGH

# ---- group: Current GHPython
python = GhPythonAHD(Panel="Foo", Color=ColourSwatch(SwatchColor=RGB(196, 160, 51)))
# ---------- python: Python ----------
""" Author: Anders Holden Deleuran """

import Grasshopper as gh

for obj in gh.Instances.ActiveCanvas.Document.Objects:
    if type(obj) is gh.Kernel.Special.GH_Panel:
        if obj.NickName == Panel:
            obj.Properties.Colour = Color
# ---------- end python ----------

# ---- group: WIP IronPython
swatch = ColourSwatch(SwatchColor=RGB(53, 13, 255))
panel = Panel("Foo")
S = Script(Panel=panel, Color=swatch)  # same code as python

# ---- group: WIP CPython
S_2 = Script(Panel="Foo", Color=ColourSwatch(SwatchColor=RGB(199, 62, 62)))
# ---------- S_2: Python ----------
""" Author: Anders Holden Deleuran """
import Grasshopper as gh

objects = gh.Instances.ActiveCanvas.Document.Objects

obj = objects[0]

# type checks
# print(gh.Kernel.Special.GH_Panel)
# print(type(obj))
# print(type(obj) is gh.Kernel.Special.GH_Panel)
# print(type(obj) == gh.Kernel.Special.GH_Panel)
# print(repr(obj.GetType()))
# print(obj.GetType() is gh.Kernel.Special.GH_Panel)
# print(obj.GetType() == gh.Kernel.Special.GH_Panel)
# print(isinstance(obj, gh.Kernel.Special.GH_Panel))

# print('='*80)
# print(type(obj) is gh.Kernel.IGH_DocumentObject)
# print(type(obj) == gh.Kernel.IGH_DocumentObject)
# print(obj.GetType() is gh.Kernel.IGH_DocumentObject)
# print(obj.GetType() == gh.Kernel.IGH_DocumentObject)

for obj in gh.Instances.ActiveCanvas.Document.Objects:
    if isinstance(obj, gh.Kernel.Special.GH_Panel):
        if obj.NickName == Panel:
            obj.Properties.Colour = Color
# ---------- end S_2 ----------

# ----
foo = Panel("Hello Color!!")

# ---- group: MAYBE LATER?
S_3 = Script(Panel=panel, Color=swatch)  # disabled
# ---------- S_3: Python ----------
""" Author: Anders Holden Deleuran """
import clr
clr.AddReferenceToFileAndPath(r"C:\Users\ein\gits\pythonnet\src\testing\bin\Debug\net6.0\Python.Test.dll")
import Grasshopper as gh

from Python.Test import InterfaceTest, ISayHello1
itest = InterfaceTest()
say_hello1 = itest.GetISayHello1()
print(type(say_hello1))
# print(say_hello1.SayHello())
# print(ISayHello1(itest).SayHello())
say_hello2 = itest.GetISayHello2()
# print(say_hello2.SayHello())

objects = gh.Instances.ActiveCanvas.Document.Objects

obj = objects[0]

# type checks
print(gh.Kernel.Special.GH_Panel)
print(type(obj))
print(type(obj) is gh.Kernel.Special.GH_Panel)
print(type(obj) == gh.Kernel.Special.GH_Panel)
print(repr(obj.GetType()))
print(obj.GetType() is gh.Kernel.Special.GH_Panel)
print(obj.GetType() is gh.Kernel.Special.GH_Panel)
print(obj.GetType() == gh.Kernel.Special.GH_Panel)
print(isinstance(obj, gh.Kernel.Special.GH_Panel))

print(clr.GetDynamicType(gh.Kernel.Special.GH_Panel))
# ---------- end S_3 ----------
