# Grasshopper definition test_legacy_scriptclass_methods.ghx (Grasshopper 1.0.7)
# plug-ins: RhinoCodePluginGH

range = Range(Domain=Domain(0, 1), Steps=Slider(2, range=0..10))
script = Script(x=range, y=range)  # -> out, a
# ---------- script: Python ----------
"""Grasshopper Script"""

import System
import Rhino
import Grasshopper

import rhinoscriptsyntax as rs

print("Start")

class MyComponent(Grasshopper.Kernel.GH_ScriptInstance):
    def RunScript(self, x, y):
        print("RunScript")        
        return x + y

    # Solve overrides 
    def BeforeRunScript(self):
        print("BeforeRunScript")

    def AfterRunScript(self):
        print("AfterRunScript")
# ---------- end script ----------
script_2 = Script(x=range, y=range)  # -> out, a; same code as script
script_3 = Script(x=range, y=range)  # -> out, a; inputs x: Double, y: Double
# ---------- script_3: C# ----------
// Grasshopper Script Instance
using System;
using System.Collections;
using System.Collections.Generic;
using System.Drawing;

using Rhino;
using Rhino.Geometry;

using Grasshopper;
using Grasshopper.Kernel;
using Grasshopper.Kernel.Data;
using Grasshopper.Kernel.Types;

Console.WriteLine("Start");

public class Script_Instance : GH_ScriptInstance
{
  private void RunScript(double x, double y, ref object a)
  {
    Print("RunScript");
    a = x + y;
  }

  public override void BeforeRunScript()
  {
    Print("BeforeRunScript");
  }

  public override void AfterRunScript()
  {
    Print("AfterRunScript");
  }
}
# ---------- end script_3 ----------
panel = Panel(script_3.a)
panel_2 = Panel(script_2.a)
panel_3 = Panel(script.out)
panel_4 = Panel(script.a)
panel_5 = Panel(script_3.out)
panel_6 = Panel(script_2.out)
