# Grasshopper definition test_legacy_scriptclass_python.ghx (Grasshopper 1.0.8)
# plug-ins: RhinoCodePluginGH

number_slider = Slider(10, range=0..10)
point = Point(Point(7.253384179, 6.354705241, 0))
point_2 = Point(Point(-5.99773188, -7.514397521, 0))
point_3 = Point(Point(10.7754214, -13.20540778, 0))
point_4 = Point(Point(-5.065933734, 6.0926445, 0))
ghpython_script = GhPythonScript(x=number_slider, y=number_slider, origin=point_4)  # -> a, b; inputs origin: Point3d
# ---------- ghpython_script: Python ----------
from ghpythonlib.componentbase import executingcomponent as component
import Grasshopper, GhPython
import System
import Rhino
import rhinoscriptsyntax as rs

class MyComponent(component):
    def RunScript(self, x, y, origin):
        self._o = origin
        return (
            x + y,
            Rhino.Geometry.Sphere(origin, x)
        )

    @property
    def ClippingBox(self):
        return Rhino.Geometry.BoundingBox(
            Rhino.Geometry.Point3d(0, 0, 0),
            Rhino.Geometry.Point3d(10, 10, 10)
        )
    
    def DrawViewportWires(self, args):
        vectorScale = 0.1
        args.Display.DrawDirectionArrow(self._o, Rhino.Geometry.Vector3d(vectorScale, .5, 0), System.Drawing.Color.Blue)
        args.Display.DrawDirectionArrow(self._o, Rhino.Geometry.Vector3d(.5, vectorScale, 0), System.Drawing.Color.Red)
        args.Display.DrawDirectionArrow(self._o, Rhino.Geometry.Vector3d(0, 1, vectorScale), System.Drawing.Color.Green)
# ---------- end ghpython_script ----------
script = Script(x=number_slider, y=number_slider, origin=point)  # -> a, b; inputs origin: Point3d
# ---------- script: Python ----------
import rhinoscriptsyntax as rs

import System
import Rhino
import Grasshopper

class MyComponent(component):
    def RunScript(self, x, y, origin):
        self._o = origin
        return (
            x + y,
            Rhino.Geometry.Sphere(origin, x)
        )

    @property
    def ClippingBox(self):
        return Rhino.Geometry.BoundingBox.Empty
    
    def DrawViewportWires(self, args):
        vectorScale = 0.1
        args.Display.DrawDirectionArrow(self._o, Rhino.Geometry.Vector3d(vectorScale, .5, 0), System.Drawing.Color.Blue)
        args.Display.DrawDirectionArrow(self._o, Rhino.Geometry.Vector3d(.5, vectorScale, 0), System.Drawing.Color.Red)
        args.Display.DrawDirectionArrow(self._o, Rhino.Geometry.Vector3d(0, 1, vectorScale), System.Drawing.Color.Green)
# ---------- end script ----------
script_2 = Script(x=number_slider, y=number_slider, origin=point_2)  # -> a, b; inputs origin: Point3d
# ---------- script_2: Python ----------
from ghpythonlib.componentbase import executingcomponent as component
import Grasshopper, GhPython
import System
import Rhino
import rhinoscriptsyntax as rs

class MyComponent(component):
    def RunScript(self, x, y, origin: Rhino.Geometry.Point3d):
        self._o = origin
        return (
            x + y,
            Rhino.Geometry.Sphere(origin, x)
        )

    @property
    def ClippingBox(self):
        return Rhino.Geometry.BoundingBox(
            Rhino.Geometry.Point3d(0, 0, 0),
            Rhino.Geometry.Point3d(10, 10, 10)
        )
    
    def DrawViewportWires(self, args):
        vectorScale = 0.1
        args.Display.DrawDirectionArrow(self._o, Rhino.Geometry.Vector3d(vectorScale, .5, 0), System.Drawing.Color.Blue)
        args.Display.DrawDirectionArrow(self._o, Rhino.Geometry.Vector3d(.5, vectorScale, 0), System.Drawing.Color.Red)
        args.Display.DrawDirectionArrow(self._o, Rhino.Geometry.Vector3d(0, 1, vectorScale), System.Drawing.Color.Green)
# ---------- end script_2 ----------
script_3 = Script(x=number_slider, y=number_slider, origin=point_3)  # -> a, b; inputs x: Double, y: Double, origin: Point3d
# ---------- script_3: C# ----------
// Grasshopper Script Instance
using System;
using System.Collections;
using System.Collections.Generic;
using System.Drawing;

using Rhino;
using Rhino.Geometry;

using Grasshopper;
using Grasshopper.Kernel;
using Grasshopper.Kernel.Data;
using Grasshopper.Kernel.Types;

public class Script_Instance : GH_ScriptInstance
{
  private void RunScript(
	double x,
	double y,
	Point3d origin,
	ref object a,
	ref object b)
  {
    a = x + y;
    b = new Sphere(origin, x);
  }
}
# ---------- end script_3 ----------
script_4 = Script(x=number_slider, y=number_slider)  # -> a
# ---------- script_4: Python ----------
import Grasshopper
import System
import Rhino
import rhinoscriptsyntax as rs

print("Debug can stop here")

def TestFunction():
    return 42

class MyComponent(component):
    def RunScript(self, x, y):
        return x + y + TestFunction()

    def __enter__(self):
        print(12)
        return self
# ---------- end script_4 ----------
script_5 = Script(x=number_slider, y=number_slider)  # -> a
# ---------- script_5: Python ----------
from ghpythonlib.componentbase import executingcomponent as component
import Grasshopper, GhPython
import System
import Rhino
import rhinoscriptsyntax as rs

print("Debug can stop here")

def TestFunction():
    return 42

class MyComponent(component):
    def RunScript(self, x, y):
        return x + y + TestFunction()

    def __enter__(self):
        print(12)
        return self
# ---------- end script_5 ----------
panel = Panel(script_4)
panel_2 = Panel([script.a, script.b])
brep = Brep(script.b)
panel_3 = Panel([script_2.a, script_2.b])
brep_2 = Brep(script_2.b)
panel_4 = Panel([script_3.a, script_3.b])
brep_3 = Brep(script_3.b)
panel_5 = Panel(script_5)
panel_6 = Panel([ghpython_script.a, ghpython_script.b])
brep_4 = Brep(ghpython_script.b)
custom_preview = CustomPreview(Geometry=brep_4, Material=ColourSwatch(SwatchColor=RGBA(255, 178, 0, 65)))
script_6 = Script(x=number_slider, y=number_slider)  # -> out, a
# ---------- script_6: Python ----------
import System
import Rhino
import Grasshopper

import rhinoscriptsyntax as rs

class MyComponent(Grasshopper.Kernel.GH_ScriptInstance):
    def RunScript(self, x, y):
        return x + y
# ---------- end script_6 ----------
script_7 = Script(x=number_slider, y=number_slider)  # -> out, a
# ---------- script_7: Python ----------
import System
import Rhino
import Grasshopper

import rhinoscriptsyntax as rs

print("Debug stops here")

class MyComponent(Grasshopper.Kernel.GH_ScriptInstance):
    def RunScript(self, x, y):
        return x + y
# ---------- end script_7 ----------
panel_7 = Panel(script_7.a)
panel_8 = Panel(script_6.a)
