# Grasshopper definition test_libraries_custom.ghx (Grasshopper 1.0.7)
# plug-ins: RhinoCodePluginGH

panel = Panel("rhino://rhino3d.com/test/libraries/csharp/TestCSharpLibrary")
panel_2 = Panel("rhino://rhino3d.com/test/libraries/csharp/TestCSharpLibrary/")
library = Library(
    panel,
    ExpireOnDiskEvent=False,
    TreatInputAsPath=True,
    SourceLanguageFamilySpec_Taxon="mcneel.roslyn.csharp",
    SourceLanguageFamilySpec_Version="9.-1")
library_2 = Library(
    panel_2,
    ExpireOnDiskEvent=False,
    TreatInputAsPath=True,
    SourceLanguageFamilySpec_Taxon="mcneel.roslyn.csharp",
    SourceLanguageFamilySpec_Version="9.-1")
panel_3 = Panel([library, library_2])
