# Grasshopper definition test_output_singlePreview.ghx (Grasshopper 1.0.8)
# plug-ins: RhinoCodePluginGH

# ---- group: ONLY CIRCLE PREVIEW
python_3_script = Python3Script()  # -> sphere, circle
# ---------- python_3_script: Python ----------
import Rhino.Geometry as G

sphere = G.Sphere(G.Point3d.Origin, 12)
circle = G.Circle(G.Point3d.Origin, 12)
# ---------- end python_3_script ----------
