# Grasshopper definition test_perf.ghx (Grasshopper 1.0.7)
# plug-ins: RhinoCodePluginGH

series = Series(Start=Slider(0.1, range=0..0.1), Step=Slider(6, range=0..10), Count=Slider(4096, range=0..10000))
c_script = CSharpScript(x=series, y=series)  # -> out, rect, joined; inputs x: Double, y: Double
# ---------- c_script: C# ----------
    if (x.GetHashCode() == 0) x = 200;
    if (y.GetHashCode() == 0) y = 200;

    x *= 0.5;
    y *= 0.5;

    Point3d[] pts = {
      new Point3d(-x, -y, 0),
      new Point3d(-x, y, 0),
      new Point3d(x, y, 0),
      new Point3d(x, -y, 0)
      };

    GH_Line[] line = {
      new GH_Line(new Line(pts[0], pts[1])),
      new GH_Line(new Line(pts[1], pts[2])),
      new GH_Line(new Line(pts[2], pts[3])),
      new GH_Line(new Line(pts[3], pts[0]))
      };

    rect = line;
    joined = new Polyline(new[] {pts[0], pts[1], pts[2], pts[3], pts[0]});
# ---------- end c_script ----------
script = Script(x=series, y=series)  # -> out, a
# ---------- script: Python ----------
a = x + y
# ---------- end script ----------
script_2 = Script(x=series, y=series)  # -> a; inputs x: Double, y: Double
# ---------- script_2: C# ----------
a = x + y;
# ---------- end script_2 ----------
ghpython_script = GhPythonScript(x=series, y=series)  # -> a; same code as script
script_3 = Script(x=series, y=series)  # -> a; same code as script
script_4 = Script(x=series, y=series)  # -> out, rect, joined; inputs x: Double, y: Double
# ---------- script_4: C# ----------
using System;
using System.Collections;
using System.Collections.Generic;
using System.Drawing;

using Rhino;
using Rhino.Geometry;

using Grasshopper;
using Grasshopper.Kernel;
using Grasshopper.Kernel.Data;
using Grasshopper.Kernel.Types;

public class Script_Instance : GH_ScriptInstance
{
  /* 
    Members:
      RhinoDoc RhinoDocument
      GH_Document GrasshopperDocument
      IGH_Component Component
      int Iteration

    Methods (Virtual & overridable):
      Print(string text)
      Print(string format, params object[] args)
      Reflect(object obj)
      Reflect(object obj, string method_name)
  */

  private void RunScript(double x, double y, ref object rect, ref object joined)
  {
    if (x.GetHashCode() == 0) x = 200;
    if (y.GetHashCode() == 0) y = 200;

    x *= 0.5;
    y *= 0.5;

    Point3d[] pts = {
      new Point3d(-x, -y, 0),
      new Point3d(-x, y, 0),
      new Point3d(x, y, 0),
      new Point3d(x, -y, 0)
      };

    GH_Line[] line = {
      new GH_Line(new Line(pts[0], pts[1])),
      new GH_Line(new Line(pts[1], pts[2])),
      new GH_Line(new Line(pts[2], pts[3])),
      new GH_Line(new Line(pts[3], pts[0]))
      };

    rect = line;
    joined = new Polyline(new[] {pts[0], pts[1], pts[2], pts[3], pts[0]});
  }
}
# ---------- end script_4 ----------
panel = Panel(script.a)
panel_2 = Panel(script_3)
panel_3 = Panel(ghpython_script)
panel_4 = Panel(script_2)
panel_5 = Panel("""// #! csharp
a = x + y;""")
panel_6 = Panel("""#! python2
a = x + y + 10""")
panel_7 = Panel("rhino://rhino3d.com/test/libraries/csharp/TestCSharpLibrary")
script_5 = Script(Script=panel_6, X=series, Y=series, Z=Slider(5, range=0..10))  # -> Out, A
panel_8 = Panel(script_5.A)
script_6 = Script(library=panel_7, x=series, y=Slider(3, range=0..10))  # -> a; inputs library: tree, x: Int32, y: Int32
#   port library: Library or libraries to execute script with
# ---------- script_6: C# ----------
using TestAssembly.Math;

var math = new DoMath();
a = math.Add(x, y);
# ---------- end script_6 ----------
panel_9 = Panel(script_6)
