# Grasshopper definition test_perf_circlepacking_perf(5, 310ms, 100ms)_rc8.9.ghx (Grasshopper 1.0.8)
# plug-ins: RhinoCodePluginGH

number_slider = Slider(1, range=0..10)
pop2d = Populate2D(Region={Plane=PlaneXY(7.5, 10, 0), Size=Domain2(u=-7.5..7.5, v=-10..10)}, Count=Slider(200, range=0..1000), Seed=1)
script = Script(pts=pop2d, n=number_slider)  # -> out, a; inputs pts: list of Point3d, n: Int32
# ---------- script: Python ----------
import Rhino.Geometry as rg
from math import sqrt
for _ in range(n):
    counts = [0] * len(pts)
    vecs = [rg.Vector3d.Zero] * len(pts)
    for i in range(len(pts)):
        for j in range(i + 1, len(pts)):
            d = pts[i].DistanceToSquared(pts[j])
            if d > 4.0: continue
            counts[i] += 1
            counts[j] += 1
            d = sqrt(d)
            vec = (pts[i] - pts[j]) / d * (2 - d) * 0.5
            vecs[i] += vec
            vecs[j] -= vec
    for i in range(len(pts)):
        if counts[i] == 0: continue
        pts[i] += vecs[i] / counts[i]
a = pts
# ---------- end script ----------
python = GhPythonScript(pts=pop2d, n=number_slider)  # -> out, a; inputs pts: list of Point3d, n: Int32; same code as script

# ---- group: output is Vector and has no preview
S = Script(pts=pop2d, n=number_slider)  # -> out, a; inputs pts: list of Point3d, n: Int32
# ---------- S: Python ----------
from math import sqrt

import Rhino.Geometry as rg

def dist(a: rg.Point3f, b: rg.Point3f):
    return (a.X - b.X)**2 + (a.Y - b.Y)**2 + (a.Z - b.Z)**2


def add(a: rg.Vector3f, b: rg.Vector3f):
    return rg.Vector3f(
        a.X + b.X,
        a.Y + b.Y,
        a.Z + b.Z
    )


def diff(a: rg.Point3f, b: rg.Point3f, d: float):
    m = (2 - d) * 0.5 / d
    return rg.Vector3f(
        (a.X - b.X) * m,
        (a.Y - b.Y) * m,
        (a.Z - b.Z) * m
        )


def div(a: rg.Vector3f, d: float):
    return rg.Vector3f(
        a.X / d,
        a.Y / d,
        a.Z / d
        )


for _ in range(n):
    c = len(pts)
    counts = [0] * c
    vecs = [rg.Vector3d.Zero] * c
    
    for i in range(c):
        for j in range(i + 1, c):
            pi = pts[i] 
            pj = pts[j]
            # d = pi.DistanceToSquared(pj)
            d = dist(pi, pj)
            if d > 4.0: continue
            counts[i] += 1
            counts[j] += 1
            d = sqrt(d)
            vec = diff(pi, pj, d)
            vi = vecs[i]
            vj = vecs[j]
            vecs[i] = add(vi, vec)
            vecs[j] = add(vj, vec)
    
    for i in range(c):
        if counts[i] == 0: continue
        pi = pts[i]
        pts[i] = add(pi, div(vecs[i], counts[i]))

a = pts
# ---------- end S ----------

# ----
S_2 = Script(pts=pop2d, n=number_slider)  # -> out, a; inputs pts: list of Point3d, n: Int32; same code as script

# ---- group: EXPECT NO ERRORS
toggle = BooleanToggle(True)
panel = Panel(toggle)
context_bake = ContextBake(Content=toggle)
