# Grasshopper definition test_python_gmsh.ghx (Grasshopper 1.0.8)
# plug-ins: RhinoCodePluginGH

max = Slider(15, range=0.05..15)
min = Slider(15, range=0..15)
dom = ConstructDomain(DomainStart=min, DomainEnd=max)
pt = Point([Point(-15, -15, 0), Point(0, -15, 0), Point(15, -15, 0), Point(15, 0, 0), Point(15, 15, 0), Point(0, 15, 0), Point(-15, 15, 0), Point(-15, 0, 0)])
pt_2 = Point(Tree({0;0}: [Point(-9, -5, 0), Point(-2, -5, 0.01007968047), Point(-2, 2, 0), Point(-9, 2, 0)], {0;1}: [Point(10, 4, 0), Point(6.545084972, 8.755282581, 0), Point(0.9549150281, 6.938926261, 0), Point(0.9549150281, 1.061073739, 0), Point(6.545084972, -0.7552825815, 0)]))
pt_3 = Point([Point(-4, -11, 1.528264007), Point(-10.64616266, 2.540488626, 1.727877033), Point(5.812827593, -0.7629923997, 1.795745666)])
pt_4 = Point([Point(-15, -15, 0), Point(0, -15, 0), Point(15, -15, 0), Point(15, 0, 0), Point(15, 15, 0), Point(0, 15, 0), Point(-15, 15, 0), Point(-14.73454468, 0, 0)])
pt_5 = Point(Tree({0;0}: [Point(-9, -5, 0), Point(-2, -5, 0.01007968047), Point(-2, 2, 0), Point(-9, 2, 0)], {0;1}: [Point(10, 4, 0), Point(6.545084972, 8.755282581, 0), Point(0.9549150281, 6.938926261, 0), Point(0.9549150281, 1.061073739, 0), Point(6.545084972, -0.7552825815, 0)]))
pt_6 = Point([Point(-4, -11, 1.528264007), Point(-10.64616266, 2.540488626, 1.727877033), Point(5.812827593, -0.7629923997, 1.795745666)])
py3 = Python3Script(outer=pt_4, length=dom, quad=Toggle(False))  # -> out, a; inputs outer: list of Point3d, inners: tree of Point3d, nodes: list, quad: Boolean
# ---------- py3: Python ----------
# venv: site-packages
# r: numpy, gmsh
import gmsh
import Rhino.Geometry as rg
import numpy as np

gmsh.initialize()

gmsh.clear()
gmsh.option.setNumber("Mesh.CharacteristicLengthMin", length.Min)
gmsh.option.setNumber("Mesh.CharacteristicLengthMax", length.Max)


def create_loop(pts):
    p_tags = [gmsh.model.geo.add_point(p.X, p.Y, 0.0, p.Z+0.01) for p in pts]
    p_tags.append(p_tags[0])
    l_tags = [gmsh.model.geo.add_line(pt1, pt2) for pt1, pt2 in zip(p_tags, p_tags[1:])]
    return gmsh.model.geo.add_curve_loop(l_tags)


loops = [create_loop(outer)]
loops.extend(create_loop(inner) for inner in inners.Branches)
plane_surface = gmsh.model.geo.add_plane_surface(loops)

if nodes != None:
    p_tags = [gmsh.model.geo.add_point(n.X, n.Y, n.Z) for n in nodes]
    field = gmsh.model.mesh.field.add("Distance")
    gmsh.model.mesh.field.setNumbers(field, "PointsList", p_tags)
    threshold_field = gmsh.model.mesh.field.add("Threshold")
    gmsh.model.mesh.field.setNumber(threshold_field, "IField", field)
    gmsh.model.mesh.field.setNumber(threshold_field, "LcMin", length.Min / 50)
    gmsh.model.mesh.field.setNumber(threshold_field, "LcMax", length.Max * 2)
    gmsh.model.mesh.field.setNumber(threshold_field, "DistMin", length.Min * 2)
    gmsh.model.mesh.field.setNumber(
        threshold_field, "DistMax", length.Min * 10 + length.Max * 10
    )
    gmsh.model.mesh.field.setAsBackgroundMesh(threshold_field)
    
if quad:
    gmsh.model.geo.mesh.setRecombine(2, 1)
gmsh.model.geo.synchronize()
gmsh.model.mesh.generate(2)  # 2 for 2D mesh


coords = np.array(gmsh.model.mesh.getNodes()[1]).reshape(-1, 3)
faces = np.array((gmsh.model.mesh.getElements()[2][1]) - 1).reshape(
    -1, 4 if quad else 3
)
gmsh.finalize()

mesh = rg.Mesh()
for point in coords:
    mesh.Vertices.Add(*point)
for face in faces:
    mesh.Faces.AddFace(*[int(v) for v in face])
mesh.RebuildNormals()
mesh.Compact()
a = mesh
# ---------- end py3 ----------
panel = Panel(py3.a)
