# Grasshopper definition test_python_input_dict.ghx (Grasshopper 1.0.8)
# plug-ins: RhinoCodePluginGH

python_3_script = Python3Script()  # -> a
# ---------- python_3_script: Python ----------
"""Grasshopper Script"""
d = {
    1: "Ehsan",
    2: "David",
    3: "Bob"
}


a = [d, d, d]
# ---------- end python_3_script ----------
python_3_script_2 = Python3Script(a=python_3_script)  # -> out
# ---------- python_3_script_2: Python ----------
print(type(a))
print(type(a[1]))
# ---------- end python_3_script_2 ----------
ironpython_2_script = IronPython2Script(a=python_3_script)  # -> out; same code as python_3_script_2
panel = Panel(python_3_script)
panel_2 = Panel(python_3_script_2)
panel_3 = Panel(ironpython_2_script)
