# Grasshopper definition test_python_inputs.ghx (Grasshopper 1.0.7)
# plug-ins: RhinoCodePluginGH

my_test_values = Panel("""1
2
3
4
5
6
7
8""")
my_test_values_2 = Panel("""1
2
3
4
5
6
7
8""")
my_test_values_3 = Panel("""1
2
3
4
5
6
7
8""")
graft = GraftTree(Tree=my_test_values_3, IncludeEmptyLists=True, IncludeNullItems=True)

# ---- group: INPUT List -> Hint None
py3 = Python3Script(LI=my_test_values)  # -> LO
# ---------- py3: Python ----------
LO = type(LI)
# ---------- end py3 ----------

# ---- group: INPUT List -> Hint Float
py3_2 = Python3Script(LI=my_test_values_2)  # -> LO; inputs LI: list of Double
# ---------- py3_2: Python ----------
LO = [type(x) for x in LI]
# ---------- end py3_2 ----------

# ---- group: INPUT Tree -> Hint Float
py3_3 = Python3Script(LI=graft)  # -> LO; inputs LI: tree of Double
# ---------- py3_3: Python ----------
import System
import Grasshopper as G

li: G.DataTree[float] = LI

dt = G.DataTree[System.Object]()

for bi in range(li.BranchCount):
    p = li.Path(bi)
    dt.AddRange([type(x) for x in li.Branch(bi)], p)

LO = dt
# ---------- end py3_3 ----------

# ----
panel = Panel(py3)
panel_2 = Panel(py3_2)
panel_3 = Panel(graft)
panel_4 = Panel(py3_3)
