# Grasshopper definition test_python_output.ghx (Grasshopper 1.0.8)
# plug-ins: RhinoCodePluginGH

ghpython_script = GhPythonScript()  # -> pythonValue, pythonList, pythonDict, dotnetValue
# ---------- ghpython_script: Python ----------
class Data:
    def __init__(self, value):
        self.value = value

    def __str__(self):
        return "Value {0}".format(self.value)


pythonValue = Data("Test Value")
pythonList = [
    Data("Test List Value 1"),
    Data("Test List Value 2"),
    Data("Test List Value 3"),
]
pythonDict = {
    "one": Data("Test Dict Value 1"),
    "two": Data("Test Dict Value 2"),
    "three": Data("Test Dict Value 3"),
}
# ---------- end ghpython_script ----------
script = Script()  # -> pythonValue, pythonList, pythonDict, dotnetValue
# ---------- script: Python ----------
class Data:
    def __init__(self, value):
        self.value = value

    def __str__(self):
        return f"Value {self.value}"


pythonValue = Data("Test Value")
pythonList = [
    Data("Test List Value 1"),
    Data("Test List Value 2"),
    Data("Test List Value 3"),
]
pythonDict = {
    "one": Data("Test Dict Value 1"),
    "two": Data("Test Dict Value 2"),
    "three": Data("Test Dict Value 3"),
}
# ---------- end script ----------
panel = Panel(ghpython_script.pythonValue)
panel_2 = Panel(ghpython_script.pythonList)
panel_3 = Panel(ghpython_script.pythonDict)
script_2 = Script(vd=ghpython_script.pythonDict)  # -> k, d; inputs vd: list
# ---------- script_2: Python ----------
kl = []
dl = []

print(vd)
for k in vd:
    kl.append(k)
    dl.append(None)

k = kl
d = dl
# ---------- end script_2 ----------
panel_4 = Panel(script.pythonList)
script_3 = Script(vl=script.pythonList)  # -> d; inputs vl: list
# ---------- script_3: Python ----------
dl = []

for v in vl:
    dl.append(v)

d = dl
# ---------- end script_3 ----------
panel_5 = Panel(script.pythonDict)
panel_6 = Panel(script.pythonValue)
script_4 = Script(v=script.pythonValue)  # -> s, t, r, d
# ---------- script_4: Python ----------
t = type(v)
r = repr(v)

d = v.value
# ---------- end script_4 ----------
script_5 = Script(vd=script.pythonDict)  # -> out, k, d; inputs vd: list; same code as script_2
panel_7 = Panel(script_2.k)
panel_8 = Panel(script_2.d)
panel_9 = Panel(script_5.k)
panel_10 = Panel(script_5.d)
panel_11 = Panel(script_5.out)
panel_12 = Panel([script_4.s, script_4.t, script_4.r, script_4.d])
panel_13 = Panel(script_3)
