# Grasshopper definition test_python_reload.ghx (Grasshopper 1.0.8)
# plug-ins: RhinoCodePluginGH

python_3_script = Python3Script()  # -> a
# ---------- python_3_script: Python ----------
import sys

sys.path.append(r'C:\Users\ein\gits\rhino\src4\rhino4\Plug-ins\RhinoCodePlugins\tests_rhino\runpythoncmd')

import somelib

a = somelib.foo()
# ---------- end python_3_script ----------
panel = Panel(python_3_script)
