# Grasshopper definition test_rhinoscript_FindLayer.ghx (Grasshopper 1.0.8)
# plug-ins: RhinoCodePluginGH

button = Button()
# add a sublayer under default and test.
# should match child layer colors to parent.
boolean = Boolean(True)
S = Script(x=boolean)  # -> out, a; inputs x: Boolean
# ---------- S: Python ----------
import rhinoscriptsyntax as rs
import Rhino
import scriptcontext as sc

sc.doc = Rhino.RhinoDoc.ActiveDoc

layerNames = rs.LayerNames()

for layer in layerNames:
    parents = rs.ParentLayer(layer)
    if parents:
        parentColors = rs.LayerColor(parents)
        rs.LayerColor(layer, parentColors)
        a = parentColors

sc.doc = ghdoc
# ---------- end S ----------
script = Script(x=boolean)  # -> out, a; same code as S
python = GhPythonScript(x=boolean)  # -> out, a; inputs x: Boolean; same code as S
panel = Panel(S.a)
panel_2 = Panel(script.a)
panel_3 = Panel(python.a)
