# Grasshopper definition test_templates_panel.ghx (Grasshopper 1.0.7)
# plug-ins: RhinoCodePluginGH

script = Script()  # -> out, a
# ---------- script: Python ----------
"""Grasshopper Script"""
a = "Hello (Not Bye Bye) IronPython 2 in Grasshopper!"
print(a)
# ---------- end script ----------
script_2 = Script()  # -> out, a; unedited script template
script_3 = Script()  # -> out, a
# ---------- script_3: C# ----------
// Grasshopper Script Instance
using System;
using System.Collections;
using System.Collections.Generic;
using System.Drawing;

using Rhino;
using Rhino.Geometry;

using Grasshopper;
using Grasshopper.Kernel;
using Grasshopper.Kernel.Data;
using Grasshopper.Kernel.Types;

public class Script_Instance : GH_ScriptInstance
{
  /* 
    Members:
      RhinoDoc RhinoDocument
      GH_Document GrasshopperDocument
      IGH_Component Component
      int Iteration

    Methods (Virtual & overridable):
      Print(string text)
      Print(string format, params object[] args)
      Reflect(object obj)
      Reflect(object obj, string method_name)
  */
  
  private void RunScript(object x, object y, out object a)
  {
    // Write your logic here
    a = null;
  }
}
# ---------- end script_3 ----------
