# Grasshopper definition test_get_app_doc.ghx (Grasshopper 1.0.8)
# plug-ins: RhinoCodePluginGH

python_3_script = Python3Script()  # -> out, version, doc
# ---------- python_3_script: Python ----------
import clr
clr.AddReference('RevitAPI') 
clr.AddReference('RevitAPIUI')
clr.AddReference('RhinoInside.Revit')

from Autodesk.Revit import DB
from RhinoInside.Revit import Revit, Convert
import rhinoscriptsyntax as rs

version = Revit.ActiveDBApplication.VersionNumber
doc = Revit.ActiveDBDocument
# ---------- end python_3_script ----------
panel = Panel([python_3_script.version, python_3_script.doc])
