# Grasshopper definition test_perf_lotsOfRounds.ghx (Grasshopper 1.0.8)
# plug-ins: RhinoCodePluginGH

series = Series(Start=Slider(0.1, range=0..0.1), Step=Slider(6, range=0..10), Count=Slider(10000, range=0..10000))

# ---- group: Implicit Cycles + Float Type Hint
ghpython_script = GhPythonScript(x=series, y=series)  # -> a
# ---------- ghpython_script: Python ----------
a = x + y
# ---------- end ghpython_script ----------
script = Script(x=series, y=series)  # -> a; inputs x: Double, y: Double; same code as ghpython_script
py3 = Python3Script(x=series, y=series)  # -> a; inputs x: Double, y: Double; same code as ghpython_script

# ---- group: Implicit Cycles + No Type Hint
ghpython_script_2 = GhPythonScript(x=series, y=series)  # -> a; same code as ghpython_script
script_2 = Script(x=series, y=series)  # -> a; same code as ghpython_script
py3_2 = Python3Script(x=series, y=series)  # -> a; same code as ghpython_script

# ---- group: Explicit Loops + Float Type Hint
ghpython_script_3 = GhPythonScript(x=series, y=series)  # -> a; inputs x: list, y: list
# ---------- ghpython_script_3: Python ----------
a = [vx+vy for vx,vy in zip(x,y)]
# ---------- end ghpython_script_3 ----------
script_3 = Script(x=series, y=series)  # -> a; inputs x: list of Double, y: list of Double; same code as ghpython_script_3
py3_3 = Python3Script(x=series, y=series)  # -> a; inputs x: list of Double, y: list of Double; same code as ghpython_script_3

# ---- group: Explicit Loops + No Type Hint
ghpython_script_4 = GhPythonScript(x=series, y=series)  # -> a; inputs x: list, y: list; same code as ghpython_script_3
script_4 = Script(x=series, y=series)  # -> a; inputs x: list, y: list; same code as ghpython_script_3
py3_4 = Python3Script(x=series, y=series)  # -> a; inputs x: list, y: list; same code as ghpython_script_3

# ---- group: Explicit Loops + Float Type Hint + GH Types
ghpython_script_5 = GhPythonScript(x=series, y=series)  # -> a; inputs x: list, y: list
# ---------- ghpython_script_5: Python ----------
from Grasshopper.Kernel.Types import GH_Number
a = [GH_Number(vx+vy) for vx,vy in zip(x,y)]
# ---------- end ghpython_script_5 ----------
script_5 = Script(x=series, y=series)  # -> a; inputs x: list of Double, y: list of Double; same code as ghpython_script_5
py3_5 = Python3Script(x=series, y=series)  # -> a; inputs x: list of Double, y: list of Double; same code as ghpython_script_5

# ---- group: Explicit Loops + No Type Hint + GH Types
ghpython_script_6 = GhPythonScript(x=series, y=series)  # -> a; inputs x: list, y: list; same code as ghpython_script_5
script_6 = Script(x=series, y=series)  # -> a; inputs x: list, y: list; same code as ghpython_script_5
py3_6 = Python3Script(x=series, y=series)  # -> a; inputs x: list, y: list; same code as ghpython_script_5
