# Grasshopper definition test_perf_native_point3d.ghx (Grasshopper 1.0.8)
# plug-ins: RhinoCodePluginGH

number_slider = Slider(100000, range=0..1000000)
range = Range(Domain=number_slider, Steps=number_slider)
python_3_script = Python3Script()
# ---------- python_3_script: Python ----------
class Foo:
    def __init__(self, x, y, z):
        self.x = x
        self.y = y
        self.z = z


for _ in range(100_000):
    x = Foo(1, 2, 3)
# ---------- end python_3_script ----------
python_3_script_2 = Python3Script(coords=range)  # -> out, a; inputs coords: list
# ---------- python_3_script_2: Python ----------
"""Grasshopper Script"""
class Foo:
    def __init__(self, x, y, z):
        self.x = x
        self.y = y
        self.z = z


a = []
for x in coords:
    a.append(Foo(x, x, x))
# ---------- end python_3_script_2 ----------

# ---- group: EXPECT NO ERRORS
toggle = BooleanToggle(True)
panel = Panel(toggle)
context_bake = ContextBake(Content=toggle)
