# Grasshopper definition PolyToPoints.ghx (Grasshopper 1.0.8)
# plug-ins: RhinoCodePluginGH

pt = Point([Point(-8, -27, 0), Point(-25, -7, 0), Point(-20, 8, 0), Point(-1, 36, 0), Point(17, 17, 0), Point(4, -8, 0)])
python_3_script = Python3Script(points=pt)  # -> polyline; inputs points: list
# ---------- python_3_script: Python ----------
from Rhino.Geometry import Polyline, PolylineCurve
polyline = Polyline(points)
polylineCurve = PolylineCurve(points)
# ---------- end python_3_script ----------
panel = Panel(python_3_script)
