# Grasshopper definition demo icon.ghx (Grasshopper 1.0.8)
# plug-ins: RhinoCodePluginGH

add = Script(x=Slider(1, range=0..1), y=Slider(2, range=0..10))  # -> out, a; inputs x: Int32, y: Int32
# ---------- add: IronPython ----------
a = x + y
# ---------- end add ----------
panel = Panel(add.a)
