# Grasshopper definition gh_command_r7.ghx (Grasshopper 1.0.7)

integer = Integer(12)
integer_2 = Integer(18)
get_integer = GetInteger(integer_2, AtLeast=1, AtMost=1, Maximum=2147483647, Minimum=-2147483648, Prompt="Second Number", TreeAccess=False)
get_integer_2 = GetInteger(integer, AtLeast=1, AtMost=1, Maximum=2147483647, Minimum=-2147483648, Prompt="First Number", TreeAccess=False)
ghpython_script = GhPythonScript(x=get_integer_2, y=get_integer)  # -> out, a
# ---------- ghpython_script: Python ----------
__author__ = "ein"
__version__ = "2023.07.01"

import rhinoscriptsyntax as rs

a = x + y
# ---------- end ghpython_script ----------
context_print = ContextPrint(Text=ghpython_script.a)
