# Grasshopper definition gh_components_internal.ghx (Grasshopper 1.0.7)
# plug-ins: RhinoCodePluginGH

number_slider = Slider(42, range=0..100)
adder2 = Script(First=number_slider, Second=number_slider)  # -> out, a
# ---------- adder2: Python ----------
a = First + Second + 50
# ---------- end adder2 ----------
testparams = Script()  # -> out, a; inputs x: list of Boolean, y: tree of Color, u: Plane, v: GeometryBase; unedited script template
csharp_adder = Script(x=adder2.a, y=adder2.a)  # -> out, a; inputs x: Int32, y: Int32
# ---------- csharp_adder: C# ----------
// Grasshopper Script Instance
//#! csharp
using System;
using System.Collections;
using System.Collections.Generic;
using System.Drawing;

using Rhino;
using Rhino.Geometry;

using Grasshopper;
using Grasshopper.Kernel;
using Grasshopper.Kernel.Data;
using Grasshopper.Kernel.Types;

public class Script_Instance : GH_ScriptInstance
{
  /* 
    Members:
      RhinoDoc RhinoDocument
      GH_Document GrasshopperDocument
      IGH_Component Component
      int Iteration

    Methods (Virtual & overridable):
      Print(string text)
      Print(string format, params object[] args)
      Reflect(object obj)
      Reflect(object obj, string method_name)
  */
  
  private void RunScript(int x, int y, out object a)
  {
    // Write your logic here
    a = x + y;
  }
}
# ---------- end csharp_adder ----------
panel = Panel(csharp_adder.a)
