# Grasshopper definition gh_components_r7.ghx (Grasshopper 1.0.7)
# plug-ins: RhinoCodePluginGH

range = Range(Domain=Domain(0, 1), Steps=10)
script = Script(l=range)  # -> out, t, tl; inputs l: list
# ---------- script: Python ----------
import scriptcontext as sc
import ghpythonlib as ghlib

import Grasshopper.Kernel as K

print(ghdoc)
print(sc.doc)
print(ghenv.Component)
print("Has Component: {0}".format(getattr(sc.doc, 'Component', None) is not None))
print("Has Component: {0}".format(ghlib.component._get_active_component() is not None))

ghlib.component.add_warning("(ghpythonlib) Test Component Warning")
ghlib.component.add_remark("(ghpythonlib) Test Component Remark")

sc.doc.Component.AddRuntimeMessage(K.GH_RuntimeMessageLevel.Warning, "Test Component Warning")

# testing list to tree
t = ghlib.treehelpers.list_to_tree(l)
print(t)

# testing tree to list
tl = ghlib.treehelpers.tree_to_list(t)
print(tl)


# test parallel
def task(i):
    print(i)


ghlib.parallel.run(task, l)
# ---------- end script ----------
script_2 = Script(x=range, y=Slider(42, range=0..100))  # -> out, a; inputs x: Int32, y: Int32
# ---------- script_2: C# ----------
// Grasshopper Script Instance
//#! csharp
using System;
using System.Collections;
using System.Collections.Generic;
using System.Drawing;

using Rhino;
using Rhino.Geometry;

using Grasshopper;
using Grasshopper.Kernel;
using Grasshopper.Kernel.Data;
using Grasshopper.Kernel.Types;

public class Script_Instance : GH_ScriptInstance
{
  /* 
    Members:
      RhinoDoc RhinoDocument
      GH_Document GrasshopperDocument
      IGH_Component Component
      int Iteration

    Methods (Virtual & overridable):
      Print(string text)
      Print(string format, params object[] args)
      Reflect(object obj)
      Reflect(object obj, string method_name)
  */
  
  private void RunScript(int x, int y, out object a)
  {
    // Write your logic here
    a = x + y;
  }
}
# ---------- end script_2 ----------
panel = Panel(script.t)
panel_2 = Panel(script.tl)
panel_3 = Panel(script_2.a)
