# Grasshopper definition gh_ctx_components.ghx (Grasshopper 1.0.7)
# plug-ins: RhinoCodePluginGH

integer = Integer(12)
integer_2 = Integer(18)
integer_3 = Integer(12)
integer_4 = Integer(18)
get_integer = GetInteger(integer_2, AtLeast=1, AtMost=1, Maximum=2147483647, Minimum=-2147483648, Prompt="Second Number", TreeAccess=False)
get_integer_2 = GetInteger(integer, AtLeast=1, AtMost=1, Maximum=2147483647, Minimum=-2147483648, Prompt="First Number", TreeAccess=False)
integer_5 = Integer(18)
get_integer_3 = GetInteger(integer_4, AtLeast=1, AtMost=1, Maximum=2147483647, Minimum=-2147483648, Prompt="Second Number", TreeAccess=False)
get_integer_4 = GetInteger(integer_3, AtLeast=1, AtMost=1, Maximum=2147483647, Minimum=-2147483648, Prompt="First Number", TreeAccess=False)
get_multiplier = GetInteger(integer_5, AtLeast=1, AtMost=1, Maximum=2147483647, Minimum=-2147483648, Prompt="Select Multiplier", TreeAccess=False)
adder = Script(x=get_integer_2, y=get_integer)  # -> out, a; inputs y: Int32
# ---------- adder: Python ----------
a = x + y + 50
# ---------- end adder ----------
adder_2 = Script(x=get_integer_4, y=get_integer_3)  # -> out, a; inputs y: Int32; same code as adder
context_bake = ContextBake(Geometry=adder.a)
multiplier = Script(x=adder_2.a, y=get_multiplier)  # -> out, a; inputs y: Int32; same code as adder
context_print = ContextPrint(Text=multiplier.a)
