# Grasshopper definition test_grasshopper_ctx.ghx (Grasshopper 1.0.8)
# plug-ins: SomeGreatPlugin.GH

number_slider = Slider(10, range=0..10)
text_entity = TextEntity(Text="JACK")  # -> TextEntity, Plane, Text
sph = Sphere(Base=PlaneXY(0, 0, 0), Radius=1)
cone = Cone(Base=PlaneXY(0, 0, 0), Radius=0.5, Length=1)  # -> Cone, Tip
line = LineSDL(Start=Point(0, 0, 0), Direction=Vector(0, 0, 1), Length=1)
pt = ConstructPoint(XCoordinate=0, YCoordinate=0, ZCoordinate=0)
pt_2 = ConstructPoint(XCoordinate=number_slider, YCoordinate=number_slider, ZCoordinate=number_slider)
panel = Panel("""<mesh length="12">
</mesh>""")
ln = Line(StartPoint=pt, EndPoint=pt_2)
pt_3 = Point(pt_2)
gh_all_ctx_gh = Gh_all_ctxGh(
    GetBoolean=Toggle(False),
    GetFilePath="some/file",
    Geometry=text_entity.TextEntity,
    GetGeometry=sph,
    GiveMeInteger=Slider(7, range=-31..100),
    GetNumber=Slider(29, range=0..100),
    GetStringAsInteger=panel,
    GetPoint=pt_3,
    GetLine=ln,
    InPointParam=pt_3,
    InPluginInput="#! python 3")  # -> Content, TextStr, OutPointParam, Volooom, JSONSS
panel_2 = Panel([gh_all_ctx_gh.Content, gh_all_ctx_gh.TextStr, gh_all_ctx_gh.OutPointParam, gh_all_ctx_gh.Volooom, gh_all_ctx_gh.JSONSS])
