# Grasshopper definition test_grasshopper_ctx_trees.ghx (Grasshopper 1.0.7)
# plug-ins: SomeGreatPlugin.GH

inputa = Slider(53, range=0..100)
inputb = Slider(43, range=0..100)
multiplication = Multiplication(A=Slider(10, range=0..10), B=graft([inputa, inputb]))
code = CODE(Input=graft([inputa, inputb]))
panel = Panel(multiplication)
panel_2 = Panel(code)
