# Grasshopper definition test_grasshopper_plugin.ghx (Grasshopper 1.0.8)
# plug-ins: SomeGreatPlugin.GH

number_slider = Slider(27, range=0..100)
panel = Panel("""Ehsan
Bob
Scott
Steve
Brian""")
testmarshal = TestMarshal()
testnotmarshal = TestNotMarshal()
number_slider_2 = Slider(4.5, range=1..10)
panel_2 = Panel(testmarshal)
panel_3 = Panel(testnotmarshal)
number_slider_3 = Slider(21, range=0..100)
script = Script(X=panel)
randoms = Randoms()
adder = Adder(X=number_slider, Y=number_slider)
adder2 = Adder2(First=number_slider, Second=number_slider)
make_sphere = Make_Sphere(X=number_slider_2, Y=number_slider_2, DisplayMessage="Message", SomeList="Message")
panel_4 = Panel(script)
panel_5 = Panel(randoms)
csharp_adder = CSharp_Adder(X=adder2, Y=adder2)
panel_6 = Panel(adder)
script_2 = Script(X=number_slider_3, Y=number_slider_3)  # -> A, B
panel_7 = Panel(csharp_adder)
brep = Brep(make_sphere)
panel_8 = Panel([script_2.A, script_2.B])
range = Range(Domain=Domain(0, 1), Steps=10)
marshinputs = MarshInputs(X=range)
marshoutputs = MarshOutputs()
panel_9 = Panel(marshoutputs)
panel_10 = Panel(marshinputs)
