# Grasshopper definition test_grasshopper_plugin_7.ghx (Grasshopper 1.0.7)
# plug-ins: SomeGreatProject.GH

range = Range(Domain=Domain(0, 1), Steps=10)
script = Script(L=range)  # -> T, Tl
panel = Panel(script.Tl)
panel_2 = Panel(script.T)
