# Grasshopper definition test_csharp_hops.ghx (Grasshopper 1.0.8)
# plug-ins: RhinoCodePluginGH

get_integer = GetInteger(Slider(12, range=0..100), AtLeast=1, AtMost=1, Maximum=2147483647, Minimum=-2147483648, TreeAccess=False)
csharp_script = CSharpScript(x=get_integer, y=get_integer)  # -> out, a; inputs x: Int32, y: Int32
# ---------- csharp_script: C# ----------
// Grasshopper Script Instance
#region Usings
using System;
using System.Collections;
using System.Collections.Generic;
using System.Drawing;

using Rhino;
using Rhino.Geometry;

using Grasshopper;
using Grasshopper.Kernel;
using Grasshopper.Kernel.Data;
using Grasshopper.Kernel.Types;
#endregion

a = x + y;
# ---------- end csharp_script ----------
context_print = ContextPrint(Text=csharp_script.a)
