# Grasshopper definition code.ghx (Grasshopper 1.0.7)

input = GetInteger(Slider(1, range=0..10), AtLeast=1, AtMost=1, Maximum=2147483647, Minimum=-2147483648, TreeAccess=False)
multiplication = Multiplication(A=Slider(10, range=0..10), B=input)
panel = Panel(multiplication)
context_bake = ContextBake(Content=multiplication)
