# Grasshopper definition gh-one.ghx (Grasshopper 1.0.7)
# plug-ins: RhinoCodePluginGH

number_slider = Slider(35, range=0..100)
series = Series(Start=Slider(20, range=0..100), Step=1, Count=10)
script = Script(A=series, B=number_slider)  # -> out, X
# ---------- script: C# ----------
// Default C# Script
using System;

// X = "Hello C# Scripting!";
X = (double)A + (double)B;

Console.WriteLine((double)A + (double)B);
# ---------- end script ----------
script_2 = Script(A=series, B=number_slider)  # -> out, X
# ---------- script_2: Python ----------
"""Default Python script"""

# X = "Hello Python 3 in Grasshopper!"
X = A + B
print(A + B)
# ---------- end script_2 ----------
panel = Panel(script_2.X)
panel_2 = Panel(script.X)
