# Grasshopper definition test_backport_runscript.ghx (Grasshopper 1.0.7)
# plug-ins: RhinoCodePluginGH

S = Script()  # -> a
# ---------- S: Python ----------
import rhinoscriptsyntax as rs
a = rs.AddSphere((0, 0, 0), 5)
# ---------- end S ----------
number_slider = Slider(41, range=0..100)
panel = Panel(S)
script = Script()  # -> resultCurves; inputs curves: list of Curve, breps: list of Brep, colliderMeshesDataTree: tree of Mesh, epsilon: Double, clashDistance: Double
# ---------- script: C# ----------
// Grasshopper Script Instance
using System;
using System.Collections;
using System.Collections.Generic;
using System.Drawing;

using Rhino;
using Rhino.Geometry;

using Grasshopper;
using Grasshopper.Kernel;
using Grasshopper.Kernel.Data;
using Grasshopper.Kernel.Types;

public class Script_Instance : GH_ScriptInstance
{
  private void RunScript(
	IEnumerable<Curve> curves,
	IEnumerable<Brep> breps,
	DataTree<Mesh> colliderMeshesDataTree,
	double epsilon,
	double clashDistance,
	out object resultCurves)
  {
    // Write your logic here
    resultCurves = default;
  }
}
# ---------- end script ----------
script_2 = Script(x=number_slider, y=number_slider)  # -> a; inputs library: tree, x: Int32, y: Double
#   port library: Library or libraries to execute script with
# ---------- script_2: C# ----------
// Grasshopper Script Instance
using System;
using System.Collections;
using System.Collections.Generic;
using System.Drawing;

using Rhino;
using Rhino.Geometry;

using Grasshopper;
using Grasshopper.Kernel;
using Grasshopper.Kernel.Data;
using Grasshopper.Kernel.Types;

public class Script_Instance : GH_ScriptInstance
{
  /* 
    Members:
      RhinoDoc RhinoDocument
      GH_Document GrasshopperDocument
      IGH_Component Component
      int Iteration

    Methods (Virtual & overridable):
      Print(string text)
      Print(string format, params object[] args)
      Reflect(object obj)
      Reflect(object obj, string method_name)
  */
  
  private void RunScript(int x, double y, out object a)
  {
    // Write your logic here
    a = x + y;
  }
}
# ---------- end script_2 ----------
script_3 = Script(x=number_slider, k=number_slider)  # -> out, a; inputs y: Brep
# ---------- script_3: Python ----------
"""Grasshopper Script Instance"""
import System
import Rhino
import Grasshopper

import rhinoscriptsyntax as rs

class MyComponent(Grasshopper.Kernel.GH_ScriptInstance):
    def RunScript(self, x, k, y: Rhino.Geometry.Brep):
        return x + k
# ---------- end script_3 ----------
script_4 = Script(x=number_slider, y=number_slider)  # -> out, a
# ---------- script_4: Python ----------
"""Grasshopper Script Instance"""
import System
import Rhino
import Grasshopper

import rhinoscriptsyntax as rs

class MyComponent(Grasshopper.Kernel.GH_ScriptInstance):
    def RunScript(self, x, y):
        return x + y
# ---------- end script_4 ----------
panel_2 = Panel([script_3.a, script_4.a, script_2])
