# Grasshopper definition test_component_numba.ghx (Grasshopper 1.0.7)
# plug-ins: RhinoCodePluginGH

range = Range(Domain=Domain(0, 1), Steps=10)
rc = RhinoCode(x=range, y=Slider(12, range=0..100))  # -> out, a
# ---------- rc: Python ----------
# https://numba.pydata.org
# r: numpy, numba
import numpy as np
from numba import jit


# Numba Specialization by Dtype
@jit(nopython=True)
def zero_clamp(x, threshold):
    # assume 1D array.  See later in this notebook for more general function
    out = np.empty_like(x)
    for i in range(out.shape[0]):
        if np.abs(x[i]) > threshold:
            out[i] = x[i]
        else:
            out[i] = 0
    return out


a_small = np.linspace(0, x * y, 50)
a = zero_clamp(a_small, 0.3)[10]
# ---------- end rc ----------
panel = Panel(rc.a)
