# Grasshopper definition test_gh_createPanels.ghx (Grasshopper 1.0.8)
# plug-ins: RhinoCodePluginGH

csharp_script = CSharpScript(x=Button())  # -> out, a; inputs x: Boolean
# ---------- csharp_script: C# ----------
// Grasshopper Script Instance
#region Usings
using System;
using System.Collections;
using System.Collections.Generic;
using System.Drawing;

using Rhino;
using Rhino.Geometry;

using Grasshopper;
using Grasshopper.Kernel;
using Grasshopper.Kernel.Data;
using Grasshopper.Kernel.Types;
using Grasshopper.Kernel.Special;
#endregion

public class Script_Instance : GH_ScriptInstance
{  
    private string formatted;

    private void CheckCanvas()
    {
        bool note = false;
        var ghdoc = Instances.ActiveCanvas.Document;

        foreach (var obj in ghdoc.Objects)
        {
            if (obj is GH_Panel panel && panel.NickName == "All Components Used")
            {
                panel.UserText = AnalyzeActiveGhDoc();
                panel.ExpireSolution(true);
                note = true;
                break;
            }
        }

        if (!note)
        {
            MakeCompsPanel();
        }
    }

    private void CheckCanvas2()
    {
        bool note2 = false;
        var ghdoc = Instances.ActiveCanvas.Document;

        foreach (var obj in ghdoc.Objects)
        {
            if (obj is GH_Panel panel && panel.NickName == "PlugIns Used")
            {
                panel.UserText = formatted;
                panel.ExpireSolution(true);
                note2 = true;
                break;
            }
        }

        if (!note2)
        {
            MakePlugInsPanel();
        }
    }

    private void MakeCompsPanel()
    {
        var panel = new GH_Panel();
        panel.Name = "All Components Used";
        panel.UserText = AnalyzeActiveGhDoc();
        panel.Properties.Colour = Color.LightSkyBlue;
        panel.Properties.Font = new Font("Trebuchet MS", 10);
        panel.Properties.Multiline = false;
        panel.CreateAttributes();
        panel.Attributes.Pivot = new PointF(-345, 0);
        panel.Attributes.Bounds = new RectangleF(-330, 0, 330, 450);
        Instances.ActiveCanvas.Document.AddObject(panel, false);
    }

    private void MakePlugInsPanel()
    {
        var panel = new GH_Panel();
        panel.Name = "PlugIns Used";
        panel.UserText = formatted;
        panel.Properties.Colour = Color.LightSkyBlue;
        panel.Properties.Font = new Font("Trebuchet MS", 10);
        panel.Properties.Multiline = false;
        panel.CreateAttributes();
        panel.Attributes.Pivot = new PointF(-690, 0);
        panel.Attributes.Bounds = new RectangleF(-330, 0, 330, 150);
        Instances.ActiveCanvas.Document.AddObject(panel, false);
    }

    private Tuple<Dictionary<Guid, GH_AssemblyInfo>, Dictionary<Guid, GH_AssemblyInfo>> Libraries()
    {
        var coreLibraries = new Dictionary<Guid, GH_AssemblyInfo>();
        var addonLibraries = new Dictionary<Guid, GH_AssemblyInfo>();
        var server = Instances.ComponentServer;

        foreach (var obj in Instances.ActiveCanvas.Document.Objects)
        {
            var objId = obj.ComponentGuid;
            if (obj is IGH_Component)
            {
                if (objId != Guid.Empty && !coreLibraries.ContainsKey(objId) && !addonLibraries.ContainsKey(objId))
                {
                    var lib = server.FindAssemblyByObject(obj);
                    if (lib != null)
                    {
                        if (lib.IsCoreLibrary)
                            coreLibraries.Add(lib.Id, lib);
                        else
                            addonLibraries.Add(lib.Id, lib);
                    }
                }
            }
        }

        return Tuple.Create(coreLibraries, addonLibraries);
    }

    private string AnalyzeActiveGhDoc()
    {
        int compCount = 0;
        var dictComponents = new Dictionary<string, Dictionary<string, Dictionary<string, int>>>();

        foreach (var obj in Instances.ActiveCanvas.Document.Objects)
        {
            if (obj is IGH_Component)
            {
                var component = obj as IGH_Component;
                var category = component.Category;
                var subCategory = component.SubCategory;
                var name = component.Name;

                if (!dictComponents.ContainsKey(category))
                    dictComponents[category] = new Dictionary<string, Dictionary<string, int>>();

                if (!dictComponents[category].ContainsKey(subCategory))
                    dictComponents[category][subCategory] = new Dictionary<string, int>();

                if (!dictComponents[category][subCategory].ContainsKey(name))
                    dictComponents[category][subCategory][name] = 0;

                dictComponents[category][subCategory][name]++;
                compCount++;
            }
        }

        string username = Environment.UserName;
        string panelText = $"{DateTime.Now.ToString("DATE- yyyy.MM.dd TIME- HH:mmh")}\n";
        panelText += $"Last saved by - {username}\n";
        panelText += $"Total Components - {compCount}\n";

        foreach (var category in dictComponents)
        {
            foreach (var subCategory in category.Value)
            {
                foreach (var comp in subCategory.Value)
                {
                    panelText += $"{category.Key}.{subCategory.Key}.{comp.Key} - {comp.Value}\n";
                }
            }
        }

        return panelText;
    }
    private void RunScript(bool x, ref object a)
    {
        if (x)
        {
            var coreLibraries = Libraries().Item1;
            var addonLibraries = Libraries().Item2;

            List<string> adds = new List<string>();
            foreach (var lib in addonLibraries.Values)
            {
                if (!string.IsNullOrEmpty(lib.Name))
                    adds.Add($"{lib.Name} {lib.Version}");
            }

            formatted = string.Join("\n", adds);

            CheckCanvas();
            CheckCanvas2();
        }
    }
      
    
}
# ---------- end csharp_script ----------
panel = Panel(csharp_script.a)
