# Grasshopper definition test_gha_assm_reference.ghx (Grasshopper 1.0.7)
# plug-ins: RhinoCodePluginGH

script = Script()  # -> out, a
# ---------- script: C# ----------
using System;

// r "C:\Users\ein\gits\rhino\src4\bin\Debug\Plug-ins\Grasshopper\Components\GhPython.gha"

using GhPython;

a = 12;
# ---------- end script ----------
panel = Panel(script.a)
