# Grasshopper definition test_ghscript_nonui_thread.ghx (Grasshopper 1.0.8)
# plug-ins: RhinoCodePluginGH

number_slider = Slider(12, range=0..100)
A = GetInteger(number_slider, AtLeast=1, AtMost=1, Maximum=2147483647, Minimum=-2147483648, TreeAccess=False)
B = GetInteger(number_slider, AtLeast=1, AtMost=1, Maximum=2147483647, Minimum=-2147483648, TreeAccess=False)
csharp_script = CSharpScript(x=A, y=B)  # -> a; inputs x: Int32, y: Int32
# ---------- csharp_script: C# ----------
// Grasshopper Script (With Nuget Package)
#r "nuget: RestSharp, 106.11.7"
#r "nuget: MathNet.Numerics, 5.0.0"

using System;
using System.Collections.Generic;
using Rhino;

a = x + y;
# ---------- end csharp_script ----------
context_print = ContextPrint(Text=csharp_script)
