# Grasshopper definition test_icons.ghx (Grasshopper 1.0.7)
# plug-ins: RhinoCodePluginGH

script = Script()  # -> out, a; unedited script template
templatescript = TemplateScript()  # -> out, a
# ---------- templatescript: Python ----------
# this is my template
a = 42
# ---------- end templatescript ----------
script_2 = Script()  # -> out, a
# ---------- script_2: Python ----------
"""Grasshopper Script"""
#! python 2
a = "Hello (Not Bye Bye) IronPython 2 in Grasshopper!"
print(a)
# ---------- end script_2 ----------
script_3 = Script()  # -> out, a
# ---------- script_3: C# ----------
// Grasshopper Script Instance
//#! csharp
using System;
using System.Collections;
using System.Collections.Generic;
using System.Drawing;

using Rhino;
using Rhino.Geometry;

using Grasshopper;
using Grasshopper.Kernel;
using Grasshopper.Kernel.Data;
using Grasshopper.Kernel.Types;

public class Script_Instance : GH_ScriptInstance
{
  /* 
    Members:
      RhinoDoc RhinoDocument
      GH_Document GrasshopperDocument
      IGH_Component Component
      int Iteration

    Methods (Virtual & overridable):
      Print(string text)
      Print(string format, params object[] args)
      Reflect(object obj)
      Reflect(object obj, string method_name)
  */
  
  private void RunScript(object x, object y, out object a)
  {
    // Write your logic here
    a = null;
  }
}
# ---------- end script_3 ----------
