# Grasshopper definition test_install_package.ghx (Grasshopper 1.0.8)
# plug-ins: RhinoCodePluginGH

python_3_script = Python3Script()  # -> out, a
# ---------- python_3_script: Python ----------
"""Grasshopper Script""" '''
dfsdfsd

# dsf
sdf

# sdfsd 

'''


a = "Hello Python 3 in Grasshopper!"
print(a)
# ---------- end python_3_script ----------
