# Grasshopper definition test_largeScript_csharp.ghx (Grasshopper 1.0.7)
# plug-ins: RhinoCodePluginGH

brep = Brep(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)
crv = Curve(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)
mesh = Mesh(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)

# ---- group: COPY AND PASTE - SHOULD BE FAST
S = Script(curves=crv, breps=brep, colliderMeshesDataTree=mesh, epsilon=0.05)  # -> out, resultCurves, resultProjectedCurves, resultParameters, resultPlanes; inputs curves: list of Curve, breps: list of Brep, colliderMeshesDataTree: tree of Mesh, epsilon: Double, clashDistance: Double
# ---------- S: C# ----------
// Grasshopper Script Instance
using System;
using System.Collections;
using System.Collections.Generic;
using System.Drawing;

using Rhino;
using Rhino.Geometry;

using Grasshopper;
using Grasshopper.Kernel;
using Grasshopper.Kernel.Data;
using Grasshopper.Kernel.Types;

using Rhino.Geometry.Intersect;
using System.Linq;

public class Script_Instance : GH_ScriptInstance
{
    private void RunScript(
	IList<Curve> curves,
	IList<Brep> breps,
	DataTree<Mesh> colliderMeshesDataTree,
	double epsilon,
	double clashDistance,
	ref object resultCurves,
	ref object resultProjectedCurves,
	ref object resultParameters,
	ref object resultPlanes)
    {
        DataTree<Curve> _resultCurves = new DataTree<Curve>();
        DataTree<Curve> _resultProjectedCurves = new DataTree<Curve>();
        DataTree<double> _resultParameters = new DataTree<double>();
        DataTree<Plane> _resultPlanes = new DataTree<Plane>();

        // curve spacing adjustment
        double tolerance = Rhino.RhinoDoc.ActiveDoc.ModelAbsoluteTolerance;
        Point3d offsetDirectionPoint = curves.ToList()[0].PointAtNormalizedLength(0.5);
        List<Mesh> existingColliders = new List<Mesh>();
        int maxIteration = 20;
        double initialOffset = 10;
        for (int branchIndex=0; branchIndex<colliderMeshesDataTree.BranchCount; branchIndex++) {
            // path
            GH_Path path = colliderMeshesDataTree.Paths[branchIndex];

            // prepare data
            List<Mesh> colliderMeshes = colliderMeshesDataTree.Branch(path);
            Brep brep = breps.ToArray()[branchIndex];
            Curve curve = curves.ToArray()[branchIndex];

            Curve adjustedCurve = curve;
            Curve projectedCurve = ProjectToBrepAndTakeFirst(adjustedCurve, brep);
            double[] parameters = PlaceMeshesOnCurveOnSurface(
                projectedCurve,
                brep,
                colliderMeshes.ToList(),
                epsilon,
                clashDistance
            );
            if (existingColliders.Count != 0) {
                double prevOffset = initialOffset;
                double offset = -initialOffset;
                bool didCurveSpacingAdjustmentSucceed = false;
                for (int iter = 0; iter < maxIteration; iter++) {
                    Curve candidateCurve = curve;
                    if (offset != 0) {
                        candidateCurve = curve.Offset(
                            offsetDirectionPoint,
                            Vector3d.ZAxis,
                            offset,
                            tolerance,
                            CurveOffsetCornerStyle.Sharp
                        )[0];
                    }
                    Curve projectedCandidateCurve = ProjectToBrepAndTakeFirst(candidateCurve, brep);

                    double[] candidateParameters = PlaceMeshesOnCurveOnSurface(
                        projectedCandidateCurve,
                        brep,
                        colliderMeshes.ToList(),
                        epsilon,
                        clashDistance
                    );
                    var candidateColliders = candidateParameters.Select(
                        t => ComputePlacementPlane(brep, projectedCandidateCurve, t)
                    ).Select(
                        (p, i) => Orient(colliderMeshes[i], p)
                    );

                    MeshClash[] clashes = MeshClash.Search(existingColliders, candidateColliders, clashDistance, 1);
                    bool didMeshesClash = clashes.Length > 0;

                    // end condition
                    if (Math.Abs(offset - prevOffset) < epsilon && !didMeshesClash) {
                        didCurveSpacingAdjustmentSucceed = true;
                        adjustedCurve = candidateCurve;
                        projectedCurve = projectedCandidateCurve;
                        Print("Curve adjustment done at {0}th iteration. Offset={1}", iter, offset);
                        break;
                    }

                    // update offset
                    double newOffset = offset;
                    if (didMeshesClash) {
                        newOffset -= Math.Abs(prevOffset - offset) / 2;
                    }
                    else {
                        newOffset += Math.Abs(prevOffset - offset) / 2;
                    }
                    prevOffset = offset;
                    offset = newOffset;
                }

                if (!didCurveSpacingAdjustmentSucceed) {
                    Print("Curve Adjustment Failed.");
                    break;
                }
            }

            // write data
            _resultParameters.EnsurePath(path);
            _resultParameters.Branch(path).AddRange(parameters);
            _resultCurves.EnsurePath(path);
            _resultCurves.Branch(path).Add(adjustedCurve);
            _resultProjectedCurves.EnsurePath(path);
            _resultProjectedCurves.Branch(path).Add(projectedCurve);
            _resultPlanes.EnsurePath(path);
            var planes = parameters.Select(t => ComputePlacementPlane(brep, projectedCurve, t));
            _resultPlanes.Branch(path).AddRange(planes);
            existingColliders.AddRange(planes.Select((p, i) => Orient(colliderMeshes[i], p)));
        }

        resultCurves = _resultCurves;
        resultProjectedCurves = _resultProjectedCurves;
        resultParameters = _resultParameters;
        resultPlanes = _resultPlanes;
    }

    private Mesh Orient(Mesh mesh, Plane plane) {
        Mesh m = (Mesh)mesh.Duplicate();
        Transform transform = Transform.ChangeBasis(plane, Plane.WorldXY);
        m.Transform(transform);
        return m;
    }

    private Curve ProjectToBrepAndTakeFirst(
        Curve curve,
        Brep brep
    ) {
        Curve[] projectedCurves = Curve.ProjectToBrep(curve, brep, Vector3d.ZAxis, 0.001);
        double minZ = double.MaxValue;
        Curve c = projectedCurves[0];
        foreach (Curve _c in projectedCurves) {
            if (_c.PointAtStart.Z < minZ) {
                minZ = _c.PointAtStart.Z;
                c = _c;
            }
        }
        return c;
    }

    private Plane ComputePlacementPlane(Brep brep, Curve curve, double t) {
        Point3d p = curve.PointAt(t);
        Vector3d x = curve.TangentAt(t);

        // find closest point
        double maximumDistance = .1;
        Point3d closestPoint;
        ComponentIndex ci;
        double _s, _t;
        Vector3d normal;
        brep.ClosestPoint(p, out closestPoint, out ci, out _s, out _t, maximumDistance, out normal);

        Vector3d y = Vector3d.CrossProduct(x, normal);
        Plane plane = new Plane(p, -y, x);
        return plane;
    }

    // Place Meshes

    private double[] PlaceMeshesOnCurveOnSurface(
        Curve baseCurve,
        Brep brep,
        List<Mesh> colliderMeshes,
        double epsilon,
        double clashDistance
    ) {
        List<double> tt = new List<double>();
        if (colliderMeshes.Count == 0) {
            return tt.ToArray();
        }
        tt.Add(baseCurve.Domain.T0);

        int maxIteration = 20;
        double tEpsilon = 0.001;
        for (int i=0; i<colliderMeshes.Count-1; i++) {
            Mesh mesh1 = colliderMeshes[i];
            Mesh mesh2 = colliderMeshes[i+1];

            // compute initial spacing
            BoundingBox boundingBox1 = mesh1.GetBoundingBox(Plane.WorldXY);
            BoundingBox boundingBox2 = mesh2.GetBoundingBox(Plane.WorldXY);
            double initialSpacing = boundingBox1.Max.X - boundingBox2.Min.X;

            // get last collider item
            double t1 = tt[i];
            Mesh collider1 = Orient(mesh1, ComputePlacementPlane(brep, baseCurve, t1));
            double lastColliderOffset = baseCurve.GetLength(new Interval(baseCurve.Domain.T0, t1));

            Curve _curve = baseCurve.Extend(CurveEnd.End, initialSpacing, CurveExtensionStyle.Smooth);

            // compute spacing by bisecting
            double prevSpacing = 0;
            double spacing = initialSpacing;
            bool didComputeLengthParameterSucceed = true;
            bool didMeshesClash = true;
            for (int iter = 0; iter < maxIteration; iter++) {
                double _t;
                didComputeLengthParameterSucceed = _curve.LengthParameter(lastColliderOffset + spacing, out _t);
                if (!didComputeLengthParameterSucceed) {
                    break;
                }

                Plane plane2 = ComputePlacementPlane(brep, _curve, _t);
                Mesh collider2 = Orient(mesh2, plane2);

                MeshClash[] clashes = MeshClash.Search(new Mesh[]{collider1}, new Mesh[]{collider2}, clashDistance, 1);
                didMeshesClash = clashes.Length > 0;

                // end condition
                if (Math.Abs(spacing - prevSpacing) < epsilon && !didMeshesClash) {
                    break;
                }

                // update spacing
                double newSpacing = spacing;
                if (didMeshesClash) {
                    newSpacing += Math.Abs(spacing - prevSpacing) / 2;
                }
                else {
                    newSpacing -= Math.Abs(spacing - prevSpacing) / 2;
                }
                prevSpacing = spacing;
                spacing = newSpacing;
            }

            // write result
            if (didMeshesClash) {
                // Print("{0}: Mesh clash still remaining.", i);
                break;
            }
            if (!didComputeLengthParameterSucceed) {
                // Print("{0}: Compute Spacing failed.", i);
                break;
            }
            double tNext;
            bool isNewParameterOnBaseCurve = baseCurve.LengthParameter(lastColliderOffset + spacing, out tNext);
            if (!isNewParameterOnBaseCurve) {
                // Print("{0}: Placement out of curve.", i);
                break;
            }
            tt.Add(tNext);
        }
        return tt.ToArray();
    }
}
# ---------- end S ----------
