# Grasshopper definition test_legacy_scriptclass.ghx (Grasshopper 1.0.7)
# plug-ins: RhinoCodePluginGH

# ---- group: Legacy C#
number_slider = Slider(9, range=0..10)
rc_class = RhinoCode(x=number_slider, y=Slider(3.992, range=0..5), z="Custom C# 10")  # -> out, a, b, c; inputs x: Int32, y: Double, z: String
# ---------- rc_class: C# ----------
#r "System.Drawing"

using System;
using System.Collections;
using System.Collections.Generic;
using System.Drawing;

using Rhino;
using Rhino.Geometry;

using Grasshopper;
using Grasshopper.Kernel;
using Grasshopper.Kernel.Data;
using Grasshopper.Kernel.Types;

public class Script_Instance : GH_ScriptInstance
{
  Point3d o = new Point3d(5, 5, 5);
  float vectorScale;
  string displayText = string.Empty;
  string displayTextPrefix = string.Empty;
  string displayTextPostfix = string.Empty;

  private void RunScript(
	int x,
	double y,
	string z,
	out object a,
	out object b,
	out object c)
  {
    Print($"x: {x}");
    Print($"y: {y}");

    Print($"Component: {Component}");
    Print($"Iteration: {Iteration}");

    a = new List<string>() {"Apple", "Orange"};
    b = new Dictionary<int, string>() {
        {1, "Apple"},
        {2, "Orange"},
        };

    c = new Rhino.Geometry.Sphere(o, x);

    vectorScale = Convert.ToSingle(y);
    displayText = z;
  }

  public override void BeforeRunScript() {
      displayTextPrefix = "[Before] ";
  }

  public override void AfterRunScript() {
      displayTextPostfix = " [After]";
  }

  public override BoundingBox ClippingBox
  {
    get
    {
        return new BoundingBox(new Point3d(0, 0, 0), new Point3d(5, 5, 5));
    }
  }

  public override void DrawViewportMeshes(IGH_PreviewArgs args)
  {
    args.Display.Draw2dLine(
        new System.Drawing.Point(0, 0),
        new System.Drawing.Point(50, 50),
        System.Drawing.Color.Red,
        5
    );
  }
  
  public override void DrawViewportWires(IGH_PreviewArgs args)
  {
    args.Display.DrawDirectionArrow(o, new Vector3f(vectorScale, .5f, 0f), Color.Blue);
    args.Display.DrawDirectionArrow(o, new Vector3f(.5f, vectorScale, 0f), Color.Red);
    args.Display.DrawDirectionArrow(o, new Vector3f(0f, 1f, vectorScale), Color.Green);

    args.Display.Draw2dText(displayTextPrefix + displayText + displayTextPostfix, Color.Yellow, new Point2d(30, 30), false, 16, "Consolas");
  }
}
# ---------- end rc_class ----------
panel = Panel([rc_class.a, rc_class.b, rc_class.c])
panel_2 = Panel(rc_class.out)

# ---- group: Base C# Test
cs_script_test = RhinoCode(x=number_slider, y=number_slider)  # -> out, a; inputs x: Int32, y: Int32
# ---------- cs_script_test: C# ----------
/* Default C# script */
using System;

a = (x * y) + 42;

Console.WriteLine(a);
# ---------- end cs_script_test ----------
panel_3 = Panel(cs_script_test.out)
panel_4 = Panel(cs_script_test.a)

# ----
brep = Brep(rc_class.c)
