# Grasshopper definition test_legacy_scriptclass_draw_nogeomoutput.ghx (Grasshopper 1.0.8)
# plug-ins: RhinoCodePluginGH

python_3_script = Python3Script()  # -> a
# ---------- python_3_script: Python ----------
import System
import System.Drawing as SD
import Rhino
import Grasshopper

import rhinoscriptsyntax as rs


class MyComponent(Grasshopper.Kernel.GH_ScriptInstance):
    def RunScript(self):
        return

    # Preview overrides 
    @property
    def ClippingBox(self):
        return Rhino.Geometry.BoundingBox.Empty

    def DrawViewportWires(self, args):
        pass

    def DrawViewportMeshes(self, args):
        args.Display.Draw2dLine(
            SD.Point(0, 0),
            SD.Point(30, 150),
            SD.Color.Blue,
            3
        )
# ---------- end python_3_script ----------
csharp_script = CSharpScript()  # -> A
# ---------- csharp_script: C# ----------
using System;
using System.Collections;
using System.Collections.Generic;

using Rhino;
using Rhino.Geometry;

using Grasshopper;
using Grasshopper.Kernel;
using Grasshopper.Kernel.Data;
using Grasshopper.Kernel.Types;

public class Script_Instance : GH_ScriptInstance
{
  private void RunScript(ref object A){}

  public override BoundingBox ClippingBox => new BoundingBox(-20, -20, -20, 20, 20, 20);

  public override void DrawViewportWires(IGH_PreviewArgs args)
  {
    args.Display.Draw2dLine(
      new System.Drawing.Point(0, 0),
      new System.Drawing.Point(150, 150),
      System.Drawing.Color.Red,
      3
      );
  }
}
# ---------- end csharp_script ----------
ironpython_2_script = IronPython2Script()  # -> a
# ---------- ironpython_2_script: IronPython ----------
import System
import System.Drawing as SD
import Rhino
import Grasshopper

import rhinoscriptsyntax as rs


class MyComponent(Grasshopper.Kernel.GH_ScriptInstance):
    def RunScript(self):
        return

    # Preview overrides 
    @property
    def ClippingBox(self):
        return Rhino.Geometry.BoundingBox.Empty

    def DrawViewportWires(self, args):
        pass

    def DrawViewportMeshes(self, args):
        args.Display.Draw2dLine(
            SD.Point(0, 0),
            SD.Point(150, 30),
            SD.Color.Yellow,
            3
        )
# ---------- end ironpython_2_script ----------
