# Grasshopper definition test_library_ref.ghx (Grasshopper 1.0.7)
# plug-ins: RhinoCodePluginGH

number_slider = Slider(12, range=0..100)
script = Script(x=number_slider, y=number_slider)  # -> out, a; inputs x: Int32, y: Int32
# ---------- script: C# ----------
#r "..\tests_projects\libraries\TestAssembly\bin\TestAssembly.dll"

var math = new TestAssembly.Math.DoMath();

a  = math.Add(x, y);
# ---------- end script ----------
panel = Panel(script.a)
