# Grasshopper definition test_marshall_preview.ghx (Grasshopper 1.0.7)
# plug-ins: RhinoCodePluginGH

panel = Panel("""#! python3
from Rhino.Geometry import Point3d
a = Point3d(0, 0, 10)""")
panel_2 = Panel("""#! python3
from Rhino.Geometry import Point3d
a = [Point3d(0, 0, 0), Point3d(1, 0, 0)]""")
guid_as_string = Script()  # -> a
# ---------- guid_as_string: Python ----------
import rhinoscriptsyntax as rs
a = rs.AddCircle([0, 0, 0], 10)
# ---------- end guid_as_string ----------
guid_as_string_2 = Script()  # -> a
# ---------- guid_as_string_2: Python ----------
import ghpythonlib as gh
import rhinoscriptsyntax as rs

a = gh.treehelpers.list_to_tree([
    rs.AddCircle([0, 0, 0], 10),
    rs.AddCircle([0, 0, 0], 10)
])
# ---------- end guid_as_string_2 ----------
guid_as_string_3 = Script()  # -> a
# ---------- guid_as_string_3: Python ----------
import ghpythonlib as gh
import rhinoscriptsyntax as rs
import System
import Grasshopper
import Grasshopper.Kernel.Data as GHD
import Grasshopper.Kernel.Types as GHT

guid = rs.AddCircle([0, 0, 0], 10)
s: GHD.GH_Structure[GHT.GH_Guid] = GHD.GH_Structure[GHT.GH_Guid]()

p1 = GHD.GH_Path(0, 1)
s.EnsurePath(p1)

p2 = GHD.GH_Path(1, 2)
s.EnsurePath(p2)

s.Append(GHT.GH_Guid(rs.AddCircle([0, 0, 0], 10)), p1)
s.Append(GHT.GH_Guid(rs.AddCircle([0, 0, 0], 20)), p1)
s.Append(GHT.GH_Guid(rs.AddCircle([0, 0, 0], 30)), p2)

a = s
# ---------- end guid_as_string_3 ----------
panel_3 = Panel(guid_as_string)
panel_4 = Panel(guid_as_string_2)
panel_5 = Panel(guid_as_string_3)
py3 = Python3Script(script=panel)  # -> out, a; unedited script template

# ---- group: CHECK OUTPUT PREVIEW
py3_2 = Python3Script(script=panel_2)  # -> out, a; unedited script template

# ----
python = GhPythonScript()  # -> out, a
# ---------- python: Python ----------
from Rhino.Geometry import Point3d
a = [Point3d(0, 10, 0), Point3d(1, 10, 0)]
# ---------- end python ----------
panel_6 = Panel(python.a)
panel_7 = Panel(py3.a)
panel_8 = Panel(py3_2.a)
