# Grasshopper definition test_nicknames.ghx (Grasshopper 1.0.7)
# plug-ins: RhinoCodePluginGH

number_slider = Slider(48, range=0..100)

# ---- group: while is keyword
script = Script(while=number_slider)  # -> out, a
# ---------- script: C# ----------
//#! csharp
using System;

a = while;
# ---------- end script ----------

# ---- group: dir is keyword
script_2 = Script(dir=number_slider)  # -> out, a
# ---------- script_2: Python ----------
"""Grasshopper Script"""
#! python 3
a = dir
# ---------- end script_2 ----------
script_3 = Script(x=number_slider)  # -> out, a
# ---------- script_3: Python ----------
"""Grasshopper Script"""
#! python 3
a = x
# ---------- end script_3 ----------
script_4 = Script(x=number_slider)  # -> out, a
# ---------- script_4: Python ----------
"""Grasshopper Script"""
#! python 2
a = x
# ---------- end script_4 ----------

# ----
script_5 = Script(dir=number_slider)  # -> out, a
# ---------- script_5: Python ----------
"""Grasshopper Script"""
#! python 2
a = dir
# ---------- end script_5 ----------
script_6 = Script(z=number_slider)  # -> out, a
# ---------- script_6: C# ----------
//#! csharp
using System;

a = z;
# ---------- end script_6 ----------
script_7 = Script(just=number_slider)  # -> out, a
# ---------- script_7: C# ----------
//#! csharp
using System;

a = @just;
# ---------- end script_7 ----------

# ---- group: 9dir12 is invalid
script_8 = Script(_9dir12=number_slider)  # -> out, a; same code as script_2

# ----
script_9 = Script(dir12=number_slider)  # -> out, a; same code as script_2

# ---- group: 9just is invalid
script_10 = Script(_9just=number_slider)  # -> out, a
# ---------- script_10: C# ----------
//#! csharp
using System;

a = 9just;
# ---------- end script_10 ----------

# ----
panel = Panel([script_6.a, script_3.a, script_4.a])

# ---- group: @just is invalid
script_11 = Script(just=number_slider)  # -> out, a; same code as script_2
