# Grasshopper definition test_notkeepingvalue.ghx (Grasshopper 1.0.7)
# plug-ins: RhinoCodePluginGH

panel = Panel("TEST")
relay = Relay()
ghpython_script = GhPythonScript(x=relay)  # -> out, a
# ---------- ghpython_script: Python ----------
a = x
# ---------- end ghpython_script ----------
script = Script(x=relay)  # -> out, a; same code as ghpython_script
script_2 = Script(x=relay)  # -> out, a
# ---------- script_2: C# ----------
a = x;
# ---------- end script_2 ----------
script_3 = Script(x=relay)  # -> out, a; same code as ghpython_script
panel_2 = Panel([ghpython_script.a, script.a, script_2.a, script_3.a])
