# Grasshopper definition test_param_convert.ghx (Grasshopper 1.0.7)
# plug-ins: RhinoCodePluginGH

# ---- group: Scripts To Library (Merge)
panel = Panel("C:\Users\ein\gits\rhino\src4\rhino4\Plug-ins\RhinoCodePlugins\tests\test_complex.cs")
panel_2 = Panel("C:\Users\ein\gits\rhino\src4\rhino4\Plug-ins\RhinoCodePlugins\tests\test_console.py")
script = RhinoCodeScript(
    [panel, panel_2],
    ExpireOnDiskEvent=False,
    TreatInputAsPath=True,
    SourceLanguageFamilySpec_Taxon="*.*.*",
    SourceLanguageFamilySpec_Version="-1.-1")
library = RhinoCodeScriptLibrary(
    script,
    ExpireOnDiskEvent=False,
    TreatInputAsPath=True,
    SourceLanguageFamilySpec_Taxon="*.*.*",
    SourceLanguageFamilySpec_Version="-1.-1")
drcsl = RhinoCodeScriptLibraryDeconstruct(RhinoCodeScriptLibrary=library)  # -> Base, LanguageSpec, Scripts
panel_3 = Panel([drcsl.Base, drcsl.LanguageSpec, drcsl.Scripts])

# ---- group: Script To Library
panel_4 = Panel("C:\Users\ein\gits\rhino\src4\rhino4\Plug-ins\RhinoCodePlugins\tests\test_complex.cs")
panel_5 = Panel("C:\Users\ein\gits\rhino\src4\rhino4\Plug-ins\RhinoCodePlugins\tests\test_console.py")
script_2 = RhinoCodeScript(
    [panel_4, panel_5],
    ExpireOnDiskEvent=False,
    TreatInputAsPath=True,
    SourceLanguageFamilySpec_Taxon="*.*.*",
    SourceLanguageFamilySpec_Version="-1.-1")
library_2 = RhinoCodeScriptLibrary(
    script_2,
    ExpireOnDiskEvent=False,
    TreatInputAsPath=True,
    SourceLanguageFamilySpec_Taxon="*.*.*",
    SourceLanguageFamilySpec_Version="-1.-1")
drcsl_2 = RhinoCodeScriptLibraryDeconstruct(RhinoCodeScriptLibrary=library_2)  # -> Base, LanguageSpec, Scripts
panel_6 = Panel([drcsl_2.Base, drcsl_2.LanguageSpec, drcsl_2.Scripts])

# ---- group: Library To Script (Fail)
panel_7 = Panel("C:\Users\ein\gits\rhino\src4\rhino4\Plug-ins\RhinoCodePlugins\tests")
library_3 = RhinoCodeScriptLibrary(
    panel_7,
    ExpireOnDiskEvent=False,
    TreatInputAsPath=True,
    SourceLanguageFamilySpec_Taxon="mcneel.roslyn.csharp",
    SourceLanguageFamilySpec_Version="9.0")
script_3 = RhinoCodeScript(
    library_3,
    ExpireOnDiskEvent=False,
    TreatInputAsPath=False,
    SourceLanguageFamilySpec_Taxon="*.*.*",
    SourceLanguageFamilySpec_Version="-1.-1")
drcs = RhinoCodeScriptDeconstruct(RhinoCodeScript=script_3)  # -> Id, LanguageId, Title, Text, Signature, StorageUri, StageStorageUri, EnvironId, Inputs
panel_8 = Panel([drcs.Id, drcs.LanguageId, drcs.Title, drcs.StorageUri])
