# Grasshopper definition test_param_library.ghx (Grasshopper 1.0.7)
# plug-ins: RhinoCodePluginGH

# ---- group: From Persistent (Manage)
# No lang spec can be specified in Manage window
# Executor will decide which languages to grab
library = RhinoCodeScriptLibrary(
    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,
    ExpireOnDiskEvent=False,
    TreatInputAsPath=True,
    SourceLanguageFamilySpec_Taxon="*.*.*",
    SourceLanguageFamilySpec_Version="-1.-1")
panel = Panel(library)

# ---- group: From Persistent
# Only codes selected from
# the original language are
# kept and stored
stored_library = RhinoCodeScriptLibrary(
    [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, {libraryCount=2, Taxon="*.*.python", Text="ZGVmIGNvbXB1dGUoYSwgYik6DQogICAgcmV0dXJuIGEgKyBi", Title="math.py", Taxon="*.*.python", Text="ZnJvbSAuIGltcG9ydCBtYXRo", Title="__init__.py", Taxon="*.*.python"}],
    ExpireOnDiskEvent=False,
    TreatInputAsPath=True,
    SourceLanguageFamilySpec_Taxon="*.*.*",
    SourceLanguageFamilySpec_Version="-1.-1")
panel_2 = Panel(stored_library)

# ----
drcsl = RhinoCodeScriptLibraryDeconstruct(RhinoCodeScriptLibrary=graft(stored_library))  # -> Base, LanguageSpec, Scripts
panel_3 = Panel([drcsl.Base, drcsl.LanguageSpec])

# ---- group: From Uri
panel_4 = Panel("C:\Users\ein\gits\rhino\src4\rhino4\Plug-ins\RhinoCodePlugins\tests_rhinogh\utils")

# ----
library_2 = RhinoCodeScriptLibrary(
    panel_4,
    ExpireOnDiskEvent=False,
    TreatInputAsPath=True,
    SourceLanguageFamilySpec_Taxon="mcneel.pythonnet.python",
    SourceLanguageFamilySpec_Version="3.-1")

# ---- group: From Uri (continued)
panel_5 = Panel(library_2)

# ----
drcsl_2 = RhinoCodeScriptLibraryDeconstruct(RhinoCodeScriptLibrary=graft(library_2))  # -> Base, LanguageSpec, Scripts
panel_6 = Panel([drcsl_2.Base, drcsl_2.LanguageSpec, drcsl_2.Scripts])

# ---- group: From Synced Uri
panel_7 = Panel("C:\Users\ein\gits\rhino\src4\rhino4\Plug-ins\RhinoCodePlugins\tests_rhinogh\utils")

# ----
library_3 = RhinoCodeScriptLibrary(
    panel_7,
    ExpireOnDiskEvent=True,
    TreatInputAsPath=True,
    SourceLanguageFamilySpec_Taxon="*.*.python",
    SourceLanguageFamilySpec_Version="-1.-1")

# ---- group: From Synced Uri (continued)
panel_8 = Panel(library_3)

# ----
drcsl_3 = RhinoCodeScriptLibraryDeconstruct(RhinoCodeScriptLibrary=graft(library_3))  # -> Base, LanguageSpec, Scripts
panel_9 = Panel([drcsl_3.Base, drcsl_3.LanguageSpec, drcsl_3.Scripts])

# ---- group: From Uri w Specific Language
panel_10 = Panel("C:\Users\ein\gits\rhino\src4\rhino4\Plug-ins\RhinoCodePlugins\tests_rhinogh\utils")

# ----
library_4 = RhinoCodeScriptLibrary(
    panel_10,
    ExpireOnDiskEvent=False,
    TreatInputAsPath=True,
    SourceLanguageFamilySpec_Taxon="*.*.csharp",
    SourceLanguageFamilySpec_Version="-1.-1")

# ---- group: From Uri w Specific Language (continued)
panel_11 = Panel(library_4)

# ----
drcsl_4 = RhinoCodeScriptLibraryDeconstruct(RhinoCodeScriptLibrary=graft(library_4))  # -> Base, LanguageSpec, Scripts
panel_12 = Panel([drcsl_4.Base, drcsl_4.LanguageSpec, drcsl_4.Scripts])

# ---- group: From Relative Uri
panel_13 = Panel("Utils")

# ----
library_5 = RhinoCodeScriptLibrary(
    panel_13,
    ExpireOnDiskEvent=False,
    TreatInputAsPath=True,
    SourceLanguageFamilySpec_Taxon="*.*.csharp",
    SourceLanguageFamilySpec_Version="-1.-1")

# ---- group: From Relative Uri (continued)
panel_14 = Panel(library_5)

# ----
drcsl_5 = RhinoCodeScriptLibraryDeconstruct(RhinoCodeScriptLibrary=graft(library_5))  # -> Base, LanguageSpec, Scripts
panel_15 = Panel([drcsl_5.Base, drcsl_5.LanguageSpec, drcsl_5.Scripts])

# ---- group: From Missing Uri (Fail)
panel_16 = Panel("C:\Users\ein\gits\rhinocodeplugins\missing")

# ----
library_6 = RhinoCodeScriptLibrary(
    panel_16,
    ExpireOnDiskEvent=False,
    TreatInputAsPath=True,
    SourceLanguageFamilySpec_Taxon="*.*.*",
    SourceLanguageFamilySpec_Version="-1.-1")

# ---- group: From Missing Uri (Fail) (continued)
panel_17 = Panel(library_6)
