# Grasshopper definition test_param_outparam_index.ghx (Grasshopper 1.0.7)
# plug-ins: RhinoCodePluginGH

py3 = Python3Script()  # -> out, a; inputs library: tree
#   port library: Library or libraries to execute script with
# ---------- py3: Python ----------
a = ghenv.Component.Params.Input[0].Name
# ---------- end py3 ----------
python = GhPythonScript(GhMemory=0)  # -> out, a
# ---------- python: Python ----------
a = ghenv.Component.Params.Output[0].Name
# ---------- end python ----------
py3_2 = Python3Script()  # -> out, a; same code as python

# ---- group: TOGGLE OUT PARAM AND OUTPUT SHOULD REFLECT PARAM AT 0
py3_3 = Python3Script()  # -> a; same code as python
panel = Panel(py3_3)

# ----
py3_4 = Python3Script()  # -> a; same code as py3
python_2 = GhPythonScript(GhMemory=0)  # -> a; same code as python
py3_5 = Python3Script()  # -> a; same code as python
panel_2 = Panel(python.a)
panel_3 = Panel(python_2)
panel_4 = Panel(py3_2.a)
panel_5 = Panel(py3_5)
panel_6 = Panel(py3_4)
panel_7 = Panel(py3.a)
panel_8 = Panel("""library
x""")

# ---- group: STDOUT COLLECTS EVENT OUT IS NOT OUT
py3_6 = Python3Script()  # -> SomethingElse, a
# ---------- py3_6: Python ----------
ghenv.Component.Params.Output[0].Name = "SomethingElse"
ghenv.Component.Params.Output[0].NickName = "SomethingElse"

print(42)
# ---------- end py3_6 ----------
panel_9 = Panel(py3_6.SomethingElse)

# ----
tmatch = MatchText(Text=[panel_2, panel_4], RegEx="out", Case=True)
tmatch_2 = MatchText(Text=[panel_3, panel_5], RegEx="Result a", Case=True)
tmatch_3 = MatchText(Text=[panel_7, panel_6], RegEx=panel_8, Case=True)
panel_10 = Panel(tmatch)
panel_11 = Panel(tmatch_2)
panel_12 = Panel(tmatch_3)
