# Grasshopper definition test_param_script.ghx (Grasshopper 1.0.7)
# plug-ins: RhinoCodePluginGH

# ---- group: From Relative Uri
script = RhinoCodeScript(
    "utils/Utils.cs",
    ExpireOnDiskEvent=False,
    TreatInputAsPath=True,
    SourceLanguageFamilySpec_Taxon="*.*.*",
    SourceLanguageFamilySpec_Version="-1.-1")
panel = Panel(script)

# ---- group: From Uri
panel_2 = Panel("C:\Users\ein\gits\rhino\src4\rhino4\Plug-ins\RhinoCodePlugins\tests\test_complex.cs")
script_2 = RhinoCodeScript(
    panel_2,
    ExpireOnDiskEvent=False,
    TreatInputAsPath=True,
    SourceLanguageFamilySpec_Taxon="*.*.*",
    SourceLanguageFamilySpec_Version="-1.-1")
panel_3 = Panel(script_2)

# ---- group: From Missing Text
script_3 = RhinoCodeScript(
    "",
    ExpireOnDiskEvent=False,
    TreatInputAsPath=False,
    SourceLanguageFamilySpec_Taxon="*.*.*",
    SourceLanguageFamilySpec_Version="-1.-1")

# ---- group: From Missing Uri
panel_4 = Panel("C:\Users\ein\gits\rhino\src4\rhino4\Plug-ins\RhinoCodePlugins\tests\missing.cs")
script_4 = RhinoCodeScript(
    panel_4,
    ExpireOnDiskEvent=False,
    TreatInputAsPath=True,
    SourceLanguageFamilySpec_Taxon="*.*.*",
    SourceLanguageFamilySpec_Version="-1.-1")

# ---- group: From Synced Uri
panel_5 = Panel("C:\Users\ein\gits\rhino\src4\rhino4\Plug-ins\RhinoCodePlugins\tests\test_complex.cs")
script_5 = RhinoCodeScript(
    panel_5,
    ExpireOnDiskEvent=True,
    TreatInputAsPath=True,
    SourceLanguageFamilySpec_Taxon="*.*.*",
    SourceLanguageFamilySpec_Version="-1.-1")
panel_6 = Panel(script_5)

# ---- group: From Missing Relative Uri
script_6 = RhinoCodeScript(
    "tests\missing.cs",
    ExpireOnDiskEvent=False,
    TreatInputAsPath=True,
    SourceLanguageFamilySpec_Taxon="*.*.*",
    SourceLanguageFamilySpec_Version="-1.-1")

# ---- group: From Persistent
_3_scripts = RhinoCodeScript(
    [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],
    ExpireOnDiskEvent=False,
    TreatInputAsPath=False,
    SourceLanguageFamilySpec_Taxon="*.*.*",
    SourceLanguageFamilySpec_Version="-1.-1")
panel_7 = Panel(_3_scripts)

# ----
panel_8 = Panel(script_3)
list_length = ListLength(List=_3_scripts)
panel_9 = Panel(list_length)
drcs = RhinoCodeScriptDeconstruct(RhinoCodeScript=script_3)  # -> Id, LanguageId, Title, Text, Signature, StorageUri, StageStorageUri, EnvironId, Inputs
panel_10 = Panel([drcs.Id, drcs.LanguageId, drcs.Title, drcs.StorageUri])

# ---- group: Keeping Data Tree Branches
_3_scripts_2 = RhinoCodeScript(
    graft([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, {Text="ZGVmIG1haW4ob25lLCB0d28sIHRocmVlKToNCiAgICBwYXNzDQogICAgcHJpbnQoDQogICAgICAgIG9uZQ0KICAgICkNCg0KDQptYWluKDEsMiwzKQ==", Title="test_formatting.py", Taxon="*.*.python"}, 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]),
    ExpireOnDiskEvent=False,
    TreatInputAsPath=False,
    SourceLanguageFamilySpec_Taxon="*.*.*",
    SourceLanguageFamilySpec_Version="-1.-1")
_3_scripts_3 = RhinoCodeScript(
    [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, {Text="ZGVmIG1haW4ob25lLCB0d28sIHRocmVlKToNCiAgICBwYXNzDQogICAgcHJpbnQoDQogICAgICAgIG9uZQ0KICAgICkNCg0KDQptYWluKDEsMiwzKQ==", Title="test_formatting.py", Taxon="*.*.python"}, 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],
    ExpireOnDiskEvent=False,
    TreatInputAsPath=False,
    SourceLanguageFamilySpec_Taxon="*.*.*",
    SourceLanguageFamilySpec_Version="-1.-1")
script_7 = RhinoCodeScript(
    [_3_scripts_2, _3_scripts_3],
    ExpireOnDiskEvent=False,
    TreatInputAsPath=False,
    SourceLanguageFamilySpec_Taxon="*.*.*",
    SourceLanguageFamilySpec_Version="-1.-1")
panel_11 = Panel(script_7)

# ----
script_deconstruct = ScriptDeconstruct(Script=_3_scripts)  # -> Id, LanguageId, Title, Text, Signature, Uri, EnvironId, Inputs, Outputs
panel_12 = Panel([script_deconstruct.Id, script_deconstruct.LanguageId, script_deconstruct.Title, script_deconstruct.Uri])

# ---- group: From String
panel_13 = Panel("""#! python3
import os

print(os)""")

# ----
script_8 = RhinoCodeScript(
    panel_13,
    ExpireOnDiskEvent=False,
    TreatInputAsPath=False,
    SourceLanguageFamilySpec_Taxon="*.*.*",
    SourceLanguageFamilySpec_Version="-1.-1")

# ---- group: From String (continued)
panel_14 = Panel(script_8)

# ---- group: Check Language Spec (Python)
panel_15 = Panel("""#! python3
import os

print(os)""")

# ----
script_9 = RhinoCodeScript(
    panel_15,
    ExpireOnDiskEvent=False,
    TreatInputAsPath=False,
    SourceLanguageFamilySpec_Taxon="*.*.*",
    SourceLanguageFamilySpec_Version="-1.-1")

# ---- group: Check Language Spec (Python) (continued)
script_deconstruct_2 = ScriptDeconstruct(Script=script_9)  # -> Id, LanguageId, Title, Text, Signature, Uri, EnvironId, Inputs, Outputs
panel_16 = Panel(script_deconstruct_2.LanguageId)

# ---- group: Double Override (CSharp)
script_10 = RhinoCodeScript(
    script_9,
    ExpireOnDiskEvent=False,
    TreatInputAsPath=False,
    SourceLanguageFamilySpec_Taxon="mcneel.roslyn.csharp",
    SourceLanguageFamilySpec_Version="9.0")
script_deconstruct_3 = ScriptDeconstruct(Script=script_10)  # -> Id, LanguageId, Title, Text, Signature, Uri, EnvironId, Inputs, Outputs
panel_17 = Panel(script_deconstruct_3.LanguageId)
