# Grasshopper definition test_perf_millionpoints_perf(3, 15000ms, 5000ms)_rc8.9.ghx (Grasshopper 1.0.8)
# plug-ins: RhinoCodePluginGH

number_slider = Slider(1000000, range=0..1000000)
S = Script(x=number_slider)  # inputs x: Int32
# ---------- S: C# ----------
// Grasshopper Script Instance
//#! csharp
using System;
using System.Collections;
using System.Collections.Generic;
using System.Drawing;

using Rhino;
using Rhino.Geometry;

using Grasshopper;
using Grasshopper.Kernel;
using Grasshopper.Kernel.Data;
using Grasshopper.Kernel.Types;

public class Script_Instance : GH_ScriptInstance
{
  /* 
    Members:
      RhinoDoc RhinoDocument
      GH_Document GrasshopperDocument
      IGH_Component Component
      int Iteration

    Methods (Virtual & overridable):
      Print(string text)
      Print(string format, params object[] args)
      Reflect(object obj)
      Reflect(object obj, string method_name)
  */
  
  private void RunScript(int x)
  {
    List<Point3d> pts = new List<Point3d>();
    for (int i = 0; i < x; i++){
        var pt = new Point3d(i,i,i);
        pts.Add(pt);
    }


  }
}
# ---------- end S ----------
python = GhPythonAHD(x=number_slider)  # inputs x: Int32
# ---------- python: Python ----------
import Rhino as rc

pts = []
for i in range(x):
    pts.append(rc.Geometry.Point3d(i,i,i))
# ---------- end python ----------
S_2 = Script(x=number_slider)  # inputs x: Int32; same code as python
S_3 = Script(x=number_slider)  # inputs x: Int32; same code as python

# ---- group: EXPECT NO ERRORS
toggle = BooleanToggle(True)
panel = Panel(toggle)
context_bake = ContextBake(Content=toggle)
