# Grasshopper definition test_perf_operatorOverloads_perf(5, 4000ms, 1500ms)_rc8.9.ghx (Grasshopper 1.0.8)
# plug-ins: RhinoCodePluginGH

number_slider = Slider(42, range=0..100)
number_slider_2 = Slider(100000, range=0..1000000)
range = Range(Domain=number_slider_2, Steps=number_slider_2)
construct_point = ConstructPoint(XCoordinate=range, YCoordinate=0, ZCoordinate=0)
construct_point_2 = ConstructPoint(XCoordinate=0, YCoordinate=number_slider, ZCoordinate=number_slider)
ghpython_script = GhPythonScript(points=construct_point, other=construct_point_2)  # -> out, a; inputs points: list of Point3d, other: Point3d
# ---------- ghpython_script: Python ----------
a = []

for pt in points:
    a.append(pt + other)
# ---------- end ghpython_script ----------
python_3_script = Python3Script(points=construct_point, other=construct_point_2)  # -> out, a; inputs points: list of Point3d, other: Point3d
# ---------- python_3_script: Python ----------
"""Grasshopper Script"""

a = []

for pt in points:
    a.append(pt + other)
# ---------- end python_3_script ----------
ironpython_2_script = IronPython2Script(points=construct_point, other=construct_point_2)  # -> out, a; inputs points: list of Point3d, other: Point3d; same code as ghpython_script
panel = Panel(python_3_script.a)
panel_2 = Panel(ironpython_2_script.a)
panel_3 = Panel(ghpython_script.a)

# ---- group: EXPECT NO ERRORS
toggle = BooleanToggle(True)
panel_4 = Panel(toggle)
context_bake = ContextBake(Content=toggle)
