# Grasshopper definition test_perf_wandering_particle.ghx (Grasshopper 1.0.8)
# plug-ins: RhinoCodePluginGH

attractor_strength = Slider(0.04, range=0..0.3)
timer = Timer(Interval=1, TimerInterval=5, Target=S)  # disabled
point = Point(Point(-13.33392054, 35.45318247, 0))
S = Script(iReset=Button(), iAttractor=point, iAttractorStrength=attractor_strength)  # -> out, oGeometry; inputs iReset: Boolean, iAttractor: Point3d, iAttractorStrength: Double
# ---------- S: Python ----------
import Rhino.Geometry as rg
import random

class Particle:
    def __init__(self):
        self.Position = rg.Point3d.Origin
        self.Velocity = rg.Vector3d(0.1, 0.1, 0.0)
        self.History = [self.Position]
        
    def Update(self):
        if iAttractor != None:
            toAttractor = iAttractor - self.Position
            toAttractor.Unitize()
            toAttractor *= self.Velocity.Length
            newVelocity = iAttractorStrength * toAttractor + (1.0 - iAttractorStrength) * self.Velocity
            newVelocity.Unitize()
            newVelocity *= self.Velocity.Length
            self.Velocity = newVelocity
        
        self.Velocity.Rotate(random.uniform(-0.2,0.2), rg.Vector3d.ZAxis)
        self.Position += self.Velocity
        self.History.append(self.Position)

# Main Script

if iReset:
    myParticle = Particle()
else:
    myParticle.Update()

oGeometry = rg.PolylineCurve(myParticle.History)
# ---------- end S ----------
panel = Panel(S.out)
panel_2 = Panel(S.oGeometry)
