# Grasshopper definition test_persistent_scope.ghx (Grasshopper 1.0.7)
# plug-ins: RhinoCodePluginGH

trigger = Trigger(Interval=100, TimerInterval=100, Target=[python, S, S_2])  # disabled
button = Button()
S = Script(reset=button)  # -> a
# ---------- S: Python ----------
if 'i' not in globals() or reset:
    i = 0
else:
    i += 1
a = i
print(globals()['i'])
# ---------- end S ----------
python = GhPythonScript(reset=button)  # -> out, a
# ---------- python: Python ----------
if 'i' not in globals() or reset:
    i = 0
else:
    i += 1
a = i
# ---------- end python ----------
S_2 = Script(reset=button)  # -> a; same code as S
panel = Panel(python.a)
panel_2 = Panel([S, S_2])
