# Grasshopper definition test_polyline.ghx (Grasshopper 1.0.7)
# plug-ins: RhinoCodePluginGH

panel = Panel("""#! python
import Rhino.Geometry as rg
pts = []
pts.append(rg.Point3d(0, 0, 0))
pts.append(rg.Point3d(10,0, 0))
pts.append(rg.Point3d(10,10,0))
pts.append(rg.Point3d(0, 10,0))
pts.append(rg.Point3d(0, 0, 0))
a = [rg.Polyline(pts)]*5""")
panel_2 = Panel("""#! python
import Rhino.Geometry as rg
pts = []
pts.append(rg.Point3d(0, 0, 0))
pts.append(rg.Point3d(10,0, 0))
pts.append(rg.Point3d(10,10,0))
pts.append(rg.Point3d(0, 10,0))
pts.append(rg.Point3d(0, 0, 0))
a = [rg.Polyline(pts).ToNurbsCurve()]*5""")

# ---- group: NO HINT ON OUTPUT - IT IS MARSHALLED INTO A LIST
panel_3 = Panel("""#! python
import Rhino.Geometry as rg
pts = []
pts.append(rg.Point3d(0, 0, 0))
pts.append(rg.Point3d(10,0, 0))
pts.append(rg.Point3d(10,10,0))
pts.append(rg.Point3d(0, 10,0))
pts.append(rg.Point3d(0, 0, 0))
a = rg.Polyline(pts)""")
S = Script(script=panel_3)  # -> a
#   port script: Script to execute
# ---------- S: Python ----------
import Rhino.Geometry as rg
pts = []
pts.append(rg.Point3d(0,0,0))
pts.append(rg.Point3d(10,0,0))
pts.append(rg.Point3d(10,10,0))
pts.append(rg.Point3d(0,10,0))
pts.append(rg.Point3d(0,0,0))
a = rg.Polyline(pts)
# ---------- end S ----------
python = GhPythonScript(Code=panel_3)
panel_4 = Panel(python)
panel_5 = Panel(S)

# ----
panel_6 = Panel("""#! python 3
import Rhino.Geometry as rg
pts = []
pts.append(rg.Point3d(0, 0, 0))
pts.append(rg.Point3d(10,0, 0))
pts.append(rg.Point3d(10,10,0))
pts.append(rg.Point3d(0, 10,0))
pts.append(rg.Point3d(0, 0, 0))
a = rg.Polyline(pts).ToNurbsCurve()""")
S_2 = Script(script=panel_6)  # -> a; same code as S
S_3 = Script(script=panel)  # -> a; same code as S
S_4 = Script(script=panel_2)  # -> a; same code as S
python_2 = GhPythonScript(Code=panel_6)
python_3 = GhPythonScript(Code=panel)
python_4 = GhPythonScript(Code=panel_2)
panel_7 = Panel(python_3)
panel_8 = Panel(python_2)
panel_9 = Panel(python_4)
panel_10 = Panel(S_4)
panel_11 = Panel(S_3)
panel_12 = Panel(S_2)
py3 = Python3Script(poly=[python_2, S_2])  # -> a
# ---------- py3: Python ----------
a = type(poly)
# ---------- end py3 ----------
panel_13 = Panel(py3)
