# Grasshopper definition test_prebuild.ghx (Grasshopper 1.0.7)
# plug-ins: RhinoCodePluginGH

# ---- group: ERROR
csharp = CSharpScript()  # -> out, a; disabled
# ---------- csharp: C# ----------
// Grasshopper Script Instance
using System;
using System.Collections;
using System.Collections.Generic;
using System.Drawing;

using Rhino;
using Rhino.Geometry;

using Grasshopper;
using Grasshopper.Kernel;
using Grasshopper.Kernel.Data;
using Grasshopper.Kernel.Types;

public class Script_Instance : GH_ScriptInstance
{
  /* 
    Members:
      RhinoDoc RhinoDocument
      GH_Document GrasshopperDocument
      IGH_Component Component
      int Iteration

    Methods (Virtual & overridable):
      Print(string text)
      Print(string format, params object[] args)
      Reflect(object obj)
      Reflect(object obj, string method_name)
  */
  
  private void RunScript(object x, object y, ref object a)
  {
    // Write your logic here
    a = null
  }
}
# ---------- end csharp ----------

# ----
test = CSharpScript()  # -> a
# ---------- test: C# ----------
using System;
using System.Linq;
using System.Collections.Generic;

using RhinoCodePlatform.Rhino3D.GH;

var doc = ghenv.Component.OnPingDocument();

var scripts = new List<string>();
foreach (IScriptObject script in doc.Objects
                                    .OfType<IScriptObject>()
                                    .Where(so => so.HasScript))
{
    if (script.Name == "_test_")
        continue;

    scripts.Add(script.Name);
    
    // build the script
    script.ReBuild();
}

a = scripts;
# ---------- end test ----------
panel = Panel(test)

# ---- group: NO ERROR
python3 = Python3Script()  # -> out, a; disabled; unedited script template
python2 = IronPython2Script()  # -> out, a; disabled
# ---------- python2: IronPython ----------
"""Grasshopper Script"""
a = "Hello IronPython 2 in Grasshopper!"
print(a)
# ---------- end python2 ----------
