# Grasshopper definition test_pyobject.ghx (Grasshopper 1.0.8)
# plug-ins: RhinoCodePluginGH

script = Script(n=Slider(23, range=0..100))  # -> out, values; inputs n: Int32
# ---------- script: Python ----------
# r: numpy

import numpy

values = []
for pt in numpy.random.rand(n, 3):
    pt = pt * 20 - 10
    values.append([pt[0], pt[1], pt[2]])
# ---------- end script ----------
script_2 = Script(coordinates=script.values)  # -> out, points
# ---------- script_2: C# ----------
using System;
using System.Collections.Generic;
using Rhino.Geometry;


var c = (List<object>)coordinates;
points = new Point3d((double)c[0], (double)c[1], (double)c[2]);
# ---------- end script_2 ----------
panel = Panel(script.values)
panel_2 = Panel(script_2.points)
script_3 = Script(point=script_2.points)  # -> out, pid
# ---------- script_3: Python ----------
import rhinoscriptsyntax as rs

pid = rs.AddPoint(point.X, point.Y, point.Z)
# ---------- end script_3 ----------
panel_3 = Panel(script_3.pid)
