# Grasshopper definition test_pytorch.ghx (Grasshopper 1.0.7)
# plug-ins: RhinoCodePluginGH

geo = Geometry(<curve referenced from the Rhino model>)
geo_2 = Geometry(<curve referenced from the Rhino model>)
number_slider = Slider(-0.1, range=-0.1..0.1)
number_slider_2 = Slider(1, range=0..10)
cp = ControlPoints(Curve=geo_2)  # -> Points, Weights, Knots
divide = DivideCurve(Curve=geo, Count=Slider(15, range=0..100), Kinks=False)  # -> Points, Tangents, Parameters
panel = Panel("C:\Users\ein\gits\rhino\src4\rhino4\Plug-ins\RhinoCodePlugins\tests_rhinogh\test_pytorch.pt")
S = Script()  # -> out, a
# ---------- S: Python ----------
#! python 3
# r: torch
# r: numpy

import torch
import numpy
print("imported")
# ---------- end S ----------
item = ListItem(List=cp.Points, Index=number_slider_2, Wrap=True)
vec = VectorXYZ(XComponent=Slider(-0.01144, range=-1..1), YComponent=Slider(-0.04906, range=-1..1), ZComponent=0)  # -> Vector, Length
Y = UnitY(Factor=1)
panel_2 = Panel(S.out)
move = Move(Geometry=item, Motion=vec.Vector)  # -> Geometry, Transform
path = FilePath(panel)
panel_3 = Panel(vec.Vector)
replace = ReplaceItems(List=cp.Points, Item=move.Geometry, Indices=number_slider_2, Wrap=False)
load_autodecoder = Script(pth=path)  # -> out, state_dict, autodecoder
# ---------- load_autodecoder: Python ----------
import torch
import numpy as np
from torch import nn
import os

print(f"Installed Torch version: {torch.__version__}")

class ComplexGaborLayer(nn.Module):
    '''
        Implicit representation with complex Gabor nonlinearity

        Inputs;
            in_features: Input features
            out_features; Output features
            bias: if True, enable bias for the linear operation
            is_first: Legacy SIREN parameter
            omega_0: Legacy SIREN parameter
            omega0: Frequency of Gabor sinusoid term
            sigma0: Scaling of Gabor Gaussian term
            trainable: If True, omega and sigma are trainable parameters
    '''

    def __init__(self, in_features, out_features, bias=True,
                 is_first=False, omega0=10.0, sigma0=40.0,
                 trainable=False):
        super().__init__()
        self.omega_0 = omega0
        self.scale_0 = sigma0
        self.is_first = is_first

        self.in_features = in_features

        if self.is_first:
            dtype = torch.float
        else:
            dtype = torch.cfloat

        # Set trainable parameters if they are to be simultaneously optimized
        self.omega_0 = nn.Parameter(self.omega_0*torch.ones(1), trainable)
        self.scale_0 = nn.Parameter(self.scale_0*torch.ones(1), trainable)

        self.linear = nn.Linear(in_features,
                                out_features,
                                bias=bias,
                                dtype=dtype)

    def forward(self, input):
        lin = self.linear(input)
        omega = self.omega_0 * lin
        scale = self.scale_0 * lin

        return torch.exp(1j*omega - scale.abs().square())
    
class ComplexGaborLayerConv(nn.Module):
    '''
        Implicit representation with complex Gabor nonlinearity

        Inputs;
            in_features: Input features
            out_features; Output features
            bias: if True, enable bias for the linear operation
            is_first: Legacy SIREN parameter
            omega_0: Legacy SIREN parameter
            omega0: Frequency of Gabor sinusoid term
            sigma0: Scaling of Gabor Gaussian term
            trainable: If True, omega and sigma are trainable parameters
    '''

    def __init__(self, in_features, out_features, bias=True,
                 is_first=False, omega0=10.0, sigma0=40.0,
                 trainable=False):
        super().__init__()
        self.omega_0 = omega0
        self.scale_0 = sigma0
        self.is_first = is_first

        self.in_features = in_features

        if self.is_first:
            dtype = torch.float
        else:
            dtype = torch.cfloat

        # Set trainable parameters if they are to be simultaneously optimized
        self.omega_0 = nn.Parameter(self.omega_0*torch.ones(1), trainable)
        self.scale_0 = nn.Parameter(self.scale_0*torch.ones(1), trainable)

        self.conv = nn.Conv1d(1,1,3, padding=1)

    def forward(self, input):
        lin = self.conv(input)
        omega = self.omega_0 * lin
        scale = self.scale_0 * lin

        return torch.exp(1j*omega - scale.abs().square())

class PoseAutoDecoder(nn.Module):
    def __init__(self, latent_in_features, hidden_features,
                 hidden_layers,
                 out_features, num_latents, outermost_linear=True,
                 first_omega_0=30, hidden_omega_0=30., scale=10.0,
                 pos_encode=False, sidelength=1, fn_samples=None,
                 use_nyquist=True):
        super().__init__()

        self.latent_in_features = latent_in_features

        # All results in the paper were with the default complex 'gabor' nonlinearity
        self.nonlin = ComplexGaborLayer

        self.latents = nn.Embedding(num_latents, (latent_in_features * sidelength * sidelength))
        self.latents.weight.data.normal_(0, 1e-1)


        # Since complex numbers are two real numbers, reduce the number of
        # hidden parameters by 2
        hidden_features = int(hidden_features/np.sqrt(2))
        dtype = torch.cfloat
        self.complex = True
        self.wavelet = 'gabor'

        # Legacy parameter
        self.pos_encode = False
        
        self.net = []
        
        self.net.append(ComplexGaborLayerConv(1, 1,
                                                 omega0=first_omega_0,
                                                 sigma0=scale,
                                                 is_first=True,
                                                 trainable=False))
        
        
        self.net.append(self.nonlin(latent_in_features * sidelength * sidelength,
                                    hidden_features,
                                    omega0=first_omega_0,
                                    sigma0=scale,
                                    is_first=False,
                                    trainable=False))

        for i in range(hidden_layers):
            self.net.append(self.nonlin(hidden_features,
                                        hidden_features,
                                        omega0=hidden_omega_0,
                                        sigma0=scale))

        final_linear = nn.Linear(hidden_features,
                                 out_features,
                                 dtype=dtype)
        self.net.append(final_linear)

        self.net = nn.Sequential(*self.net)

    def forward(self, idx):
        if idx.dtype == torch.long or idx.dtype == torch.int:
            latents = self.latents(idx)
        else:
            latents = idx

        latents = latents.unsqueeze(1)
        #latents = self.latent_conv(latents)
        #print(latents.shape)

        outputs = self.net(latents)

        if self.wavelet == 'gabor':
            if idx.dtype == torch.long or idx.dtype == torch.int:
                return outputs.real.reshape(len(idx), -1, 4), latents
            else:
                return outputs.real.reshape(-1, 4), latents

        return outputs, latents

num_poses = 818
latent_in_features = 16
hidden_features = 64
hidden_layers = 3
out_features = 46*4

omega0 = 10.0
sigma0 = 10.0

pose_ad = PoseAutoDecoder(
    latent_in_features,
    hidden_features,
    hidden_layers,
    out_features,
    num_poses,
    first_omega_0=omega0,
    hidden_omega_0=omega0,
    scale = sigma0)

model_info = torch.load(pth, map_location = torch.device('cpu'))
state_dict = model_info['model_state_dict']


pose_ad.load_state_dict(state_dict)
pose_ad.eval()

autodecoder = pose_ad
# ---------- end load_autodecoder ----------
nurbs = NurbsCurve(Vertices=replace, Degree="2", Periodic=False)  # -> Curve, Length, Domain
project = ProjectPoint(Point=divide.Points, Direction=Y, Geometry=nurbs.Curve)  # -> Point, Index
dist = Distance(PointA=divide.Points, PointB=project.Point)
panel_4 = Panel(load_autodecoder.autodecoder)
cp_2 = ControlPoints(Curve=nurbs.Curve)  # -> Points, Weights, Knots
S_2 = Script(x=load_autodecoder.state_dict)  # -> out, keys, simplify(values)
# ---------- S_2: Python ----------
import ghpythonlib.treehelpers as th
import torch

keys = x.keys()
latents = x['latents.weight'].tolist()

values = th.list_to_tree(latents, 0)
# ---------- end S_2 ----------
tstat = TreeStatistics(Tree=S_2.values)  # -> Paths, Length, Count
flip = FlipMatrix(Data=S_2.values)
sort = SortList(Keys=flip)  # -> Keys, ValuesA
item_2 = ListItem(List=tstat.Paths, Index=0, Wrap=True)  # -> Item, Item1
branch = TreeBranch(Tree=S_2.values, Path=[item_2.Item, item_2.Item1], MaintainPaths=True)
item_3 = ListItem(List=sort.Keys, Index=0, Wrap=True)  # -> flatten(Item1), flatten(Item)
panel_5 = Panel(item_3.Item)
panel_6 = Panel(dist)
panel_7 = Panel(item_3.Item1)
dom = ConstructDomain(DomainStart=item_3.Item, DomainEnd=item_3.Item1)
remap = RemapNumbers(Value=dist, Source=Domain(0, 1), Target=dom)  # -> Mapped, Clipped
panel_8 = Panel(dom)
evaluate_autodecoder = Script(autodecoder=load_autodecoder.autodecoder, latents=remap.Mapped)  # -> out, simplify(points); inputs latents: tree
# ---------- evaluate_autodecoder: Python ----------
import torch
import ghpythonlib.treehelpers as th

pose_ad = autodecoder
latents = th.tree_to_list(latents)
tensors = torch.tensor(latents, dtype=torch.float32)

evals = pose_ad(tensors)[0].tolist()

points = th.list_to_tree(evals, 0)
# ---------- end evaluate_autodecoder ----------
split = SplitList(List=evaluate_autodecoder.points, Index="3")  # -> simplify(ListA), simplify(ListB)
panel_9 = Panel("""1,0
 3,2
 3,1
 4,3
 6,5
 6,4
 8,7
 10,9
 11,8
 11,12
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""")
num2pt = NumbersToPoints(Numbers=split.ListA, Mask=4)  # -> simplify(flatten(Points))
split_2 = TextSplit(Text=graft(panel_9), Separators=",")  # -> simplify(Result)
item_4 = ListItem(List=num2pt, Index=split_2, Wrap=True)
vec_2 = VectorXYZ(XComponent="0.6546", YComponent="0.2234", ZComponent="-0.0077")  # -> Vector, Length
scale_nu = ScaleNU(Geometry=item_4, Plane=PlaneXY(0, 0, 0), ScaleX="0.2403", ScaleY="0.2470", ScaleZ="0.1092")  # -> Geometry, Transform
move_2 = Move(Geometry=scale_nu.Geometry, Motion=vec_2.Vector)  # -> Geometry, Transform
pline = PolyLine(Vertices=move_2.Geometry, Closed=False)
