# Grasshopper definition test_scriptcontext_sticky.ghx (Grasshopper 1.0.7)
# plug-ins: RhinoCodePluginGH

script = Panel("""import scriptcontext as sc


sc.sticky["One"] = 1
sc.sticky["Two"] = 2

items  = sc.sticky.items()
keys   = sc.sticky.keys()
values = sc.sticky.values()

iteritems  = sc.sticky.iteritems()
iterkeys   = sc.sticky.iterkeys()
itervalues = sc.sticky.itervalues()

viewitems  = sc.sticky.viewitems()
viewkeys   = sc.sticky.viewkeys()
viewvalues = sc.sticky.viewvalues()

has_key = sc.sticky.has_key("One")""")
script_2 = Script(script=script)  # -> items, keys, values, iteritems, iterkeys, itervalues, viewitems, viewkeys, viewvalues, has_key
#   port script: Script to execute
# ---------- script_2: Python ----------
"""Grasshopper Script"""
#! python 3
import scriptcontext as sc


sc.sticky["One"] = 1
sc.sticky["Two"] = 2

items  = sc.sticky.items()
keys   = sc.sticky.keys()
values = sc.sticky.values()
# ---------- end script_2 ----------
script_3 = Script(script=script)  # -> items, keys, values, iteritems, iterkeys, itervalues, viewitems, viewkeys, viewvalues, has_key
#   port script: Script to execute
# ---------- script_3: Python ----------
"""Grasshopper Script"""
#! python 2
import scriptcontext as sc


sc.sticky["One"] = 1
sc.sticky["Two"] = 2
# ---------- end script_3 ----------
ghpython_script = GhPythonScript(Code=script)  # -> Items, Keys, Values, Iteritems, Iterkeys, Itervalues, Viewitems, Viewkeys, Viewvalues, Has_key
panel = Panel(script_2.viewitems)
panel_2 = Panel(script_2.has_key)
panel_3 = Panel(script_2.iteritems)
panel_4 = Panel(script_2.items)
panel_5 = Panel(script_3.viewitems)
panel_6 = Panel(script_3.has_key)
panel_7 = Panel(script_3.iteritems)
panel_8 = Panel(script_3.items)
panel_9 = Panel(ghpython_script.Has_key)
panel_10 = Panel(ghpython_script.Viewitems)
panel_11 = Panel(ghpython_script.Iteritems)
panel_12 = Panel(ghpython_script.Items)
panel_13 = Panel(script_2.viewkeys)
panel_14 = Panel(script_2.iterkeys)
panel_15 = Panel(script_2.keys)
panel_16 = Panel(script_3.viewkeys)
panel_17 = Panel(script_3.iterkeys)
panel_18 = Panel(script_3.keys)
panel_19 = Panel(ghpython_script.Viewkeys)
panel_20 = Panel(ghpython_script.Iterkeys)
panel_21 = Panel(ghpython_script.Keys)
panel_22 = Panel(script_2.viewvalues)
panel_23 = Panel(script_2.itervalues)
panel_24 = Panel(script_2.values)
panel_25 = Panel(script_3.viewvalues)
panel_26 = Panel(script_3.itervalues)
panel_27 = Panel(script_3.values)
panel_28 = Panel(ghpython_script.Viewvalues)
panel_29 = Panel(ghpython_script.Itervalues)
panel_30 = Panel(ghpython_script.Values)
