# Grasshopper definition test_shared_library.ghx (Grasshopper 1.0.7)
# plug-ins: RhinoCodePluginGH

panel = Panel("C:\Users\ein\gits\rhino\src4\rhino4\Plug-ins\RhinoCodePlugins\tests_projects\libraries\TestAssembly")
panel_2 = Panel("C:\Users\ein\gits\rhino\src4\rhino4\Plug-ins\RhinoCodePlugins\tests_projects\libraries\testmodule")
number_slider = Slider(46, range=0..100)
script_library = ScriptLibrary(
    panel,
    ExpireOnDiskEvent=True,
    TreatInputAsPath=True,
    SourceLanguageFamilySpec_Taxon="*.*.csharp",
    SourceLanguageFamilySpec_Version="-1.-1")
script = Script(library=[script_library, panel_2], x=number_slider, y=number_slider)  # -> out, a; inputs library: tree, x: Int32, y: Int32
#   port library: Library or libraries to execute script with
# ---------- script: C# ----------
using System;
using TestAssembly.Math;

var m = new DoMath();
a = m.Add(x, y);
# ---------- end script ----------
panel_3 = Panel(script_library)
script_2 = Script(library=panel_2, x=number_slider, y=number_slider)  # -> out, a; inputs library: tree
#   port library: Library or libraries to execute script with
# ---------- script_2: Python ----------
#! python3

from importlib import reload
from testmodule import riazi
reload(riazi)

a = riazi.add(x, y)
# ---------- end script_2 ----------
script_3 = Script(x=number_slider, y=number_slider)  # -> out, a; inputs x: Int32, y: Int32
# ---------- script_3: Python ----------
#! python3

from TestAssembly.Math import DoMath

m = DoMath()
a = m.Add(x, y)
# ---------- end script_3 ----------
panel_4 = Panel(script.a)
panel_5 = Panel(script_2.a)
panel_6 = Panel(script_3.a)
