# Grasshopper definition test_shared_scriptlibrary.ghx (Grasshopper 1.0.7)
# plug-ins: RhinoCodePluginGH

shared_module = Panel("""#! python3

def do_something(x, y):
	return x + y""")
number_slider = Slider(12, range=0..100)
script = Script(libraries=shared_module, x=number_slider, y=number_slider)  # -> a; inputs libraries: tree
#   port libraries: Library or libraries to execute script with
# ---------- script: Python ----------
import shared_module

a = shared_module.do_something(x, y)
# ---------- end script ----------
script_2 = Script(libraries=shared_module, x=number_slider, y=number_slider)  # -> a; inputs libraries: tree; same code as script
panel = Panel(script)
panel_2 = Panel(script_2)
