# Grasshopper definition test_tkinter.ghx (Grasshopper 1.0.8)
# plug-ins: RhinoCodePluginGH

py3 = Python3Script()  # -> out, a
# ---------- py3: Python ----------
"""tkinter test in RCE"""
import tkinter
import os
from tkinter import *

os.environ["TK_SILENCE_DEPRECATION"] = "1"

window = Tk()
window.title("Welcome to LikeGeeks app")
window.geometry('350x200')

lbl = Label(window, text="Hello")
lbl.grid(column=0, row=0)

txt = Entry(window,width=10)
txt.grid(column=1, row=0)

def clicked():
    """Button click handler"""
    res = "Welcome to " + txt.get()
    lbl.configure(text= res)

btn = Button(window, text="Click Me", command=clicked)
btn.grid(column=2, row=0)

window.mainloop()
# ---------- end py3 ----------
