# Grasshopper definition test_toggle_legacy.ghx (Grasshopper 1.0.7)

ghpython_script = GhPythonScript()  # -> out, a
# ---------- ghpython_script: Python ----------
__author__ = "ein"
__version__ = "2023.10.25"

import rhinoscriptsyntax as rs
import scriptcontext as sc

import ghpythonlib as ghlib
import System
import System.Drawing as SD

c = ghlib.component._get_active_component()
# c.SetIconOverride(SD.Image.FromFile(r""))
c.ToggleObsolete(False)
# ---------- end ghpython_script ----------
c_script = CSharpScript()  # -> out, A
# ---------- c_script: C# ----------
    ((dynamic)Component).ToggleObsolete(false);
# ---------- end c_script ----------
