# Grasshopper definition test_userobject.ghx (Grasshopper 1.0.7)
# plug-ins: RhinoCodePluginGH

templatescript = TemplateScript()  # -> out, a
# ---------- templatescript: Python ----------
# this is my template
a = 42
# ---------- end templatescript ----------
