# Grasshopper definition test_window_createsomanyscripts.ghx (Grasshopper 1.0.7)
# plug-ins: RhinoCodePluginGH

py3 = Python3Script()  # -> out, a; unedited script template
py3_2 = Python3Script()  # -> out, a; unedited script template
py3_3 = Python3Script()  # -> out, a; unedited script template
py3_4 = Python3Script()  # -> out, a; unedited script template
py3_5 = Python3Script()  # -> out, a; unedited script template
py3_6 = Python3Script()  # -> out, a; unedited script template
py3_7 = Python3Script()  # -> out, a; unedited script template
py3_8 = Python3Script()  # -> out, a; unedited script template
py3_9 = Python3Script()  # -> out, a; unedited script template
py3_10 = Python3Script()  # -> out, a; unedited script template
py3_11 = Python3Script()  # -> out, a; unedited script template
py3_12 = Python3Script()  # -> out, a; unedited script template
ipy2 = IronPython2Script()  # -> out, a
# ---------- ipy2: IronPython ----------
"""Grasshopper Script"""
a = "Hello IronPython 2 in Grasshopper!"
print(a)
# ---------- end ipy2 ----------
py3_13 = Python3Script()  # -> out, a; unedited script template
ipy2_2 = IronPython2Script()  # -> out, a; same code as ipy2
py3_14 = Python3Script()  # -> out, a; unedited script template
ipy2_3 = IronPython2Script()  # -> out, a; same code as ipy2
py3_15 = Python3Script()  # -> out, a; unedited script template
ipy2_4 = IronPython2Script()  # -> out, a; same code as ipy2
py3_16 = Python3Script()  # -> out, a; unedited script template
ipy2_5 = IronPython2Script()  # -> out, a; same code as ipy2
py3_17 = Python3Script()  # -> out, a; unedited script template
ipy2_6 = IronPython2Script()  # -> out, a; same code as ipy2
py3_18 = Python3Script()  # -> out, a; unedited script template
ipy2_7 = IronPython2Script()  # -> out, a; same code as ipy2
py3_19 = Python3Script()  # -> out, a; unedited script template
ipy2_8 = IronPython2Script()  # -> out, a; same code as ipy2
py3_20 = Python3Script()  # -> out, a; unedited script template
ipy2_9 = IronPython2Script()  # -> out, a; same code as ipy2
py3_21 = Python3Script()  # -> out, a; unedited script template
ipy2_10 = IronPython2Script()  # -> out, a; same code as ipy2
py3_22 = Python3Script()  # -> out, a; unedited script template
ipy2_11 = IronPython2Script()  # -> out, a; same code as ipy2
py3_23 = Python3Script()  # -> out, a; unedited script template
ipy2_12 = IronPython2Script()  # -> out, a; same code as ipy2
py3_24 = Python3Script()  # -> out, a; unedited script template
ipy2_13 = IronPython2Script()  # -> out, a; same code as ipy2
cs = CSharpScript()  # -> out, a
# ---------- cs: C# ----------
// Grasshopper Script Instance
using System;
using System.Collections;
using System.Collections.Generic;
using System.Drawing;

using Rhino;
using Rhino.Geometry;

using Grasshopper;
using Grasshopper.Kernel;
using Grasshopper.Kernel.Data;
using Grasshopper.Kernel.Types;

public class Script_Instance : GH_ScriptInstance
{
  /* 
    Members:
      RhinoDoc RhinoDocument
      GH_Document GrasshopperDocument
      IGH_Component Component
      int Iteration

    Methods (Virtual & overridable):
      Print(string text)
      Print(string format, params object[] args)
      Reflect(object obj)
      Reflect(object obj, string method_name)
  */
  
  private void RunScript(object x, object y, ref object a)
  {
    // Write your logic here
    a = null;
  }
}
# ---------- end cs ----------
py3_25 = Python3Script()  # -> out, a; unedited script template
ipy2_14 = IronPython2Script()  # -> out, a; same code as ipy2
cs_2 = CSharpScript()  # -> out, a; same code as cs
py3_26 = Python3Script()  # -> out, a; unedited script template
ipy2_15 = IronPython2Script()  # -> out, a; same code as ipy2
cs_3 = CSharpScript()  # -> out, a; same code as cs
py3_27 = Python3Script()  # -> out, a; unedited script template
ipy2_16 = IronPython2Script()  # -> out, a; same code as ipy2
cs_4 = CSharpScript()  # -> out, a; same code as cs
py3_28 = Python3Script()  # -> out, a; unedited script template
ipy2_17 = IronPython2Script()  # -> out, a; same code as ipy2
cs_5 = CSharpScript()  # -> out, a; same code as cs
py3_29 = Python3Script()  # -> out, a; unedited script template
ipy2_18 = IronPython2Script()  # -> out, a; same code as ipy2
cs_6 = CSharpScript()  # -> out, a; same code as cs
py3_30 = Python3Script()  # -> out, a; unedited script template
ipy2_19 = IronPython2Script()  # -> out, a; same code as ipy2
cs_7 = CSharpScript()  # -> out, a; same code as cs
py3_31 = Python3Script()  # -> out, a; unedited script template
ipy2_20 = IronPython2Script()  # -> out, a; same code as ipy2
cs_8 = CSharpScript()  # -> out, a; same code as cs
py3_32 = Python3Script()  # -> out, a; unedited script template
ipy2_21 = IronPython2Script()  # -> out, a; same code as ipy2
cs_9 = CSharpScript()  # -> out, a; same code as cs
py3_33 = Python3Script()  # -> out, a; unedited script template
ipy2_22 = IronPython2Script()  # -> out, a; same code as ipy2
cs_10 = CSharpScript()  # -> out, a; same code as cs
py3_34 = Python3Script()  # -> out, a; unedited script template
ipy2_23 = IronPython2Script()  # -> out, a; same code as ipy2
cs_11 = CSharpScript()  # -> out, a; same code as cs
py3_35 = Python3Script()  # -> out, a; unedited script template
ipy2_24 = IronPython2Script()  # -> out, a; same code as ipy2
cs_12 = CSharpScript()  # -> out, a; same code as cs
py3_36 = Python3Script()  # -> out, a; unedited script template
ipy2_25 = IronPython2Script()  # -> out, a; same code as ipy2
cs_13 = CSharpScript()  # -> out, a; same code as cs
py3_37 = Python3Script()  # -> out, a; unedited script template
ipy2_26 = IronPython2Script()  # -> out, a; same code as ipy2
py3_38 = Python3Script()  # -> out, a; unedited script template
ipy2_27 = IronPython2Script()  # -> out, a; same code as ipy2
py3_39 = Python3Script()  # -> out, a; unedited script template
ipy2_28 = IronPython2Script()  # -> out, a; same code as ipy2
py3_40 = Python3Script()  # -> out, a; unedited script template
ipy2_29 = IronPython2Script()  # -> out, a; same code as ipy2
py3_41 = Python3Script()  # -> out, a; unedited script template
ipy2_30 = IronPython2Script()  # -> out, a; same code as ipy2
py3_42 = Python3Script()  # -> out, a; unedited script template
ipy2_31 = IronPython2Script()  # -> out, a; same code as ipy2
py3_43 = Python3Script()  # -> out, a; unedited script template
ipy2_32 = IronPython2Script()  # -> out, a; same code as ipy2
py3_44 = Python3Script()  # -> out, a; unedited script template
ipy2_33 = IronPython2Script()  # -> out, a; same code as ipy2
py3_45 = Python3Script()  # -> out, a; unedited script template
ipy2_34 = IronPython2Script()  # -> out, a; same code as ipy2
py3_46 = Python3Script()  # -> out, a; unedited script template
ipy2_35 = IronPython2Script()  # -> out, a; same code as ipy2
py3_47 = Python3Script()  # -> out, a; unedited script template
ipy2_36 = IronPython2Script()  # -> out, a; same code as ipy2
ipy2_37 = IronPython2Script()  # -> out, a; same code as ipy2
ipy2_38 = IronPython2Script()  # -> out, a; same code as ipy2
ipy2_39 = IronPython2Script()  # -> out, a; same code as ipy2
ipy2_40 = IronPython2Script()  # -> out, a; same code as ipy2
ipy2_41 = IronPython2Script()  # -> out, a; same code as ipy2
ipy2_42 = IronPython2Script()  # -> out, a; same code as ipy2
ipy2_43 = IronPython2Script()  # -> out, a; same code as ipy2
ipy2_44 = IronPython2Script()  # -> out, a; same code as ipy2
ipy2_45 = IronPython2Script()  # -> out, a; same code as ipy2
ipy2_46 = IronPython2Script()  # -> out, a; same code as ipy2
ipy2_47 = IronPython2Script()  # -> out, a; same code as ipy2
ipy2_48 = IronPython2Script()  # -> out, a; same code as ipy2
