# Grasshopper definition test_writeSpeed.ghx (Grasshopper 1.0.8)
# plug-ins: RhinoCodePluginGH

python_3_script = Python3Script()  # -> out, a
# ---------- python_3_script: Python ----------
"""Test Write Speed"""

for i in range(10_000):
    print(i)
# ---------- end python_3_script ----------
panel = Panel(python_3_script.out)
