# Grasshopper definition test_zui_output.ghx (Grasshopper 1.0.7)
# plug-ins: RhinoCodePluginGH

number_slider = Slider(12, range=0..100)
py3 = Python3Script(x=number_slider, y=number_slider)  # -> out, a
# ---------- py3: Python ----------
a = x + y
print(a)
# ---------- end py3 ----------
panel = Panel(py3.out)
