# Grasshopper definition test_singles_disabled.ghx (Grasshopper 1.0.8)
# plug-ins: RhinoCodePluginGH

number_slider = Slider(12, range=0..100)

# ---- group: EDIT DEFAULT LANG
script = Script()  # -> Out, A; disabled

# ---- group: OPEN EDITOR WITH LANG
python_3_script = Python3Script(x=number_slider, y=number_slider)  # -> out, a; disabled
# ---------- python_3_script: Python ----------
a = x + y
# ---------- end python_3_script ----------
ironpython_2_script = IronPython2Script(x=number_slider, y=number_slider)  # -> out, a; disabled; same code as python_3_script
csharp_script = CSharpScript(x=number_slider, y=number_slider)  # -> out, a; inputs x: Int32, y: Int32; disabled
# ---------- csharp_script: C# ----------
a = x + y;
# ---------- end csharp_script ----------

# ---- group: ERROR ON EDITOR OPEN
python_3_script_2 = Python3Script(x=number_slider, y=number_slider)  # -> out, a; disabled
# ---------- python_3_script_2: Python ----------
a = x +
# ---------- end python_3_script_2 ----------
ironpython_2_script_2 = IronPython2Script(x=number_slider, y=number_slider)  # -> out, a; disabled; same code as python_3_script_2
csharp_script_2 = CSharpScript(x=number_slider, y=number_slider)  # -> out, a; inputs x: Int32, y: Int32; disabled; same code as python_3_script
