# Grasshopper definition test_training_example.ghx (Grasshopper 1.0.8)
# plug-ins: RhinoCodePluginGH

trigger = Trigger(Interval=500, TimerInterval=500, Target=python_3_script)  # disabled
python_3_script = Python3Script()  # -> a, b
# ---------- python_3_script: Python ----------
import System
import System.Drawing as SD
import Rhino
import Rhino.Geometry as G
import Grasshopper
import Grasshopper.Kernel as GHK
import threading
import time


def main_solve():
    for r in range(10, 20):
        # wait represents compute work
        Rhino.RhinoApp.WriteLine("computing mesh")
        time.sleep(1)

        sphere = G.Sphere(G.Point3d.Origin, r)
        MyComponent.CURRENT_MESH = G.Mesh.CreateFromSphere(sphere, 10, 10)
        Rhino.RhinoApp.WriteLine("computed mesh")

    Rhino.RhinoApp.WriteLine("computed completed")


class MyComponent(Grasshopper.Kernel.GH_ScriptInstance):
    SOVLE_STARTED = False
    CURRENT_MESH = None

    def RunScript(self):
        if MyComponent.SOVLE_STARTED:
            return ("Training in Progress", MyComponent.CURRENT_MESH)
        
        MyComponent.SOVLE_STARTED = True
        threading.Thread(target=main_solve).start()
        return ("Training in Progress", None)
        
    @property
    def ClippingBox(self):
        return G.BoundingBox(-30, -30, -30, 30, 30, 30)

    def DrawViewportMeshes(self, args: GHK.IGH_PreviewArgs):
        if d := getattr(args, "Display", None):
            if MyComponent.CURRENT_MESH:
                d.DrawMeshWires(MyComponent.CURRENT_MESH, SD.Color.Blue, 2)
# ---------- end python_3_script ----------
panel = Panel([python_3_script.a, python_3_script.b])
custom_preview = CustomPreview(Geometry=python_3_script.b, Material=ColourSwatch(SwatchColor=RGBA(154, 181, 159, 12)))
