# Grasshopper definition test_viewportimage.ghx (Grasshopper 1.0.7)
# plug-ins: RhinoCodePluginGH

pt = Point([Point(-9.294403839, -5.21826814, 0), Point(-39.26549914, 25.12374519, 0)])
brep = Brep([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])
item = ListItem(List=pt, Index=0, Wrap=True)  # -> Item, Item1
object = ModelObject(Object=brep, Layer="Temp::Test")
cache = ContentCache(Content=object, Pattern=Toggle(True))
symcus = SymbolDisplayCustom(P=flatten(item.Item), F="test_viewportimage.png", S=Slider(16.24, range=0..50), D=Toggle(True), V=Toggle(True))  # inputs P: list of Point3d, F: String, D: Boolean, V: Boolean
# ---------- symcus: Python ----------
__author__ = "Michael Vollrath"
__version__ = "2023.07.30"
# Made With ♥ In Dallas, TX

#Setup Parameter Names & Descriptions
ghenv.Component.Name = "Symbol Display (Custom)"
ghenv.Component.NickName = "SymCus"
ghenv.Component.Description = "Symbol display that accepts custom images and optionally draws them in the foreground"

ghenv.Component.Params.Input[0].Name = "Point"
ghenv.Component.Params.Input[0].NickName = "P"
ghenv.Component.Params.Input[0].Description = "Location To Add Symbol"

ghenv.Component.Params.Input[1].Name = "File Path"
ghenv.Component.Params.Input[1].NickName = "F"
ghenv.Component.Params.Input[1].Description = "File Path Location Of Symbol Image"

ghenv.Component.Params.Input[2].Name = "Size"
ghenv.Component.Params.Input[2].NickName = "S"
ghenv.Component.Params.Input[2].Description = "Symbol Size"

ghenv.Component.Params.Input[3].Name = "Draw Order"
ghenv.Component.Params.Input[3].NickName = "D"
ghenv.Component.Params.Input[3].Description = "Set True To Draw Symbol In Foreground"

ghenv.Component.Params.Input[4].Name = "Variable Scale"
ghenv.Component.Params.Input[4].NickName = "V"
ghenv.Component.Params.Input[4].Description = "Set True For Fixed Scale"

from ghpythonlib.componentbase import executingcomponent as component

import System
import Rhino
import Rhino as rh
import Rhino.Geometry as rg

class MyComponent(component):
    
    def RunScript(self,
            P: System.Collections.Generic.IList[Rhino.Geometry.Point3d],
            F: str,
            S,
            D: bool,
            V: bool):

        if S == None: S = 20
        if D == None: D = True
        if V == None: V = False
        
        self.F = F
        self.P = P
        self.D = D  # Store the value of D as an instance variable
        
        if self.F:
            bitmap = System.Drawing.Bitmap.FromFile(F)
            self.B = rh.Display.DisplayBitmap(bitmap)

        self.S = S
        self.size = V
        
        if self.P and len(P) > 0:
            bb = rg.BoundingBox(P)
            self.bb = bb
        else:
            self.bb = rh.Geometry.BoundingBox.Empty

    def DrawForeground(self, sender, arg):
        if self.D:  # If D is True, draw the sprite in the foreground
            if self.P and self.F:
                items = rh.Display.DisplayBitmapDrawList()
                items.SetPoints(self.P)
                arg.Display.DrawSprites(self.B, items, self.S, self.size)

    def DrawViewportWires(self, arg):
        if not self.D:  # If D is False, draw the sprite as before using DrawViewportWires
            if self.P and self.F:
                items = rh.Display.DisplayBitmapDrawList()
                items.SetPoints(self.P)
                arg.Display.DrawSprites(self.B, items, self.S, self.size)
    
    def get_ClippingBox(self):
        return self.bb
    
    def IsPreviewCapable(self):
        return True

    def __exit__(self):
        rh.Display.DisplayPipeline.DrawForeground -= self.DrawForeground

    def __enter__(self):
        rh.Display.DisplayPipeline.DrawForeground += self.DrawForeground
# ---------- end symcus ----------
