# Grasshopper definition test.ghx (Grasshopper 1.0.8)
# plug-ins: RhinoCodePluginGH

construct_domain = ConstructDomain(DomainStart=Slider(1, range=0..1), DomainEnd=Slider(5, range=0..10))
number_slider = Slider(7, range=0..10)
range = Range(Domain=construct_domain, Steps=Slider(5, range=0..10))

# ---- group: TEST DEBUG STOP AND RE-REBUG
py3 = Python3Script()  # -> out, a; unedited script template

# ----
rhinocode = RhinoCode(x=range, y=number_slider)  # -> out, a, b; inputs x: Double, y: Double
# ---------- rhinocode: C# ----------
// Default C# Script Instance with extended overrides
using System;
using System.Collections;
using System.Collections.Generic;
using System.Drawing;
using System.Threading;

using Rhino;
using Rhino.Geometry;

using Grasshopper;
using Grasshopper.Kernel;
using Grasshopper.Kernel.Data;
using Grasshopper.Kernel.Types;

Random rnd = new Random();
RhinoApp.WriteLine(rnd.Next().ToString());

public class Script_Instance : GH_ScriptInstance
{
  private void RunScript(double x, double y, ref object a, ref object b)
  {
    // Write your logic here
    Print("RunScript");
    a = x + y;
    b = new Sphere(Point3d.Origin, x);
  }
  
  public override void AfterRunScript()
  {
    // Print does not work here
    Print("AfterRunScript");
  }
}
# ---------- end rhinocode ----------

# ---- group: Hit StepOver and it should pause in next RunScript
py3_2 = Python3Script(x=range, y=number_slider)  # -> out, a
# ---------- py3_2: Python ----------
import System
import Rhino
import Grasshopper

import rhinoscriptsyntax as rs

class MyComponent(Grasshopper.Kernel.GH_ScriptInstance):
    def RunScript(self, x, y):
        print("RunScript")
        a = x + y
        return a
# ---------- end py3_2 ----------
ipy2 = IronPython2Script(x=range, y=number_slider)  # -> out, a; same code as py3_2
panel = Panel(ipy2.a)
panel_2 = Panel(py3_2.a)

# ----
panel_3 = Panel(rhinocode.a)
rhinocode_2 = RhinoCode(x=rhinocode.a, y=number_slider)  # -> out, a
# ---------- rhinocode_2: Python ----------
"""Default Python script"""


a = x + y
print(a)
# ---------- end rhinocode_2 ----------
script = Script(x=rhinocode_2.a, y=number_slider)  # -> out, a; same code as rhinocode_2
panel_4 = Panel(rhinocode_2.a)
panel_5 = Panel(script.a)
