# Grasshopper definition test_component_with_preview.ghx (Grasshopper 1.0.8)
# plug-ins: TestGHComponents.Components

# Toggle Enable/Disable
# Toggle Preview/Hide
# Toggle Preview Styles
# Preview should be blue sphere and move with slider
# Preview should not be drawn when switched to another document
number_slider = Slider(13, range=0..20)
pt = ConstructPoint(XCoordinate=0, YCoordinate=0, ZCoordinate=number_slider)
component_with_preview = Component_with_preview(PickCenterPoint=pt)
panel = Panel(component_with_preview)
