# Grasshopper definition test_gh_eto.ghx (Grasshopper 1.0.7)
# plug-ins: RhinoCodePluginGH

py3 = Python3Script()  # -> a
# ---------- py3: Python ----------
# r "Eto.dll"

import System
import Eto.Forms as EF


class TestTree(EF.Dialog):
    def __init__(self):
        super().__init__()
        
        self._input = EF.TextBox()
        self.Result = None

        self.Title = "Enter Information"
        self.Width = 300
        self.Height = 400

        layout = EF.TableLayout()

        row = EF.TableRow()
        cell = EF.TableCell()
        cell.Control = EF.TreeGridView()
        row.Cells.Add(cell)
        layout.Rows.Add(row)

        row = EF.TableRow()
        cell = EF.TableCell()
        cell.Control = self._input
        row.Cells.Add(cell)
        layout.Rows.Add(row)

        row = EF.TableRow()
        cell = EF.TableCell()
        okButton = EF.Button()
        okButton.Text = "OK"
        okButton.Click += self.onClick
        cell.Control = okButton
        row.Cells.Add(cell)
        layout.Rows.Add(row)

        self.Content = layout
    
    def onClick(self, sender, args):
        self.Close();
        self.Result = self._input.Text;


tf = TestTree()
tf.ShowModal()

a = tf.Result
# ---------- end py3 ----------
eto_test = RhinoCode()  # -> a
# ---------- eto_test: C# ----------
# r "Eto"

using System;
using Eto.Forms;


var tf = new TestTree();

tf.ShowModal();

a = tf.Result;

public class TestTree : Eto.Forms.Dialog
{
	TextBox _input = new TextBox();
	Button _okButton = new Button { Text = "OK" };
 
    public string Result { get; set; }

	public TestTree()
	{
		Title = "Enter Information";
		Width = 300;

		_okButton.Click += (s, e) => {
			Close();
			Result = _input.Text;
		};

		Content = new TableLayout {
			Rows = {
				new TreeGridView(),
				_input,
				_okButton,
			}
		};
	}
}
# ---------- end eto_test ----------
panel = Panel(eto_test)
panel_2 = Panel(py3)
