# Grasshopper definition script_with_menu.ghx (Grasshopper 1.0.8)
# plug-ins: RhinoCodePluginGH

scriptwithmenu = CSharpScript()  # -> o
# ---------- scriptwithmenu: C# ----------
using System;
using System.IO;
using System.Linq;
using System.Text;
using System.Collections;
using System.Collections.Generic;

using SD = System.Drawing;
using SWF = System.Windows.Forms;

using Rhino;
using Rhino.Input;
using Rhino.Input.Custom;
using Rhino.DocObjects;
using Rhino.Geometry;

using Grasshopper;
using Grasshopper.Kernel;
using Grasshopper.Kernel.Data;
using Grasshopper.Kernel.Parameters;
using Grasshopper.Kernel.Types;

public class Script_Instance : GH_ScriptInstance
{
    object _output = default;

    private void RunScript(object i, ref object o)
    {
        o = _output;
    }

    public override void AppendAdditionalMenuItems(SWF.ToolStripDropDown menu)
    {
        SD.Bitmap bmp;
        using (var ms = new MemoryStream(Convert.FromBase64String(ICON)))
        {
            bmp = new SD.Bitmap(ms);
        }

        menu.Items.Add("Options", bmp, (s, e) => {
            _output = 42;

            // component is only set if script is executed
            // at least once
            this.Component?.ExpireSolution(true);
        });

        menu.Items.Add(new SWF.ToolStripSeparator());
    }

    const string ICON = "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";
}
# ---------- end scriptwithmenu ----------
panel = Panel(scriptwithmenu)
