# Grasshopper definition test_plugin_script_with_menu_rc8.13.ghx (Grasshopper 1.0.8)
# plug-ins: RhinoCodePluginGH, Test_ScriptWithMenu.Components

number_slider = Slider(0, range=0..100)
scriptwithmenu = ScriptWithMenu()
equals = Equality(FirstNumber=scriptwithmenu, SecondNumber=Slider(42, range=0..100))  # -> Equality, Inequality
at = AssertTrue(equals.Equality)
