# Grasshopper definition test_plugin_output_preview_context_rc8.10.ghx (Grasshopper 1.0.8)
# plug-ins: RhinoCodePluginGH, ScriptInstancePreviews.Components

# C and D are set to Preview Off
# in the embedded GH document
number_slider = Slider(1, range=0..1)
scriptinstancepreviews_context_ghx = ScriptInstancePreviews_ContextGhx(GetNumber=number_slider)  # -> A, B, C, D
panel = Panel(scriptinstancepreviews_context_ghx.A)
panel_2 = Panel(scriptinstancepreviews_context_ghx.B)
panel_3 = Panel(scriptinstancepreviews_context_ghx.C)
panel_4 = Panel(scriptinstancepreviews_context_ghx.D)

# ---- group: Expected Previews
image = ImageSampler(
    FilePath="C:\Users\ein\LEO-WX\Downloads\_sharex\Rhino_w7IrYo6cBs.png",
    Filter="Colour",
    Interpolate=False,
    Umax=1,
    Umin=0,
    Vmax=1,
    Vmin=0,
    Wrap=1)

# ----
tmatch = MatchText(Text=[panel, panel_2, panel_3, panel_4], RegEx="Untrimmed Surface", Case=True)
at = AssertTrue(tmatch)
