# Grasshopper definition test_plugin_output_preview_single_rc8.10.ghx (Grasshopper 1.0.8)
# plug-ins: RhinoCodePluginGH, ScriptInstancePreviews.GH

number_slider = Slider(1, range=0..1)
outpreviewscriptwithpreview = OutPreviewScriptWithPreview(X=number_slider, Y=number_slider)
outpreviewsdkwithpreview = OutPreviewSDKWithPreview(X=number_slider, Y=number_slider)
panel = Panel(outpreviewsdkwithpreview)
panel_2 = Panel(outpreviewscriptwithpreview)
tmatch = MatchText(Text=panel, RegEx="Untrimmed Surface", Case=True)
tmatch_2 = MatchText(Text=panel_2, RegEx="Untrimmed Surface", Case=True)
at = AssertTrue(tmatch_2)
at_2 = AssertTrue(tmatch)

# ---- group: Expected Previews
image_sampler = ImageSampler(Filter="Colour", Interpolate=False, Umax=1, Umin=0, Vmax=1, Vmin=0, Wrap=1)

# ----
outpreviewscriptnopreview = OutPreviewScriptNoPreview(X=number_slider, Y=number_slider)
outpreviewsdknopreview = OutPreviewSDKNoPreview(X=number_slider, Y=number_slider)
panel_3 = Panel(outpreviewscriptnopreview)
panel_4 = Panel(outpreviewsdknopreview)
tmatch_3 = MatchText(Text=panel_3, RegEx="Untrimmed Surface", Case=True)
tmatch_4 = MatchText(Text=panel_4, RegEx="Untrimmed Surface", Case=True)
at_3 = AssertTrue(tmatch_3)
at_4 = AssertTrue(tmatch_4)
