# Grasshopper definition test_runcommand.ghx (Grasshopper 1.0.8)
# plug-ins: RhinoCodePluginGH

boolean_toggle = BooleanToggle(True)
command = Panel("_interpcrv")
layer = Panel("Default")
ghpython_script = GhPythonScript(layer=layer, command=command, run=boolean_toggle)  # -> out, a
# ---------- ghpython_script: Python ----------
import rhinoscriptsyntax as rs
import scriptcontext as sc
import Rhino

print("run")

sc.doc = Rhino.RhinoDoc.ActiveDoc
current_layer = rs.CurrentLayer()
rs.CurrentLayer(layer)

if run:
    print("send command")
    rs.Command(command)

rs.CurrentLayer(current_layer)
sc.doc = ghdoc
# ---------- end ghpython_script ----------
ironpython_2_script = IronPython2Script(command=command, run=boolean_toggle)  # -> out, a; same code as ghpython_script
py3 = Python3Script(command=command, run=boolean_toggle)  # -> out, a; inputs layer: String, command: String, run: Boolean; same code as ghpython_script
panel = Panel(ghpython_script.out)
panel_2 = Panel(py3.out)
panel_3 = Panel(ironpython_2_script.out)
