# Grasshopper definition test_savecode_when_editing.ghx (Grasshopper 1.0.7)
# plug-ins: RhinoCodePluginGH

number_slider = Slider(40, range=0..100)
python = GhPythonScript(x=number_slider, y=number_slider)  # -> out, a
# ---------- python: Python ----------
a = x + y
# ---------- end python ----------
S = Script(x=number_slider, y=number_slider)  # -> out, a
# ---------- S: Python ----------
"""Grasshopper Script Instance"""
import System
import Rhino
import Grasshopper

import rhinoscriptsyntax as rs

class MyComponent(Grasshopper.Kernel.GH_ScriptInstance):
    def RunScript(self, x, y):
        return x + y + 40
# ---------- end S ----------
S_2 = Script(x=number_slider, y=number_slider)  # -> out, a; inputs x: Int32, y: Int32
# ---------- S_2: C# ----------
// Grasshopper Script Instance
using System;
using System.Collections;
using System.Collections.Generic;
using System.Drawing;

using Rhino;
using Rhino.Geometry;

using Grasshopper;
using Grasshopper.Kernel;
using Grasshopper.Kernel.Data;
using Grasshopper.Kernel.Types;

public class Script_Instance : GH_ScriptInstance
{
  private void RunScript(int x, int y, out object a)
  {
    a = x + y + 40;
  }
}
# ---------- end S_2 ----------
panel = Panel(S_2.a)
panel_2 = Panel(python.a)
panel_3 = Panel(S.a)
