# Grasshopper definition test_grasshopper_fail.ghx (Grasshopper 1.0.9)

ipy2 = IronPython2Script()  # -> out, a
# ---------- ipy2: IronPython ----------
a = False
# ---------- end ipy2 ----------
at = AssertTrue(ipy2.a)
