# Grasshopper definition test_grasshopper_pass.ghx (Grasshopper 1.0.9)

ipy2 = IronPython2Script()  # -> out, a
# ---------- ipy2: IronPython ----------
a = True
# ---------- end ipy2 ----------
at = AssertTrue(ipy2.a)
