# Grasshopper definition hops_python3.ghx (Grasshopper 1.0.8)
# plug-ins: RhinoCodePluginGH

input = GetInteger(Slider(7, range=0..10), AtLeast=1, AtMost=1, Maximum=2147483647, Minimum=-2147483648, TreeAccess=False)
py3 = Python3Script(x=input, y=Slider(12, range=0..100))  # -> out, result; inputs x: Int32, y: Int32
# ---------- py3: Python ----------
result = x + y - 1;
# ---------- end py3 ----------
context_print = ContextPrint(Result=py3.result)
