# Grasshopper definition test_component_singles.ghx (Grasshopper 1.0.8)
# plug-ins: RhinoCodePluginGH

number_slider = Slider(21, range=0..100)
addition = Addition(A=number_slider, B=number_slider)
csharp = CSharp(x=number_slider, y=number_slider)  # -> out, a; inputs x: Int32, y: Int32
# ---------- csharp: C# ----------
a = x + y;
# ---------- end csharp ----------
python_3 = Python3(x=number_slider, y=number_slider)  # -> out, a
# ---------- python_3: Python ----------
a = x + y
# ---------- end python_3 ----------
ironpython_2 = IronPython2(x=number_slider, y=number_slider)  # -> out, a; same code as python_3
equals = Equality(FirstNumber=csharp.a, SecondNumber=addition)  # -> Equality, Inequality
equals_2 = Equality(FirstNumber=python_3.a, SecondNumber=addition)  # -> Equality, Inequality
equals_3 = Equality(FirstNumber=ironpython_2.a, SecondNumber=addition)  # -> Equality, Inequality
python = GhPythonScript(checks=flatten([equals.Equality, equals_2.Equality, equals_3.Equality]))  # -> all_true; inputs checks: list
# ---------- python: Python ----------
all_true = all(checks)
# ---------- end python ----------
panel = Panel(python)
context_bake = ContextBake(Content=python)
