# Grasshopper definition test_csharp_bitmap_cast.ghx (Grasshopper 1.0.8)
# plug-ins: RhinoCodePluginGH

py3 = Python3Script(x="test_image.png")  # -> out, a; inputs x: String
# ---------- py3: Python ----------
import System

a  = System.Drawing.Bitmap.FromFile(x)
# ---------- end py3 ----------
c_script = CSharpScript(x=py3.a)  # -> a
# ---------- c_script: C# ----------
using System;
using System.Linq;
using System.Collections;
using System.Collections.Generic;
using System.Drawing;

using Rhino;
using Rhino.Geometry;

using Grasshopper;
using Grasshopper.Kernel;
using Grasshopper.Kernel.Data;
using Grasshopper.Kernel.Types;

public class Script_Instance : GH_ScriptInstance
{
    private void RunScript(object x, ref object a)
    {
        Bitmap bitmap = (Bitmap) x;
        a = bitmap;
    }
}
# ---------- end c_script ----------
panel = Panel(c_script)
match_text = MatchText(Text=c_script, RegEx="System.Drawing.Bitmap", Case=True)
assert_true = AssertTrue(match_text)
