# Grasshopper definition test_csharp_compile_rc8.6_rc9.0_error.ghx (Grasshopper 1.0.8)
# plug-ins: RhinoCodePluginGH

cs = CSharpScript()  # -> a
# ---------- cs: C# ----------
#r "nuget: RestSharp, 106.11.7"

using System;
using System.Collections.Generic;
using Rhino;

using Grasshopper;
using Grasshopper.Kernel;

using RestSharp;
using RestSharp.Authenticators;

public class Script_Instance : GH_ScriptInstance
{
  private void RunScript(ref object a)
  {
    var client = new RestClient("https://httpbin.org");
    var request = new RestRequest("get", DataFormat.Json);
    var response = client.Get(request);
    Console.WriteLine(response.Content);
    a = response.Content
  }
}
# ---------- end cs ----------
num = Number(0.33)
S = Script(x=num, y=num)  # -> out, a; inputs x: Double, y: Double
# ---------- S: C# ----------
// Grasshopper Script Instance
//#! csharp
using System;

double result = a + b;

// Write your logic here
a = null;
# ---------- end S ----------
