# Grasshopper definition test_csharp_relative_lib_ref_rc9.0.ghx (Grasshopper 1.0.9)

# ---- group: Expects no errors
c_script = CSharpScript()  # -> out, a
# ---------- c_script: C# ----------
# r "lib: BrushTools.dll"

using BrushTools;

a = true;
# ---------- end c_script ----------

# ----
at = AssertTrue(c_script.a)
