# Grasshopper definition test_csharp_runtime_error.ghx (Grasshopper 1.0.8)
# plug-ins: RhinoCodePluginGH

num = Number(0.33)
S = Script(x=num, y=num)  # -> out, a; inputs x: Double, y: Double
# ---------- S: C# ----------
// Grasshopper Script Instance
//#! csharp
using System;

int m = 0;
double result = 12 / m;
# ---------- end S ----------
