# Grasshopper definition test_csharp_runtime_etoFileDialogDirectory_rc8.8_error.ghx (Grasshopper 1.0.8)
# plug-ins: RhinoCodePluginGH

c_script = CSharpScript()  # -> out, a
# ---------- c_script: C# ----------
#r "Eto.dll"

using System;
using Rhino;
using EF = Eto.Forms;

var ofd = new EF.OpenFileDialog();
// ofd.ShowDialog(Rhino.UI.RhinoEtoApp.MainWindow);

Uri d = ofd.Directory;
Console.WriteLine(d);
# ---------- end c_script ----------
