# Grasshopper definition test_csharp_scriptinstance_compile_error.ghx (Grasshopper 1.0.8)
# plug-ins: RhinoCodePluginGH

num = Number(0.33)
S = Script(x=num, y=num)  # -> out, a; inputs x: Double, y: Double
# ---------- S: C# ----------
// Grasshopper Script Instance
//#! csharp
using System;
using System.Collections;
using System.Collections.Generic;
using System.Drawing;

using Rhino;
using Rhino.Geometry;

using Grasshopper;
using Grasshopper.Kernel;
using Grasshopper.Kernel.Data;
using Grasshopper.Kernel.Types;

public class Script_Instance : GH_ScriptInstance /*sdf*/ {
  /* 
    Members:
      RhinoDoc RhinoDocument
      GH_Document GrasshopperDocument
      IGH_Component Component
      int Iteration

    Methods (Virtual & overridable):
      Print(string text)
      Print(string format, params object[] args)
      Reflect(object obj)
      Reflect(object obj, string method_name)
  */
  
  private void RunScript(double x, double y, ref object a)
  {

    double result = a + b;
    
    // Write your logic here
    a = null;
  }

  #region Display
  public override BoundingBox ClippingBox => BoundingBox.Empty;

  public override void DrawViewportMeshes(IGH_PreviewArgs args)
  {
    // Draw meshes
  }

  public override void DrawViewportWires(IGH_PreviewArgs args)
  {
    // Draw wires
  }
  #endregion
}
# ---------- end S ----------
