# Grasshopper definition test_csharp_scriptinstance_component_diagnose_rc8.7.ghx (Grasshopper 1.0.8)
# plug-ins: RhinoCodePluginGH

c_script = CSharpScript()  # -> script, a
#   port script: Script being executed
# ---------- c_script: C# ----------
#region Usings
using System;
using System.Linq;
using System.Collections;
using System.Collections.Generic;
using System.Drawing;

using Rhino;
using Rhino.Geometry;

using Grasshopper;
using Grasshopper.Kernel;
using Grasshopper.Kernel.Data;
using Grasshopper.Kernel.Types;
#endregion

public class Script_Instance : GH_ScriptInstance
{
    private void RunScript(ref object a)
    {
        // Write your logic here
        a = null;
        this.Component.AddRuntimeMessage(GH_RuntimeMessageLevel.Warning, "Test Warning Message");
    }
}
# ---------- end c_script ----------

# ---- group: NO DIAGS EXPECTED
python = GhPythonScript(script=c_script.script, WARN=Toggle(True), INFO=Toggle(True), HINT=Toggle(True))  # -> diags; inputs WARN: Boolean, INFO: Boolean, HINT: Boolean
# ---------- python: Python ----------
import clr
clr.AddReference('Rhino.Runtime.Code')
from Rhino.Runtime.Code.Languages import DiagnoseOptions

code = script.CreateCode()

opts = DiagnoseOptions()
opts.Errors = True
opts.Warnings = WARN
opts.Infos = INFO
opts.Hints = HINT

diags = list(code.Diagnose(opts))
print(diags)
# ---------- end python ----------
lng = ListLength(List=python)

# ----
equals = Equality(FirstNumber=lng, SecondNumber=Slider(0, range=0..100))  # -> Equality, Inequality
panel = Panel(equals.Equality)
context_bake = ContextBake(Content=equals.Equality)
