# Grasshopper definition test_csharp_scriptinstance_runscript_error.ghx (Grasshopper 1.0.8)
# plug-ins: RhinoCodePluginGH

cs = CSharpScript()  # -> a
# ---------- cs: C# ----------
// Grasshopper Script Instance
#region Usings
using System;
using System.Linq;
using System.Collections;
using System.Collections.Generic;
using System.Drawing;

using Rhino;
using Rhino.Geometry;

using Grasshopper;
using Grasshopper.Kernel;
using Grasshopper.Kernel.Data;
using Grasshopper.Kernel.Types;
#endregion

public class Script_Instance : GH_ScriptInstance
{
    #region Notes
    /* 
      Members:
        RhinoDoc RhinoDocument
        GH_Document GrasshopperDocument
        IGH_Component Component
        int Iteration

      Methods (Virtual & overridable):
        Print(string text)
        Print(string format, params object[] args)
        Reflect(object obj)
        Reflect(object obj, string method_name)
    */
    #endregion

    private void RunScript(ref object a)
    {
        a = null;
        throw new Exception("I am an exceptional script");
    }
}
# ---------- end cs ----------
panel = Panel(cs)
