# Grasshopper definition test_csharp_scriptinstance_runtime_error.ghx (Grasshopper 1.0.8)
# plug-ins: RhinoCodePluginGH

num = Number(0.33)
S = Script(x=num)  # -> out, a; inputs x: Double
# ---------- S: C# ----------
// Grasshopper Script Instance
//#! csharp
using System;
using System.Collections;
using System.Collections.Generic;
using System.Drawing;

using Rhino;
using Rhino.Geometry;

using Grasshopper;
using Grasshopper.Kernel;
using Grasshopper.Kernel.Data;
using Grasshopper.Kernel.Types;

public class Script_Instance : GH_ScriptInstance
{
  private void RunScript(double x, ref object a)
  {
    int m = 0;
    double result = 12 / m;
  }
}
# ---------- end S ----------
