# Grasshopper definition test_csharp_this.ghx (Grasshopper 1.0.9)

c_script = CSharpScript()  # -> a
# ---------- c_script: C# ----------
a = __this__.Path;
# ---------- end c_script ----------
panel = Panel(c_script)
tmatch = MatchText(Text=c_script, RegEx="rhinocode:\\\\\\grasshopper\\1\\.+", Case=True)
at = AssertTrue(tmatch)
