# Grasshopper definition test_extract_scripts.ghx (Grasshopper 1.0.8)
# plug-ins: RhinoCodePluginGH

py3 = Python3Script()  # -> out, a
# ---------- py3: Python ----------
print("Python 3 Script")
# ---------- end py3 ----------
c_script = CSharpScript()  # -> out, a
# ---------- c_script: C# ----------
using System;Console.WriteLine("CSharp 9 Script");
# ---------- end c_script ----------
ipy2 = IronPython2Script()  # -> out, a
# ---------- ipy2: IronPython ----------
print("IronPython 2 Script")
# ---------- end ipy2 ----------
python = GhPythonScript()  # -> script, language, languageVersion
# ---------- python: Python ----------
doc = ghenv.Component.OnPingDocument()

scripts = []
languages = []
versions = []

for o in doc.Objects:
    if o is ghenv.Component:
        continue

    if hasattr(o, 'LanguageSpec'):
        scripts.append(o.Text)
        languages.append(o.LanguageSpec.Taxon.Family)
        versions.append(o.LanguageSpec.Version.Major)

    # Legacy Python Components
    elif hasattr(o, 'Code'):
        scripts.append(o.Code)
        languages.append('python-legacy')
        versions.append(2)

    # Legacy CSharp Components
    elif hasattr(o, 'ScriptSource'):
        scripts.append(o.ScriptSource.ScriptCode)
        languages.append('csharp-legacy')
        versions.append(7)

script = scripts
language = languages
languageVersion = versions
# ---------- end python ----------
panel = Panel("""python
csharp
python""")
panel_2 = Panel("""3
9
2""")
panel_3 = Panel(python.language)
panel_4 = Panel(python.script)
panel_5 = Panel(python.languageVersion)
tmatch = MatchText(Text=python.language, RegEx=panel, Case=True)
tmatch_2 = MatchText(Text=python.languageVersion, RegEx=panel_2, Case=True)
panel_6 = Panel(tmatch_2)
panel_7 = Panel(tmatch)
panel_8 = Panel("""print\("Python 3 Script"\)
using System;Console.WriteLine\("CSharp 9 Script"\);
print\("IronPython 2 Script"\)""")
tmatch_3 = MatchText(Text=panel_4, RegEx=panel_8, Case=True)
panel_9 = Panel(tmatch_3)
and = GateAnd(C=tmatch_3, A=tmatch, B=tmatch_2)
context_bake = ContextBake(Content=and)
panel_10 = Panel(and)
