# Grasshopper definition test_ghdoc_available.ghx (Grasshopper 1.0.8)
# plug-ins: RhinoCodePluginGH

panel = Panel("""#! python3
a = ghdoc is None""")
py3 = Python3Script(script=panel)  # -> out, a
#   port script: Script to execute
# ---------- py3: Python ----------
a = ghdoc
# ---------- end py3 ----------
python = GhPythonScript(Code="a = ghdoc is None")  # -> Out, A
panel_2 = Panel(py3.a)
panel_3 = Panel(python.A)
equality = Equality(FirstNumber=py3.a, SecondNumber=python.A)  # -> Equality, Inequality
context_bake = ContextBake(Content=equality.Equality)
panel_4 = Panel(equality.Equality)
