# Grasshopper definition test_ghenv_available.ghx (Grasshopper 1.0.8)
# plug-ins: RhinoCodePluginGH

script = Script()  # -> has_ghenv
# ---------- script: Python ----------
import scriptcontext as sc

has_ghenv = 'ghenv' in globals()
# ---------- end script ----------
script_2 = Script()  # -> has_ghenv; same code as script
and = GateAnd(A=script, B=script_2)
panel = Panel(and)
context_bake = ContextBake(Content=and)
