# Grasshopper definition test_ghenv_sourceParam_getValue.ghx (Grasshopper 1.0.8)
# plug-ins: RhinoCodePluginGH

panel = Panel("""Grasshopper.Kernel.Special.GH_Boolean
True""")
ipy2 = IronPython2Script(T=Toggle(False))  # -> out; inputs T: Boolean
# ---------- ipy2: IronPython ----------
t_input = [i for i in ghenv.Component.Params.Input if i.Name == "T"][0]
t_input_toggle = t_input.Sources[0]
print(t_input_toggle)
print(hasattr(t_input_toggle, "Value"))
# ---------- end ipy2 ----------
py3 = Python3Script(T=Toggle(False))  # -> out; inputs T: Boolean; same code as ipy2
c_script = CSharpScript(T=Toggle(False))  # -> out; inputs T: Boolean
# ---------- c_script: C# ----------
// Grasshopper Script Instance
#region Usings
using System;
using System.Linq;
using System.Collections;
using System.Collections.Generic;
using System.Drawing;

using Rhino;
using Rhino.Geometry;

using Grasshopper;
using Grasshopper.Kernel;
using Grasshopper.Kernel.Data;
using Grasshopper.Kernel.Types;
#endregion

public class Script_Instance : GH_ScriptInstance
{
    #region Notes
    /* 
      Members:
        RhinoDoc RhinoDocument
        GH_Document GrasshopperDocument
        IGH_Component Component
        int Iteration

      Methods (Virtual & overridable):
        Print(string text)
        Print(string format, params object[] args)
        Reflect(object obj)
        Reflect(object obj, string method_name)
    */
    #endregion

    private void RunScript(bool T)
    {
        var tInputParam = Component.Params.Input.Find(p => p.Name == "T");        
        var tInputSource = tInputParam.Sources[0];
        var hasValueProperty = tInputSource.GetType().GetProperty("Value") != null;
        Print(tInputSource.GetType().ToString());
        Print(hasValueProperty.ToString());
    }
}
# ---------- end c_script ----------
panel_2 = Panel(ipy2)
panel_3 = Panel(c_script)
panel_4 = Panel(py3)
match_text = MatchText(Text=c_script, RegEx=panel, Case=True)
match_text_2 = MatchText(Text=ipy2, RegEx=panel, Case=True)
match_text_3 = MatchText(Text=py3, RegEx=panel, Case=True)
assert_true = AssertTrue(match_text)
assert_true_2 = AssertTrue(match_text_2)
assert_true_3 = AssertTrue(match_text_3)
