# Grasshopper definition test_ghparam_script_to_string_rc8.13_rc9.0.ghx (Grasshopper 1.0.8)
# plug-ins: RhinoCodePluginGH

panel = Panel("""#! python 3
import os""")
panel_2 = Panel("""// #! csharp
using System;""")
panel_3 = Panel("""#! python 2
import os""")
S = Script(Script=["code.gh", "code.ghx", "code.py"])  # -> Script, Result
S_2 = Script(Script=[panel, panel_3, panel_2])  # -> Script, Result
panel_4 = Panel(S.Script)
panel_5 = Panel(S_2.Script)
tmatch = MatchText(Text=S_2.Script, RegEx=[panel, panel_3, panel_2], Case=True)
tmatch_2 = MatchText(Text=S.Script, RegEx=["Script \(.+\\code.gh\) - \*\.gh1\.grasshopper\@1\.\*", "\<\?xml.+", panel], Case=True)
at = AssertTrue(tmatch)
at_2 = AssertTrue(tmatch_2)
