# Grasshopper definition test_ghpythonlib.ghx (Grasshopper 1.0.8)
# plug-ins: RhinoCodePluginGH

range = Range(Domain=Domain(0, 1), Steps=10)
ghpython_script = GhPythonScript(l=range)  # -> t, tl; inputs l: list
# ---------- ghpython_script: Python ----------
import scriptcontext as sc
import ghpythonlib as ghlib


ghlib.component.add_warning("(ghpythonlib) Test Component Warning")
ghlib.component.add_remark("(ghpythonlib) Test Component Remark")

# testing list to tree
t = ghlib.treehelpers.list_to_tree(l)

# testing tree to list
tl = ghlib.treehelpers.tree_to_list(t)

# test parallel
def task(i):
    pass


ghlib.parallel.run(task, l)
# ---------- end ghpython_script ----------
rc = RhinoCode(l=range)  # -> t, tl; inputs l: list; same code as ghpython_script
script = Script(l=range)  # -> t, tl; inputs l: list; same code as ghpython_script
lng = ListLength(List=ghpython_script.t)
lng_2 = ListLength(List=ghpython_script.tl)
lng_3 = ListLength(List=rc.t)
lng_4 = ListLength(List=rc.tl)
lng_5 = ListLength(List=script.t)
lng_6 = ListLength(List=script.tl)
equals = Equality(FirstNumber=lng, SecondNumber=lng_3)  # -> Equality, Inequality
equals_2 = Equality(FirstNumber=lng, SecondNumber=lng_5)  # -> Equality, Inequality
equals_3 = Equality(FirstNumber=lng_2, SecondNumber=lng_4)  # -> Equality, Inequality
equals_4 = Equality(FirstNumber=lng_2, SecondNumber=lng_6)  # -> Equality, Inequality
and = GateAnd(A=equals.Equality, B=equals_3.Equality, C=equals_2.Equality, D=equals_4.Equality)
panel = Panel(and)
context_bake = ContextBake(Content=and)
