# Grasshopper definition test_ghpythonlib_components_trimWithBreps.ghx (Grasshopper 1.0.8)
# plug-ins: RhinoCodePluginGH

crv = Curve(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)
brep = Brep(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)
py3 = Python3Script(C=crv, B=brep)  # -> out, inside, outside; inputs C: Curve, B: Brep
# ---------- py3: Python ----------
# Python 3.9
import ghpythonlib.components as ghcomp

result = ghcomp.TrimwithBreps(C, B)
inside = getattr(result, 'inside', None)
outside = getattr(result, 'outside', None)
# ---------- end py3 ----------
ipy2 = IronPython2Script(C=crv, B=brep)  # -> out, inside, outside; inputs C: Curve, B: Brep
# ---------- ipy2: IronPython ----------
# IronPython 2.7
import ghpythonlib.components as ghcomp

result = ghcomp.TrimwithBreps(C, B)
inside = getattr(result, 'inside', None)
outside = getattr(result, 'outside', None)
# ---------- end ipy2 ----------
trim_with_brep = TrimWithBrep(Curve=crv, Brep=brep)  # -> Inside, Outside
curve = Curve(py3.inside)
curve_2 = Curve(ipy2.inside)
curve_3 = Curve(ipy2.outside)
curve_4 = Curve(py3.outside)
curve_5 = Curve(trim_with_brep.Inside)
curve_6 = Curve(trim_with_brep.Outside)

# ---- group: EXPECT NO ERRORS
toggle = BooleanToggle(True)
panel = Panel(toggle)
context_bake = ContextBake(Content=toggle)
