# Grasshopper definition test_ghpythonlib_customEnumerable.ghx (Grasshopper 1.0.8)
# plug-ins: RhinoCodePluginGH

curve = Curve(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)
ghpython_script = GhPythonScript(x=curve)  # -> out, a; inputs x: Curve
# ---------- ghpython_script: Python ----------
import ghpythonlib.components as ghc
a = ghc.ControlPoints(x).points
# ---------- end ghpython_script ----------
ironpython_2_script = IronPython2Script(x=curve)  # -> out, a; inputs x: Curve; same code as ghpython_script
python_3_script = Python3Script(x=curve)  # -> out, a; inputs x: Curve; same code as ghpython_script
pt = Point(ghpython_script.a)
pt_2 = Point(ironpython_2_script.a)
pt_3 = Point(python_3_script.a)
lng = ListLength(List=pt)
lng_2 = ListLength(List=pt_2)
lng_3 = ListLength(List=pt_3)
equals = Equality(FirstNumber=lng, SecondNumber=lng_2)  # -> Equality, Inequality
equals_2 = Equality(FirstNumber=lng, SecondNumber=lng_3)  # -> Equality, Inequality
and = GateAnd(A=equals.Equality, B=equals_2.Equality)
context_bake = ContextBake(Content=and)
