# Grasshopper definition test_ghpythonlib_divideCurve_rc8.8.ghx (Grasshopper 1.0.8)
# plug-ins: RhinoCodePluginGH

arc = Arc(Plane=PlaneXY(0, 0, 0), Radius=1, Angle=Domain(0, 3.141592654))  # -> Arc, Length
crv = Curve(arc.Arc)
divide = DivideCurve(Curve=crv, Count=Slider(10, range=0..10), Kinks=Toggle(False))  # -> Points, Tangents, Parameters
py3 = Python3Script(crv=crv)  # -> points, tangents, parameters
# ---------- py3: Python ----------
import ghpythonlib as ghlib

ghc = ghlib.components

result = ghc.DivideCurve(crv, 10, False)

points = getattr(result, 'points', None)
tangents = getattr(result, 'tangents', None)
parameters = getattr(result, 'parameters', None)
# ---------- end py3 ----------
ipy2 = IronPython2Script(crv=crv)  # -> points, tangents, parameters; same code as py3
equals = Equality(FirstNumber=py3.points, SecondNumber=divide.Points)  # -> Equality, Inequality
equals_2 = Equality(FirstNumber=py3.tangents, SecondNumber=divide.Tangents)  # -> Equality, Inequality
equals_3 = Equality(FirstNumber=py3.parameters, SecondNumber=divide.Parameters)  # -> Equality, Inequality
equals_4 = Equality(FirstNumber=ipy2.points, SecondNumber=divide.Points)  # -> Equality, Inequality
equals_5 = Equality(FirstNumber=ipy2.tangents, SecondNumber=divide.Tangents)  # -> Equality, Inequality
equals_6 = Equality(FirstNumber=ipy2.parameters, SecondNumber=divide.Parameters)  # -> Equality, Inequality
at = AssertTrue(equals.Equality)
at_2 = AssertTrue(equals_2.Equality)
at_3 = AssertTrue(equals_3.Equality)
at_4 = AssertTrue(equals_4.Equality)
at_5 = AssertTrue(equals_5.Equality)
at_6 = AssertTrue(equals_6.Equality)
