# Grasshopper definition test_ghpythonlib_empty_trees.ghx (Grasshopper 1.0.8)
# plug-ins: RhinoCodePluginGH

pp = PythonScript()  # -> graft(tree)
# ---------- pp: Python ----------
import itertools as it
import Grasshopper as gh

import ghpythonlib.treehelpers as th

tree = th.list_to_tree([None, None, None])
# ---------- end pp ----------
script = Script()  # -> graft(tree); same code as pp
pp_2 = PythonScript(inobj=pp)  # -> outobj; inputs inobj: list of String
# ---------- pp_2: Python ----------
import itertools as it
import Grasshopper as gh

import ghpythonlib.treehelpers as th


outobj = inobj
# ---------- end pp_2 ----------
script_2 = Script(inobj=script)  # -> outobj; same code as pp
panel = Panel(script)
panel_2 = Panel(pp_2)
panel_3 = Panel(script_2)
panel_4 = Panel(pp)
python = GhPythonScript(checks=flatten([pp_2, script_2]))  # -> all_true; inputs checks: list
# ---------- python: Python ----------
all_true = all([x is None for x in checks])
# ---------- end python ----------
python_2 = GhPythonScript(checks=flatten([pp, script]))  # -> all_true; inputs checks: list; same code as python
and = GateAnd(B=python_2, C=python)
panel_5 = Panel(and)
context_bake = ContextBake(Content=and)
