# Grasshopper definition test_ghpythonlib_nodeincode_addition.ghx (Grasshopper 1.0.8)
# plug-ins: RhinoCodePluginGH

number_slider = Slider(12, range=0..100)
script = Script(x=number_slider, y=number_slider)  # -> a
# ---------- script: Python ----------
#! python 3
import ghpythonlib.components as ghcomp
a = ghcomp.Addition(x, y)
# ---------- end script ----------
script_2 = Script(x=number_slider, y=number_slider)  # -> a
# ---------- script_2: Python ----------
#! python 2
import ghpythonlib.components as ghcomp
a = ghcomp.Addition(x, y)
# ---------- end script_2 ----------
ghpython_script = GhPythonScript(x=number_slider, y=number_slider)  # -> a; same code as script_2
equals = Equality(FirstNumber=script, SecondNumber=ghpython_script)  # -> Equality, Inequality
equals_2 = Equality(FirstNumber=script_2, SecondNumber=ghpython_script)  # -> Equality, Inequality
and = GateAnd(A=equals.Equality, B=equals_2.Equality)
panel = Panel(and)
context_bake = ContextBake(Content=and)
