# Grasshopper definition test_ghpythonlib_nodeincode_angle_vs_angle_rc8.21.ghx (Grasshopper 1.0.8)

python_3_script = Python3Script()  # -> a
# ---------- python_3_script: Python ----------
import ghpythonlib.components as ghc

gh_angle = ghc.Angle.__doc__
kg_angle = ghc.Kangaroo2Component.Angle.__doc__

a = gh_angle != kg_angle
# ---------- end python_3_script ----------
assert_true = AssertTrue(python_3_script)
