# Grasshopper definition test_ghpythonlib_nodeincode_curvexcurve_rc8.14.ghx (Grasshopper 1.0.8)
# plug-ins: RhinoCodePluginGH

curve = Curve(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)
curve_2 = Curve(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)
curve_curve = CurveCurve(CurveA=curve, CurveB=curve_2)  # -> Points, ParamsA, ParamsB
ironpython_2_script = IronPython2Script(x=curve, y=curve_2)  # -> points, params_a, params_b; inputs x: Curve, y: Curve
# ---------- ironpython_2_script: IronPython ----------
import ghpythonlib.components as comps
import ghpythonlib.treehelpers as TH

res = comps.CurveXCurve(x, y)

points = res.points
params_a = res.params_a
params_b = res.params_b
# ---------- end ironpython_2_script ----------
ironpython_2_script_2 = IronPython2Script(x=curve, y=curve_2)  # -> points, params_a, params_b; inputs x: Curve, y: Curve
# ---------- ironpython_2_script_2: IronPython ----------
import ghpythonlib.components as comps
import ghpythonlib.treehelpers as TH

points, params_a, params_b = comps.CurveXCurve(x, y)
# ---------- end ironpython_2_script_2 ----------
python_3_script = Python3Script(x=curve, y=curve_2)  # -> points, params_a, params_b; inputs x: Curve, y: Curve; same code as ironpython_2_script
python_3_script_2 = Python3Script(x=curve, y=curve_2)  # -> points, params_a, params_b; inputs x: Curve, y: Curve; same code as ironpython_2_script_2
equality = Equality(FirstNumber=ironpython_2_script.points, SecondNumber=curve_curve.Points)  # -> Equality, Inequality
equality_2 = Equality(FirstNumber=ironpython_2_script.params_a, SecondNumber=curve_curve.ParamsA)  # -> Equality, Inequality
equality_3 = Equality(FirstNumber=ironpython_2_script.params_b, SecondNumber=curve_curve.ParamsB)  # -> Equality, Inequality
equality_4 = Equality(FirstNumber=ironpython_2_script_2.points, SecondNumber=curve_curve.Points)  # -> Equality, Inequality
equality_5 = Equality(FirstNumber=ironpython_2_script_2.params_a, SecondNumber=curve_curve.ParamsA)  # -> Equality, Inequality
equality_6 = Equality(FirstNumber=ironpython_2_script_2.params_b, SecondNumber=curve_curve.ParamsB)  # -> Equality, Inequality
equality_7 = Equality(FirstNumber=python_3_script.points, SecondNumber=curve_curve.Points)  # -> Equality, Inequality
equality_8 = Equality(FirstNumber=python_3_script.params_a, SecondNumber=curve_curve.ParamsA)  # -> Equality, Inequality
equality_9 = Equality(FirstNumber=python_3_script.params_b, SecondNumber=curve_curve.ParamsB)  # -> Equality, Inequality
equality_10 = Equality(FirstNumber=python_3_script_2.points, SecondNumber=curve_curve.Points)  # -> Equality, Inequality
equality_11 = Equality(FirstNumber=python_3_script_2.params_a, SecondNumber=curve_curve.ParamsA)  # -> Equality, Inequality
equality_12 = Equality(FirstNumber=python_3_script_2.params_b, SecondNumber=curve_curve.ParamsB)  # -> Equality, Inequality
assert_true = AssertTrue([equality.Equality, equality_2.Equality, equality_3.Equality])
assert_true_2 = AssertTrue([equality_7.Equality, equality_8.Equality, equality_9.Equality])
assert_true_3 = AssertTrue([equality_4.Equality, equality_5.Equality, equality_6.Equality])
assert_true_4 = AssertTrue([equality_10.Equality, equality_11.Equality, equality_12.Equality])

# ---- group: Py3 Iter returns values
python_3_script_3 = Python3Script(x=curve, y=curve_2)  # -> items; inputs x: Curve, y: Curve
# ---------- python_3_script_3: Python ----------
import ghpythonlib.components as comps
import ghpythonlib.treehelpers as TH

res = comps.CurveXCurve(x, y)
items = list(iter(res))
# ---------- end python_3_script_3 ----------
match_text = MatchText(Text=python_3_script_3, RegEx="System\.Collections\.Generic\.List`1\[System\.Object\]", Case=True)
assert_true_5 = AssertTrue(match_text)

# ---- group: IPY Iter returns keys
ironpython_2_script_3 = IronPython2Script(x=curve, y=curve_2)  # -> items; inputs x: Curve, y: Curve; same code as python_3_script_3
panel = Panel("""points
params_a
params_b""")
match_text_2 = MatchText(Text=ironpython_2_script_3, RegEx=panel, Case=True)
assert_true_6 = AssertTrue(match_text_2)
