# Grasshopper definition test_ghpythonlib_nodeincode_ipy_lists.ghx (Grasshopper 1.0.8)
# plug-ins: RhinoCodePluginGH

arc = Arc(Plane=PlaneXY(0, 0, 0), Radius=1, Angle=Domain(0, 3.141592654))  # -> Arc, Length
crv = Curve(arc.Arc)

# ---- group: NodeInCode Module returns IronPython lists
py3 = Python3Script(crv=crv)  # -> out
# ---------- py3: Python ----------
import ghpythonlib as ghlib

ghc = ghlib.components
result = ghc.DivideCurve(crv, 10, False)
print(result['points'])
print(result['parameters'])
print(result['tangents'])
# ---------- end py3 ----------
panel = Panel(py3)
tmatch = MatchText(Text=py3, RegEx="IronPython.Runtime.List", Case=True)
at = AssertTrue(tmatch)

# ----
divide = DivideCurve(Curve=crv, Count=Slider(10, range=0..10), Kinks=Toggle(False))  # -> Points, Tangents, Parameters
