# Grasshopper definition test_ghpythonlib_nodeincode_kangaroo_py2_rc8.18.ghx (Grasshopper 1.0.8)

# https://mcneel.myjetbrains.com/youtrack/issue/RH-85999
msphere = MeshSphere(Base=PlaneXY(0, 0, 0), Radius=10, UCount=10, VCount=20)
ipy2 = IronPython2Script(mesh=msphere)  # -> isMesh
# ---------- ipy2: IronPython ----------
from Rhino.Geometry import Mesh
from Rhino.NodeInCode import Components
m, d, c = Components.NodeInCodeFunctions.Kangaroo2Component_TriRemesh(mesh, None, None, None, 1, 25)
isMesh = m and isinstance(m[0], Mesh)
# ---------- end ipy2 ----------
ipy2_2 = IronPython2Script(mesh=msphere)  # -> isMesh
# ---------- ipy2_2: IronPython ----------
from Rhino.Geometry import Mesh
from Rhino.NodeInCode import Components
m, d, c = Components.NodeInCodeFunctions.TriRemesh(mesh, None, None, None, 1, 25)
isMesh = m and isinstance(m[0], Mesh)
# ---------- end ipy2_2 ----------
ipy2_3 = IronPython2Script(mesh=msphere)  # -> isMesh
# ---------- ipy2_3: IronPython ----------
from Rhino.Geometry import Mesh
import ghpythonlib.components as ghcomp
m, d, c = ghcomp.Kangaroo2Component.TriRemesh(mesh, None, None, None, 1, 25)
isMesh = isinstance(m, Mesh)
# ---------- end ipy2_3 ----------
ipy2_4 = IronPython2Script(mesh=msphere)  # -> isMesh
# ---------- ipy2_4: IronPython ----------
from Rhino.Geometry import Mesh
import ghpythonlib.components as ghcomp
m, d, c = ghcomp.TriRemesh(mesh, None, None, None, 1, 25)
isMesh = isinstance(m, Mesh)
# ---------- end ipy2_4 ----------
at = AssertTrue(ipy2)
at_2 = AssertTrue(ipy2_2)
at_3 = AssertTrue(ipy2_3)
at_4 = AssertTrue(ipy2_4)
