# Grasshopper definition test_ghpythonlib_nodeincode_kangaroo_py3_rc8.18.ghx (Grasshopper 1.0.8)

# https://mcneel.myjetbrains.com/youtrack/issue/RH-85999
msphere = MeshSphere(Base=PlaneXY(0, 0, 0), Radius=10, UCount=10, VCount=20)

# ---- group: See RH-85966
py3 = Python3Script(mesh=msphere)  # -> isMesh; disabled
# ---------- py3: Python ----------
from Rhino.Geometry import Mesh
from Rhino.NodeInCode import Components
m, d, c = Components.NodeInCodeFunctions.Kangaroo2Component_TriRemesh(mesh, None, None, None, 1, 25)
isMesh = m and isinstance(m[0], Mesh)
# ---------- end py3 ----------
py3_2 = Python3Script(mesh=msphere)  # -> isMesh; disabled
# ---------- py3_2: Python ----------
from Rhino.Geometry import Mesh
from Rhino.NodeInCode import Components
m, d, c = Components.NodeInCodeFunctions.TriRemesh(mesh, None, None, None, 1, 25)
isMesh = m and isinstance(m[0], Mesh)
# ---------- end py3_2 ----------

# ----
py3_3 = Python3Script(mesh=msphere)  # -> isMesh
# ---------- py3_3: Python ----------
from Rhino.Geometry import Mesh
import ghpythonlib.components as ghcomp
m, d, c = ghcomp.Kangaroo2Component.TriRemesh(mesh, None, None, None, 1, 25)
isMesh = isinstance(m, Mesh)
# ---------- end py3_3 ----------
py3_4 = Python3Script(mesh=msphere)  # -> isMesh
# ---------- py3_4: Python ----------
from Rhino.Geometry import Mesh
import ghpythonlib.components as ghcomp
m, d, c = ghcomp.TriRemesh(mesh, None, None, None, 1, 25)
isMesh = isinstance(m, Mesh)
# ---------- end py3_4 ----------
at = AssertTrue(py3)  # disabled
at_2 = AssertTrue(py3_2)  # disabled
at_3 = AssertTrue(py3_3)
at_4 = AssertTrue(py3_4)
