# Grasshopper definition test_ghpythonlib_nodeincode_project_2inputs_rc8.20.ghx (Grasshopper 1.0.9)

pt = Point(Point(-0.4241800697, 0, 3.488929792))
sph = Sphere(Base=pt, Radius=1)
pln = Plane(Plane(origin=(0.9429066112, -0.1885813222, 0), x=(0.7906308747, -0.6122930834, 0), y=(0.6122930834, 0.7906308747, 0)))
project = Project(Geometry=sph, Plane=pln)  # -> Geometry, Transform
script = Script(G=sph, P=pln)  # -> a; inputs G: GeometryBase, P: Plane
# ---------- script: Python ----------
#! python 3
import ghpythonlib.components as ghcomp
a, _ = ghcomp.Project(G, P)
print(a)
# ---------- end script ----------
script_2 = Script(G=sph, P=pln)  # -> a; inputs G: GeometryBase, P: Plane
# ---------- script_2: Python ----------
import ghpythonlib.components as ghcomp
a, _ = ghcomp.Project(G, P)
# ---------- end script_2 ----------
ghpython_script = GhPythonScript(G=sph, P=pln)  # -> a; inputs G: GeometryBase, P: Plane; same code as script_2
python = GhPythonScript(x=project.Geometry)  # -> out
# ---------- python: Python ----------
print(type(x))
# ---------- end python ----------
panel = Panel(script)
panel_2 = Panel(ghpython_script)
panel_3 = Panel(script_2)
panel_4 = Panel(python)
# https://mcneel.slack.com/archives/C0DNZ1L8Y/p1751570073171089
panel_5 = Panel("^Invalid Surface$")
tmatch = MatchText(Text=[panel, panel_3, panel_2], RegEx=panel_5, Case=True)
at = AssertTrue(tmatch)
