# Grasshopper definition test_ghpythonlib_nodeincode_project_3inputs_rc8.18.ghx (Grasshopper 1.0.8)

ln = Line(StartPoint=Point(-10.91183294, -27.50895138, 0), EndPoint=Point(16.96234533, 8.992190687, 0))
planesrf = PlaneSurface(Plane=PlaneXY(0, 0, 0), XSize=Domain(-10, 10), YSize=Domain(-10, 10))
Z = UnitZ(Factor=1)
project = Project(Curve=ln, Brep=planesrf, Direction=Z)
script = Script(C=ln, B=planesrf, D=Z)  # -> a; inputs C: Curve, B: Brep, D: Vector3d
# ---------- script: Python ----------
#! python 3
import ghpythonlib.components as ghcomp
a = ghcomp.ProjectCurve(C, B, D)
# ---------- end script ----------
script_2 = Script(C=ln, B=planesrf, D=Z)  # -> a; inputs C: Curve, B: Brep, D: Vector3d
# ---------- script_2: Python ----------
import ghpythonlib.components as ghcomp
a = ghcomp.ProjectCurve(C, B, D)
# ---------- end script_2 ----------
ghpython_script = GhPythonScript(C=ln, B=planesrf, D=Z)  # -> a; inputs C: Curve, B: Brep, D: Vector3d; same code as script_2
panel = Panel(project)
panel_2 = Panel(script)
panel_3 = Panel(ghpython_script)
panel_4 = Panel(script_2)
tmatch = MatchText(Text=[panel_2, panel_4, panel_3, panel], RegEx="^Line-like Curve$", Case=True)
at = AssertTrue(tmatch)
