# Grasshopper definition test_ghpythonlib_nodeincode_repr_rc8.9.ghx (Grasshopper 1.0.8)
# plug-ins: RhinoCodePluginGH

arc = Arc(Plane=PlaneXY(0, 0, 0), Radius=1, Angle=Domain(0, 3.141592654))  # -> Arc, Length
panel = Panel("""\{.+\}
'parameters':
'points':
'tangents':""")
panel_2 = Panel("""\{.+\}
'parameters':
'points':
'tangents':""")
crv = Curve(arc.Arc)
divide = DivideCurve(Curve=crv, Count=Slider(10, range=0..10), Kinks=Toggle(False))  # -> Points, Tangents, Parameters
py3 = Python3Script(crv=crv)  # -> out
# ---------- py3: Python ----------
import ghpythonlib as ghlib

ghc = ghlib.components
result = ghc.DivideCurve(crv, 10, False)
print(result)
# ---------- end py3 ----------
ipy2 = IronPython2Script(crv=crv)  # -> out; same code as py3
panel_3 = Panel(py3)
panel_4 = Panel(ipy2)
tmatch = MatchText(Text=py3, RegEx=panel, Case=True)
tmatch_2 = MatchText(Text=ipy2, RegEx=panel_2, Case=True)
at = AssertTrue(tmatch)
at_2 = AssertTrue(tmatch_2)
