# Grasshopper definition test_ghpythonlib_str_to_trees.ghx (Grasshopper 1.0.8)
# plug-ins: RhinoCodePluginGH

panel = Panel("""CAT
DOG
TREE""")
script = Script(Objects=panel)  # -> tree; inputs Objects: list of String
# ---------- script: Python ----------
import itertools as it
import Grasshopper as gh

import ghpythonlib.treehelpers as th


# Generate permutations allowing 1,2 and 3 elements, using a loop and the permutations function
permutations = []
#for i in range(len(Objects)):
for i in range(2, 3):
    pSet = it.permutations(Objects,i+1)
    permutations.extend(pSet)

tree = th.list_to_tree(permutations)
# ---------- end script ----------
pp = PythonScript(Objects=panel)  # -> tree; inputs Objects: list of String; same code as script
python = PythonScript(Objects=panel)  # -> tree; inputs Objects: list; same code as script
script_2 = Script(Objects=panel)  # -> tree; same code as script
python_2 = PythonScript(Objects=panel)  # -> tree; same code as script
pp_2 = PythonScript(Objects=panel)  # -> tree; inputs Objects: String; same code as script
tmatch = MatchText(Text=python, Pattern=pp, Case=True)
tmatch_2 = MatchText(Text=python, Pattern=script, Case=True)
tmatch_3 = MatchText(Text=python_2, Pattern=pp_2, Case=True)
tmatch_4 = MatchText(Text=python_2, Pattern=script_2, Case=True)
python_3 = GhPythonScript(checks=flatten([tmatch_2, tmatch_4, tmatch, tmatch_3]))  # -> all_true; inputs checks: list
# ---------- python_3: Python ----------
all_true = all(checks)
# ---------- end python_3 ----------
context_bake = ContextBake(Content=python_3)
panel_2 = Panel(python_3)
