# Grasshopper definition test_ghpythonlib_tree_to_list_mixed.ghx (Grasshopper 1.0.8)
# plug-ins: RhinoCodePluginGH

pop2d = Populate2D(Region={Plane=PlaneXY(0, 0, 0), Size=Domain2(u=0..20, v=0..10)}, Count=100, Seed=1)
sift = SiftPattern(List=pop2d, SiftPattern=[0, 0, 1, 1])  # -> Output0, simplify(graft(Output1))
pt = Point(sift.Output1)
panel = Panel(pt)
python = GhPythonScript(x=pt)  # -> a; inputs x: tree
# ---------- python: Python ----------
import ghpythonlib.treehelpers as th

a = th.tree_to_list(x)
# ---------- end python ----------
S = Script(x=pt)  # -> a; inputs x: tree; same code as python
ipy2 = IronPython2Script(x=pt)  # -> a; inputs x: tree; same code as python
lng = ListLength(List=S)
lng_2 = ListLength(List=ipy2)
lng_3 = ListLength(List=python)
equals = Equality(FirstNumber=lng, SecondNumber=lng_3)  # -> Equality, Inequality
equals_2 = Equality(FirstNumber=lng_2, SecondNumber=lng_3)  # -> Equality, Inequality
and = GateAnd(A=equals.Equality, B=equals_2.Equality)
panel_2 = Panel(and)
context_bake = ContextBake(Content=and)
