# Grasshopper definition test_ghpythonlib_warning.ghx (Grasshopper 1.0.8)
# plug-ins: RhinoCodePluginGH

arc = Arc(Plane=PlaneXY(0, 0, 0), Radius=1, Angle=Domain(0, 3.141592654))  # -> Arc, Length
crv = Curve(arc.Arc)
py3 = Python3Script(crv=crv)  # -> a
# ---------- py3: Python ----------
import ghpythonlib as ghlib

ghc = ghlib.components

a = ghc.DivideCurve(crv, 10, False)
# ---------- end py3 ----------
ipy2 = IronPython2Script(crv=crv)  # -> a; same code as py3
