# Grasshopper definition test_ghscript.ghx (Grasshopper 1.0.8)
# plug-ins: RhinoCodePluginGH

number_slider = Slider(10, range=0..10)
inputa = Slider(64, range=0..100)
inputb = Slider(37, range=0..100)
panel = Panel("https://github.com/mcneel/rhinocodetests/raw/main/files/gh1/test_self.gh")
txt = Text(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)
txt_2 = Text("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")
S = Script(Script="code_skip.gh", Input=graft([inputa, inputb]))  # -> Out, Result
S_2 = Script(Script="code_skip.gh")  # -> Out, Result
S_3 = Script(Script=txt, Input=graft([inputa, inputb]))  # -> Out, Result
S_4 = Script(Script=panel, Input=graft([inputa, inputb]))  # -> Out, Result
S_5 = Script(Script=txt_2, Input=graft([inputa, inputb]))  # -> Out, Result
multiplication = Multiplication(A=number_slider, B=[inputa, inputb])
equals = Equality(FirstNumber=multiplication, SecondNumber=S.Result)  # -> Equality, Inequality
equals_2 = Equality(FirstNumber=number_slider, SecondNumber=S_2.Result)  # -> Equality, Inequality
equals_3 = Equality(FirstNumber=multiplication, SecondNumber=S_3.Result)  # -> Equality, Inequality
equals_4 = Equality(FirstNumber=multiplication, SecondNumber=S_5.Result)  # -> Equality, Inequality
python = GhPythonScript(checks=flatten([equals.Equality, equals_2.Equality, equals_3.Equality, equals_4.Equality]))  # -> all_true; inputs checks: list
# ---------- python: Python ----------
all_true = all(checks)
# ---------- end python ----------
context_bake = ContextBake(Content=python)
panel_2 = Panel(python)
