# Grasshopper definition test_ghscript_constraints.ghx (Grasshopper 1.0.8)
# plug-ins: RhinoCodePluginGH

number_slider = Slider(0.4, range=0..1)
panel = Panel("ghscript_constraints.gh")
plane = Plane(Plane(origin=(-39.75533023, -99.24674507, 0), x=(0.9625761388, 0.2710113966, 0), y=(-0.2485338361, 0.8827405168, 0.3987481815)))
srf = Surface(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)
graft_tree = GraftTree(Tree=number_slider, IncludeEmptyLists=True, IncludeNullItems=True)
S = Script(Script=panel, InputSurface=plane, InputNum=number_slider)  # -> Out, Result
S_2 = Script(Script=panel, InputSrf=simplify(srf), InputSurface=plane, InputNum=graft_tree)  # -> Out, Result
S_3 = Script(Script=panel)  # -> Out, Result
panel_2 = Panel(S.Result)
panel_3 = Panel(S_2.Result)
list_length = ListLength(List=S.Result)
list_length_2 = ListLength(List=S_2.Result)
pt = Point([Point(6.86, 2.22, 0), Point(6.86, 2.22, 0)])
equality = Equality(FirstNumber=list_length, SecondNumber=1)  # -> Equality, Inequality
equality_2 = Equality(FirstNumber=list_length_2, SecondNumber=2)  # -> Equality, Inequality
int = Integer(pt)
int_2 = Integer(S_3.Result)
panel_4 = Panel(S_3.Result)
panel_5 = Panel(pt)
equals = Equality(FirstNumber=int, SecondNumber=int_2)  # -> Equality, Inequality
construct_path = ConstructPath(Indices=[0, 0])
tree_branch = TreeBranch(Tree=S_2.Result, Path=construct_path, MaintainPaths=True)
panel_6 = Panel(tree_branch)
python = GhPythonScript(checks=flatten([equality.Equality, equals.Equality, equality_2.Equality]))  # -> all_true; inputs checks: list
# ---------- python: Python ----------
all_true = all(checks)
# ---------- end python ----------
panel_7 = Panel(python)
context_bake = ContextBake(Content=python)
