# Grasshopper definition test_ghscript_constraints_error.ghx (Grasshopper 1.0.8)
# plug-ins: RhinoCodePluginGH

panel = Panel("ghscript_constraints.gh")
unit_z = UnitZ(Factor=1)
circle = Circle(Plane=PlaneXY(0, 0, 0), Radius=1)
extrude = Extrude(Base=circle, Direction=unit_z)
point = Point(Point(-22.49664289, -23.49928401, 0))
extrusion = Extrusion(extrude)

# ---- group: ERROR: INPUT IS INVALID
S = Script(Script=panel, InputSurface=point)  # -> Out, Result

# ---- group: EXTRUSION NOT ACCEPTED
S_2 = Script(Script=panel, InputSrf=simplify(extrusion))  # -> Out, Result
