# Grasshopper definition test_ghscript_embedded.ghx (Grasshopper 1.0.8)
# plug-ins: RhinoCodePluginGH

inputa = Slider(64, range=0..100)
inputb = Slider(37, range=0..100)
txt = Text(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)
txt_2 = Text("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")
S = Script(Script=txt, Input=graft([inputa, inputb]))  # -> Out, Result
S_2 = Script(Script=txt_2, Input=graft([inputa, inputb]))  # -> Out, Result
multiplication = Multiplication(A=Slider(10, range=0..10), B=[inputa, inputb])
equals = Equality(FirstNumber=multiplication, SecondNumber=S_2.Result)  # -> Equality, Inequality
equals_2 = Equality(FirstNumber=multiplication, SecondNumber=S.Result)  # -> Equality, Inequality
python = GhPythonScript(checks=flatten([equals_2.Equality, equals.Equality]))  # -> all_true; inputs checks: list
# ---------- python: Python ----------
all_true = all(checks)
# ---------- end python ----------
context_bake = ContextBake(Content=python)
panel = Panel(python)
