# Grasshopper definition test_ghscript_xref_rc8.7.ghx (Grasshopper 1.0.8)
# plug-ins: RhinoCodePluginGH

number_slider = Slider(10, range=0..10)
inputa = Slider(64, range=0..100)
inputb = Slider(37, range=0..100)
S = Script(Script="code_skip.gh", Input=graft([inputa, inputb]))  # -> Out, Result
S_2 = Script(Script="code_skip.gh")  # -> Out, Result
multiplication = Multiplication(A=number_slider, B=[inputa, inputb])
equals = Equality(FirstNumber=multiplication, SecondNumber=S.Result)  # -> Equality, Inequality
equals_2 = Equality(FirstNumber=number_slider, SecondNumber=S_2.Result)  # -> Equality, Inequality
python = GhPythonScript(checks=flatten([equals.Equality, equals_2.Equality]))  # -> all_true; inputs checks: list
# ---------- python: Python ----------
all_true = all(checks)
# ---------- end python ----------
context_bake = ContextBake(Content=python)
panel = Panel(python)
