# Grasshopper definition test_ghscript_xref_remote.ghx (Grasshopper 1.0.9)

panel = Panel("https://github.com/mcneel/rhinocodetests/raw/main/files/gh1/test_self.gh")
python = GhPythonScript(p=panel)  # -> fixed
# ---------- python: Python ----------
import Rhino

v = Rhino.RhinoApp.Version
rh_8_20_and_above = v.Major == 8 and v.Minor >= 20
rh_9_and_above = v.Major >= 9

if rh_8_20_and_above or rh_9_and_above:
    fixed = p.replace("main", "rhino-{0}.x").format(Rhino.RhinoApp.Version.Major)
else:
    fixed = p
# ---------- end python ----------
S = Script(Script=python)  # -> Out, Result
python_2 = GhPythonScript(checks=flatten(S.Result))  # -> all_true; inputs checks: list
# ---------- python_2: Python ----------
all_true = all(checks)
# ---------- end python_2 ----------
panel_2 = Panel(python_2)
context_bake = ContextBake(Content=python_2)
