# Grasshopper definition test_hops_python3_rc8.14.ghx (Grasshopper 1.0.8)
# plug-ins: RhinoCodePluginGH, Hops

py3 = Python3Script(p="hops_python3.gh")
hops = Hops(
    _Path=py3,
    Input=Slider(10, range=0..100),
    CacheResultsInMemory=False,
    CacheSolveResults=False,
    RemoteDefinitionLocation="C:\Users\ein\Downloads\hops_python3.gh",
    RemoteSolveVersion=(0, 1, 0),
    ShowInput_Enabled=False,
    ShowInput_Path=True,
    SynchronousSolve=True)
equals = Equality(FirstNumber=hops, SecondNumber=Slider(21, range=0..100))  # -> Equality, Inequality
at = AssertTrue(equals.Equality)
