# Grasshopper definition test_marsh_csharp_componentMarshOptions_rc8.6_rc8.7.ghx (Grasshopper 1.0.8)
# plug-ins: RhinoCodePluginGH

c_script = CSharpScript()  # -> script, out, a
#   port script: Script being executed
# ---------- c_script: C# ----------
// Grasshopper Script Instance
#region Usings
using System;
using System.Linq;
using System.Collections;
using System.Collections.Generic;
using System.Drawing;

using Rhino;
using Rhino.Geometry;

using Grasshopper;
using Grasshopper.Kernel;
using Grasshopper.Kernel.Data;
using Grasshopper.Kernel.Types;
#endregion

public class Script_Instance : GH_ScriptInstance
{
    #region Notes
    /* 
      Members:
        RhinoDoc RhinoDocument
        GH_Document GrasshopperDocument
        IGH_Component Component
        int Iteration

      Methods (Virtual & overridable):
        Print(string text)
        Print(string format, params object[] args)
        Reflect(object obj)
        Reflect(object obj, string method_name)
    */
    #endregion

    private void RunScript(object x, object y, ref object a)
    {
        // Write your logic here
        a = null;
    }
}
# ---------- end c_script ----------
c_script_2 = CSharpScript()  # -> script, out, a; same code as c_script
c_script_3 = CSharpScript()  # -> script, out, a; same code as c_script
script_source_deconstruct = ScriptSourceDeconstruct(ScriptSource=c_script.script)  # -> Id, LanguageId, Title, Text, Signature, Uri, EnvironId, Inputs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
script_source_deconstruct_2 = ScriptSourceDeconstruct(ScriptSource=c_script_2.script)  # -> Id, LanguageId, Title, Text, Signature, Uri, EnvironId, Inputs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
script_source_deconstruct_3 = ScriptSourceDeconstruct(ScriptSource=c_script_3.script)  # -> Id, LanguageId, Title, Text, Signature, Uri, EnvironId, Inputs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
gate_not = GateNot(A=script_source_deconstruct.MarshallInputs)
gate_not_2 = GateNot(A=script_source_deconstruct_2.MarshallOutputs)
gate_not_3 = GateNot(A=script_source_deconstruct_3.MarshallGuids)
c_script_4 = CSharpScript()  # -> script, out, a; same code as c_script
panel = Panel(gate_not)
panel_2 = Panel(gate_not_2)
panel_3 = Panel(gate_not_3)
script_source_deconstruct_4 = ScriptSourceDeconstruct(ScriptSource=c_script_4.script)  # -> Id, LanguageId, Title, Text, Signature, Uri, EnvironId, Inputs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
panel_4 = Panel(script_source_deconstruct_4.MarshallGuids)
python = GhPythonScript(checks=flatten([gate_not, gate_not_2, gate_not_3, script_source_deconstruct_4.MarshallGuids]))  # -> all_true; inputs checks: list
# ---------- python: Python ----------
all_true = all(checks)
# ---------- end python ----------
panel_5 = Panel(python)
context_bake = ContextBake(Content=python)
