# Grasshopper definition test_marsh_csharp_componentMarshOptions_rc8.8.ghx (Grasshopper 1.0.8)
# plug-ins: RhinoCodePluginGH

c_script = CSharpScript()  # -> script, out, a
#   port script: Script being executed
# ---------- c_script: C# ----------
// Grasshopper Script Instance
#region Usings
using System;
using System.Linq;
using System.Collections;
using System.Collections.Generic;
using System.Drawing;

using Rhino;
using Rhino.Geometry;

using Grasshopper;
using Grasshopper.Kernel;
using Grasshopper.Kernel.Data;
using Grasshopper.Kernel.Types;
#endregion

public class Script_Instance : GH_ScriptInstance
{
    #region Notes
    /* 
      Members:
        RhinoDoc RhinoDocument
        GH_Document GrasshopperDocument
        IGH_Component Component
        int Iteration

      Methods (Virtual & overridable):
        Print(string text)
        Print(string format, params object[] args)
        Reflect(object obj)
        Reflect(object obj, string method_name)
    */
    #endregion

    private void RunScript(object x, object y, ref object a)
    {
        // Write your logic here
        a = null;
    }
}
# ---------- end c_script ----------
c_script_2 = CSharpScript()  # -> script, out, a; same code as c_script
c_script_3 = CSharpScript()  # -> script, out, a; same code as c_script
c_script_4 = CSharpScript()  # -> script, out, a; same code as c_script
ds = ScriptSourceDeconstruct(ScriptSource=c_script_2.script)  # -> Id, LanguageSpec, Title, Text, Signature, Uri, EnvironId, Inputs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
ds_2 = ScriptSourceDeconstruct(ScriptSource=c_script_3.script)  # -> Id, LanguageSpec, Title, Text, Signature, Uri, EnvironId, Inputs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
ds_3 = ScriptSourceDeconstruct(ScriptSource=c_script_4.script)  # -> Id, LanguageSpec, Title, Text, Signature, Uri, EnvironId, Inputs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
ds_4 = ScriptSourceDeconstruct(ScriptSource=c_script.script)  # -> Id, LanguageSpec, Title, Text, Signature, Uri, EnvironId, Inputs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
gate_not = GateNot(A=ds.MarshallInputs)
gate_not_2 = GateNot(A=ds_2.MarshallOutputs)
gate_not_3 = GateNot(A=ds_3.MarshallGuids)
at = AssertTrue(gate_not)
at_2 = AssertTrue(gate_not_2)
at_3 = AssertTrue(gate_not_3)
at_4 = AssertTrue(ds_4.MarshallGuids)
