# Grasshopper definition test_marsh_python3_componentMarshOptions.ghx (Grasshopper 1.0.8)
# plug-ins: RhinoCodePluginGH

python_3_script = Python3Script()  # -> script, out, a; unedited script template
python_3_script_2 = Python3Script()  # -> script, out, a; unedited script template
python_3_script_3 = Python3Script()  # -> script, out, a; unedited script template
script_source_deconstruct = ScriptSourceDeconstruct(ScriptSource=python_3_script.script)  # -> Id, LanguageId, Title, Text, Signature, Uri, EnvironId, Inputs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
script_source_deconstruct_2 = ScriptSourceDeconstruct(ScriptSource=python_3_script_2.script)  # -> Id, LanguageId, Title, Text, Signature, Uri, EnvironId, Inputs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
script_source_deconstruct_3 = ScriptSourceDeconstruct(ScriptSource=python_3_script_3.script)  # -> Id, LanguageId, Title, Text, Signature, Uri, EnvironId, Inputs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
panel = Panel(script_source_deconstruct.MarshallInputs)
panel_2 = Panel(script_source_deconstruct_2.MarshallOutputs)
panel_3 = Panel(script_source_deconstruct_3.MarshallGuids)
python_3_script_4 = Python3Script()  # -> script, out, a; unedited script template
python_3_script_5 = Python3Script()  # -> script, out, a; unedited script template
python_3_script_6 = Python3Script()  # -> script, out, a; unedited script template
script_source_deconstruct_4 = ScriptSourceDeconstruct(ScriptSource=python_3_script_4.script)  # -> Id, LanguageId, Title, Text, Signature, Uri, EnvironId, Inputs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
script_source_deconstruct_5 = ScriptSourceDeconstruct(ScriptSource=python_3_script_5.script)  # -> Id, LanguageId, Title, Text, Signature, Uri, EnvironId, Inputs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
script_source_deconstruct_6 = ScriptSourceDeconstruct(ScriptSource=python_3_script_6.script)  # -> Id, LanguageId, Title, Text, Signature, Uri, EnvironId, Inputs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
gate_not = GateNot(A=script_source_deconstruct_4.MarshallInputs)
gate_not_2 = GateNot(A=script_source_deconstruct_5.MarshallOutputs)
gate_not_3 = GateNot(A=script_source_deconstruct_6.MarshallGuids)
panel_4 = Panel(gate_not)
panel_5 = Panel(gate_not_2)
panel_6 = Panel(gate_not_3)
python = GhPythonScript(checks=flatten([script_source_deconstruct.MarshallInputs, script_source_deconstruct_2.MarshallOutputs, script_source_deconstruct_3.MarshallGuids, gate_not, gate_not_2, gate_not_3]))  # -> all_true; inputs checks: list
# ---------- python: Python ----------
all_true = all(checks)
# ---------- end python ----------
panel_7 = Panel(python)
context_bake = ContextBake(Content=python)
