# Grasshopper definition test_marsh_python3_extractedScript.ghx (Grasshopper 1.0.8)
# plug-ins: RhinoCodePluginGH

# INPUT SCRIPT IS EXTRACTED FROM COMPONENT
# AND SHOULD CARRY SAME MARSH OPTIONS
script = Script(
    {MarshGuids=True, MarshInputs=True, MarshOutputs=True, Text="IiIiR3Jhc3Nob3BwZXIgU2NyaXB0IiIiDQphID0gIkhlbGxvIFB5dGhvbiAzIGluIEdyYXNzaG9wcGVyISINCnByaW50KGEpDQo=", Title="Python 3 Script", Taxon="*.*.python"},
    ExpireOnDiskEvent=False,
    TreatInputAsPath=False,
    SourceLanguageFamilySpec_Taxon="*.*.*",
    SourceLanguageFamilySpec_Version="*.*")
python_3_script = Python3Script(script=script)  # -> script, out, a; unedited script template
script_source_deconstruct = ScriptSourceDeconstruct(ScriptSource=script)  # -> Id, LanguageId, Title, Text, Signature, Uri, EnvironId, Inputs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
python = GhPythonScript(checks=flatten([script_source_deconstruct.MarshallInputs, script_source_deconstruct.MarshallOutputs, script_source_deconstruct.MarshallGuids]))  # -> all_true; inputs checks: list
# ---------- python: Python ----------
all_true = all(checks)
# ---------- end python ----------
panel = Panel(python)
context_bake = ContextBake(Content=python)
