# Grasshopper definition test_nested_scripts_rc8.12.ghx (Grasshopper 1.0.8)
# plug-ins: RhinoCodePluginGH

panel = Panel("""using Rhino.Runtime.Code;
using Rhino.Runtime.Code.Execution;

var ctx = new RunContext {
  AutoApplyParams = true,
  Inputs = {
    ["x"] = 21,
    ["y"] = 21,
  },
  Outputs = {
    ["a"] = 0
  }
};

RhinoCode.RunScript("#! python 3\na = x + y", ctx);

a= ctx.Outputs.Get<int>("a");""")
panel_2 = Panel("""using Rhino.Runtime.Code;
using Rhino.Runtime.Code.Execution;

var ctx = new RunContext {
  AutoApplyParams = true,
  Inputs = {
    ["x"] = 21,
    ["y"] = 21,
  },
  Outputs = {
    ["a"] = 0
  }
};

RhinoCode.RunScript("// #! csharp\na = x + y;", ctx);

a= ctx.Outputs.Get<int>("a");""")
panel_3 = Panel("""using Rhino.Runtime.Code;
using Rhino.Runtime.Code.Execution;

var ctx = new RunContext {
  AutoApplyParams = true,
  Inputs = {
    ["x"] = 21,
    ["y"] = 21,
  },
  Outputs = {
    ["a"] = 0
  }
};

RhinoCode.RunScript("#! python 2\na = x + y", ctx);

a= ctx.Outputs.Get<int>("a");""")
number_slider = Slider(42, range=0..100)

# ---- group: C# Running Python 3
S = Script(script=panel)  # -> out, a
#   port script: Script to execute
# ---------- S: C# ----------
// Grasshopper Script Instance
#region Usings
using System;
using System.Linq;
using System.Collections;
using System.Collections.Generic;
using System.Drawing;

using Rhino;
using Rhino.Geometry;

using Grasshopper;
using Grasshopper.Kernel;
using Grasshopper.Kernel.Data;
using Grasshopper.Kernel.Types;
#endregion

public class Script_Instance : GH_ScriptInstance
{
    #region Notes
    /* 
      Members:
        RhinoDoc RhinoDocument
        GH_Document GrasshopperDocument
        IGH_Component Component
        int Iteration

      Methods (Virtual & overridable):
        Print(string text)
        Print(string format, params object[] args)
        Reflect(object obj)
        Reflect(object obj, string method_name)
    */
    #endregion

    private void RunScript(object x, object y, ref object a)
    {
        // Write your logic here
        a = null;
    }
}
# ---------- end S ----------

# ---- group: C# Running C#
S_2 = Script(script=panel_2)  # -> out, a; same code as S

# ---- group: C# Running Python 2
S_3 = Script(script=panel_3)  # -> out, a; same code as S

# ----
equality = Equality(FirstNumber=number_slider, SecondNumber=S.a)  # -> Equality, Inequality
equality_2 = Equality(FirstNumber=number_slider, SecondNumber=S_3.a)  # -> Equality, Inequality
equality_3 = Equality(FirstNumber=number_slider, SecondNumber=S_2.a)  # -> Equality, Inequality
c_running_python_3 = AssertTrue(equality.Equality)
c_running_python_2 = AssertTrue(equality_2.Equality)
c_running_c = AssertTrue(equality_3.Equality)
