# Grasshopper definition test_package_restore.ghx (Grasshopper 1.0.8)
# plug-ins: RhinoCodePluginGH

rhinocode = RhinoCode()  # -> out, a
# ---------- rhinocode: Python ----------
"""Python 3 with Numpy"""
# requirements: numpy

import numpy as np

# numpy array with random values
a = list(np.random.rand(7))

print(a)
# ---------- end rhinocode ----------
rhinocode_2 = RhinoCode()  # -> out, a
# ---------- rhinocode_2: C# ----------
// Default C# Script with Nuget package

#r "nuget: RestSharp, 106.11.7"

using System;
using System.Collections.Generic;
using Rhino;

using RestSharp;
using RestSharp.Authenticators;

var client = new RestClient("https://httpbin.org");
var request = new RestRequest("get", DataFormat.Json);
var response = client.Get(request);

Console.WriteLine(response.Content);

a = response.Content;
# ---------- end rhinocode_2 ----------
list_length = ListLength(List=rhinocode.a)
match_text = MatchText(Text=rhinocode_2.a, RegEx="\\\"https:\\/\\/httpbin\\.org\\/get\\\"", Case=True)
equality = Equality(FirstNumber=list_length, SecondNumber=Slider(7, range=0..10))  # -> Equality, Inequality
gate_and = GateAnd(A=equality.Equality, B=match_text)
context_bake = ContextBake(Content=gate_and)
panel = Panel(gate_and)
