# Grasshopper definition test_package_restore_csharp_rc8.16_error.ghx (Grasshopper 1.0.8)
# plug-ins: RhinoCodePluginGH

cs = CSharpScript()  # -> a
# ---------- cs: C# ----------
#r "nuget: BIVIZ, 106.11.7"

using System;
using System.Collections.Generic;
using Rhino;

using RestSharp;
using RestSharp.Authenticators;

public class Script_Instance : GH_ScriptInstance
{
  private void RunScript(ref object a)
  {
    var client = new RestClient("https://httpbin.org");
    var request = new RestRequest("get", DataFormat.Json);
    var response = client.Get(request);
    Console.WriteLine(response.Content);
    a = response.Content;
  }
}
# ---------- end cs ----------
