# Grasshopper definition test_package_restore_csharp_rc8.8.ghx (Grasshopper 1.0.8)
# plug-ins: RhinoCodePluginGH

c_script = CSharpScript()  # -> out, a
# ---------- c_script: C# ----------
// Grasshopper Script Instance
#region Usings
using System;
using System.Linq;
using System.Collections;
using System.Collections.Generic;
using System.Drawing;
using System.Net.NetworkInformation;

using Rhino;
using Rhino.Geometry;

using Grasshopper;
using Grasshopper.Kernel;
using Grasshopper.Kernel.Data;
using Grasshopper.Kernel.Types;
#endregion

public class Script_Instance : GH_ScriptInstance
{
    #region Notes
    /* 
      Members:
        RhinoDoc RhinoDocument
        GH_Document GrasshopperDocument
        IGH_Component Component
        int Iteration

      Methods (Virtual & overridable):
        Print(string text)
        Print(string format, params object[] args)
        Reflect(object obj)
        Reflect(object obj, string method_name)
    */
    #endregion

    private void RunScript(object x, object y, ref object a)
    {
        string website = "api.nuget.org"; // Change this to the website you want to ping

        Ping ping = new Ping();
        PingReply reply = ping.Send(website);

        if (reply.Status == IPStatus.Success)
        {
            Console.WriteLine($"Ping to {website} successful.");
            Console.WriteLine($"Roundtrip time: {reply.RoundtripTime} ms");
        }
        else
        {
            Console.WriteLine($"Failed to ping {website}. Error: {reply.Status}");
        }
    }
}
# ---------- end c_script ----------
c_script_2 = CSharpScript()  # -> out, a
# ---------- c_script_2: C# ----------
// Grasshopper Script Instance
#region Usings
#r "nuget: MessagePack, 2.5.140"
#r "nuget: MessagePack.Annotations, 2.5.140"
#r "nuget: System.Runtime.CompilerServices.Unsafe, 6.0.0"
#r "nuget: Microsoft.NET.StringTools, 17.9.5"
using System;
using System.Linq;
using System.Collections;
using System.Collections.Generic;
using System.Drawing;

using Rhino;
using Rhino.Geometry;

using Grasshopper;
using Grasshopper.Kernel;
using Grasshopper.Kernel.Data;
using Grasshopper.Kernel.Types;

using MessagePack;
using System.Net;
using System.Net.Sockets;
#endregion

public class Script_Instance : GH_ScriptInstance
{
    #region Notes
    /* 
      Members:
        RhinoDoc RhinoDocument
        GH_Document GrasshopperDocument
        IGH_Component Component
        int Iteration

      Methods (Virtual & overridable):
        Print(string text)
        Print(string format, params object[] args)
        Reflect(object obj)
        Reflect(object obj, string method_name)
    */
    #endregion

    private void RunScript(object x, object y, ref object a)
    {
        var mc = new MyClass
        {
            Age = 99,
            FirstName = "hoge",
            LastName = "huga",
        };

        // Call Serialize/Deserialize, that's all.
        byte[] bytes = MessagePackSerializer.Serialize(mc);
        MyClass mc2 = MessagePackSerializer.Deserialize<MyClass>(bytes);

        // You can dump MessagePack binary blobs to human readable json.
        // Using indexed keys (as opposed to string keys) will serialize to MessagePack arrays,
        // hence property names are not available.
        // [99,"hoge","huga"]
        var json = MessagePackSerializer.ConvertToJson(bytes);
        Console.WriteLine(json);
    }
}

[MessagePackObject]
public class MyClass
{
    // Key attributes take a serialization index (or string name)
    // The values must be unique and versioning has to be considered as well.
    // Keys are described in later sections in more detail.
    [Key(0)]
    public int Age { get; set; }

    [Key(1)]
    public string FirstName { get; set; }

    [Key(2)]
    public string LastName { get; set; }

    // All fields or properties that should not be serialized must be annotated with [IgnoreMember].
    [IgnoreMember]
    public string FullName { get { return FirstName + LastName; } }
}

public class CustomAttribute: Attribute
{
    public string Name{get;set;}

    public CustomAttribute(string name)
    {
        Name = name;
    }
}

[Custom("Test, attribute, class.")]
public class DemoClass
{
    [Custom("Test, attribute, method.")]
    public void DemoMethod()
    {
        Console.WriteLine("DemoMethod executed.");
    }
}
# ---------- end c_script_2 ----------
c_script_3 = CSharpScript()  # -> out, a
# ---------- c_script_3: C# ----------
// Grasshopper Script (With Nuget Package)
#r "nuget: RestSharp, 106.11.7"

using System;
using System.Linq;
using System.Collections.Generic;
using Rhino;

using RestSharp;
using RestSharp.Authenticators;

var client = new RestClient("https://httpbin.org");
var request = new RestRequest("get", DataFormat.Json);
var response = client.Get(request);

Console.WriteLine(response.Content);

a = response.Content;
# ---------- end c_script_3 ----------
panel = Panel(c_script.out)
panel_2 = Panel(c_script_3.a)
panel_3 = Panel(c_script_2.out)
match_text = MatchText(Text=panel, RegEx="Failed to ping api.nuget.org. Error: TimedOut", Case=True)
match_text_2 = MatchText(Text=panel_3, RegEx="[99,\"hoge\",\"huga\"]", Case=True)
match_text_3 = MatchText(Text=panel_2, RegEx="\"url\": \"https://httpbin.org/get\"", Case=True)
assert_true = AssertTrue(match_text)
assert_true_2 = AssertTrue(match_text_2)
assert_true_3 = AssertTrue(match_text_3)
