# Grasshopper definition test_package_restore_woodNano_rc8.8_skip.ghx (Grasshopper 1.0.8)
# plug-ins: RhinoCodePluginGH

# ---- group: # r: wood-nano
# https://mcneel.myjetbrains.com/youtrack/issue/RH-81913
py3 = Python3Script()  # -> out, a
# ---------- py3: Python ----------
# r: wood-nano

import wood_nano
print(wood_nano)
a = True
# ---------- end py3 ----------
panel = Panel(py3.a)

# ---- group: # r: wood_nano
# Py3 env should match wood_nano to the
# actual package name of wood-nano
py3_2 = Python3Script()  # -> out, a
# ---------- py3_2: Python ----------
# r: wood_nano

import wood_nano
print(wood_nano)
a = True
# ---------- end py3_2 ----------
panel_2 = Panel(py3_2.a)

# ---- group: EXPECT NO ERRORS
toggle = BooleanToggle(True)
panel_3 = Panel(toggle)
context_bake = ContextBake(Content=toggle)
