# Grasshopper definition test_params_access_list.ghx (Grasshopper 1.0.8)
# plug-ins: RhinoCodePluginGH

sph = Sphere(Base=PlaneXY(0, 0, 0), Radius=1)
sph_2 = Sphere(Base=PlaneXY(0, 0, 0), Radius=1)
range = Range(Domain=Domain(0, 1), Steps=10)
merge = Merge(Data1=sph, Data2=sph_2)
panel = Panel("""0
0.1
0.2
0.3
0.4
0.5
0.6
0.7
0.8
0.9
1""")
rc = RhinoCode(x=[merge, range])  # -> out, a; inputs x: list
# ---------- rc: Python ----------
"""Default Python script"""

a = []
print(x)
for m in x:
    a.append(m)
    print(m)
# ---------- end rc ----------
rc_2 = RhinoCode(x=[range, merge])  # -> out, a; inputs x: list
# ---------- rc_2: C# ----------
// Default C# Script Instance
using System;
using System.Collections;
using System.Collections.Generic;
using System.Drawing;

using Rhino;
using Rhino.Geometry;

using Grasshopper;
using Grasshopper.Kernel;
using Grasshopper.Kernel.Data;
using Grasshopper.Kernel.Types;

public class Script_Instance : GH_ScriptInstance
{
  private void RunScript(IList<object> x, ref object a)
  {
    var l = new List<object>();

    if (x is IEnumerable enuminput)
    {
        foreach(var m in enuminput)
            l.Add(m);
    }

    a = l;
  }
}
# ---------- end rc_2 ----------
num = Number(panel)
branch = TreeBranch(Tree=rc.a, Path="{0}", MaintainPaths=True)
branch_2 = TreeBranch(Tree=rc.a, Path="{0;0}", MaintainPaths=True)
branch_3 = TreeBranch(Tree=rc_2.a, Path="{0}", MaintainPaths=True)
branch_4 = TreeBranch(Tree=rc_2.a, Path="{0;0}", MaintainPaths=True)
equals = Equality(FirstNumber=merge, SecondNumber=branch)  # -> Equality, Inequality
equals_2 = Equality(FirstNumber=branch_2, SecondNumber=num)  # -> Equality, Inequality
equals_3 = Equality(FirstNumber=merge, SecondNumber=branch_3)  # -> Equality, Inequality
equals_4 = Equality(FirstNumber=branch_4, SecondNumber=num)  # -> Equality, Inequality
and = GateAnd(A=equals.Equality, B=equals_2.Equality, C=equals_3.Equality, D=equals_4.Equality)
python = GhPythonScript(checks=flatten(and))  # -> all_true; inputs checks: list
# ---------- python: Python ----------
all_true = all(checks)
# ---------- end python ----------
context_bake = ContextBake(Content=python)
panel_2 = Panel(python)
