# Grasshopper definition test_params_access_list_dataType_rc8.8_rc8.8.ghx (Grasshopper 1.0.8)
# plug-ins: RhinoCodePluginGH

c_script = CSharpScript()  # -> script, a; inputs x: list
#   port script: Script being executed
# ---------- c_script: C# ----------
// Grasshopper Script Instance
#region Usings
using System;
using System.Linq;
using System.Collections;
using System.Collections.Generic;
using System.Drawing;

using Rhino;
using Rhino.Geometry;

using Grasshopper;
using Grasshopper.Kernel;
using Grasshopper.Kernel.Data;
using Grasshopper.Kernel.Types;
#endregion

public class Script_Instance : GH_ScriptInstance
{
    #region Notes
    /* 
      Members:
        RhinoDoc RhinoDocument
        GH_Document GrasshopperDocument
        IGH_Component Component
        int Iteration

      Methods (Virtual & overridable):
        Print(string text)
        Print(string format, params object[] args)
        Reflect(object obj)
        Reflect(object obj, string method_name)
    */
    #endregion

    private void RunScript(List<object> x, ref object a)
    {
        // Write your logic here
        a = null;
    }
}
# ---------- end c_script ----------
ds = ScriptSourceDeconstruct(ScriptSource=c_script.script)  # -> Id, LanguageId, Title, Text, Signature, Uri, EnvironId, Inputs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
dsp = ScriptParameterDeconstruct(ScriptInputOutputParameter=ds.Inputs)  # -> Name, PrettyName, Description, Access, Kind, Type
panel = Panel(dsp.Type)
tmatch = MatchText(Text=dsp.Type, RegEx="System.Collections.Generic.List\<object\>", Case=True)
panel_2 = Panel(tmatch)
context_bake = ContextBake(Content=tmatch)
