# Grasshopper definition test_params_access_list_nullItems_rc8.17.ghx (Grasshopper 1.0.8)

txt = Text(Tree({0}: [null], {1}: [null], {2}: ["Apple", "Orange", "Pear"]))
panel = Panel(txt)
txt_2 = Text(Tree({0}: [], {1}: [], {2}: ["Apple", "Orange", "Pear"]))
panel_2 = Panel(txt_2)
python = GhPythonScript(x=txt)  # -> out, a; inputs x: list
# ---------- python: Python ----------
print(x)
a = x
# ---------- end python ----------
python_2 = GhPythonScript(x=txt_2)  # -> out, a; inputs x: list; same code as python
panel_3 = Panel(python.a)
py3 = Python3Script(x=txt)  # -> out, a; inputs x: list; same code as python
panel_4 = Panel(python_2.a)
py3_2 = Python3Script(x=txt_2)  # -> out, a; inputs x: list; same code as python
lng = ListLength(List=python.a)
lng_2 = ListLength(List=py3.a)
panel_5 = Panel(py3.a)
lng_3 = ListLength(List=python_2.a)
lng_4 = ListLength(List=py3_2.a)
panel_6 = Panel(py3_2.a)
equals = Equality(FirstNumber=lng, SecondNumber=lng_2)  # -> Equality, Inequality
equals_2 = Equality(FirstNumber=lng_3, SecondNumber=lng_4)  # -> Equality, Inequality
at = AssertTrue(equals.Equality)
at_2 = AssertTrue(equals_2.Equality)
