# Grasshopper definition test_params_access_list_tree_mesh_rc8.8.ghx (Grasshopper 1.0.8)
# plug-ins: RhinoCodePluginGH

cone = Cone(Base=PlaneXY(0, 0, 0), Radius=0.5, Length=1)  # -> Cone, Tip
cyl = Cylinder(Base=PlaneXY(0, 0, 0), Radius=0.5, Length=1)
sph = Sphere(Base=PlaneXY(0, 0, 0), Radius=1)
srf = Surface([cone.Cone, cyl, sph])
graft = GraftTree(Tree=srf, IncludeEmptyLists=True, IncludeNullItems=True)

# ---- group: List/Tree Accessor with Mesh Cast
# marshing inputs
# not marshing inputs
rc = RhinoCode(x=srf, y=graft)  # -> x_check, y_check; inputs x: list of Mesh, y: tree of Mesh
# ---------- rc: C# ----------
using System;
using System.Collections.Generic;
using Rhino.Geometry;
using Grasshopper.Kernel.Data;

x_check = x is List<Mesh>;
y_check = y is IGH_DataTree;
# ---------- end rc ----------
rc_2 = RhinoCode(x=srf, y=graft)  # -> x_check, y_check; inputs x: list of Mesh, y: tree of Mesh
# ---------- rc_2: Python ----------
from System.Collections.Generic import List
from Rhino.Geometry import Mesh
from Grasshopper.Kernel.Data import IGH_DataTree
x_check = isinstance(x, list)
y_check = isinstance(y, IGH_DataTree)
# ---------- end rc_2 ----------
script = Script(x=srf, y=graft)  # -> x_check, y_check; inputs x: list of Mesh, y: tree of Mesh; same code as rc_2

# ----
rc_3 = RhinoCode(x=srf, y=graft)  # -> x_check, y_check; inputs x: list of Mesh, y: tree of Mesh
# ---------- rc_3: Python ----------
from System.Collections.Generic import List
from Rhino.Geometry import Mesh
from Grasshopper.Kernel.Data import IGH_DataTree
x_check = isinstance(x, List[Mesh])
y_check = isinstance(y, IGH_DataTree)
# ---------- end rc_3 ----------
gate_and = GateAnd(
    A=rc.x_check,
    B=rc.y_check,
    C=rc_2.x_check,
    D=rc_2.y_check,
    E=rc_3.x_check,
    F=rc_3.y_check,
    G=script.x_check,
    H=script.y_check)
panel = Panel(gate_and)
context_bake = ContextBake(Content=gate_and)
