# Grasshopper definition test_params_access_tree.ghx (Grasshopper 1.0.8)
# plug-ins: RhinoCodePluginGH

range = Range(Domain=Domain(0, 1), Steps=10)
python_3_script = Python3Script(x=range)  # -> a; inputs x: tree
# ---------- python_3_script: Python ----------
import ghpythonlib.treehelpers as th
numbers = th.tree_to_list(x)

a = all([isinstance(x, float) for nums in numbers for x in nums])
# ---------- end python_3_script ----------
ipy2 = IronPython2Script(x=range)  # -> a; inputs x: tree; same code as python_3_script
ghpython_script = GhPythonScript(x=range)  # -> a; inputs x: tree; same code as python_3_script
equals = Equality(FirstNumber=python_3_script, SecondNumber=ghpython_script)  # -> Equality, Inequality
equals_2 = Equality(FirstNumber=ipy2, SecondNumber=ghpython_script)  # -> Equality, Inequality
and = GateAnd(A=equals.Equality, B=equals_2.Equality)
context_bake = ContextBake(Content=and)
panel = Panel(and)
