# Grasshopper definition test_params_access_tree_advanced.ghx (Grasshopper 1.0.8)
# plug-ins: RhinoCodePluginGH

# ---- group: A
data = Data([{Plane=Plane(origin=(17.9044864, 35.66569168, 1), x=(-1, 0, 0), y=(0, -1, 0)), X=Domain(-1, 1), Y=Domain(-2, 2), Z=Domain(0, 6)}, {Plane=Plane(origin=(17.9044864, 48.16569168, 1), x=(-1, 0, 0), y=(0, -1, 0)), X=Domain(-1, 1), Y=Domain(-2, 2), Z=Domain(0, 6)}, {Plane=Plane(origin=(20.9044864, 51.16569168, 1), x=(0, 1, 0), y=(-1, 0, 0)), X=Domain(-1, 1), Y=Domain(-2, 2), Z=Domain(0, 6)}, {Plane=Plane(origin=(26.07115306, 51.16569168, 1), x=(0, 1, 0), y=(-1, 0, 0)), X=Domain(-1, 1), Y=Domain(-2, 2), Z=Domain(0, 6)}, {Plane=Plane(origin=(31.23781973, 51.16569168, 1), x=(0, 1, 0), y=(-1, 0, 0)), X=Domain(-1, 1), Y=Domain(-2, 2), Z=Domain(0, 6)}, {Plane=Plane(origin=(41.55031973, 54.66569168, 1), x=(-1, 0, 0), y=(0, -1, 0)), X=Domain(-1, 1), Y=Domain(-1.5, 1.5), Z=Domain(0, 6)}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])

# ---- group: B
data_2 = Data(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)

# ---- group: Test DataTree<Brep>
sintmt = SolidIntersectionMultiThreaded(A=data, B=data_2)  # -> R; inputs A: tree of Brep, B: tree of Brep
# ---------- sintmt: C# ----------
// Grasshopper Script Instance
using System;
using System.Collections;
using System.Collections.Generic;
using System.Drawing;

using Rhino;
using Rhino.Geometry;

using Grasshopper;
using Grasshopper.Kernel;
using Grasshopper.Kernel.Data;
using Grasshopper.Kernel.Types;

using System.Linq;

public class Script_Instance : GH_ScriptInstance
{
  private void RunScript(DataTree<Brep> A, DataTree<Brep> B, ref object R)
  {

    //Assign Tooltips
    Component.Name = "Solid Intersection (Multi-Threaded)";
    Component.NickName = "SIntMT";
    Component.Description = "A multi-threaded version of the Solid Intersection component";

    Component.Params.Input[0].Name = "Breps A";
    Component.Params.Input[0].NickName = "A";
    Component.Params.Input[0].Description = "First Set Of Breps";

    Component.Params.Input[1].Name = "Breps B";
    Component.Params.Input[1].NickName = "B";
    Component.Params.Input[1].Description = "Second Set Of Breps";

    Component.Params.Output[0].Name = "Result";
    Component.Params.Output[0].NickName = "R";
    Component.Params.Output[0].Description = "Solid Intersection Result";

    /////////////////////////////
    //written by Brian Washburn//
    //washburnarchitecture.com //
    //2023.09.08               //
    /////////////////////////////

    ////////////////////////////////
    //Modified by Michael Vollrath//
    //toyblock.co                 //
    //2023.09.23                  //
    ////////////////////////////////

    //Add Component Warnings Mimicking Native Component
    bool hasWarnings = false; // Flag to track if any warnings have been issued

    // Check if input A is null or empty
    if (A == null || A.DataCount == 0)
    {
        Component.AddRuntimeMessage(GH_RuntimeMessageLevel.Warning, "Input A Failed To Collect Data");
        hasWarnings = true;
    }

    // Check if input B is null or empty
    if (B == null || B.DataCount == 0)
    {
        Component.AddRuntimeMessage(GH_RuntimeMessageLevel.Warning, "Input B Failed To Collect Data");
        hasWarnings = true;
    }

    // If any warnings were issued, set R to null and return
    if (hasWarnings)
    {
        R = null;
        return;
    }

    double tolerance = Rhino.RhinoDoc.ActiveDoc.ModelAbsoluteTolerance;

    var mainBrepsMT = new System.Collections.Concurrent.ConcurrentDictionary<GH_Path,List<Rhino.Geometry.Brep>> ();

    int totalMaxConcurrancy = System.Environment.ProcessorCount - 1;
    this.Component.Message = totalMaxConcurrancy + " Threads";


    //start of the parallel engine
    System.Threading.Tasks.Parallel.ForEach(A.Paths, new System.Threading.Tasks.ParallelOptions
    { MaxDegreeOfParallelism = totalMaxConcurrancy},
    pth => {
    mainBrepsMT[pth] = Brep.CreateBooleanIntersection(A.Branch(pth), B.Branch(pth), tolerance).ToList();
    });
    //end of the parallel engine

    //convert dictionaries to regular old data trees
    DataTree<Rhino.Geometry.Brep> mainBreps = new DataTree<Rhino.Geometry.Brep>();

    foreach(KeyValuePair<GH_Path,List<Rhino.Geometry.Brep>> p in mainBrepsMT)
    {
        mainBreps.AddRange(p.Value, p.Key);
    }

    R = mainBreps;
    // Iterate through the branches of mainBreps and print the number of intersections in each branch
    foreach (var path in mainBreps.Paths)
    {
        // Console.WriteLine($"Branch {path}: {mainBreps.Branch(path).Count} intersections");
        // Console.WriteLine("Type of mainBreps: " + mainBreps.GetType().FullName);
    }

  }
}
# ---------- end sintmt ----------

# ----
panel = Panel(sintmt)
brep = Brep(sintmt)
bool = Boolean(True)
# should not throw error in brep
context_bake = ContextBake(Content=bool)
