# Grasshopper definition test_params_access_tree_empty_paths_8.17.ghx (Grasshopper 1.0.8)

# https://mcneel.myjetbrains.com/youtrack/issue/RH-85932
v_by_k = GhPythonScript()  # -> tree_with_empty_branches
# ---------- v_by_k: Python ----------
import ghpythonlib.treehelpers as th

list_with_empty_sublists = [ [], [], ['Not','An','Empty','List'], ['Also','Not','Empty'] ]

tree_with_empty_branches = th.list_to_tree(list_with_empty_sublists)
# ---------- end v_by_k ----------
panel = Panel(v_by_k)

# ----
# New Python2 Component
ipy2 = IronPython2Script(tree_with_empty_branches=v_by_k)  # -> out; inputs tree_with_empty_branches: tree
# ---------- ipy2: IronPython ----------
import ghpythonlib.treehelpers as th

list_with_empty_sublists = th.tree_to_list(tree_with_empty_branches)

print list_with_empty_sublists
# ---------- end ipy2 ----------
panel_2 = Panel(ipy2)

# ----
# New Python2 Component
py3 = Python3Script(tree_with_empty_branches=v_by_k)  # -> out; inputs tree_with_empty_branches: tree
# ---------- py3: Python ----------
import ghpythonlib.treehelpers as th

list_with_empty_sublists = th.tree_to_list(tree_with_empty_branches)

print(list_with_empty_sublists)
# ---------- end py3 ----------
panel_3 = Panel(py3)

# ----
# Old Python2 Component
v_by_k_2 = GhPythonScript(tree_with_empty_branches=v_by_k)  # -> out; inputs tree_with_empty_branches: tree; same code as ipy2
panel_4 = Panel(v_by_k_2)

panel_5 = Panel("\[\[\], \[\], \['Not', 'An', 'Empty', 'List'\], \['Also', 'Not', 'Empty'\]\]")
tmatch = MatchText(Text=panel_3, RegEx=panel_5, Case=True)
tmatch_2 = MatchText(Text=panel_2, RegEx=panel_5, Case=True)
at = AssertTrue(tmatch)
at_2 = AssertTrue(tmatch_2)
