# Grasshopper definition test_params_context_csharp_method_accessing_global_diagnose_rc8.7.ghx (Grasshopper 1.0.8)

panel = Panel("""// #! csharp
using System;

Data d = new Data();
a = d.Compute();

class Data 
{
    public int Compute()
    {
        return x + y;
    }
}""")
panel_2 = Panel("""The name 'x' does not exist 
The name 'y' does not exist""")
python = GhPythonScript(script=panel, WARN=Toggle(False), INFO=Toggle(False), HINT=Toggle(False))  # -> diags; inputs WARN: Boolean, INFO: Boolean, HINT: Boolean
# ---------- python: Python ----------
import clr
clr.AddReference('Rhino.Runtime.Code')
from Rhino.Runtime.Code import RhinoCode
from Rhino.Runtime.Code.Languages import DiagnoseOptions

code = RhinoCode.CreateCode(script)

code.Outputs.Add("a")

opts = DiagnoseOptions()
opts.Errors = True
opts.Warnings = WARN
opts.Infos = INFO
opts.Hints = HINT

diags = list(code.Diagnose(opts))
print(diags)
# ---------- end python ----------
panel_3 = Panel(python)
tmatch = MatchText(Text=python, RegEx=panel_2, Case=True)
python_2 = GhPythonScript(checks=flatten(tmatch))  # -> all_true; inputs checks: list
# ---------- python_2: Python ----------
all_true = all(checks)
# ---------- end python_2 ----------
panel_4 = Panel(python_2)
context_bake = ContextBake(Content=python_2)
