# Grasshopper definition test_params_context_csharp_method_accessing_global_rc8.8_error.ghx (Grasshopper 1.0.8)
# plug-ins: RhinoCodePluginGH

c_script = CSharpScript()  # -> out, a; inputs x: Double, y: Double
# ---------- c_script: C# ----------
using System;

Data d = new Data();
a = d.Compute();

class Data 
{
    public int Compute()
    {
        return x + y;
    }
}
# ---------- end c_script ----------
