# Grasshopper definition test_params_context_csharp_missing_param_diagnose_rc8.7.ghx (Grasshopper 1.0.8)

panel = Panel("""// #! csharp
using System;

Console.WriteLine(x);
Console.WriteLine(m);""")
python = GhPythonScript(script=panel, WARN=Toggle(False), INFO=Toggle(False), HINT=Toggle(False))  # -> diags; inputs WARN: Boolean, INFO: Boolean, HINT: Boolean
# ---------- python: Python ----------
import clr
clr.AddReference('Rhino.Runtime.Code')
from Rhino.Runtime.Code import RhinoCode
from Rhino.Runtime.Code.Languages import DiagnoseOptions

code = RhinoCode.CreateCode(script)

code.Inputs.Add("x")

opts = DiagnoseOptions()
opts.Errors = True
opts.Warnings = WARN
opts.Infos = INFO
opts.Hints = HINT

diags = list(code.Diagnose(opts))
print(diags)
# ---------- end python ----------
panel_2 = Panel(python)
tmatch = MatchText(Text=python, RegEx="The name 'm' does not exist ", Case=True)
panel_3 = Panel(tmatch)
context_bake = ContextBake(Content=tmatch)
