# Grasshopper definition test_params_context_csharp_missing_param_error.ghx (Grasshopper 1.0.8)
# plug-ins: RhinoCodePluginGH

c_script = CSharpScript()  # -> out, a
# ---------- c_script: C# ----------
using System;

Console.WriteLine(x);
Console.WriteLine(m);
# ---------- end c_script ----------
