# Grasshopper definition test_params_context_csharp_scriptinstance_global_diagnose_rc8.15.ghx (Grasshopper 1.0.8)
# plug-ins: RhinoCodePluginGH

panel = Panel("""// #! csharp
// Grasshopper Script Instance
#region Usings
using System;
using System.Linq;
using System.Collections;
using System.Collections.Generic;
using System.Drawing;

using Rhino;
using Rhino.Geometry;

using Grasshopper;
using Grasshopper.Kernel;
using Grasshopper.Kernel.Data;
using Grasshopper.Kernel.Types;
#endregion

Console.WriteLine(x);
Console.WriteLine(y);
Console.WriteLine(m);

public class Script_Instance : GH_ScriptInstance
{
    #region Notes
    /* 
      Members:
        RhinoDoc RhinoDocument
        GH_Document GrasshopperDocument
        IGH_Component Component
        int Iteration

      Methods (Virtual & overridable):
        Print(string text)
        Print(string format, params object[] args)
        Reflect(object obj)
        Reflect(object obj, string method_name)
    */
    #endregion

    private void RunScript(object x, object y, ref object a)
    {
        // Write your logic here
        a = null;
    }
}""")
panel_2 = Panel("""'Script_Instance' does not implement inherited abstract member 'GH_ScriptInstance.InvokeRunScript
The name 'x' does not exist 
The name 'm' does not exist """)
python = GhPythonScript(script=panel, WARN=Toggle(False), INFO=Toggle(False), HINT=Toggle(False))  # -> diags; inputs WARN: Boolean, INFO: Boolean, HINT: Boolean
# ---------- python: Python ----------
import clr
clr.AddReference('Rhino.Runtime.Code')
from Rhino.Runtime.Code import RhinoCode
from Rhino.Runtime.Code.Languages import DiagnoseOptions

code = RhinoCode.CreateCode(script)

code.Inputs.Add("y")

opts = DiagnoseOptions()
opts.Errors = True
opts.Warnings = WARN
opts.Infos = INFO
opts.Hints = HINT

diags = list(code.Diagnose(opts))
print(diags)
# ---------- end python ----------
tmatch = MatchText(Text=python, RegEx=panel_2, Case=True)
assert_true = AssertTrue(tmatch)
