# Grasshopper definition test_params_context_csharp_scriptinstance_missing_param_diagnose_rc8.7.ghx (Grasshopper 1.0.8)

panel = Panel("""// #! csharp
// Grasshopper Script Instance
#region Usings
using System;
using System.Linq;
using System.Collections;
using System.Collections.Generic;
using System.Drawing;

using Rhino;
using Rhino.Geometry;

using Grasshopper;
using Grasshopper.Kernel;
using Grasshopper.Kernel.Data;
using Grasshopper.Kernel.Types;
#endregion

public class Script_Instance : GH_ScriptInstance
{
    #region Notes
    /* 
      Members:
        RhinoDoc RhinoDocument
        GH_Document GrasshopperDocument
        IGH_Component Component
        int Iteration

      Methods (Virtual & overridable):
        Print(string text)
        Print(string format, params object[] args)
        Reflect(object obj)
        Reflect(object obj, string method_name)
    */
    #endregion

    private void RunScript(object x, object y, ref object a)
    {
        Console.WriteLine(x);
        Console.WriteLine(m);
    }
}""")
python = GhPythonScript(script=panel, WARN=Toggle(False), INFO=Toggle(False), HINT=Toggle(False))  # -> diags; inputs WARN: Boolean, INFO: Boolean, HINT: Boolean
# ---------- python: Python ----------
import clr
clr.AddReference('Rhino.Runtime.Code')
from Rhino.Runtime.Code import RhinoCode
from Rhino.Runtime.Code.Languages import DiagnoseOptions

code = RhinoCode.CreateCode(script)

code.Text.TransformOptions.AutoDeclareParams = False

opts = DiagnoseOptions()
opts.Errors = True
opts.Warnings = WARN
opts.Infos = INFO
opts.Hints = HINT

diags = list(code.Diagnose(opts))
print(diags)
# ---------- end python ----------
split = SplitList(List=python, Index=5)  # -> ListA, ListB
panel_2 = Panel(split.ListA)
panel_3 = Panel(split.ListB)
tmatch = MatchText(Text=split.ListB, RegEx="The name 'm' does not exist ", Case=True)
panel_4 = Panel(tmatch)
context_bake = ContextBake(Content=tmatch)
