# Grasshopper definition test_params_context_ghenv_and_ghdoc_csharp_global_diagnose_rc8.8.ghx (Grasshopper 1.0.8)
# plug-ins: RhinoCodePluginGH

panel = Panel("""// #! csharp
using System;
using System.Linq;
using System.Collections;
using System.Collections.Generic;
using System.Drawing;

using Rhino;
using Rhino.Geometry;

using Grasshopper;
using Grasshopper.Kernel;
using Grasshopper.Kernel.Data;
using Grasshopper.Kernel.Types;

Script_Instance.s_ghEnv = ghEnv;
Script_Instance.s_ghDoc = ghDoc;

public class Script_Instance : GH_ScriptInstance
{
    public static object s_ghEnv = default;
    public static object s_ghDoc = default;

    private void RunScript(ref object ghEnv, ref object ghDoc)
    {
        // Does not exist
        ghEnv = s_ghEnv;
        ghDoc = s_ghDoc;
    }
}""")
panel_2 = Panel("""The name 'ghEnv' does not exist 
The name 'ghDoc' does not exist """)
python = GhPythonScript(script=panel, WARN=Toggle(False), INFO=Toggle(False), HINT=Toggle(False))  # -> diags; inputs WARN: Boolean, INFO: Boolean, HINT: Boolean
# ---------- python: Python ----------
import clr
clr.AddReference('Rhino.Runtime.Code')
from Rhino.Runtime.Code import RhinoCode
from Rhino.Runtime.Code.Languages import DiagnoseOptions

code = RhinoCode.CreateCode(script)

opts = DiagnoseOptions()
opts.Errors = True
opts.Warnings = WARN
opts.Infos = INFO
opts.Hints = HINT

diags = list(code.Diagnose(opts))
print(diags)
# ---------- end python ----------
split = SplitList(List=python, Index=5)  # -> ListA, ListB
panel_3 = Panel(split.ListA)
panel_4 = Panel(split.ListB)
tmatch = MatchText(Text=split.ListB, RegEx=panel_2, Case=True)
assert_true = AssertTrue(tmatch)
