# Grasshopper definition test_params_context_ghenv_and_ghdoc_csharp_global_rc8.8_error.ghx (Grasshopper 1.0.8)
# plug-ins: RhinoCodePluginGH

c_script = CSharpScript()  # -> ghEnv, ghDoc
# ---------- c_script: C# ----------
using System;
using System.Linq;
using System.Collections;
using System.Collections.Generic;
using System.Drawing;

using Rhino;
using Rhino.Geometry;

using Grasshopper;
using Grasshopper.Kernel;
using Grasshopper.Kernel.Data;
using Grasshopper.Kernel.Types;

Script_Instance.s_ghEnv = ghEnv;
Script_Instance.s_ghDoc = ghDoc;

public class Script_Instance : GH_ScriptInstance
{
    public static object s_ghEnv = default;
    public static object s_ghDoc = default;

    private void RunScript(ref object ghEnv, ref object ghDoc)
    {
        // Does not exist
        ghEnv = s_ghEnv;
        ghDoc = s_ghDoc;
    }
}
# ---------- end c_script ----------
panel = Panel([c_script.ghEnv, c_script.ghDoc])
