# Grasshopper definition test_params_context_ghenv_and_ghdoc_rc8.11_rc9.0.ghx (Grasshopper 1.0.8)
# plug-ins: RhinoCodePluginGH

panel = Panel("""RhinoCodePlatform.Rhino3D.Languages.GH1.Legacy.ProxyScriptEnv
RhinoCodePlatform.Rhino3D.Languages.GH1.Legacy.ProxyDocument
2""")
panel_2 = Panel("""RhinoCodePlatform.Rhino3D.Languages.GH1.Legacy.ProxyScriptEnv
RhinoCodePlatform.Rhino3D.Languages.GH1.Legacy.ProxyDocument""")
panel_3 = Panel("""#! python 3
import scriptcontext
script_id = __id__
script_ctx = __context__
i = scriptcontext.id""")
panel_4 = Panel("""#! python 2
import scriptcontext
script_id = __id__
script_ctx = __context__
i = scriptcontext.id""")
panel_5 = Panel("""Rhino.Runtime.Code.Execution.RunContext
2""")

# ---- group: EXTERNAL SCRIPT-MODE
panel_6 = Panel("""#! python 3
import scriptcontext
i = scriptcontext.id""")
panel_7 = Panel("""#! python 2
import scriptcontext
i = scriptcontext.id""")
panel_8 = Panel("""// #! csharp
using System;
ghEnv = ghenv;
ghDoc = ghdoc;""")
c_script = CSharpScript(script=panel_8)  # -> ghEnv, ghDoc
#   port script: Script to execute
# ---------- c_script: C# ----------
using System;

ghEnv = ghenv;
ghDoc = ghdoc;
# ---------- end c_script ----------
py3 = Python3Script(script=graft([panel_6, panel_7]))  # -> ghenv, ghdoc, i
#   port script: Script to execute
# ---------- py3: Python ----------
import scriptcontext

i = scriptcontext.id
# ---------- end py3 ----------
panel_9 = Panel([c_script.ghEnv, c_script.ghDoc])
match_text = MatchText(Text=[c_script.ghEnv, c_script.ghDoc], Pattern=panel_2, Case=True)
panel_10 = Panel([py3.ghenv, py3.ghdoc, py3.i])
match_text_2 = MatchText(Text=[py3.ghenv, py3.ghdoc, py3.i], Pattern=panel, Case=True)
assert_true = AssertTrue(match_text)
assert_true_2 = AssertTrue(match_text_2)
py3_scr_ctx = Python3Script(script=graft([panel_3, panel_4]))  # -> script_id, script_ctx, i
#   port script: Script to execute
# ---------- py3_scr_ctx: Python ----------
import scriptcontext

script_id = __id__
script_ctx = __context__
i = scriptcontext.id
# ---------- end py3_scr_ctx ----------
panel_11 = Panel([py3_scr_ctx.script_id, py3_scr_ctx.script_ctx, py3_scr_ctx.i])
guid = Guid(py3_scr_ctx.script_id)
match_text_3 = MatchText(Text=[py3_scr_ctx.script_ctx, py3_scr_ctx.i], Pattern=panel_5, Case=True)
assert_true_3 = AssertTrue(match_text_3)
