# Grasshopper definition test_params_context_ghenv_and_ghdoc_rc9.0.ghx (Grasshopper 1.0.9)

panel = Panel("""RhinoCodePlatform.Rhino3D.Languages.GH1.Legacy.ProxyScriptEnv
RhinoCodePlatform.Rhino3D.Languages.GH1.Legacy.ProxyDocument""")
panel_2 = Panel("""RhinoCodePlatform.Rhino3D.Languages.GH1.Legacy.ProxyScriptEnv
RhinoCodePlatform.Rhino3D.Languages.GH1.Legacy.ProxyDocument
2""")
panel_3 = Panel("""Rhino.Runtime.Code.Execution.RunContext
2""")

# ---- group: SDK-MODE
py3 = Python3Script()  # -> ghenv, ghdoc, i
# ---------- py3: Python ----------
import System
import Rhino
import Grasshopper

import rhinoscriptsyntax as rs
import scriptcontext


class MyComponent(Grasshopper.Kernel.GH_ScriptInstance):
    def RunScript(self):
        return ghenv, ghdoc, scriptcontext.id
# ---------- end py3 ----------
ipy2 = IronPython2Script()  # -> ghenv, ghdoc, i; same code as py3
c_script = CSharpScript()  # -> ghEnv, ghDoc
# ---------- c_script: C# ----------
using System;
using System.Linq;
using System.Collections;
using System.Collections.Generic;
using System.Drawing;

using Rhino;
using Rhino.Geometry;

using Grasshopper;
using Grasshopper.Kernel;
using Grasshopper.Kernel.Data;
using Grasshopper.Kernel.Types;

public class Script_Instance : GH_ScriptInstance
{
    private void RunScript(ref object ghEnv, ref object ghDoc)
    {
        // Does not exist
        ghEnv = "Not Supported";
        ghDoc = "Not Supported";
    }
}
# ---------- end c_script ----------
panel_4 = Panel([py3.ghenv, py3.ghdoc, py3.i])
panel_5 = Panel([ipy2.ghenv, ipy2.ghdoc, ipy2.i])
panel_6 = Panel([c_script.ghEnv, c_script.ghDoc])
match_text = MatchText(Text=[ipy2.ghenv, ipy2.ghdoc, ipy2.i], Pattern=panel_2, Case=True)
match_text_2 = MatchText(Text=[py3.ghenv, py3.ghdoc, py3.i], Pattern=panel_2, Case=True)
assert_true = AssertTrue(match_text)
assert_true_2 = AssertTrue(match_text_2)
py3_2 = Python3Script()  # -> ghenv, ghdoc, i
# ---------- py3_2: Python ----------
import System
import Rhino
import Grasshopper

import rhinoscriptsyntax as rs
import scriptcontext

c = ghenv
d = ghdoc
scid = scriptcontext.id

class MyComponent(Grasshopper.Kernel.GH_ScriptInstance):
    def RunScript(self):
        return c, d, scid
# ---------- end py3_2 ----------
ipy2_2 = IronPython2Script()  # -> ghenv, ghdoc, i; same code as py3_2
panel_7 = Panel([py3_2.ghenv, py3_2.ghdoc, py3_2.i])
panel_8 = Panel([ipy2_2.ghenv, ipy2_2.ghdoc, ipy2_2.i])
match_text_3 = MatchText(Text=[py3_2.ghenv, py3_2.ghdoc, py3_2.i], Pattern=panel_2, Case=True)
match_text_4 = MatchText(Text=[ipy2_2.ghenv, ipy2_2.ghdoc, ipy2_2.i], Pattern=panel_2, Case=True)
assert_true_3 = AssertTrue(match_text_4)
assert_true_4 = AssertTrue(match_text_3)
py3_sdk_ctx = Python3Script()  # -> script_id, script_ctx, i
# ---------- py3_sdk_ctx: Python ----------
import System
import Rhino
import Grasshopper

import rhinoscriptsyntax as rs
import scriptcontext


class MyComponent(Grasshopper.Kernel.GH_ScriptInstance):
    def RunScript(self):
        _, ctx = __this__.TryGetContext()
        return __id__, ctx, scriptcontext.id
# ---------- end py3_sdk_ctx ----------
ipy2_sdk_ctx = IronPython2Script()  # -> script_id, script_ctx, i; same code as py3_sdk_ctx
panel_9 = Panel([py3_sdk_ctx.script_id, py3_sdk_ctx.script_ctx, py3_sdk_ctx.i])
panel_10 = Panel([ipy2_sdk_ctx.script_id, ipy2_sdk_ctx.script_ctx, ipy2_sdk_ctx.i])
guid = Guid(py3_sdk_ctx.script_id)
guid_2 = Guid(ipy2_sdk_ctx.script_id)
match_text_5 = MatchText(Text=[ipy2_sdk_ctx.script_ctx, ipy2_sdk_ctx.i], Pattern=panel_3, Case=True)
match_text_6 = MatchText(Text=[py3_sdk_ctx.script_ctx, py3_sdk_ctx.i], Pattern=panel_3, Case=True)
assert_true_5 = AssertTrue(match_text_6)
assert_true_6 = AssertTrue(match_text_5)

# ---- group: SCRIPT-MODE
py3_3 = Python3Script()  # -> ghenv, ghdoc, i
# ---------- py3_3: Python ----------
import scriptcontext

i = scriptcontext.id
# ---------- end py3_3 ----------
ipy2_3 = IronPython2Script()  # -> ghenv, ghdoc, i; same code as py3_3
c_script_2 = CSharpScript()  # -> ghEnv, ghDoc
# ---------- c_script_2: C# ----------
using System;

ghEnv = ghenv;
ghDoc = ghdoc;
# ---------- end c_script_2 ----------
panel_11 = Panel([py3_3.ghenv, py3_3.ghdoc, py3_3.i])
panel_12 = Panel([ipy2_3.ghenv, ipy2_3.ghdoc, ipy2_3.i])
panel_13 = Panel([c_script_2.ghEnv, c_script_2.ghDoc])
match_text_7 = MatchText(Text=[c_script_2.ghEnv, c_script_2.ghDoc], Pattern=panel, Case=True)
match_text_8 = MatchText(Text=[ipy2_3.ghenv, ipy2_3.ghdoc, ipy2_3.i], Pattern=panel_2, Case=True)
match_text_9 = MatchText(Text=[py3_3.ghenv, py3_3.ghdoc, py3_3.i], Pattern=panel_2, Case=True)
assert_true_7 = AssertTrue(match_text_7)
assert_true_8 = AssertTrue(match_text_8)
assert_true_9 = AssertTrue(match_text_9)
py3_scr_ctx = Python3Script()  # -> script_id, script_ctx, i
# ---------- py3_scr_ctx: Python ----------
import scriptcontext

script_id = __id__
_, script_ctx = __this__.TryGetContext()
i = scriptcontext.id
# ---------- end py3_scr_ctx ----------
ipy2_scr_ctx = IronPython2Script()  # -> script_id, script_ctx, i; same code as py3_scr_ctx
panel_14 = Panel([py3_scr_ctx.script_id, py3_scr_ctx.script_ctx, py3_scr_ctx.i])
guid_3 = Guid(py3_scr_ctx.script_id)
guid_4 = Guid(ipy2_scr_ctx.script_id)
panel_15 = Panel([ipy2_scr_ctx.script_id, ipy2_scr_ctx.script_ctx, ipy2_scr_ctx.i])
match_text_10 = MatchText(Text=[py3_scr_ctx.script_ctx, py3_scr_ctx.i], Pattern=panel_3, Case=True)
match_text_11 = MatchText(Text=[ipy2_scr_ctx.script_ctx, ipy2_scr_ctx.i], Pattern=panel_3, Case=True)
assert_true_10 = AssertTrue(match_text_10)
assert_true_11 = AssertTrue(match_text_11)
