# Grasshopper definition test_params_context_python3_missing_param_error.ghx (Grasshopper 1.0.8)
# plug-ins: RhinoCodePluginGH

py3 = Python3Script()  # -> out, a
# ---------- py3: Python ----------
print(x)
print(m)
# ---------- end py3 ----------
