# Grasshopper definition test_params_context_python3_scriptinstance_missing_param_diagnose_rc8.7.ghx (Grasshopper 1.0.8)

panel = Panel("""#! python 3
import System
import Rhino
import Grasshopper

import rhinoscriptsyntax as rs


class MyComponent(Grasshopper.Kernel.GH_ScriptInstance):
    def RunScript(self, x, y):
        print(x)
        print(k)
        return""")
python = GhPythonScript(script=panel, WARN=Toggle(False), INFO=Toggle(False), HINT=Toggle(False))  # -> diags; inputs WARN: Boolean, INFO: Boolean, HINT: Boolean
# ---------- python: Python ----------
import clr
clr.AddReference('Rhino.Runtime.Code')
from Rhino.Runtime.Code import RhinoCode
from Rhino.Runtime.Code.Languages import DiagnoseOptions

code = RhinoCode.CreateCode(script)

code.Text.TransformOptions.AutoDeclareParams = False

opts = DiagnoseOptions()
opts.Errors = True
opts.Warnings = WARN
opts.Infos = INFO
opts.Hints = HINT

diags = list(code.Diagnose(opts))
print(diags)
# ---------- end python ----------
panel_2 = Panel(python)
tmatch = MatchText(Text=python, RegEx="undefined name 'k'", Case=True)
python_2 = GhPythonScript(checks=flatten(tmatch))  # -> all_true; inputs checks: list
# ---------- python_2: Python ----------
all_true = all(checks)
# ---------- end python_2 ----------
panel_3 = Panel(python_2)
context_bake = ContextBake(Content=python_2)
