# Grasshopper definition test_params_context_python3_scriptinstance_missing_param_error.ghx (Grasshopper 1.0.8)
# plug-ins: RhinoCodePluginGH

py3 = Python3Script()  # -> out, a
# ---------- py3: Python ----------
import System
import Rhino
import Grasshopper

import rhinoscriptsyntax as rs


class MyComponent(Grasshopper.Kernel.GH_ScriptInstance):
    def RunScript(self, x, y):
        print(x)
        print(k)
        return
# ---------- end py3 ----------
