# Grasshopper definition test_params_converter_missing_rc8.9_error.ghx (Grasshopper 1.0.8)
# plug-ins: RhinoCodePluginGH

python_3_script = Python3Script()  # -> model
# ---------- python_3_script: Python ----------
import Rhino.Geometry as RG
from Grasshopper.Rhinoceros import ModelContentName
from Grasshopper.Rhinoceros.Model import ModelObject, ModelLayer

sphere = RG.Sphere(RG.Point3d.Origin, 10)
brep = sphere.ToBrep()


mo_builder = ModelObject.Cast(brep).ToAttributes()
layer_attribs = ModelLayer.Attributes()
layer_attribs.Name = ModelContentName("LayerName")
mo_builder.Layer = layer_attribs


model  = mo_builder
# ---------- end python_3_script ----------
python_3_script_2 = Python3Script(mo=python_3_script)  # -> out, new_mo
# ---------- python_3_script_2: Python ----------
print(type(mo))
builder = mo.ToAttributes()
new_mo = builder.ToModelData()
# fix casting
# new_mo.Layer = "sfd"
# ---------- end python_3_script_2 ----------
