# Grasshopper definition test_params_inputs_convert_directCast_rc8.7.ghx (Grasshopper 1.0.8)
# plug-ins: RhinoCodePluginGH

panel = Panel("""Rhino\.UI\.Gumball\.GumballMode
System\.Text\.Decoder""")

# ---- group: Check Direct Cast Hint on 'y'
script = Script()  # -> script, out, a
#   port x: Casts source data to object
#   port y: Casts source data to object
#   port script: Script being executed
# ---------- script: C# ----------
// Grasshopper Script Instance
using System;
using System.Collections;
using System.Collections.Generic;
using System.Drawing;

using Rhino;
using Rhino.Geometry;

using Grasshopper;
using Grasshopper.Kernel;
using Grasshopper.Kernel.Data;
using Grasshopper.Kernel.Types;

public class Script_Instance : GH_ScriptInstance
{
  private void RunScript(
	Rhino.UI.Gumball.GumballMode x,
	System.Text.Decoder y,
	ref object a)
  {
    a = null;
  }
}
# ---------- end script ----------

# ----
ds = ScriptSourceDeconstruct(ScriptSource=script.script)  # -> Id, LanguageId, Title, Text, Signature, Uri, EnvironId, Inputs, Outputs
tmatch = MatchText(Text=ds.Inputs, RegEx=panel, Case=True)
python = GhPythonScript(checks=flatten(tmatch))  # -> all_true; inputs checks: list
# ---------- python: Python ----------
all_true = all(checks)
# ---------- end python ----------
panel_2 = Panel(python)
context_bake = ContextBake(Content=python)
