# Grasshopper definition test_params_inputs_convert_error.ghx (Grasshopper 1.0.8)
# plug-ins: RhinoCodePluginGH

panel = Panel("""1
2
3
4
5
6
7
8
9""")

# ---- group: FAIL STR TO FLOAT
ghpython_script = GhPythonScript(x=panel)  # -> out, a
# ---------- ghpython_script: Python ----------
print(x)
a = x
# ---------- end ghpython_script ----------
panel_2 = Panel(ghpython_script.a)
panel_3 = Panel(ghpython_script.out)

# ----
panel_4 = Panel("Parameter \\\"x\\\" type conversion failed from GH_String")
lng = ListLength(List=ghpython_script.a)

# ---- group: FAIL STR TO DOUBLE
python_3_script = Python3Script(x=panel)  # -> out, a; inputs x: Double; same code as ghpython_script
panel_5 = Panel(python_3_script.a)
lng_2 = ListLength(List=python_3_script.a)
equals = Equality(FirstNumber=lng_2, SecondNumber=lng)  # -> Equality, Inequality
ironpython_2_script = IronPython2Script(x=panel)  # -> out, a; inputs x: Double; same code as ghpython_script
panel_6 = Panel(ironpython_2_script.a)
lng_3 = ListLength(List=ironpython_2_script.a)
equals_2 = Equality(FirstNumber=lng_3, SecondNumber=lng)  # -> Equality, Inequality
csharp_script = CSharpScript(x=panel)  # -> out, a; inputs x: Double
# ---------- csharp_script: C# ----------
using System;

Console.WriteLine(x);
a = x;
# ---------- end csharp_script ----------
panel_7 = Panel(csharp_script.a)
lng_4 = ListLength(List=csharp_script.a)
equals_3 = Equality(FirstNumber=lng_4, SecondNumber=lng)  # -> Equality, Inequality

# ----
panel_8 = Panel(python_3_script.out)
item = CherryPicker(python_3_script.out, ListIndex=9)
tmatch = MatchText(Text=item, RegEx=panel_4, Case=True)
panel_9 = Panel(ironpython_2_script.out)
item_2 = CherryPicker(ironpython_2_script.out, ListIndex=9)
tmatch_2 = MatchText(Text=item_2, RegEx=panel_4, Case=True)
panel_10 = Panel(csharp_script.out)
item_3 = CherryPicker(csharp_script.out, ListIndex=9)
tmatch_3 = MatchText(Text=item_3, RegEx=panel_4, Case=True)
python = GhPythonScript(checks=flatten([tmatch, tmatch_2, tmatch_3, equals.Equality, equals_2.Equality, equals_3.Equality]))  # -> all_true; inputs checks: list
# ---------- python: Python ----------
all_true = all(checks)
# ---------- end python ----------
panel_11 = Panel(python)
context_bake = ContextBake(Content=python)
