# Grasshopper definition test_params_inputs_convert_filepath.ghx (Grasshopper 1.0.8)
# plug-ins: RhinoCodePluginGH

py3 = Python3Script(RP="somefile.ext")  # -> AP; inputs RP: String
# ---------- py3: Python ----------
AP = RP
# ---------- end py3 ----------
panel = Panel(py3)
tmatch = MatchText(Text=py3, RegEx="[\\\/]files[\\\/]gh1[\\\/]somefile.ext", Case=True)
panel_2 = Panel(tmatch)
context_bake = ContextBake(Content=tmatch)
