# Grasshopper definition test_params_inputs_convert_floatOrDouble.ghx (Grasshopper 1.0.8)
# plug-ins: RhinoCodePluginGH

number_slider = Slider(10, range=0..10)

# ---- group: x: Double
script = Script(x=number_slider)  # -> stdout, a; inputs x: Double
# ---------- script: C# ----------
using System;

a = x;

Console.WriteLine($"Test {a}");
# ---------- end script ----------

# ---- group: x: float
script_2 = Script(x=number_slider)  # -> out, a; inputs x: Double
# ---------- script_2: Python ----------
#! python 3
a = x
print(f"Test {a}");
# ---------- end script_2 ----------
ghpython_script = GhPythonScript(x=number_slider)  # -> out, a
# ---------- ghpython_script: Python ----------
a = x
print("Test {0}".format(a));
# ---------- end ghpython_script ----------

# ---- group: EXPECT NO ERRORS
toggle = BooleanToggle(True)
panel = Panel(toggle)
context_bake = ContextBake(Content=toggle)
