# Grasshopper definition test_params_inputs_convert_null.ghx (Grasshopper 1.0.8)
# plug-ins: RhinoCodePluginGH

# ---- group: SHOULD NOT SHOW ERRORS ON NULL CONVERT
script = Script()  # -> out, a; inputs x: Double
# ---------- script: C# ----------
// Grasshopper Script Instance
using System;
using System.Collections;
using System.Collections.Generic;
using System.Drawing;

using Rhino;
using Rhino.Geometry;

using Grasshopper;
using Grasshopper.Kernel;
using Grasshopper.Kernel.Data;
using Grasshopper.Kernel.Types;

public class Script_Instance : GH_ScriptInstance
{
  private void RunScript(double x, ref object a)
  {
    // Write your logic here
    a = null;
  }
}
# ---------- end script ----------
script_2 = Script()  # -> out, a; inputs x: Point3d
# ---------- script_2: C# ----------
// Grasshopper Script Instance
using System;
using System.Collections;
using System.Collections.Generic;
using System.Drawing;

using Rhino;
using Rhino.Geometry;

using Grasshopper;
using Grasshopper.Kernel;
using Grasshopper.Kernel.Data;
using Grasshopper.Kernel.Types;

public class Script_Instance : GH_ScriptInstance
{
  private void RunScript(Point3d x, ref object a)
  {
    // Write your logic here
    a = null;
  }
}
# ---------- end script_2 ----------
py3 = Python3Script()  # -> out, a; inputs x: Point3d
# ---------- py3: Python ----------
"""Grasshopper Script"""
a = "Hello Python 3 in Grasshopper!"
print(a)

import System
import Rhino
import Grasshopper

import rhinoscriptsyntax as rs


class MyComponent(Grasshopper.Kernel.GH_ScriptInstance):
    def RunScript(self, x: Rhino.Geometry.Point3d):
        return
# ---------- end py3 ----------

# ----
bool = Boolean(True)
context_bake = ContextBake(Content=bool)
panel = Panel(bool)
