# Grasshopper definition test_params_inputs_convert_objToGuid_legacy_rc8.12.ghx (Grasshopper 1.0.8)
# plug-ins: RhinoCodePluginGH

curve = Curve(<curve referenced from the Rhino model>)
curve_2 = Curve(<curve referenced from the Rhino model>)
curve_3 = Curve(<curve referenced from the Rhino model>)
curve_4 = Curve(<curve referenced from the Rhino model>)
c_script = CSharpScript(id=[curve, curve_2])  # -> out, a; inputs id: Guid
# ---------- c_script: C# ----------
        a = id;
# ---------- end c_script ----------
c_script_2 = CSharpScript(id=[curve, curve_2])  # -> out, a; inputs id: list of Guid; same code as c_script
c_script_3 = CSharpScript(id=[curve, curve_2])  # -> out, a; inputs id: tree of Guid; same code as c_script
ghpython_script = GhPythonScript(obj_id=[curve_3, curve_4])  # -> out, a; inputs obj_id: Guid
# ---------- ghpython_script: Python ----------
a = obj_id
# ---------- end ghpython_script ----------
ghpython_script_2 = GhPythonScript(obj_id=[curve_3, curve_4])  # -> out, a; inputs obj_id: list of Guid; same code as ghpython_script
ghpython_script_3 = GhPythonScript(obj_id=[curve_3, curve_4])  # -> out, a; inputs obj_id: tree of Guid; same code as ghpython_script
panel = Panel(c_script.a)
panel_2 = Panel(c_script_2.a)
panel_3 = Panel(c_script_3.a)
panel_4 = Panel(ghpython_script.a)
panel_5 = Panel(ghpython_script_2.a)
panel_6 = Panel(ghpython_script_3.a)
curve_5 = Curve(ghpython_script.a)
curve_6 = Curve(ghpython_script_2.a)
curve_7 = Curve(ghpython_script_3.a)
guid = Guid(panel)
guid_2 = Guid(panel_2)
guid_3 = Guid(panel_3)
assert_true = AssertTrue(curve_5)
assert_true_2 = AssertTrue(curve_6)
assert_true_3 = AssertTrue(curve_7)
assert_true_4 = AssertTrue(guid)
assert_true_5 = AssertTrue(guid_2)
assert_true_6 = AssertTrue(guid_3)
