# Grasshopper definition test_params_inputs_convert_objToGuid_rc8.12.ghx (Grasshopper 1.0.8)
# plug-ins: RhinoCodePluginGH

curve = Curve(<curve referenced from the Rhino model>)
curve_2 = Curve(<curve referenced from the Rhino model>)
curve_3 = Curve(<curve referenced from the Rhino model>)
curve_4 = Curve(<curve referenced from the Rhino model>)
curve_5 = Curve(<curve referenced from the Rhino model>)
curve_6 = Curve(<curve referenced from the Rhino model>)

# ---- group: Item
script = Script(id=[curve, curve_2])  # -> out, a; inputs id: Guid
# ---------- script: C# ----------
a = id;
# ---------- end script ----------

# ---- group: List
script_2 = Script(id=[curve, curve_2])  # -> out, a; inputs id: list of Guid; same code as script

# ---- group: Tree
script_3 = Script(id=[curve, curve_2])  # -> out, a; inputs id: tree of Guid; same code as script

# ----
python_3_script = Python3Script(obj_id=[curve_3, curve_4])  # -> out, a; inputs obj_id: Guid
# ---------- python_3_script: Python ----------
a = obj_id
# ---------- end python_3_script ----------
python_3_script_2 = Python3Script(obj_id=[curve_3, curve_4])  # -> out, a; inputs obj_id: list of Guid; same code as python_3_script
python_3_script_3 = Python3Script(obj_id=[curve_3, curve_4])  # -> out, a; inputs obj_id: tree of Guid; same code as python_3_script
ironpython_2_script = IronPython2Script(obj_id=[curve_5, curve_6])  # -> out, a; inputs obj_id: Guid; same code as python_3_script
ironpython_2_script_2 = IronPython2Script(obj_id=[curve_5, curve_6])  # -> out, a; inputs obj_id: list of Guid; same code as python_3_script
ironpython_2_script_3 = IronPython2Script(obj_id=[curve_5, curve_6])  # -> out, a; inputs obj_id: tree of Guid; same code as python_3_script
panel = Panel(script.a)
panel_2 = Panel(script_2.a)
panel_3 = Panel(script_3.a)
panel_4 = Panel(python_3_script.a)
panel_5 = Panel(python_3_script_2.a)
panel_6 = Panel(python_3_script_3.a)
panel_7 = Panel(ironpython_2_script.a)
panel_8 = Panel(ironpython_2_script_2.a)
panel_9 = Panel(ironpython_2_script_3.a)
guid = Guid(panel)
guid_2 = Guid(panel_2)
guid_3 = Guid(panel_3)
guid_4 = Guid(panel_4)
guid_5 = Guid(panel_5)
guid_6 = Guid(panel_6)
guid_7 = Guid(panel_7)
guid_8 = Guid(panel_8)
guid_9 = Guid(panel_9)
assert_true = AssertTrue(guid)
assert_true_2 = AssertTrue(guid_2)
assert_true_3 = AssertTrue(guid_3)
assert_true_4 = AssertTrue(guid_4)
assert_true_5 = AssertTrue(guid_5)
assert_true_6 = AssertTrue(guid_6)
assert_true_7 = AssertTrue(guid_7)
assert_true_8 = AssertTrue(guid_8)
assert_true_9 = AssertTrue(guid_9)
