# Grasshopper definition test_params_inputs_convert_textDot_error.ghx (Grasshopper 1.0.8)
# plug-ins: RhinoCodePluginGH

script = Script(x=Slider(10, range=0..10))  # -> stdout, a
# ---------- script: C# ----------
using System;

a = x;

Console.WriteLine($"Test {a}");
# ---------- end script ----------
