# Grasshopper definition test_params_inputs_dataTypes.ghx (Grasshopper 1.0.8)

number_slider = Slider(21, range=0..100)
py3 = Python3Script(x=Slider(21, range=0..100))  # -> a
# ---------- py3: Python ----------
a = repr(type(x))
# ---------- end py3 ----------
py3_2 = Python3Script(x=Slider(21, range=0..100))  # -> a; inputs x: list; same code as py3
python = GhPythonScript(x=number_slider)  # -> a; inputs x: tree; same code as py3
py3_3 = Python3Script(x=number_slider)  # -> a; inputs x: tree; same code as py3
py3_4 = Python3Script(x=number_slider)  # -> a; inputs x: tree of Int32; same code as py3
c_script = CSharpScript(x=Slider(21, range=0..100))  # -> a
# ---------- c_script: C# ----------
a = x?.GetType().FullName ?? "NULL";
# ---------- end c_script ----------
c_script_2 = CSharpScript(x=Slider(21, range=0..100))  # -> a; inputs x: list; same code as c_script
c_script_3 = CSharpScript(x=Slider(21, range=0..100))  # -> a; inputs x: list of Int32; same code as c_script
c_script_4 = CSharpScript(x=Slider(21, range=0..100))  # -> a; inputs x: tree; same code as c_script
c_script_5 = CSharpScript(x=Slider(21, range=0..100))  # -> a; inputs x: tree of Int32; same code as c_script
panel = Panel(py3)
panel_2 = Panel(py3_2)
panel_3 = Panel(python)
panel_4 = Panel(py3_3)
panel_5 = Panel(c_script)
panel_6 = Panel(c_script_2)
panel_7 = Panel(c_script_3)
panel_8 = Panel(c_script_4)
panel_9 = Panel(c_script_5)
panel_10 = Panel(py3_4)
panel_11 = Panel("""<class 'float'>
<class 'list'>
<class '.+DataTree\[Object\]'>
<class '.+DataTree\[Int32\]'>""")
tmatch = MatchText(Text=[panel, panel_2, panel_4, panel_10], RegEx=panel_11, Case=True)
panel_12 = Panel("""System.Double
System.Collections.Generic.List`1\[.+System.Object.+\]
System.Collections.Generic.List`1\[.+System.Int32.+\]
Grasshopper.DataTree`1\[.+System.Object.+\]
Grasshopper.DataTree`1\[.+System.Int32.+\]""")
at = AssertTrue(tmatch)
tmatch_2 = MatchText(Text=[panel_5, panel_6, panel_7, panel_8, panel_9], RegEx=panel_12, Case=True)
at_2 = AssertTrue(tmatch_2)
