# Grasshopper definition test_params_inputs_empty.ghx (Grasshopper 1.0.8)
# plug-ins: RhinoCodePluginGH

panel = Panel("""#! python3
a = str(x) == 'None'""")
panel_2 = Panel("""#! python3
a = x is None""")
S = Script(Script=panel_2)
S_2 = Script(Script=panel)
python = GhPythonScript(Code="a = x is None")
python_2 = GhPythonScript(Code="a = str(x) == 'None'")
python_3_script = Python3Script()  # -> a
# ---------- python_3_script: Python ----------
a = x is None
# ---------- end python_3_script ----------
ironpython_2_script = IronPython2Script()  # -> a; same code as python_3_script
csharp_script = CSharpScript()  # -> a
# ---------- csharp_script: C# ----------
a = x is null;
# ---------- end csharp_script ----------
gate_and = GateAnd(A=python, B=python_2)
gate_and_2 = GateAnd(A=S, B=S_2)
gate_and_3 = GateAnd(A=python_3_script, B=ironpython_2_script, C=csharp_script)
gate_and_4 = GateAnd(A=gate_and, B=gate_and_2, C=gate_and_3)
context_bake = ContextBake(Content=gate_and_4)
panel_3 = Panel(gate_and_4)
