# Grasshopper definition test_params_inputs_indexing.ghx (Grasshopper 1.0.8)
# plug-ins: RhinoCodePluginGH

number_slider = Slider(42, range=0..100)
construct_domain = ConstructDomain(DomainStart=number_slider, DomainEnd=1)
range = Range(Domain=construct_domain, Steps=10)

# ---- group: INDEX
script = Script(inputList=range)  # -> out, a; inputs inputList: list, inputTree: tree
# ---------- script: Python ----------
a = inputList[0]
# ---------- end script ----------
script_2 = Script(inputList=range)  # -> out, a; inputs inputList: list, inputTree: tree; same code as script
script_3 = Script(inputList=range)  # -> out, a; inputs inputList: list, inputTree: tree
# ---------- script_3: C# ----------
a = inputList[0];
# ---------- end script_3 ----------

# ----
panel = Panel(script.a)
panel_2 = Panel(script_3.a)
panel_3 = Panel(script_2.a)
script_4 = Script(inputList=range)  # -> out, outputPyList; inputs inputList: list
# ---------- script_4: Python ----------
outputPyList = inputList
# ---------- end script_4 ----------

# ---- group: SLICE
script_5 = Script(inputList=script_4.outputPyList)  # -> out, a; inputs inputList: list
# ---------- script_5: Python ----------
a = inputList[0:2]
# ---------- end script_5 ----------
script_6 = Script(inputList=range)  # -> out, a; inputs inputList: list, inputTree: tree; same code as script_5
script_7 = Script(inputList=range)  # -> out, a; inputs inputList: list, inputTree: tree; same code as script_5
script_8 = Script(inputList=range)  # -> out, a; inputs inputList: list, inputTree: tree
# ---------- script_8: C# ----------
using System.Linq;

a = inputList.Skip(0).Take(2);
# ---------- end script_8 ----------

# ----
equals = Equality(FirstNumber=number_slider, SecondNumber=script.a)  # -> Equality, Inequality
equals_2 = Equality(FirstNumber=number_slider, SecondNumber=script_2.a)  # -> Equality, Inequality
equals_3 = Equality(FirstNumber=number_slider, SecondNumber=script_3.a)  # -> Equality, Inequality
panel_4 = Panel(script_7.a)
panel_5 = Panel(script_5.a)
panel_6 = Panel(script_6.a)
panel_7 = Panel(script_8.a)
subset = SubList(List=range, Domain=Domain(0, 1), Wrap=True)  # -> List, Index
num = Number(subset.List)
equals_4 = Equality(FirstNumber=num, SecondNumber=script_5.a)  # -> Equality, Inequality
equals_5 = Equality(FirstNumber=num, SecondNumber=script_6.a)  # -> Equality, Inequality
equals_6 = Equality(FirstNumber=num, SecondNumber=script_7.a)  # -> Equality, Inequality
equals_7 = Equality(FirstNumber=num, SecondNumber=script_8.a)  # -> Equality, Inequality
python = GhPythonScript(checks=flatten([equals_4.Equality, equals_5.Equality, equals_6.Equality, equals_7.Equality, equals.Equality, equals_2.Equality, equals_3.Equality]))  # -> all_true; inputs checks: list
# ---------- python: Python ----------
all_true = all(checks)
# ---------- end python ----------
context_bake = ContextBake(Content=python)
panel_8 = Panel(python)
