# Grasshopper definition test_params_inputs_marshalling_python_accessKinds_scriptinstance_rc8.8.ghx (Grasshopper 1.0.8)
# plug-ins: RhinoCodePluginGH

range = Range(Domain=Domain(0, 1), Steps=2)
python = GhPythonScript(x=range)  # -> out
# ---------- python: Python ----------
from ghpythonlib.componentbase import executingcomponent as component
import Grasshopper, GhPython
import System
import Rhino
import rhinoscriptsyntax as rs

class MyComponent(component):
    def RunScript(self, x):
        print(type(x))
        return
# ---------- end python ----------
python_2 = GhPythonScript(x=range)  # -> out; inputs x: list; same code as python
python_3 = GhPythonScript(x=range)  # -> out; inputs x: tree; same code as python
py3 = Python3Script(x=range)  # -> out
# ---------- py3: Python ----------
import Grasshopper

class MyComponent(Grasshopper.Kernel.GH_ScriptInstance):
    def RunScript(self, x):
        print(type(x))
        return
# ---------- end py3 ----------
py3_2 = Python3Script(x=range)  # -> out; same code as py3
py3_3 = Python3Script(x=range)  # -> out; inputs x: list
# ---------- py3_3: Python ----------
import Grasshopper

class MyComponent(Grasshopper.Kernel.GH_ScriptInstance):
    def RunScript(self, x: list[object]):
        print(type(x))
        return
# ---------- end py3_3 ----------
py3_4 = Python3Script(x=range)  # -> out; inputs x: list
# ---------- py3_4: Python ----------
import System
import Grasshopper

class MyComponent(Grasshopper.Kernel.GH_ScriptInstance):
    def RunScript(self, x: System.Collections.Generic.List[object]):
        print(type(x))
        return
# ---------- end py3_4 ----------
py3_5 = Python3Script(x=range)  # -> out; inputs x: tree
# ---------- py3_5: Python ----------
import System
import Grasshopper

class MyComponent(Grasshopper.Kernel.GH_ScriptInstance):
    def RunScript(self, x: Grasshopper.DataTree[object]):
        print(type(x))
        return
# ---------- end py3_5 ----------
py3_6 = Python3Script(x=range)  # -> out; inputs x: tree; same code as py3_5
ipy2 = IronPython2Script(x=range)  # -> out
# ---------- ipy2: IronPython ----------
import System
import Grasshopper

class MyComponent(Grasshopper.Kernel.GH_ScriptInstance):
    def RunScript(self, x):
        print(type(x))
        return
# ---------- end ipy2 ----------
ipy2_2 = IronPython2Script(x=range)  # -> out; same code as ipy2
ipy2_3 = IronPython2Script(x=range)  # -> out; inputs x: list; same code as ipy2

# ---- group: Manually Set Marsh Inputs to False
ipy2_4 = IronPython2Script(x=range)  # -> out; inputs x: list; same code as ipy2

# ----
ipy2_5 = IronPython2Script(x=range)  # -> out; inputs x: tree; same code as ipy2
ipy2_6 = IronPython2Script(x=range)  # -> out; inputs x: tree; same code as ipy2
panel = Panel(py3_3)
panel_2 = Panel(py3_4)
panel_3 = Panel(py3_5)
panel_4 = Panel(py3_6)
panel_5 = Panel(py3)
panel_6 = Panel(py3_2)
panel_7 = Panel(ipy2)
panel_8 = Panel(ipy2_3)
panel_9 = Panel(ipy2_4)
panel_10 = Panel(python_3)
panel_11 = Panel(ipy2_2)
panel_12 = Panel(ipy2_5)
panel_13 = Panel(ipy2_6)
panel_14 = Panel(python)
panel_15 = Panel(python_2)

# ---- group: Trees should be 'DataTree'
tmatch = MatchText(Text=[py3_5, py3_6, ipy2_5, ipy2_6], RegEx="DataTree\[(O|o)bject\]'", Case=True)
at = AssertTrue(tmatch)

# ---- group: Items should be 'float'
tmatch_2 = MatchText(Text=[py3, ipy2, py3_2, ipy2_2], RegEx="'float'", Case=True)
at_2 = AssertTrue(tmatch_2)

# ---- group: Lists should be 'list'
tmatch_3 = MatchText(Text=[py3_3, ipy2_3], RegEx="'list'", Case=True)
at_3 = AssertTrue(tmatch_3)

# ---- group: Except when explicitly marshed into dotnet
tmatch_4 = MatchText(Text=[py3_4, ipy2_4], RegEx="List\[(O|o)bject\]'", Case=True)
at_4 = AssertTrue(tmatch_4)
