# Grasshopper definition test_params_inputs_marshalling_python_guids.ghx (Grasshopper 1.0.8)
# plug-ins: RhinoCodePluginGH

rec = Rectangle({Plane=PlaneXY(20.5, 12, 0), Size=Domain2(u=-17.5..17.5, v=-35..35)})
rec_2 = Rectangle({Plane=PlaneXY(20.5, 12, 0), Size=Domain2(u=-17.5..17.5, v=-35..35)})

# ---- group: AVOID MARSH OUTPUTS
rec_3 = Rectangle({Plane=PlaneXY(20.5, 12, 0), Size=Domain2(u=-17.5..17.5, v=-35..35)})
rec_4 = Rectangle({Plane=PlaneXY(20.5, 12, 0), Size=Domain2(u=-17.5..17.5, v=-35..35)})
py3 = Python3Script(y=rec_3)  # -> out
# ---------- py3: Python ----------
print(type(y))
# ---------- end py3 ----------
python = GhPythonScript(y=rec_3)  # -> out; same code as py3
py3_2 = Python3Script(y=rec_4)  # -> out; same code as py3
python_2 = GhPythonScript(y=rec_4)  # -> out; same code as py3
panel = Panel(py3)
panel_2 = Panel(python)
panel_3 = Panel(py3_2)
panel_4 = Panel(python_2)
tmatch = MatchText(Text=py3, RegEx="System\.Guid", Case=True)
tmatch_2 = MatchText(Text=python, RegEx="type \'Guid\'", Case=True)
tmatch_3 = MatchText(Text=py3_2, RegEx="Rhino\.Geometry\.Rectangle3d", Case=True)
tmatch_4 = MatchText(Text=python_2, RegEx="type \'Rectangle3d\'", Case=True)
and = GateAnd(A=tmatch, B=tmatch_2)
and_2 = GateAnd(A=tmatch_3, B=tmatch_4)

# ----
py3_3 = Python3Script(y=rec)  # -> out; same code as py3
python_3 = GhPythonScript(y=rec)  # -> out; same code as py3
py3_4 = Python3Script(y=rec_2)  # -> out; same code as py3
python_4 = GhPythonScript(y=rec_2)  # -> out; same code as py3
panel_5 = Panel(py3_3)
panel_6 = Panel(python_3)
panel_7 = Panel(py3_4)
panel_8 = Panel(python_4)
tmatch_5 = MatchText(Text=py3_3, RegEx="System\.Guid", Case=True)
tmatch_6 = MatchText(Text=python_3, RegEx="type \'Guid\'", Case=True)
tmatch_7 = MatchText(Text=py3_4, RegEx="Rhino\.Geometry\.Rectangle3d", Case=True)
tmatch_8 = MatchText(Text=python_4, RegEx="type \'Rectangle3d\'", Case=True)
and_3 = GateAnd(A=tmatch_5, B=tmatch_6)
and_4 = GateAnd(A=tmatch_7, B=tmatch_8)
and_5 = GateAnd(A=and_3, B=and_4, C=and, D=and_2)
panel_9 = Panel(and_5)
context_bake = ContextBake(Content=and_5)
