# Grasshopper definition test_params_inputs_marshalling_python_guids_accessKinds.ghx (Grasshopper 1.0.8)
# plug-ins: RhinoCodePluginGH

range = Range(Domain=Domain(0, 1), Steps=2)
python = GhPythonScript(x=range)  # -> out
# ---------- python: Python ----------
print(type(x))
# ---------- end python ----------
python_2 = GhPythonScript(x=range)  # -> out; inputs x: list; same code as python
python_3 = GhPythonScript(x=range)  # -> out; inputs x: tree; same code as python
py3 = Python3Script(x=range)  # -> out; same code as python
py3_2 = Python3Script(x=range)  # -> out; same code as python
py3_3 = Python3Script(x=range)  # -> out; inputs x: list; same code as python
py3_4 = Python3Script(x=range)  # -> out; inputs x: list; same code as python
py3_5 = Python3Script(x=range)  # -> out; inputs x: tree; same code as python
py3_6 = Python3Script(x=range)  # -> out; inputs x: tree; same code as python
ipy2 = IronPython2Script(x=range)  # -> out; same code as python
ipy2_2 = IronPython2Script(x=range)  # -> out; same code as python
ipy2_3 = IronPython2Script(x=range)  # -> out; inputs x: list; same code as python

# ---- group: Manually Set Marsh Inputs to False
ipy2_4 = IronPython2Script(x=range)  # -> out; inputs x: list; same code as python

# ----
ipy2_5 = IronPython2Script(x=range)  # -> out; inputs x: tree; same code as python
ipy2_6 = IronPython2Script(x=range)  # -> out; inputs x: tree; same code as python
panel = Panel(py3_3)
panel_2 = Panel(py3_4)
panel_3 = Panel(py3_5)
panel_4 = Panel(py3_6)
panel_5 = Panel(py3)
panel_6 = Panel(py3_2)
panel_7 = Panel(ipy2)
panel_8 = Panel(ipy2_3)
panel_9 = Panel(ipy2_4)
panel_10 = Panel(python_3)
panel_11 = Panel(ipy2_2)
panel_12 = Panel(ipy2_5)
panel_13 = Panel(ipy2_6)
panel_14 = Panel(python)
panel_15 = Panel(python_2)

# ---- group: Trees should be 'DataTree'
tmatch = MatchText(Text=[python_3, py3_5, py3_6, ipy2_5, ipy2_6], RegEx="DataTree\[(O|o)bject\]'", Case=True)
at = AssertTrue(tmatch)

# ---- group: Items should be 'float'
tmatch_2 = MatchText(Text=[python, py3, ipy2, py3_2, ipy2_2], RegEx="'float'", Case=True)
at_2 = AssertTrue(tmatch_2)

# ---- group: Lists should be 'list'
tmatch_3 = MatchText(Text=[python_2, py3_3, ipy2_3], RegEx="'list'", Case=True)
at_3 = AssertTrue(tmatch_3)

# ---- group: Except when explicitly marshed into dotnet
tmatch_4 = MatchText(Text=[py3_4, ipy2_4], RegEx="List\[(O|o)bject\]'", Case=True)
at_4 = AssertTrue(tmatch_4)
