# Grasshopper definition test_params_inputs_marshalling_python_guids_accessKinds_rhinoscriptsyntax.ghx (Grasshopper 1.0.8)
# plug-ins: RhinoCodePluginGH

panel = Panel("""650
560""")
srf = Surface([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])
python = GhPythonScript(x=srf)  # -> a
# ---------- python: Python ----------
import rhinoscriptsyntax as rs

a = rs.Area(x)
# ---------- end python ----------
python_2 = GhPythonScript(x=srf)  # -> a; inputs x: list
# ---------- python_2: Python ----------
import rhinoscriptsyntax as rs

sum = 0
for i in x:
    sum += rs.Area(i)

a = sum
# ---------- end python_2 ----------
python_3 = GhPythonScript(x=srf)  # -> a; inputs x: tree
# ---------- python_3: Python ----------
import rhinoscriptsyntax as rs
import Grasshopper

sum = 0
dt = x
for b in dt.Branches:
    for i in b:
        sum += rs.Area(i)

a = sum
# ---------- end python_3 ----------
py3 = Python3Script(x=srf)  # -> a; same code as python
py3_2 = Python3Script(x=srf)  # -> a; inputs x: list; same code as python_2
py3_3 = Python3Script(x=srf)  # -> a; inputs x: tree
# ---------- py3_3: Python ----------
import rhinoscriptsyntax as rs
import Grasshopper

sum = 0
dt: Grasshopper.DataTree = x
for b in dt.Branches:
    for i in b:
        sum += rs.Area(i)

a = sum
# ---------- end py3_3 ----------
ipy2 = IronPython2Script(x=srf)  # -> a; same code as python
ipy2_2 = IronPython2Script(x=srf)  # -> a; inputs x: list; same code as python_2
ipy2_3 = IronPython2Script(x=srf)  # -> a; inputs x: tree; same code as python_3
equals = Equality(FirstNumber=panel, SecondNumber=python)  # -> Equality, Inequality
equals_2 = Equality(FirstNumber="1210", SecondNumber=python_2)  # -> Equality, Inequality
equals_3 = Equality(FirstNumber="1210", SecondNumber=python_3)  # -> Equality, Inequality
equals_4 = Equality(FirstNumber=panel, SecondNumber=py3)  # -> Equality, Inequality
equals_5 = Equality(FirstNumber="1210", SecondNumber=py3_2)  # -> Equality, Inequality
equals_6 = Equality(FirstNumber="1210", SecondNumber=py3_3)  # -> Equality, Inequality
equals_7 = Equality(FirstNumber=panel, SecondNumber=ipy2)  # -> Equality, Inequality
equals_8 = Equality(FirstNumber="1210", SecondNumber=ipy2_2)  # -> Equality, Inequality
equals_9 = Equality(FirstNumber="1210", SecondNumber=ipy2_3)  # -> Equality, Inequality
panel_2 = Panel(equals.Equality)
panel_3 = Panel(equals_2.Equality)
panel_4 = Panel(equals_3.Equality)
panel_5 = Panel(equals_4.Equality)
panel_6 = Panel(equals_5.Equality)
panel_7 = Panel(equals_6.Equality)
panel_8 = Panel(equals_7.Equality)
panel_9 = Panel(equals_8.Equality)
panel_10 = Panel(equals_9.Equality)
python_4 = GhPythonScript(checks=flatten([equals.Equality, equals_2.Equality, equals_3.Equality, equals_4.Equality, equals_5.Equality, equals_6.Equality, equals_7.Equality, equals_8.Equality, equals_9.Equality]))  # -> all_true; inputs checks: list
# ---------- python_4: Python ----------
all_true = all(checks)
# ---------- end python_4 ----------
panel_11 = Panel(python_4)
context_bake = ContextBake(Content=python_4)
