# Grasshopper definition test_params_inputs_marshalling_python_guids_nested.ghx (Grasshopper 1.0.8)
# plug-ins: RhinoCodePluginGH

# ---- group: BREAK IN BEHAVIOUR
# BREAK IN BEHAVIOUR. SEE
# https://mcneel.myjetbrains.com/youtrack/issue/RH-81471
number_slider = Slider(12, range=0..100)
py3 = Python3Script(r=number_slider)  # -> a
# ---------- py3: Python ----------
import rhinoscriptsyntax as rs

a = rs.AddSphere((1,1,0), r)
# ---------- end py3 ----------
id = Guid(py3)
py3_2 = Python3Script(x=py3)  # -> out, a
# ---------- py3_2: Python ----------
print(type(x))
a = x
# ---------- end py3_2 ----------
id_2 = Guid(py3_2.a)

# ----
python = GhPythonScript(r=Slider(12, range=0..100))  # -> a; same code as py3
id_3 = Guid(python)
python_2 = GhPythonScript(x=python)  # -> out, a; same code as py3_2
brep = Brep(python_2.a)
tmatch = MatchText(Text=[python_2.out, py3_2.out], RegEx="Guid'\>", Case=True)

# ---- group: ALSO NO ERRORS ON PARAMS
python_3 = GhPythonScript(checks=flatten(tmatch))  # -> all_true; inputs checks: list
# ---------- python_3: Python ----------
all_true = all(checks)
# ---------- end python_3 ----------
context_bake = ContextBake(Content=python_3)
panel = Panel(python_3)
