# Grasshopper definition test_params_inputs_marshalling_python_scriptinstance_rc8.6_rc8.7.ghx (Grasshopper 1.0.8)
# plug-ins: RhinoCodePluginGH

range = Range(Domain=Domain(0, 1), Steps=Slider(2, range=0..2))
python_3_script = Python3Script(x=range)  # -> out, a; inputs x: list
# ---------- python_3_script: Python ----------
import System
import Rhino
import Grasshopper

import rhinoscriptsyntax as rs


class MyComponent(Grasshopper.Kernel.GH_ScriptInstance):
    def RunScript(self, x: list[object]):
        print(type(x))
        return x
# ---------- end python_3_script ----------
python_3_script_2 = Python3Script(x=range)  # -> out, a; inputs x: list
# ---------- python_3_script_2: Python ----------
import System
import Rhino
import Grasshopper

import rhinoscriptsyntax as rs


class MyComponent(Grasshopper.Kernel.GH_ScriptInstance):
    def RunScript(self, x: System.Collections.Generic.List[object]):
        print(type(x))
        return x
# ---------- end python_3_script_2 ----------
ironpython_2_script = IronPython2Script(x=range)  # -> out, a; inputs x: list
# ---------- ironpython_2_script: IronPython ----------
import System
import Rhino
import Grasshopper

import rhinoscriptsyntax as rs


class MyComponent(Grasshopper.Kernel.GH_ScriptInstance):
    def RunScript(self, x):
        print(type(x))
        return x
# ---------- end ironpython_2_script ----------
ironpython_2_script_2 = IronPython2Script(i=python_3_script.a)  # -> out
# ---------- ironpython_2_script_2: IronPython ----------
print(type(i))
# ---------- end ironpython_2_script_2 ----------
ironpython_2_script_3 = IronPython2Script(i=python_3_script_2.a)  # -> out; same code as ironpython_2_script_2
ironpython_2_script_4 = IronPython2Script(i=ironpython_2_script.a)  # -> out; same code as ironpython_2_script_2
panel = Panel(python_3_script.out)
panel_2 = Panel(python_3_script_2.out)
panel_3 = Panel(ironpython_2_script.out)
panel_4 = Panel(ironpython_2_script_2)
panel_5 = Panel(ironpython_2_script_3)
panel_6 = Panel(ironpython_2_script_4)
tmatch = MatchText(Text=ironpython_2_script_4, RegEx="type \'float\'", Case=True)
tmatch_2 = MatchText(Text=ironpython_2_script.out, RegEx="type \'List\[object\]\'", Case=True)
tmatch_3 = MatchText(Text=python_3_script.out, RegEx="class \'list\'", Case=True)
tmatch_4 = MatchText(Text=ironpython_2_script_2, RegEx="type \'float\'", Case=True)
tmatch_5 = MatchText(Text=python_3_script_2.out, RegEx="class \'System\.Collections\.Generic\.List\[Object\]\'", Case=True)
tmatch_6 = MatchText(Text=ironpython_2_script_3, RegEx="type \'float\'", Case=True)
panel_7 = Panel(tmatch_3)
panel_8 = Panel(tmatch_4)
panel_9 = Panel(tmatch_5)
panel_10 = Panel(tmatch_6)
panel_11 = Panel(tmatch_2)
panel_12 = Panel(tmatch)
python = GhPythonScript(checks=flatten([tmatch_3, tmatch_4, tmatch_5, tmatch_6, tmatch_2, tmatch]))  # -> all_true; inputs checks: list
# ---------- python: Python ----------
all_true = all(checks)
# ---------- end python ----------
context_bake = ContextBake(Content=python)
panel_13 = Panel(python)
