# Grasshopper definition test_params_inputs_polyline_to_point3dList_convert.ghx (Grasshopper 1.0.8)
# plug-ins: RhinoCodePluginGH

pt = Point([Point(-8, -27, 0), Point(-25, -7, 0), Point(-20, 8, 0), Point(-1, 36, 0), Point(17, 17, 0), Point(4, -8, 0)])
pt_2 = Point([Point(-8, -27, 0), Point(-25, -7, 0), Point(-20, 8, 0), Point(-1, 36, 0), Point(17, 17, 0), Point(4, -8, 0)])
entwine = Entwine(Branch00=pt_2, Branch01=pt, FlattenInputs=True)

# ---- group: CREATING POLYLINE -> POLYLINE_CURVE
python_3_script = Python3Script(points=entwine)  # -> polyline; inputs points: list of Point3d
# ---------- python_3_script: Python ----------
from Rhino.Geometry import Polyline, PolylineCurve
polyline = Polyline(points)
polylineCurve = PolylineCurve(points)
# ---------- end python_3_script ----------

# ----
# Input has Point3dList converter
pline = PolyLine(Vertices=entwine, Closed=False)
py3 = Python3Script(points=pline)  # -> a
# ---------- py3: Python ----------
print(type(points))
a = points
# ---------- end py3 ----------
py3_2 = Python3Script(points=python_3_script)  # -> a; same code as py3
pt_3 = Point(py3_2)
pt_4 = Point(py3)
lng = ListLength(List=pt_3)
lng_2 = ListLength(List=pt_4)
panel = Panel("""6
6""")
equals = Equality(FirstNumber=lng, SecondNumber=panel)  # -> Equality, Inequality
equals_2 = Equality(FirstNumber=lng_2, SecondNumber=panel)  # -> Equality, Inequality
python = GhPythonScript(checks=flatten([equals.Equality, equals_2.Equality]))  # -> all_true; inputs checks: list
# ---------- python: Python ----------
all_true = all(checks)
# ---------- end python ----------
panel_2 = Panel(python)
context_bake = ContextBake(Content=python)
