# Grasshopper definition test_params_inputs_python2_valueType_rc8.18.ghx (Grasshopper 1.0.8)

# No type hint
py3 = Python3Script()  # -> a
# ---------- py3: Python ----------
if x is not None:
    a = "INPUT"
else:
    a = "NOINPUT"
# ---------- end py3 ----------
# Type hint: Str
# Type hint: ghdoc object
py3_2 = Python3Script()  # -> a; inputs x: String; same code as py3
py3_3 = Python3Script()  # -> a; same code as py3
# Type hint: Curve
py3_4 = Python3Script()  # -> a; inputs x: Curve; same code as py3
# Type hint: GeometryBase
py3_5 = Python3Script()  # -> a; inputs x: GeometryBase; same code as py3
c_script = CSharpScript()  # -> a
# ---------- c_script: C# ----------
if (x is null)
    a = "NOINPUT";
else
    a = "INPUT";
# ---------- end c_script ----------
tmatch = MatchText(Text=py3, RegEx="NOINPUT", Case=True)
tmatch_2 = MatchText(Text=py3_2, RegEx="NOINPUT", Case=True)
tmatch_3 = MatchText(Text=py3_3, RegEx="NOINPUT", Case=True)
tmatch_4 = MatchText(Text=py3_4, RegEx="NOINPUT", Case=True)
tmatch_5 = MatchText(Text=py3_5, RegEx="NOINPUT", Case=True)
tmatch_6 = MatchText(Text=c_script, RegEx="NOINPUT", Case=True)
at = AssertTrue(tmatch)
at_2 = AssertTrue(tmatch_2)
at_3 = AssertTrue(tmatch_3)
at_4 = AssertTrue(tmatch_4)
at_5 = AssertTrue(tmatch_5)
at_6 = AssertTrue(tmatch_6)

# ---- group: Value Type Hints
# Type hint: Float
# Type hint: Boolean
# Type hint: Integer
# Type hint: Point 3d
py3_6 = Python3Script()  # -> a; inputs x: Double; same code as py3
py3_7 = Python3Script()  # -> a; inputs x: Boolean; same code as py3
py3_8 = Python3Script()  # -> a; inputs x: Int32; same code as py3
py3_9 = Python3Script()  # -> a; inputs x: Point3d; same code as py3
tmatch_7 = MatchText(Text=py3_6, RegEx="NOINPUT", Case=True)
tmatch_8 = MatchText(Text=py3_7, RegEx="NOINPUT", Case=True)
tmatch_9 = MatchText(Text=py3_8, RegEx="NOINPUT", Case=True)
tmatch_10 = MatchText(Text=py3_9, RegEx="NOINPUT", Case=True)
at_7 = AssertTrue(tmatch_7)
at_8 = AssertTrue(tmatch_8)
at_9 = AssertTrue(tmatch_9)
at_10 = AssertTrue(tmatch_10)

# ---- group: Non-Nullable Types can not be NULL in C#
c_script_2 = CSharpScript()  # -> a; inputs x: Int32; disabled; same code as c_script
tmatch_11 = MatchText(Text=c_script_2, RegEx="NOINPUT", Case=True)  # disabled
at_11 = AssertTrue(tmatch_11)  # disabled
