# Grasshopper definition test_params_inputs_python_ghobjectHint.ghx (Grasshopper 1.0.8)
# plug-ins: RhinoCodePluginGH

python_3_script = Python3Script()  # -> objectId, nomarsh
# ---------- python_3_script: Python ----------
import Rhino
import Rhino.Geometry as RG
import rhinoscriptsyntax as rs

objectId = rs.AddRectangle(RG.Plane.WorldXY, 10, 10)
nomarsh = RG.Rectangle3d(RG.Plane.WorldXY, 10, 10)
# ---------- end python_3_script ----------
ghpython_script = GhPythonScript()  # -> objectId, nomarsh; same code as python_3_script
python_3_script_2 = Python3Script(x=python_3_script.objectId, y=python_3_script.nomarsh, y_hinted=python_3_script.nomarsh)  # -> out, nomarsh_x, nomarsh_y, nomarsh_y_hinted
# ---------- python_3_script_2: Python ----------
print(f"x:        {type(x)}")
print(f"y:        {type(y)}")
print(f"y_hinted: {type(y_hinted)}")
nomarsh_x = x
nomarsh_y = y
nomarsh_y_hinted = y_hinted
# ---------- end python_3_script_2 ----------
ghpython_script_2 = GhPythonScript(x=ghpython_script.objectId, y=ghpython_script.nomarsh, y_hinted=ghpython_script.nomarsh)  # -> out, nomarsh_x, nomarsh_y, nomarsh_y_hinted
# ---------- ghpython_script_2: Python ----------
print("x:        {}".format(type(x)))
print("y:        {}".format(type(y)))
print("y_hinted: {}".format(type(y_hinted)))
nomarsh_x = x
nomarsh_y = y
nomarsh_y_hinted = y_hinted
# ---------- end ghpython_script_2 ----------
panel = Panel(python_3_script_2.out)
panel_2 = Panel([python_3_script_2.nomarsh_x, python_3_script_2.nomarsh_y, python_3_script_2.nomarsh_y_hinted])
panel_3 = Panel([ghpython_script_2.nomarsh_x, ghpython_script_2.nomarsh_y, ghpython_script_2.nomarsh_y_hinted])
panel_4 = Panel(ghpython_script_2.out)
id = Guid(python_3_script_2.nomarsh_x)
rec = Rectangle(python_3_script_2.nomarsh_y)
id_2 = Guid(ghpython_script_2.nomarsh_x)
rec_2 = Rectangle(ghpython_script_2.nomarsh_y)
# should not throw any errors on parameters
bool = Boolean(True)
context_bake = ContextBake(Content=bool)
