# Grasshopper definition test_params_inputs_python_polyline_convert.ghx (Grasshopper 1.0.8)
# plug-ins: RhinoCodePluginGH

pt = Point([Point(0, 0, 0), Point(5, 0, 0), Point(5, 5, 0), Point(0, 5, 0)])
pt_2 = Point([Point(0, 0, 0), Point(5, 0, 0), Point(5, 5, 0), Point(0, 5, 0)])
pline = PolyLine(Vertices=pt, Closed=False)
panel = Panel(pline)
pline_2 = PolyLine(Vertices=pt_2, Closed=False)
panel_2 = Panel(pline_2)
py3 = Python3Script(pl=pline)  # -> a
# ---------- py3: Python ----------
#! python 3
from System import Guid
import Rhino.Geometry as RG
a = isinstance(pl, Guid)
# ---------- end py3 ----------
ipy2 = IronPython2Script(pl=pline)  # -> a
# ---------- ipy2: IronPython ----------
#! python 2
from System import Guid
import Rhino.Geometry as RG
a = isinstance(pl, Guid)
# ---------- end ipy2 ----------
python = GhPythonScript(pl=pline)  # -> a
# ---------- python: Python ----------
from System import Guid
import Rhino.Geometry as RG
a = isinstance(pl, Guid)
# ---------- end python ----------
py3_2 = Python3Script(pl=pline_2)  # -> a; inputs pl: Polyline
# ---------- py3_2: Python ----------
#! python 3
import Rhino.Geometry as RG
a = isinstance(pl, RG.Polyline)
# ---------- end py3_2 ----------
ipy2_2 = IronPython2Script(pl=pline_2)  # -> a; inputs pl: Polyline
# ---------- ipy2_2: IronPython ----------
#! python 2
import Rhino.Geometry as RG
a = isinstance(pl, RG.Polyline)
# ---------- end ipy2_2 ----------
python_2 = GhPythonScript(pl=pline_2)  # -> a; inputs pl: Polyline
# ---------- python_2: Python ----------
import Rhino.Geometry as RG
a = isinstance(pl, RG.Polyline)
# ---------- end python_2 ----------
panel_3 = Panel(py3_2)
panel_4 = Panel(ipy2_2)
panel_5 = Panel(python_2)
panel_6 = Panel(py3)
panel_7 = Panel(ipy2)
panel_8 = Panel(python)
and = GateAnd(A=py3, B=ipy2)
and_2 = GateAnd(A=py3_2, B=ipy2_2)
and_3 = GateAnd(A=and, B=python)
and_4 = GateAnd(A=and_2, B=python_2)
and_5 = GateAnd(A=and_4, B=and_3)
context_bake = ContextBake(Content=and_5)
panel_9 = Panel(and_5)
