# Grasshopper definition test_params_inputs_python_polyline_rc8.8.ghx (Grasshopper 1.0.8)
# plug-ins: RhinoCodePluginGH

panel = Panel("""#! python
import Rhino.Geometry as rg
pts = []
pts.append(rg.Point3d(0, 0, 0))
pts.append(rg.Point3d(10,0, 0))
pts.append(rg.Point3d(10,10,0))
pts.append(rg.Point3d(0, 10,0))
pts.append(rg.Point3d(0, 0, 0))
a = [rg.Polyline(pts)]*5""")
panel_2 = Panel("""#! python
import Rhino.Geometry as rg
pts = []
pts.append(rg.Point3d(0, 0, 0))
pts.append(rg.Point3d(10,0, 0))
pts.append(rg.Point3d(10,10,0))
pts.append(rg.Point3d(0, 10,0))
pts.append(rg.Point3d(0, 0, 0))
a = [rg.Polyline(pts).ToNurbsCurve()]*5""")
panel_3 = Panel("""#! python 3
import Rhino.Geometry as rg
pts = []
pts.append(rg.Point3d(0, 0, 0))
pts.append(rg.Point3d(10,0, 0))
pts.append(rg.Point3d(10,10,0))
pts.append(rg.Point3d(0, 10,0))
pts.append(rg.Point3d(0, 0, 0))
a = rg.Polyline(pts).ToNurbsCurve()""")
S = Script(script=panel_3)  # -> a
#   port script: Script to execute
# ---------- S: Python ----------
import Rhino.Geometry as rg
pts = []
pts.append(rg.Point3d(0,0,0))
pts.append(rg.Point3d(10,0,0))
pts.append(rg.Point3d(10,10,0))
pts.append(rg.Point3d(0,10,0))
pts.append(rg.Point3d(0,0,0))
a = rg.Polyline(pts)
# ---------- end S ----------
S_2 = Script(script=panel)  # -> a; same code as S
S_3 = Script(script=panel_2)  # -> a; same code as S
python = GhPythonScript(Code=panel_3)
python_2 = GhPythonScript(Code=panel)
python_3 = GhPythonScript(Code=panel_2)
crv = Curve(S)
crv_2 = Curve(python_3)
crv_3 = Curve(python)
py3 = Python3Script(poly=[python, S])  # -> a
# ---------- py3: Python ----------
a = poly
# ---------- end py3 ----------
crv_4 = Curve(python_2)
crv_5 = Curve(S_3)
crv_6 = Curve(S_2)
panel_4 = Panel(crv)
panel_5 = Panel(crv_3)
panel_6 = Panel(crv_6)
panel_7 = Panel(crv_2)
panel_8 = Panel(crv_4)
id = Guid(py3)
panel_9 = Panel(crv_5)
panel_10 = Panel(id)
panel_11 = Panel("""{0, 0, 0}
{10, 0, 0}
{10, 10, 0}
{0, 10, 0}
{0, 0, 0}""")
tmatch = MatchText(Text=[panel_5, panel_4, panel_8, panel_6, panel_7, panel_9], RegEx="Polyline Curve", Case=True)
at = AssertTrue(tmatch)

# ---- group: NO HINT ON OUTPUT - IT IS MARSHALLED INTO A LIST
panel_12 = Panel("""#! python
import Rhino.Geometry as rg
pts = []
pts.append(rg.Point3d(0, 0, 0))
pts.append(rg.Point3d(10,0, 0))
pts.append(rg.Point3d(10,10,0))
pts.append(rg.Point3d(0, 10,0))
pts.append(rg.Point3d(0, 0, 0))
a = rg.Polyline(pts)""")
S_4 = Script(script=panel_12)  # -> a; same code as S
python_4 = GhPythonScript(Code=panel_12)
panel_13 = Panel(python_4)

# ----
crv_7 = Curve(S_4)

# ---- group: NO HINT ON OUTPUT - IT IS MARSHALLED INTO A LIST (continued)
panel_14 = Panel(crv_7)

# ----
tmatch_2 = MatchText(Text=panel_13, RegEx=panel_11, Case=True)
at_2 = AssertTrue(tmatch_2)
