# Grasshopper definition test_params_inputs_required_rc8.14_warning.ghx (Grasshopper 1.0.8)
# plug-ins: RhinoCodePluginGH

py3 = Python3Script(x=Slider(42, range=0..100))  # -> out, a
# ---------- py3: Python ----------
a = x + (y or 10)
# ---------- end py3 ----------
