# Grasshopper definition test_params_inputs_strEnumerable.ghx (Grasshopper 1.0.8)
# plug-ins: RhinoCodePluginGH

path = FilePath("C:\Users\Adam\Documents\GitHub\RePoseNotebook\RePose\Output\2023_11_30\1701331429\1701331429_best_loss.pt")
py3 = Python3Script(x=path)  # -> out, a
# ---------- py3: Python ----------
"""Grasshopper Script"""
a = x
print(type(x))
# ---------- end py3 ----------
panel = Panel(py3.a)
panel_2 = Panel(py3.out)
tmatch = MatchText(Text=py3.out, RegEx="class \'str\'", Case=True)
panel_3 = Panel(tmatch)
lng = ListLength(List=py3.a)
equals = Equality(FirstNumber=Slider(1, range=0..1), SecondNumber=lng)  # -> Equality, Inequality
and = GateAnd(A=equals.Equality, B=tmatch)
context_bake = ContextBake(Content=and)
panel_4 = Panel(and)
