# Grasshopper definition test_params_inputs_upstreamUpdate.ghx (Grasshopper 1.0.8)
# plug-ins: RhinoCodePluginGH

# https://mcneel.myjetbrains.com/youtrack/issue/RH-81617/GH-Script-component-changes-upstream-mesh
mesh = Mesh(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)
c_script = CSharpScript(im=mesh, n=Slider(16, range=0..100))  # -> om; inputs im: Mesh, n: Int32
# ---------- c_script: C# ----------
// Grasshopper Script Instance
#region Usings
using System;
using System.Linq;
using System.Collections;
using System.Collections.Generic;
using System.Drawing;

using Rhino;
using Rhino.Geometry;

using Grasshopper;
using Grasshopper.Kernel;
using Grasshopper.Kernel.Data;
using Grasshopper.Kernel.Types;
#endregion

public class Script_Instance : GH_ScriptInstance
{
    #region Notes
    /* 
      Members:
        RhinoDoc RhinoDocument
        GH_Document GrasshopperDocument
        IGH_Component Component
        int Iteration

      Methods (Virtual & overridable):
        Print(string text)
        Print(string format, params object[] args)
        Reflect(object obj)
        Reflect(object obj, string method_name)
    */
    #endregion

    private void RunScript(Mesh im, int n, ref object om)
    {
        im.Reduce(n, true, 10, true);
        om = im;
    }
}
# ---------- end c_script ----------
panel = Panel("""Mesh \(V:561  F:512\)
Mesh \(V:16  F:16\)""")

# ---- group: THIS MUST BE AFTER SCRIPT TO CAPTURE UPSTREAM UPDATE IF HAPPENS BY SCRIPT
tmatch = MatchText(Text=[mesh, c_script], RegEx=panel, Case=True)

# ----
and = GateAnd(A=tmatch)
context_bake = ContextBake(Content=and)
panel_2 = Panel(and)
