# Grasshopper definition test_params_libraryInParam_csharp_to_python3_rc8.14.ghx (Grasshopper 1.0.8)
# plug-ins: RhinoCodePluginGH

python_3_script = Python3Script(library="TestLibraryInputCSharpInPython3")  # -> out, a; inputs library: tree
#   port library: Library or libraries to execute script with
# ---------- python_3_script: Python ----------
from TestLibraryInput.CSharpInPython3 import TestClass
print(TestClass())
# ---------- end python_3_script ----------
panel = Panel(python_3_script.out)
tmatch = MatchText(Text=panel, RegEx="TestLibraryInput\.CSharpInPython3\.TestClass", Case=True)
at = AssertTrue(tmatch)
