# Grasshopper definition test_params_marshalling_python_dict.ghx (Grasshopper 1.0.8)
# plug-ins: RhinoCodePluginGH

panel = Panel("""#! python 3
a = [
  {'foo1': 'bar1'},
  {'foo2': 'bar2'}
]""")
panel_2 = Panel("""#! python 3
print(type(x))
k = x.keys()
v = x.values()""")
panel_3 = Panel("System.Collections.Generic.Dictionary`2\[Grasshopper.Kernel.Types.IGH_Goo,Grasshopper.Kernel.Types.IGH_Goo\]")
py3 = Python3Script(script=panel)  # -> a
#   port script: Script to execute
# ---------- py3: Python ----------
a = [{'foo1': 'bar1'}, {'foo2': 'bar2'}]
# ---------- end py3 ----------
py3_2 = Python3Script(script=panel_2, x=py3)  # -> out, k, v
#   port script: Script to execute
# ---------- py3_2: Python ----------
print(type(x))
k = x.keys()
v = x.values()
# ---------- end py3_2 ----------
panel_4 = Panel("""bar1
bar2""")
panel_5 = Panel("""foo1
foo2""")
tmatch = MatchText(Text=flatten(py3_2.out), RegEx="dict'\>", Case=True)
tmatch_2 = MatchText(Text=py3, RegEx=panel_3, Case=True)
tmatch_3 = MatchText(Text=py3_2.k, RegEx=panel_5, Case=True)
tmatch_4 = MatchText(Text=py3_2.v, RegEx=panel_4, Case=True)
python = GhPythonScript(checks=flatten([tmatch_2, tmatch, tmatch_3, tmatch_4]))  # -> all_true; inputs checks: list
# ---------- python: Python ----------
all_true = all(checks)
# ---------- end python ----------
panel_6 = Panel(python)
context_bake = ContextBake(Content=python)
