# Grasshopper definition test_params_modelObject_layer_rc8.9_error.ghx (Grasshopper 1.0.8)
# plug-ins: RhinoCodePluginGH

python_3_script = Python3Script(ml="Layer Name")  # -> out
# ---------- python_3_script: Python ----------
print(type(mo))
# ---------- end python_3_script ----------
ironpython_2_script = IronPython2Script(ml="Layer Name")  # -> out
# ---------- ironpython_2_script: IronPython ----------
"""Grasshopper Script"""
a = "Hello IronPython 2 in Grasshopper!"
print(a)
# ---------- end ironpython_2_script ----------
panel = Panel(python_3_script)
panel_2 = Panel(ironpython_2_script)
