# Grasshopper definition test_params_modelObject_layer_rc8.9_onlyLocal_error.ghx (Grasshopper 1.0.8)
# plug-ins: RhinoCodePluginGH

python_3_script = Python3Script(ml="Layer Name")  # -> out
# ---------- python_3_script: Python ----------
print(type(ml))
# ---------- end python_3_script ----------
ironpython_2_script = IronPython2Script(ml="Layer Name")  # -> out; same code as python_3_script
panel = Panel(python_3_script)
panel_2 = Panel(ironpython_2_script)
tmatch = MatchText(Text=panel_2, RegEx="ModelLayer", Case=True)
tmatch_2 = MatchText(Text=panel, RegEx="Grasshopper.Rhinoceros.Model.ModelLayer", Case=True)
at = AssertTrue(tmatch_2)
at_2 = AssertTrue(tmatch)
