# Grasshopper definition test_params_modelObject_modify_rc8.9_onlyLocal.ghx (Grasshopper 1.0.8)

python_3_script = Python3Script()  # -> model
# ---------- python_3_script: Python ----------
import Rhino.Geometry as RG
from Grasshopper.Rhinoceros import ModelContentName
from Grasshopper.Rhinoceros.Model import ModelObject, ModelLayer

sphere = RG.Sphere(RG.Point3d.Origin, 10)
brep = sphere.ToBrep()


mo_builder = ModelObject.Cast(brep).ToAttributes()
layer_attribs = ModelLayer.Attributes()
layer_attribs.Name = ModelContentName("LayerName")
mo_builder.Layer = layer_attribs


model  = mo_builder
# ---------- end python_3_script ----------
sphere = Sphere(Base=PlaneXY(0, 0, 0), Radius=1)
python_3_script_2 = Python3Script(mo=python_3_script)  # -> out, new_mo; inputs mo: Model
# ---------- python_3_script_2: Python ----------
print(type(mo))
builder = mo.ToAttributes()
new_mo = builder.ToModelData()
# fix casting
# new_mo.Layer = "sfd"
# ---------- end python_3_script_2 ----------
model_object = ModelObject(Object=python_3_script)  # -> Object, Geometry, Name, Layer, Visibility, Display, Drafting, Render
panel = Panel(python_3_script)
python_3_script_3 = Python3Script(mo=python_3_script)  # -> a; unedited script template
brep = Brep(sphere)
python_3_script_4 = Python3Script(mo=brep)  # -> out; inputs mo: Model
# ---------- python_3_script_4: Python ----------
print(type(mo))
# ---------- end python_3_script_4 ----------
panel_2 = Panel(python_3_script_2.new_mo)
python_3_script_5 = Python3Script(mo=python_3_script)  # -> out, layer; inputs mo: Model
# ---------- python_3_script_5: Python ----------
print(type(mo))
layer = mo.Layer
# ---------- end python_3_script_5 ----------
panel_3 = Panel(model_object.Layer)
panel_4 = Panel(python_3_script_4)
panel_5 = Panel(python_3_script_5.out)
panel_6 = Panel(python_3_script_5.layer)
ironpython_2_script = IronPython2Script()  # -> model
# ---------- ironpython_2_script: IronPython ----------
import Rhino.Geometry as RG
from Grasshopper.Rhinoceros import ModelContentName
from Grasshopper.Rhinoceros.Model import ModelObject, ModelLayer

sphere = RG.Sphere(RG.Point3d.Origin, 10)
brep = sphere.ToBrep()


mo_builder = ModelObject.Cast(brep).ToAttributes()
mo_builder.Layer = "LayerName"


model  = mo_builder.ToModelData()
# ---------- end ironpython_2_script ----------
model_object_2 = ModelObject(Object=ironpython_2_script)  # -> Object, Geometry, Name, Layer, Visibility, Display, Drafting, Render
panel_7 = Panel(ironpython_2_script)
tmatch = MatchText(Text=panel_4, RegEx="Grasshopper.Rhinoceros.Model.ModelObject", Case=True)
panel_8 = Panel(model_object_2.Layer)
at = AssertTrue(tmatch)
tmatch_2 = MatchText(Text=[python_3_script_2.new_mo, python_3_script, ironpython_2_script], RegEx=panel, Case=True)
tmatch_3 = MatchText(Text=[python_3_script_5.layer, model_object.Layer, model_object_2.Layer], RegEx="LayerName", Case=True)
at_2 = AssertTrue(tmatch_2)
at_3 = AssertTrue(tmatch_3)
