# Grasshopper definition test_params_modelObject_rc8.8_error.ghx (Grasshopper 1.0.8)
# plug-ins: RhinoCodePluginGH

python_3_script = Python3Script(relpath="test_params_modelObject.3dm")  # -> doc; inputs relpath: String
# ---------- python_3_script: Python ----------
import Rhino

doc = Rhino.RhinoDoc.OpenHeadless(relpath)
# ---------- end python_3_script ----------
python_3_script_2 = Python3Script(doc=python_3_script)  # -> a
# ---------- python_3_script_2: Python ----------
import Rhino

rdoc: Rhino.RhinoDoc = doc

a = list(rdoc.Objects)[0]
# ---------- end python_3_script_2 ----------
panel = Panel(python_3_script_2)
model_object = ModelObject(python_3_script_2)
