# Grasshopper definition test_params_modelObject_rc8.9.ghx (Grasshopper 1.0.8)
# plug-ins: RhinoCodePluginGH

python_3_script = Python3Script(relpath="test_params_modelObject.3dm")  # -> fullpath; inputs relpath: String
# ---------- python_3_script: Python ----------
fullpath = relpath
# ---------- end python_3_script ----------
import_3dm = Import3DM(File=python_3_script, Layer="*", Name="*")
model_object = ModelObject(import_3dm)
brep = Brep(model_object)
object = ModelObject(Object=model_object)  # -> Object, Geometry, Name, Layer, Visibility, Display, Drafting, Render
python_3_script_2 = Python3Script(x=model_object)  # -> res, a
# ---------- python_3_script_2: Python ----------
"""Grasshopper Script"""
import Rhino.Geometry as RG

res, a = x.CastTo[RG.Brep]()

print(type(a))
# ---------- end python_3_script_2 ----------
python_3_script_3 = Python3Script(x=model_object)  # -> a
# ---------- python_3_script_3: Python ----------
"""Grasshopper Script"""
import Rhino.Geometry as RG
import Grasshopper.Kernel.Types as GT

res, a = x.CastTo[GT.GH_Brep]()

print(type(a))
print(type(a.Value))
# ---------- end python_3_script_3 ----------
python_3_script_4 = Python3Script(x=object.Geometry)  # -> out, a
# ---------- python_3_script_4: Python ----------
print(type(x))
a = x
# ---------- end python_3_script_4 ----------
panel = Panel(python_3_script_4.out)
panel_2 = Panel(python_3_script_2.a)
panel_3 = Panel(python_3_script_3)
brep_2 = Brep(python_3_script_3)
brep_3 = Brep(python_3_script_4.a)
assert_true = AssertTrue(python_3_script_2.res)
match_text = MatchText(Text=python_3_script_4.out, RegEx="'Rhino.Geometry.Brep'\>", Case=True)
assert_true_2 = AssertTrue(match_text)
match_text_2 = MatchText(Text=[panel_3, python_3_script_2.a], RegEx="Untrimmed Surface", Case=True)
assert_true_3 = AssertTrue(match_text_2)
