# Grasshopper definition test_params_output_convert_pointcloud_rc8.8.ghx (Grasshopper 1.0.8)
# plug-ins: RhinoCodePluginGH

range = Range(Domain=Domain(0, 1), Steps=10)
pt = ConstructPoint(XCoordinate=range, YCoordinate=range, ZCoordinate=range)
py3 = Python3Script(points=pt)  # -> pcloud; inputs points: list
# ---------- py3: Python ----------
import Rhino.Geometry as RG
from System.Collections.Generic import List

# pcloud = RG.PointCloud()
# pcloud.AddRange(points)

# pcloud = [
#     List[RG.Point3d](points),
#     List[RG.Point3d](points),
# ]

pcloud = points
# ---------- end py3 ----------
ipy2 = IronPython2Script(points=pt)  # -> pcloud; inputs points: list; same code as py3
lng = ListLength(List=pt)
pcloud = PointCloud(py3)
pcloud_2 = PointCloud(ipy2)
lng_2 = ListLength(List=pcloud)
lng_3 = ListLength(List=pcloud_2)
equals = Equality(FirstNumber=lng_3, SecondNumber=lng)  # -> Equality, Inequality
equals_2 = Equality(FirstNumber=lng_2, SecondNumber=lng)  # -> Equality, Inequality
at = AssertTrue(equals_2.Equality)
at_2 = AssertTrue(equals.Equality)
