# Grasshopper definition test_params_outputs_convert_list_rc8.7.ghx (Grasshopper 1.0.8)
# plug-ins: RhinoCodePluginGH

# ---- group: MARSH
py3 = Python3Script()  # -> a
# ---------- py3: Python ----------
import rhinoscriptsyntax as rs

a = []
a.append(rs.AddCircle((1, 1, 0), 10))
a.append(rs.AddCircle((1, 1, 0), 20))
a.append(rs.AddCircle((1, 1, 0), 30))
# ---------- end py3 ----------
py3_2 = Python3Script()  # -> a; same code as py3
py3_3 = Python3Script()  # -> a; same code as py3
py3_4 = Python3Script()  # -> a; same code as py3
panel = Panel(py3)
panel_2 = Panel(py3_2)
panel_3 = Panel(py3_3)
panel_4 = Panel(py3_4)
num = Number(py3)
pln = Plane(py3_2)
crv = Curve(py3_3)
circle = Circle(py3_4)

# ---- group: NO MARSH
py3_5 = Python3Script()  # -> a; same code as py3
py3_6 = Python3Script()  # -> a; same code as py3
py3_7 = Python3Script()  # -> a; same code as py3
py3_8 = Python3Script()  # -> a; same code as py3
id = Guid(py3_5)
id_2 = Guid(py3_6)
id_3 = Guid(py3_7)
id_4 = Guid(py3_8)

# ---- group: EXPECT NO ERRORS
toggle = BooleanToggle(True)
panel_5 = Panel(toggle)
context_bake = ContextBake(Content=toggle)

# ---- group: MARSH
c_script = CSharpScript()  # -> a
# ---------- c_script: C# ----------
using System;
using System.Collections.Generic;
using Rhino.Geometry;

var circles = new List<Circle>();
circles.Add(new Circle(10));
circles.Add(new Circle(20));
circles.Add(new Circle(30));

a = circles;
# ---------- end c_script ----------
c_script_2 = CSharpScript()  # -> a; same code as c_script
c_script_3 = CSharpScript()  # -> a; same code as c_script
c_script_4 = CSharpScript()  # -> a; same code as c_script
panel_6 = Panel(c_script)
panel_7 = Panel(c_script_2)
panel_8 = Panel(c_script_3)
panel_9 = Panel(c_script_4)
pln_2 = Plane(c_script_2)
crv_2 = Curve(c_script_3)
circle_2 = Circle(c_script_4)
num_2 = Number(c_script)
