# Grasshopper definition test_params_outputs_convert_list_rc8.7_error.ghx (Grasshopper 1.0.8)
# plug-ins: RhinoCodePluginGH

py3 = Python3Script()  # -> a
# ---------- py3: Python ----------
import rhinoscriptsyntax as rs

a = []
a.append(rs.AddCircle((1, 1, 0), 10))
a.append(rs.AddCircle((1, 1, 0), 20))
a.append(rs.AddCircle((1, 1, 0), 30))
# ---------- end py3 ----------
py3_2 = Python3Script()  # -> a; same code as py3
panel = Panel(py3)
panel_2 = Panel(py3_2)
