# Grasshopper definition test_params_outputs_convert_null.ghx (Grasshopper 1.0.8)
# plug-ins: RhinoCodePluginGH

number_slider = Slider(1, range=0..1)
python_3_script = Python3Script()  # -> empty
# ---------- python_3_script: Python ----------
import Rhino
import Rhino.Geometry as RG

# empty value is not set
# empty = RG.Rectangle3d(RG.Plane.WorldXY, 10, 10)
# ---------- end python_3_script ----------
ipy2 = IronPython2Script()  # -> empty; same code as python_3_script
lng = ListLength(List=flatten([python_3_script, number_slider]))
lng_2 = ListLength(List=flatten([ipy2, number_slider]))
equals = Equality(FirstNumber=lng_2, SecondNumber=number_slider)  # -> Equality, Inequality
equals_2 = Equality(FirstNumber=lng, SecondNumber=number_slider)  # -> Equality, Inequality
and = GateAnd(A=equals_2.Equality, B=equals.Equality)
context_bake = ContextBake(Content=and)
panel = Panel(and)
