# Grasshopper definition test_params_outputs_convert_textDot_error.ghx (Grasshopper 1.0.8)
# plug-ins: RhinoCodePluginGH

script = Script(x=Slider(10, range=0..10))  # -> out, a
# ---------- script: C# ----------
using System;

a = x;

Console.WriteLine($"Test {x.GetType()} {a}");
# ---------- end script ----------
