# Grasshopper definition test_params_outputs_convert_unmatchedList_error.ghx (Grasshopper 1.0.8)
# plug-ins: RhinoCodePluginGH

range = Range(Domain=Domain(0, 1), Steps=10)
ironpython_2_script = IronPython2Script(x=range)  # -> a
# ---------- ironpython_2_script: IronPython ----------
# r "Eto.dll"

from Eto.Drawing import Brushes
a = Brushes.Bisque
# ---------- end ironpython_2_script ----------
ch = CurveHighlight(T=ironpython_2_script)  # -> a; inputs T: list of Color
# ---------- ch: Python ----------
import System
import Rhino
import Grasshopper

import rhinoscriptsyntax as rs


class MyComponent(Grasshopper.Kernel.GH_ScriptInstance):
    def RunScript(self, T: System.Collections.Generic.IList[System.Drawing.Color]):
        return T[0]
# ---------- end ch ----------
