# Grasshopper definition test_params_outputs_csharp_autoout.ghx (Grasshopper 1.0.8)
# plug-ins: RhinoCodePluginGH

# ---- group: NO ERRORS ON MISSING OUTPUTS
script = Script()  # -> out, a, b, c
# ---------- script: C# ----------
using System;
using System.Collections;
using System.Collections.Generic;
using System.Drawing;

using Rhino;
using Rhino.Geometry;

using Grasshopper;
using Grasshopper.Kernel;
using Grasshopper.Kernel.Data;
using Grasshopper.Kernel.Types;

public class Script_Instance : GH_ScriptInstance
{  
  private void RunScript(ref object a, ref object b, ref object c)
  {
  }
}
# ---------- end script ----------

# ---- group: EXPECT NO ERRORS
toggle = BooleanToggle(True)
panel = Panel(toggle)
context_bake = ContextBake(Content=toggle)
