# Grasshopper definition test_params_outputs_csharp_noMarshall_convert_rc8.7_error.ghx (Grasshopper 1.0.8)
# plug-ins: RhinoCodePluginGH

cs = CSharpScript()  # -> a
# ---------- cs: C# ----------
using System;
using Rhino;
using Rhino.Geometry;
using Grasshopper;
using Grasshopper.Kernel;
using Grasshopper.Kernel.Data;
using Grasshopper.Kernel.Types;

Rhino.DocObjects.Material material = new  Rhino.DocObjects.Material();
a = new GH_Material(Rhino.Render.RenderMaterial.CreateBasicMaterial(material));
# ---------- end cs ----------
