# Grasshopper definition test_params_outputs_csharp_polyline_convert.ghx (Grasshopper 1.0.8)
# plug-ins: RhinoCodePluginGH

pt = Point([Point(17, -3, 0), Point(20, 2, 0), Point(24, -3, 0), Point(29, -2, 0), Point(30, 2, 0)])
pt_2 = Point([Point(17, -3, 0), Point(20, 2, 0), Point(24, -3, 0), Point(29, -2, 0), Point(30, 2, 0)])
pt_3 = Point([Point(17, -3, 0), Point(20, 2, 0), Point(24, -3, 0), Point(29, -2, 0), Point(30, 2, 0)])
csharp_script = CSharpScript(points=pt)  # -> OutPolyline; inputs points: list of Point3d
# ---------- csharp_script: C# ----------
// Grasshopper Script Instance
using System;
using System.Collections;
using System.Collections.Generic;
using System.Drawing;

using Rhino;
using Rhino.Geometry;

using Grasshopper;
using Grasshopper.Kernel;
using Grasshopper.Kernel.Data;
using Grasshopper.Kernel.Types;

public class Script_Instance : GH_ScriptInstance
{
  /* 
    Members:
      RhinoDoc RhinoDocument
      GH_Document GrasshopperDocument
      IGH_Component Component
      int Iteration

    Methods (Virtual & overridable):
      Print(string text)
      Print(string format, params object[] args)
      Reflect(object obj)
      Reflect(object obj, string method_name)
  */
  
  private void RunScript(IList<Point3d> points, ref object OutPolyline)
  {
    //Create a new instance of a polyline
    Polyline pline = new Polyline(points);

    OutPolyline = pline;
  }
}
# ---------- end csharp_script ----------
csharp_script_2 = CSharpScript(points=pt_2)  # -> OutPolyline; inputs points: list of Point3d; same code as csharp_script
csharp_script_3 = CSharpScript(points=pt_3)  # -> OutPolyline; inputs points: list of Point3d; same code as csharp_script
int = Integer(csharp_script)
crv = Curve(csharp_script_2)
crv_2 = Curve(csharp_script_3)
panel = Panel(int)
panel_2 = Panel(crv)
panel_3 = Panel(crv_2)

# ---- group: EXPECT NO ERRORS
toggle = BooleanToggle(True)
panel_4 = Panel(toggle)
context_bake = ContextBake(Content=toggle)
