# Grasshopper definition test_params_outputs_dict.ghx (Grasshopper 1.0.8)
# plug-ins: RhinoCodePluginGH

cs = CSharpScript()  # -> a
# ---------- cs: C# ----------
using System.Collections.Generic;

var d = new Dictionary<string, string>();
d["Key"] = "Value";

a = d;
# ---------- end cs ----------

# ---- group: inconsistent with passing a python dict to output
python = GhPythonScript()  # -> a
# ---------- python: Python ----------
from System.Collections.Generic import Dictionary

d = Dictionary[str, str]()
d["Key"] = "Value"

a = d
# ---------- end python ----------
python_2 = GhPythonScript()  # -> a
# ---------- python_2: Python ----------
d = {}
d["Key"] = "Value"

a = d
# ---------- end python_2 ----------
panel = Panel(python)
panel_2 = Panel(python_2)

# ----
S = Script()  # -> a; same code as python
S_2 = Script()  # -> a; same code as python
tmatch = MatchText(Text=S, Pattern="Key", Case=True)
tmatch_2 = MatchText(Text=S_2, Pattern="Key", Case=True)
tmatch_3 = MatchText(Text=cs, Pattern="Key", Case=True)
and = GateAnd(A=tmatch, B=tmatch_2, C=tmatch_3)
panel_3 = Panel(and)
context_bake = ContextBake(Content=and)
