# Grasshopper definition test_params_outputs_empty.ghx (Grasshopper 1.0.8)
# plug-ins: RhinoCodePluginGH

series = Series(Start=0, Step=1, Count=Slider(6, range=1..10))
ipy2 = IronPython2Script(x=series)  # -> a, b
# ---------- ipy2: IronPython ----------
if x % 2 == 0:
    a = x
else:
    b = x
# ---------- end ipy2 ----------
py3 = Python3Script(x=series)  # -> a, b; same code as ipy2
cs = CSharpScript(x=series)  # -> a, b; inputs x: Int32
# ---------- cs: C# ----------
if (x % 2 == 0)
{
    a = x;
}
else
{
    b = x;
}
# ---------- end cs ----------
python = GhPythonScript(x=series)  # -> a, b
# ---------- python: Python ----------
if x % 2 == 0:
    a = x
    # b = None
else:
    # a = None
    b = x
# ---------- end python ----------
panel = Panel(cs.a)
panel_2 = Panel(ipy2.a)
panel_3 = Panel(py3.a)
panel_4 = Panel(python.a)
panel_5 = Panel(cs.b)
panel_6 = Panel(ipy2.b)
panel_7 = Panel(py3.b)
panel_8 = Panel(python.b)
cull_i = CullIndex(List=ipy2.a, Indices=[1, 3, 5], Wrap=True)
cull_i_2 = CullIndex(List=ipy2.b, Indices=[0, 2, 4], Wrap=True)
cull_i_3 = CullIndex(List=py3.a, Indices=[1, 3, 5], Wrap=True)
cull_i_4 = CullIndex(List=py3.b, Indices=[0, 2, 4], Wrap=True)
cull_i_5 = CullIndex(List=cs.a, Indices=[1, 3, 5], Wrap=True)
cull_i_6 = CullIndex(List=cs.b, Indices=[0, 2, 4], Wrap=True)
cull_i_7 = CullIndex(List=python.a, Indices=[1, 3, 5], Wrap=True)
cull_i_8 = CullIndex(List=python.b, Indices=[0, 2, 4], Wrap=True)
equals = Equality(FirstNumber=cull_i, SecondNumber=cull_i_7)  # -> Equality, Inequality
equals_2 = Equality(FirstNumber=cull_i_2, SecondNumber=cull_i_8)  # -> Equality, Inequality
equals_3 = Equality(FirstNumber=cull_i_3, SecondNumber=cull_i_7)  # -> Equality, Inequality
equals_4 = Equality(FirstNumber=cull_i_4, SecondNumber=cull_i_8)  # -> Equality, Inequality
equals_5 = Equality(FirstNumber=cull_i_5, SecondNumber=cull_i_7)  # -> Equality, Inequality
equals_6 = Equality(FirstNumber=cull_i_6, SecondNumber=cull_i_8)  # -> Equality, Inequality
python_2 = GhPythonScript(checks=flatten([equals.Equality, equals_2.Equality, equals_3.Equality, equals_4.Equality, equals_5.Equality, equals_6.Equality]))  # -> all_true; inputs checks: list
# ---------- python_2: Python ----------
all_true = all(checks)
# ---------- end python_2 ----------
context_bake = ContextBake(Content=python_2)
panel_9 = Panel(python_2)
