# Grasshopper definition test_params_outputs_marshalling_python_dict_rc8.13.ghx (Grasshopper 1.0.8)
# plug-ins: RhinoCodePluginGH

panel = Panel("""#! python 3
a = [
  {'foo1': 'bar1'},
  {'foo2': 'bar2'}
]""")
panel_2 = Panel("""#! python 3
print(type(x))
k = x.keys()
v = x.values()""")
panel_3 = Panel("System.Collections.Generic.Dictionary`2\[System.Object,System.Object\]")
py3 = Python3Script(script=panel)  # -> a
#   port script: Script to execute
# ---------- py3: Python ----------
a = [{'foo1': 'bar1'}, {'foo2': 'bar2'}]
# ---------- end py3 ----------
py3_2 = Python3Script(script=panel_2, x=py3)  # -> out, k, v
#   port script: Script to execute
# ---------- py3_2: Python ----------
print(type(x))
k = x.keys()
v = x.values()
# ---------- end py3_2 ----------
panel_4 = Panel(py3_2.out)
panel_5 = Panel(py3_2.k)
panel_6 = Panel(py3_2.v)
panel_7 = Panel(py3)
py3_3 = Python3Script(k=py3_2.k)  # -> flatten(a)
# ---------- py3_3: Python ----------
a = list(k)
# ---------- end py3_3 ----------
panel_8 = Panel(py3_3)

# ---- group: ENSURE EXTRACTED KEY IS NOT GH_GOO
py3_4 = Python3Script(k=py3_2.k)  # -> foo
# ---------- py3_4: Python ----------
keys = list(k)
foo = keys[0]
# ---------- end py3_4 ----------

# ----
panel_9 = Panel(py3_4)
panel_10 = Panel("""dict_keys\(\['foo1'\]\)
dict_keys\(\['foo2'\]\)""")
panel_11 = Panel("""dict_values\(\['bar1'\]\)
dict_values\(\['bar2'\]\)""")
panel_12 = Panel("""foo1
foo2""")
panel_13 = Panel("""foo1
foo2""")
tmatch = MatchText(Text=flatten(py3_2.out), RegEx="dict'\>", Case=True)
tmatch_2 = MatchText(Text=py3, RegEx=panel_3, Case=True)
tmatch_3 = MatchText(Text=py3_2.k, RegEx=panel_10, Case=True)
tmatch_4 = MatchText(Text=py3_2.v, RegEx=panel_11, Case=True)
tmatch_5 = MatchText(Text=py3_3, RegEx=panel_12, Case=True)
tmatch_6 = MatchText(Text=py3_4, RegEx=panel_13, Case=True)
at = AssertTrue([tmatch_2, tmatch, tmatch_3, tmatch_4, tmatch_5, tmatch_6])
