# Grasshopper definition test_params_outputs_marshalling_python_guid.ghx (Grasshopper 1.0.8)
# plug-ins: RhinoCodePluginGH

# ---- group: NO MARSHALL
S = Script()  # -> a
# ---------- S: Python ----------
import rhinoscriptsyntax as rs
a = rs.AddCircle([0, 0, 0], 10)
# ---------- end S ----------
guid_as_string = Script()  # -> a
# ---------- guid_as_string: Python ----------
import rhinoscriptsyntax as rs
guid = rs.AddCircle([0, 0, 0], 10)
a = str(guid)
# ---------- end guid_as_string ----------
S_2 = Script()  # -> a; same code as S
S_3 = Script()  # -> a; same code as S
S_4 = Script()  # -> a; same code as S

# ----
S_5 = Script()  # -> a; same code as S
python = GhPythonScript()  # -> a; same code as S

# ---- group: MARSHALL
S_6 = Script()  # -> a; same code as S
guid_as_string_2 = Script()  # -> a; same code as guid_as_string
S_7 = Script()  # -> a; same code as S
S_8 = Script()  # -> a; same code as S
S_9 = Script()  # -> a; same code as S

# ----
S_10 = Script()  # -> a
# ---------- S_10: Python ----------
import ghpythonlib as gh
import rhinoscriptsyntax as rs
import System
import Grasshopper
import Grasshopper.Kernel.Data as GHD
import Grasshopper.Kernel.Types as GHT

guid = rs.AddCircle([0, 0, 0], 10)
s = GHD.GH_Structure[GHT.GH_Guid]()

p1 = GHD.GH_Path(0, 1)
s.EnsurePath(p1)

p2 = GHD.GH_Path(1, 2)
s.EnsurePath(p2)

s.Append(GHT.GH_Guid(rs.AddCircle([0, 0, 0], 10)), p1)
s.Append(GHT.GH_Guid(rs.AddCircle([0, 0, 0], 20)), p1)
s.Append(GHT.GH_Guid(rs.AddCircle([0, 0, 0], 30)), p2)

a = s
# ---------- end S_10 ----------

# ---- group: MARSHALL CONVERT
guid_as_string_3 = Script()  # -> a
# ---------- guid_as_string_3: Python ----------
import rhinoscriptsyntax as rs
guid = rs.AddCircle([0, 0, 0], 10)
a = { guid : 0 }
# ---------- end guid_as_string_3 ----------
guid_as_string_4 = Script()  # -> a
# ---------- guid_as_string_4: Python ----------
import ghpythonlib as gh
import rhinoscriptsyntax as rs
import System
import Grasshopper

t: Grasshopper.DataTree[System.Object] = gh.treehelpers.list_to_tree([
    rs.AddCircle([0, 0, 0], 10),
    rs.AddCircle([0, 0, 0], 10)
])
a = t
# ---------- end guid_as_string_4 ----------
guid_as_string_5 = Script()  # -> a
# ---------- guid_as_string_5: Python ----------
import ghpythonlib as gh
import rhinoscriptsyntax as rs
import System
import Grasshopper
import Grasshopper.Kernel.Data as GHD
import Grasshopper.Kernel.Types as GHT

guid = rs.AddCircle([0, 0, 0], 10)
s: GHD.GH_Structure[GHT.GH_Guid] = GHD.GH_Structure[GHT.GH_Guid]()

p1 = GHD.GH_Path(0, 1)
s.EnsurePath(p1)

p2 = GHD.GH_Path(1, 2)
s.EnsurePath(p2)

s.Append(GHT.GH_Guid(rs.AddCircle([0, 0, 0], 10)), p1)
s.Append(GHT.GH_Guid(rs.AddCircle([0, 0, 0], 20)), p1)
s.Append(GHT.GH_Guid(rs.AddCircle([0, 0, 0], 30)), p2)

a = s
# ---------- end guid_as_string_5 ----------

# ----
panel = Panel(guid_as_string_5)
panel_2 = Panel(S_5)
panel_3 = Panel(python)
panel_4 = Panel(S)
panel_5 = Panel(guid_as_string)
panel_6 = Panel(S_3)
panel_7 = Panel(S_2)
panel_8 = Panel(S_4)
panel_9 = Panel(guid_as_string_3)
panel_10 = Panel(guid_as_string_4)
panel_11 = Panel(S_10)
panel_12 = Panel(S_6)
panel_13 = Panel(guid_as_string_2)
panel_14 = Panel(S_8)
panel_15 = Panel(S_7)
panel_16 = Panel(S_9)
id = Guid(S)
id_2 = Guid(guid_as_string)
id_3 = Guid(S_3)
id_4 = Guid(S_2)
id_5 = Guid(S_4)
circle = Circle(S_6)
circle_2 = Circle(guid_as_string_2)
circle_3 = Circle(S_8)
circle_4 = Circle(S_7)
circle_5 = Circle(S_9)
circle_6 = Circle(guid_as_string_3)
circle_7 = Circle(guid_as_string_4)
circle_8 = Circle(guid_as_string_5)
circle_9 = Circle(S_5)
circle_10 = Circle(python)
circle_11 = Circle(S_10)
bool = Boolean(True)
# should not throw error in params
context_bake = ContextBake(Content=bool)
