# Grasshopper definition test_params_outputs_marshalling_python_list_nested_rc8.8.ghx (Grasshopper 1.0.8)
# plug-ins: RhinoCodePluginGH

range = Range(Domain=Domain(0, 1), Steps=10)
pt = ConstructPoint(XCoordinate=range, YCoordinate=range, ZCoordinate=range)
py3 = Python3Script(points=pt)  # -> pcloud; inputs points: list
# ---------- py3: Python ----------
import Rhino.Geometry as RG
from System.Collections.Generic import List

# pcloud = RG.PointCloud()
# pcloud.AddRange(points)

pcloud = [
    List[RG.Point3d](points),
    List[RG.Point3d](points)
]
# ---------- end py3 ----------
py3_2 = Python3Script(points=pt)  # -> pcloud; inputs points: list
# ---------- py3_2: Python ----------
import Rhino.Geometry as RG
from System.Collections.Generic import List

pcloud = [
    points,
    points,
]
# ---------- end py3_2 ----------
python = GhPythonScript(o=py3)  # -> out
# ---------- python: Python ----------
print(type(o))
# ---------- end python ----------
python_2 = GhPythonScript(o=py3_2)  # -> out; same code as python
panel = Panel(python)
panel_2 = Panel(python_2)
tmatch = MatchText(Text=panel_2, RegEx="'PyObject'\>", Case=True)
tmatch_2 = MatchText(Text=panel, RegEx="List\[object\]'\>", Case=True)
at = AssertTrue(tmatch_2)
at_2 = AssertTrue(tmatch)
