# Grasshopper definition test_params_outputs_marshalling_python_list_of_dict_rc8.13.ghx (Grasshopper 1.0.8)
# plug-ins: RhinoCodePluginGH

py3 = Python3Script()  # -> G, D
# ---------- py3: Python ----------
"""Simple example"""

import ghpythonlib.components as ghc
import rhinoscriptsyntax as rs

G = []
D = []

for x in range(3):
    for y in range(3):
        G.append(ghc.Sphere(ghc.ConstructPoint(x, y, 0), 0.5))
        D.append({'x_index':x, 'y_index':y})
# ---------- end py3 ----------
ipy2 = IronPython2Script()  # -> G, D; same code as py3
# The first component generates a grid of spheres along with a dictionary containing properties for each sphere.
# The second component reads it and translates the object based on the x index in the dictionary.
python = GhPythonScript()  # -> G, D; same code as py3
X = UnitX(Factor=4)

# ---- group: No Errors
X_2 = UnitX(Factor=4)
move = Move(Geometry=[py3.G, ipy2.G], Motion=X_2)  # -> Geometry, Transform

# ----
py3_2 = Python3Script(G=py3.G, D=py3.D)  # -> G; inputs G: GeometryBase
# ---------- py3_2: Python ----------
import ghpythonlib.components as ghc

x_index = D['x_index']

_vec = ghc.VectorXYZ(0,0,x_index)['vector']
G = ghc.Move(G, _vec)['geometry']
# ---------- end py3_2 ----------
ipy2_2 = IronPython2Script(G=ipy2.G, D=ipy2.D)  # -> G; inputs G: GeometryBase; same code as py3_2
python_2 = GhPythonScript(G=python.G, D=python.D)  # -> G; inputs G: GeometryBase; same code as py3_2
move_2 = Move(Geometry=python.G, Motion=X)  # -> Geometry, Transform
panel = Panel("System.Collections.Generic.Dictionary`2\[System.Object,System.Object\]")
tmatch = MatchText(Text=python.D, RegEx="IronPython\.Runtime\.PythonDictionary", Case=True)
tmatch_2 = MatchText(Text=[ipy2.D, py3.D], RegEx=panel, Case=True)
at = AssertTrue([tmatch_2, tmatch])
