# Grasshopper definition test_params_outputs_marshalling_python_points_rc8.8.ghx (Grasshopper 1.0.8)
# plug-ins: RhinoCodePluginGH

script = Script(n=Slider(23, range=0..100))  # -> out, values; inputs n: Int32
# ---------- script: Python ----------
# r: numpy

import numpy

values = []
for pt in numpy.random.rand(n, 3):
    pt = pt * 20 - 10
    values.append([pt[0], pt[1], pt[2]])
# ---------- end script ----------
script_2 = Script(n=Slider(23, range=0..100))  # -> out, values; inputs n: Int32; same code as script
panel = Panel(script.values)
python = GhPythonScript(data=script.values)  # -> out
# ---------- python: Python ----------
print(type(data))
# ---------- end python ----------
lng = ListLength(List=script.values)
script_3 = Script(coordinates=script_2.values)  # -> out, points
# ---------- script_3: C# ----------
using System;
using System.Collections.Generic;
using Rhino.Geometry;


var c = (List<object>)coordinates;
points = new Point3d((double)c[0], (double)c[1], (double)c[2]);
# ---------- end script_3 ----------
panel_2 = Panel(script_2.values)
equals = Equality(FirstNumber=lng, SecondNumber=Slider(1, range=0..1))  # -> Equality, Inequality
panel_3 = Panel(python)
tmatch = MatchText(Text=python, RegEx="'PyObject'\>", Case=True)
panel_4 = Panel(script_3.points)
at = AssertTrue(tmatch)
at_2 = AssertTrue(equals.Equality)
