# Grasshopper definition test_params_outputs_marshalling_python_proxyDoc.ghx (Grasshopper 1.0.8)
# plug-ins: RhinoCodePluginGH

S = Script()  # -> out, a
# ---------- S: Python ----------
import scriptcontext as sc
import rhinoscriptsyntax as rs
a = rs.AddCircle([0, 0, 0], 10)
a = sc.doc
# ---------- end S ----------
S_2 = Script()  # -> out, a; same code as S
python = GhPythonScript()  # -> out, a; same code as S
panel = Panel(S.a)
panel_2 = Panel(S_2.a)
panel_3 = Panel(python.a)
circle = Circle(S.a)
circle_2 = Circle(S_2.a)
circle_3 = Circle(python.a)
bool = Boolean(True)
# should not throw error in params
context_bake = ContextBake(Content=bool)
