# Grasshopper definition test_params_outputs_marshalling_python_recursiveMarsh.ghx (Grasshopper 1.0.8)
# plug-ins: RhinoCodePluginGH

# ---- group: SHOULD NOT CRASH
panel = Panel("""#! python3
a = globals()""")
panel_2 = Panel("""#! python3
l = list()
l.append(l)
a = l""")
panel_3 = Panel("""#! python3
d = dict()
d["self"] = d
a = d""")
py3 = Python3Script(script=panel)  # -> out, a
#   port script: Script to execute
# ---------- py3: Python ----------
a = ghdoc
# ---------- end py3 ----------
py3_2 = Python3Script(script=panel_2)  # -> out, a; same code as py3
py3_3 = Python3Script(script=panel_3)  # -> out, a; same code as py3
py3_4 = Python3Script(script=panel)  # -> out, a; same code as py3
panel_4 = Panel(py3.a)
panel_5 = Panel(py3_2.a)
panel_6 = Panel(py3_3.a)
panel_7 = Panel(py3_4.a)

# ----
bool = Boolean(True)
panel_8 = Panel(bool)
context_bake = ContextBake(Content=bool)
