# Grasshopper definition test_params_outputs_marshalling_python_scriptinstance.ghx (Grasshopper 1.0.8)
# plug-ins: RhinoCodePluginGH

py3_script_mode = Python3Script()  # -> a
# ---------- py3_script_mode: Python ----------
#! python3

a = list(range(3))
# ---------- end py3_script_mode ----------
ipy2_script_mode = IronPython2Script()  # -> out, a
# ---------- ipy2_script_mode: IronPython ----------
#! python2

a = list(range(3))
# ---------- end ipy2_script_mode ----------
py3_script_mode_2 = Python3Script()  # -> a; same code as py3_script_mode
panel = Panel(ipy2_script_mode.a)
tstat = TreeStatistics(Tree=ipy2_script_mode.a)  # -> Paths, Length, Count
print_type_x = IronPython2Script(x=ipy2_script_mode.a)  # -> out, a
# ---------- print_type_x: IronPython ----------
a = repr(type(x))
# ---------- end print_type_x ----------
panel_2 = Panel(py3_script_mode)
tstat_2 = TreeStatistics(Tree=py3_script_mode)  # -> Paths, Length, Count
print_type_x_2 = IronPython2Script(x=py3_script_mode)  # -> out, a; same code as print_type_x
tstat_3 = TreeStatistics(Tree=py3_script_mode_2)  # -> Paths, Length, Count
print_type_x_3 = IronPython2Script(x=py3_script_mode_2)  # -> out, a; same code as print_type_x
panel_3 = Panel(py3_script_mode_2)
panel_4 = Panel(print_type_x_2.a)
panel_5 = Panel(print_type_x.a)
panel_6 = Panel([tstat_2.Paths, tstat_2.Length, tstat_2.Count])
panel_7 = Panel([tstat.Paths, tstat.Length, tstat.Count])
panel_8 = Panel([tstat_3.Paths, tstat_3.Length, tstat_3.Count])
panel_9 = Panel(print_type_x_3.a)
py3_script_mode_3 = Python3Script()  # -> a
# ---------- py3_script_mode_3: Python ----------
#! python3

import System
import Rhino
import Grasshopper

import rhinoscriptsyntax as rs


class MyComponent(Grasshopper.Kernel.GH_ScriptInstance):
    def RunScript(self, x, y):
        a = list(range(3))
        return a
# ---------- end py3_script_mode_3 ----------
ipy2_script_mode_2 = IronPython2Script()  # -> out, a
# ---------- ipy2_script_mode_2: IronPython ----------
#! python2

import System
import Rhino
import Grasshopper

import rhinoscriptsyntax as rs


class MyComponent(Grasshopper.Kernel.GH_ScriptInstance):
    def RunScript(self, x, y):
        a = list(range(3))
        return a
# ---------- end ipy2_script_mode_2 ----------
py3_script_mode_4 = Python3Script()  # -> a; same code as py3_script_mode_3
panel_10 = Panel(ipy2_script_mode_2.a)
tstat_4 = TreeStatistics(Tree=ipy2_script_mode_2.a)  # -> Paths, Length, Count
print_type_x_4 = IronPython2Script(x=ipy2_script_mode_2.a)  # -> out, a; same code as print_type_x
panel_11 = Panel(py3_script_mode_3)
tstat_5 = TreeStatistics(Tree=py3_script_mode_3)  # -> Paths, Length, Count
print_type_x_5 = IronPython2Script(x=py3_script_mode_3)  # -> out, a; same code as print_type_x
tstat_6 = TreeStatistics(Tree=py3_script_mode_4)  # -> Paths, Length, Count
print_type_x_6 = IronPython2Script(x=py3_script_mode_4)  # -> out, a; same code as print_type_x
panel_12 = Panel(py3_script_mode_4)
panel_13 = Panel(print_type_x_5.a)
panel_14 = Panel(print_type_x_6.a)
panel_15 = Panel([tstat_5.Paths, tstat_5.Length, tstat_5.Count])
panel_16 = Panel([tstat_4.Paths, tstat_4.Length, tstat_4.Count])
panel_17 = Panel(print_type_x_4.a)
panel_18 = Panel([tstat_6.Paths, tstat_6.Length, tstat_6.Count])
equality = Equality(FirstNumber=tstat_2.Length, SecondNumber=tstat_5.Length)  # -> Equality, Inequality
equality_2 = Equality(FirstNumber=tstat.Length, SecondNumber=tstat_4.Length)  # -> Equality, Inequality
equality_3 = Equality(FirstNumber=tstat_3.Length, SecondNumber=tstat_6.Length)  # -> Equality, Inequality
and = GateAnd(A=equality.Equality, B=equality_3.Equality, C=equality_2.Equality)
context_bake = ContextBake(Content=and)
panel_19 = Panel(and)
