# Grasshopper definition test_params_outputs_marshalling_python_scriptinstance_rc8.8.ghx (Grasshopper 1.0.8)
# plug-ins: RhinoCodePluginGH

py3 = Python3Script()  # -> a
# ---------- py3: Python ----------
import System
import Rhino
import Grasshopper

class MyComponent(Grasshopper.Kernel.GH_ScriptInstance):
    def RunScript(self):
        return [1.0, 2.0, 3.0]
# ---------- end py3 ----------
py3_2 = Python3Script()  # -> a; same code as py3
ipy2 = IronPython2Script()  # -> a; same code as py3
python = GhPythonScript(data=py3)  # -> out
# ---------- python: Python ----------
print(type(data))
# ---------- end python ----------
python_2 = GhPythonScript(data=py3_2)  # -> out; same code as python
python_3 = GhPythonScript(data=ipy2)  # -> out; same code as python
panel = Panel(python)
panel_2 = Panel(python_2)
panel_3 = Panel(python_3)
tmatch = MatchText(Text=[panel, python_3], RegEx="'float'", Case=True)
tmatch_2 = MatchText(Text=panel_2, RegEx="'PyObject'\>", Case=True)
at = AssertTrue(tmatch)
at_2 = AssertTrue(tmatch_2)
