# Grasshopper definition test_params_outputs_noGooConvert.ghx (Grasshopper 1.0.8)
# Copyright: mrtn.ch
# plug-ins: RhinoCodePluginGH

# ---- group: "Mat" IS GH_MATERIAL
path = FilePath("C:\Users\martinsiegrist\Pictures\19_12_28_spherical_mesh.702.png")
cs = CSharpScript(Colour=RGB(255, 255, 255), Reflection=0, Smoothness=1, Transparency=Slider(0.3, range=0..1), filename=path)  # -> out, Mat; inputs Colour: Color, Reflection: Double, Smoothness: Double, Transparency: Double, filename: String
# ---------- cs: C# ----------
// Grasshopper Script Instance
#region Usings
using System;
using System.Collections;
using System.Collections.Generic;
using System.Drawing;

using Rhino;
using Rhino.Geometry;

using Grasshopper;
using Grasshopper.Kernel;
using Grasshopper.Kernel.Data;
using Grasshopper.Kernel.Types;
#endregion

public class Script_Instance : GH_ScriptInstance
{
    #region Notes
    /* 
      Members:
        RhinoDoc RhinoDocument
        GH_Document GrasshopperDocument
        IGH_Component Component
        int Iteration

      Methods (Virtual & overridable):
        Print(string text)
        Print(string format, params object[] args)
        Reflect(object obj)
        Reflect(object obj, string method_name)
    */
    #endregion

    private void RunScript(
	Color Colour,
	double Reflection,
	double Smoothness,
	double Transparency,
	string filename,
	ref object Mat)
    {
    
    Reflection = Math.Min(Math.Max(Reflection, 0), 1);
    Smoothness = Math.Min(Math.Max(Smoothness, 0), 1);
    Rhino.DocObjects.Material material = new  Rhino.DocObjects.Material();
    //material.SetBitmapTexture(fileName);
    material.ReflectionColor = Colour;
    material.DiffuseColor = Colour;
    material.AmbientColor = System.Drawing.Color.Black;
    material.EmissionColor = System.Drawing.Color.Black;
    material.Reflectivity = Reflection;
    material.ReflectionGlossiness = Smoothness;
    material.Transparency = Transparency;

    Rhino.DocObjects.Texture text = new Rhino.DocObjects.Texture();
    text.ApplyUvwTransform = false;
    //text.UvwTransform = transform;
    text.FileName = filename;
    material.SetTexture(text, Rhino.DocObjects.TextureType.Diffuse);


    var renderMaterial = Rhino.Render.RenderMaterial.CreateBasicMaterial(material);

    
    Mat = new GH_Material(renderMaterial);
    
    }
}
# ---------- end cs ----------
shader = Shader(cs.Mat)

# ----
tmatch = MatchText(Text=shader, RegEx="Xml Material \(\)", Case=True)
context_bake = ContextBake(Content=tmatch)
panel = Panel(tmatch)
