# Grasshopper definition test_params_outputs_point3dList_convert.ghx (Grasshopper 1.0.8)
# plug-ins: RhinoCodePluginGH

pt = Point([Point(-8, -27, 0), Point(-25, -7, 0), Point(-20, 8, 0), Point(-1, 36, 0), Point(17, 17, 0), Point(4, -8, 0)])
pt_2 = Point([Point(-8, -27, 0), Point(-25, -7, 0), Point(-20, 8, 0), Point(-1, 36, 0), Point(17, 17, 0), Point(4, -8, 0)])
# Output has Point3dList converter
entwine = Entwine(Branch00=pt, Branch01=pt_2, FlattenInputs=True)

# ---- group: OUTPUT
python_3_script = Python3Script(points=[pt, pt_2])  # -> polyline; inputs points: list of Point3d
# ---------- python_3_script: Python ----------
from Rhino.Geometry import Polyline, PolylineCurve
polyline = Polyline(points)
polylineCurve = PolylineCurve(points)
# ---------- end python_3_script ----------
python_3_script_2 = Python3Script(points=entwine)  # -> polyline; inputs points: list of Point3d; same code as python_3_script
pt_3 = Point(python_3_script)
pt_4 = Point(python_3_script_2)

# ----
ipy2 = IronPython2Script(points=[pt, pt_2])  # -> polyline; inputs points: list of Point3d; same code as python_3_script
ipy2_2 = IronPython2Script(points=entwine)  # -> polyline; inputs points: list of Point3d; same code as python_3_script
python = GhPythonScript(points=[pt, pt_2])  # -> polyline; inputs points: list of Point3d; same code as python_3_script
pt_5 = Point(ipy2)
pt_6 = Point(ipy2_2)
pt_7 = Point(python)
entwine_2 = Entwine(Branch00=pt_3, Branch01=pt_5, FlattenInputs=True)
entwine_3 = Entwine(Branch00=pt_4, Branch01=pt_6, FlattenInputs=True)
lng = ListLength(List=pt_7)
lng_2 = ListLength(List=entwine_3)
panel = Panel(lng_2)
lng_3 = ListLength(List=entwine_2)
panel_2 = Panel(lng_3)
equals = Equality(FirstNumber=lng_3, SecondNumber="12")  # -> Equality, Inequality
equals_2 = Equality(FirstNumber=lng_2, SecondNumber="12")  # -> Equality, Inequality
panel_3 = Panel(equals.Equality)
panel_4 = Panel(equals_2.Equality)
equals_3 = Equality(FirstNumber=lng, SecondNumber="12")  # -> Equality, Inequality
panel_6 = Panel(equals_3.Equality)

# ---- group: ALSO NO ERRORS ON PARAMS
python_2 = GhPythonScript(checks=flatten([equals_2.Equality, equals.Equality, equals_3.Equality]))  # -> all_true; inputs checks: list
# ---------- python_2: Python ----------
all_true = all(checks)
# ---------- end python_2 ----------
panel_7 = Panel(python_2)
context_bake = ContextBake(Content=python_2)
