# Grasshopper definition test_params_outputs_pointcloud_rc8.8.ghx (Grasshopper 1.0.8)
# plug-ins: RhinoCodePluginGH

# https://mcneel.myjetbrains.com/youtrack/issue/RH-82044
range = Range(Domain=Domain(0, 1), Steps=10)
pt = ConstructPoint(XCoordinate=range, YCoordinate=range, ZCoordinate=range)
python = GhPythonScript(points=pt)  # -> pcloud; inputs points: list
# ---------- python: Python ----------
import Rhino.Geometry as RG

pcloud = RG.PointCloud()
pcloud.AddRange(points)
# ---------- end python ----------
py3 = Python3Script(points=pt)  # -> pcloud; inputs points: list; same code as python
ipy2 = IronPython2Script(points=pt)  # -> pcloud; inputs points: list; same code as python
panel = Panel(python)
tmatch = MatchText(Text=python, RegEx="Rhino.Geometry.PointCloudItem", Case=True)
panel_2 = Panel(py3)
pcloud = PointCloud(py3)
pcloud_2 = PointCloud(ipy2)
at = AssertTrue(tmatch)
