# Grasshopper definition test_params_outputs_polyline_vs_points_rc8.7.ghx (Grasshopper 1.0.8)
# plug-ins: RhinoCodePluginGH

pt = Point([Point(17, -3, 0), Point(20, 2, 0), Point(24, -3, 0), Point(29, -2, 0), Point(30, 2, 0)])

# ---- group: INCONSISTENT
ghpython_script = GhPythonScript(points=pt)  # -> polyline, polylineCurve; inputs points: list of Point3d
# ---------- ghpython_script: Python ----------
from Rhino.Geometry import Polyline, PolylineCurve
polyline = Polyline(points)
polylineCurve = PolylineCurve(points)
# ---------- end ghpython_script ----------
c_script = CSharpScript(points=pt)  # -> polyline, polylineCurve; inputs points: list of Point3d
# ---------- c_script: C# usings ----------
using System.IO;
using System.Linq;
using System.Data;
using System.Drawing;
using System.Reflection;
using System.Windows.Forms;
using System.Xml;
using System.Xml.Linq;
using System.Runtime.InteropServices;

using Rhino.DocObjects;
using Rhino.Collections;
using GH_IO;
using GH_IO.Serialization;
# ---------- c_script: C# ----------
    //Create a new instance of a polyline
    polyline = new Polyline(points);
    polylineCurve = new PolylineCurve(points);
# ---------- end c_script ----------

# ---- group: DEFAULT OUT HINTS
ironpython_2_script = IronPython2Script(points=pt)  # -> polyline, polylineCurve; inputs points: list of Point3d; same code as ghpython_script
python_3_script = Python3Script(points=pt)  # -> polyline, polylineCurve; inputs points: list of Point3d; same code as ghpython_script
csharp_script = CSharpScript(points=pt)  # -> polyline, polylineCurve; inputs points: list of Point3d
# ---------- csharp_script: C# ----------
// Grasshopper Script Instance
using System;
using System.Collections;
using System.Collections.Generic;
using System.Drawing;

using Rhino;
using Rhino.Geometry;

using Grasshopper;
using Grasshopper.Kernel;
using Grasshopper.Kernel.Data;
using Grasshopper.Kernel.Types;

public class Script_Instance : GH_ScriptInstance
{
  /* 
    Members:
      RhinoDoc RhinoDocument
      GH_Document GrasshopperDocument
      IGH_Component Component
      int Iteration

    Methods (Virtual & overridable):
      Print(string text)
      Print(string format, params object[] args)
      Reflect(object obj)
      Reflect(object obj, string method_name)
  */
  
  private void RunScript(
	List<Point3d> points,
	ref object polyline,
	ref object polylineCurve)
  {
    //Create a new instance of a polyline
    polyline = new Polyline(points);
    polylineCurve = new PolylineCurve(points);
  }
}
# ---------- end csharp_script ----------

# ---- group: NO OUT HINTS
ironpython_2_script_2 = IronPython2Script(points=pt)  # -> polyline, polylineCurve; inputs points: list of Point3d; same code as ghpython_script
python_3_script_2 = Python3Script(points=pt)  # -> polyline, polylineCurve; inputs points: list of Point3d; same code as ghpython_script
csharp_script_2 = CSharpScript(points=pt)  # -> polyline, polylineCurve; inputs points: list of Point3d; same code as csharp_script

# ---- group: POINT3DLIST HINT
ironpython_2_script_3 = IronPython2Script(points=pt)  # -> polyline; inputs points: list of Point3d; same code as ghpython_script
python_3_script_3 = Python3Script(points=pt)  # -> polyline; inputs points: list of Point3d
# ---------- python_3_script_3: Python ----------
from Rhino.Geometry import Polyline, PolylineCurve
polyline = Polyline(points)
# ---------- end python_3_script_3 ----------
csharp_script_3 = CSharpScript(points=pt)  # -> polyline; inputs points: list of Point3d
# ---------- csharp_script_3: C# ----------
// Grasshopper Script Instance
using System;
using System.Collections;
using System.Collections.Generic;
using System.Drawing;

using Rhino;
using Rhino.Geometry;

using Grasshopper;
using Grasshopper.Kernel;
using Grasshopper.Kernel.Data;
using Grasshopper.Kernel.Types;

public class Script_Instance : GH_ScriptInstance
{
  /* 
    Members:
      RhinoDoc RhinoDocument
      GH_Document GrasshopperDocument
      IGH_Component Component
      int Iteration

    Methods (Virtual & overridable):
      Print(string text)
      Print(string format, params object[] args)
      Reflect(object obj)
      Reflect(object obj, string method_name)
  */
  
  private void RunScript(List<Point3d> points, ref object polyline)
  {
    //Create a new instance of a polyline
    polyline = new Polyline(points);
  }
}
# ---------- end csharp_script_3 ----------

# ----
curve = Curve(ghpython_script.polylineCurve)
curve_2 = Curve()
curve_3 = Curve(ironpython_2_script.polylineCurve)
curve_4 = Curve(python_3_script.polylineCurve)
curve_5 = Curve(csharp_script.polylineCurve)
curve_6 = Curve(ironpython_2_script_2.polylineCurve)
curve_7 = Curve(python_3_script_2.polylineCurve)
curve_8 = Curve(csharp_script_2.polylineCurve)
point = Point(ironpython_2_script_3)
point_2 = Point(python_3_script_3)
point_3 = Point(csharp_script_3)
point_4 = Point(ghpython_script.polyline)
curve_9 = Curve()
curve_10 = Curve(ironpython_2_script.polyline)
curve_11 = Curve(python_3_script.polyline)
curve_12 = Curve(csharp_script.polyline)
curve_13 = Curve(ironpython_2_script_2.polyline)
curve_14 = Curve(python_3_script_2.polyline)
curve_15 = Curve(csharp_script_2.polyline)

# ---- group: EXPECT NO ERRORS
toggle = BooleanToggle(True)
panel = Panel(toggle)
context_bake = ContextBake(Content=toggle)
