# Grasshopper definition test_params_outputs_python2_noMarshall_convert_error.ghx (Grasshopper 1.0.8)
# plug-ins: RhinoCodePluginGH

ipy2 = IronPython2Script()  # -> a
# ---------- ipy2: IronPython ----------
import System
import Rhino
import Rhino.Geometry
import Grasshopper
import Grasshopper.Kernel
import Grasshopper.Kernel.Data
import Grasshopper.Kernel.Types

material = Rhino.DocObjects.Material();
a = Grasshopper.Kernel.Types.GH_Material(
        Rhino.Render.RenderMaterial.CreateBasicMaterial(material)
    );
# ---------- end ipy2 ----------
