# Grasshopper definition test_params_outputs_python3_noMarshall_convert_error.ghx (Grasshopper 1.0.8)
# plug-ins: RhinoCodePluginGH

py3 = Python3Script()  # -> a
# ---------- py3: Python ----------
import System
import Rhino
import Rhino.Geometry
import Grasshopper
import Grasshopper.Kernel
import Grasshopper.Kernel.Data
import Grasshopper.Kernel.Types

material = Rhino.DocObjects.Material();
a = Grasshopper.Kernel.Types.GH_Material(
        Rhino.Render.RenderMaterial.CreateBasicMaterial(material)
    );
# ---------- end py3 ----------
