# Grasshopper definition test_params_outputs_python_list_dict.ghx (Grasshopper 1.0.8)
# plug-ins: RhinoCodePluginGH

ghpython_script = GhPythonScript(GhMemory=0)  # -> out, SL, SD
# ---------- ghpython_script: Python ----------
import Rhino
import Rhino.Geometry as rg

spheres = []
spheresdict = {}

sphere = rg.Sphere(rg.Point3d(0, 0, 0), 12)
spheres.append(sphere)
spheresdict[1] = sphere

sphere = rg.Sphere(rg.Point3d(10, 10, 0), 12)
spheres.append(sphere)
spheresdict[2] = sphere

SL = spheres
SD = spheresdict
# ---------- end ghpython_script ----------
rc = RhinoCode()  # -> out, SL, SD; same code as ghpython_script
script = Script()  # -> out, SL, SD; same code as ghpython_script
volume = Volume(Geometry=ghpython_script.SL)  # -> Volume, Centroid
volume_2 = Volume(Geometry=rc.SL)  # -> Volume, Centroid
volume_3 = Volume(Geometry=script.SL)  # -> Volume, Centroid
equality = Equality(FirstNumber=volume.Volume, SecondNumber=volume_2.Volume)  # -> Equality, Inequality
equality_2 = Equality(FirstNumber=volume.Volume, SecondNumber=volume_3.Volume)  # -> Equality, Inequality
equality_3 = Equality(FirstNumber=ghpython_script.SD, SecondNumber=rc.SD)  # -> Equality, Inequality
equality_4 = Equality(FirstNumber=ghpython_script.SD, SecondNumber=script.SD)  # -> Equality, Inequality
mass_addition = MassAddition(Input=flatten([equality.Equality, equality_3.Equality]))  # -> Result, PartialResults
list_length = ListLength(List=flatten([equality.Equality, equality_3.Inequality]))
mass_addition_2 = MassAddition(Input=flatten([equality_2.Equality, equality_4.Equality]))  # -> Result, PartialResults
list_length_2 = ListLength(List=flatten([equality_2.Equality, equality_4.Equality]))
equality_5 = Equality(FirstNumber=mass_addition.Result, SecondNumber=list_length)  # -> Equality, Inequality
equality_6 = Equality(FirstNumber=mass_addition_2.Result, SecondNumber=list_length_2)  # -> Equality, Inequality
gate_and = GateAnd(A=equality_5.Equality, B=equality_6.Equality)
panel = Panel(gate_and)
context_bake = ContextBake(Content=gate_and)
