# Grasshopper definition test_params_outputs_python_polyline_convert_rc8.7.ghx (Grasshopper 1.0.8)
# plug-ins: RhinoCodePluginGH

# ---- group: RECTANGLE OUT -> RECTANGLE
python_3_script = Python3Script()  # -> a
# ---------- python_3_script: Python ----------
import Rhino
import Rhino.Geometry as RG

a = RG.Rectangle3d(RG.Plane.WorldXY, 10, 10)
# ---------- end python_3_script ----------
python_3_script_2 = Python3Script()  # -> nomarsh
# ---------- python_3_script_2: Python ----------
import Rhino
import Rhino.Geometry as RG

nomarsh = RG.Rectangle3d(RG.Plane.WorldXY, 10, 10)
# ---------- end python_3_script_2 ----------
panel = Panel(python_3_script)
panel_2 = Panel(python_3_script_2)
rec = Rectangle(python_3_script)
rec_2 = Rectangle(python_3_script_2)

# ---- group: RECTANGLE OUT -> POLYLINE
python_3_script_3 = Python3Script()  # -> a; same code as python_3_script
python_3_script_4 = Python3Script()  # -> nomarsh; same code as python_3_script_2
panel_3 = Panel(python_3_script_3)
panel_4 = Panel(python_3_script_4)
crv = Curve(python_3_script_3)
crv_2 = Curve(python_3_script_4)

# ---- group: RECTANGLE OUT -> ghobject
python_3_script_5 = Python3Script()  # -> a; same code as python_3_script
python_3_script_6 = Python3Script()  # -> nomarsh; same code as python_3_script_2
ghpython_script = GhPythonScript()  # -> a; same code as python_3_script
ghpython_script_2 = GhPythonScript()  # -> nomarsh; same code as python_3_script_2
panel_5 = Panel(python_3_script_5)
panel_6 = Panel(python_3_script_6)
panel_7 = Panel(ghpython_script)
panel_8 = Panel(ghpython_script_2)
rec_3 = Rectangle(python_3_script_5)
rec_4 = Rectangle(python_3_script_6)
rec_5 = Rectangle(ghpython_script)
rec_6 = Rectangle(ghpython_script_2)

# ---- group: POLYLINE OUT -> ghobject
python_3_script_7 = Python3Script()  # -> a
# ---------- python_3_script_7: Python ----------
import Rhino
import Rhino.Geometry as RG

a = RG.Polyline([RG.Point3d.Origin, RG.Point3d(1,1,2), RG.Point3d(5,5,8)])
# ---------- end python_3_script_7 ----------
python_3_script_8 = Python3Script()  # -> nomarsh
# ---------- python_3_script_8: Python ----------
import Rhino
import Rhino.Geometry as RG

nomarsh = RG.Polyline([RG.Point3d.Origin, RG.Point3d(1,1,2), RG.Point3d(5,5,8)])
# ---------- end python_3_script_8 ----------
panel_9 = Panel(python_3_script_7)
panel_10 = Panel(python_3_script_8)
crv_3 = Curve(python_3_script_7)
crv_4 = Curve(python_3_script_8)

python_3_script_9 = Python3Script()  # -> a; same code as python_3_script_7
python_3_script_10 = Python3Script()  # -> nomarsh; same code as python_3_script_8
panel_11 = Panel(python_3_script_9)
panel_12 = Panel(python_3_script_10)
crv_5 = Curve(python_3_script_9)
crv_6 = Curve(python_3_script_10)

# ---- group: BREAKING LEGACY BEHAVIOUR HERE (USE Point3dList)
ghpython_script_3 = GhPythonScript()  # -> a; same code as python_3_script_7
ghpython_script_4 = GhPythonScript()  # -> nomarsh; same code as python_3_script_8
panel_13 = Panel(ghpython_script_3)
panel_14 = Panel(ghpython_script_4)
pt = Point(ghpython_script_3)
pt_2 = Point(ghpython_script_4)

# ---- group: RECTANGLE IN: ghobject
python_3_script_11 = Python3Script(x=python_3_script_5)  # -> a
# ---------- python_3_script_11: Python ----------
a = x
# ---------- end python_3_script_11 ----------
python_3_script_12 = Python3Script(x=python_3_script_6)  # -> nomarsh
# ---------- python_3_script_12: Python ----------
nomarsh = x
# ---------- end python_3_script_12 ----------
ghpython_script_5 = GhPythonScript(x=ghpython_script)  # -> a; same code as python_3_script_11
ghpython_script_6 = GhPythonScript(x=ghpython_script_2)  # -> nomarsh; same code as python_3_script_12
panel_15 = Panel(python_3_script_11)
panel_16 = Panel(python_3_script_12)
panel_17 = Panel(ghpython_script_5)
panel_18 = Panel(ghpython_script_6)

# ----
# should not throw any errors on parameters
bool = Boolean(True)
context_bake = ContextBake(Content=bool)
