# Grasshopper definition test_params_outputs_python_string_rc8.18.ghx (Grasshopper 1.0.8)

py3 = Python3Script()  # -> out, a
# ---------- py3: Python ----------
import System
import Rhino
import Grasshopper

import rhinoscriptsyntax as rs

class MyComponent(Grasshopper.Kernel.GH_ScriptInstance):
    def RunScript(self, x, y):
        return "Hello IronPython 2 in Grasshopper!"
# ---------- end py3 ----------
ipy2 = IronPython2Script()  # -> out, a; same code as py3
python = GhPythonScript()  # -> a
# ---------- python: Python ----------
from ghpythonlib.componentbase import executingcomponent as component
import Grasshopper, GhPython
import System
import Rhino
import rhinoscriptsyntax as rs

class MyComponent(component):
    
    def RunScript(self, x, y):
        return "Hello!"
# ---------- end python ----------
lng = ListLength(List=py3.a)
lng_2 = ListLength(List=python)
lng_3 = ListLength(List=ipy2.a)
equals = Equality(FirstNumber=lng, SecondNumber=lng_2)  # -> Equality, Inequality
equals_2 = Equality(FirstNumber=lng_3, SecondNumber=lng_2)  # -> Equality, Inequality
at = AssertTrue(equals_2.Equality)
at_2 = AssertTrue(equals.Equality)

# ---- group: IEnumerable
ipy2_2 = IronPython2Script()  # -> a
# ---------- ipy2_2: IronPython ----------
from System.Collections import IEnumerable

s = "Hello IronPython 2 in Grasshopper!"
a = isinstance(s, IEnumerable)
# ---------- end ipy2_2 ----------
at_3 = AssertTrue(ipy2_2)
py3_2 = Python3Script()  # -> a
# ---------- py3_2: Python ----------
from System.Collections import IEnumerable

s = "Hello Python 3 in Grasshopper!"
a = isinstance(s, IEnumerable)
# ---------- end py3_2 ----------

# ----
not = GateNot(A=py3_2)

# ---- group: IEnumerable (continued)
at_4 = AssertTrue(not)

# ---- group: ICollection
ipy2_3 = IronPython2Script()  # -> a
# ---------- ipy2_3: IronPython ----------
from System.Collections import ICollection

s = "Hello IronPython 2 in Grasshopper!"
a = isinstance(s, ICollection)
# ---------- end ipy2_3 ----------
py3_3 = Python3Script()  # -> a
# ---------- py3_3: Python ----------
from System.Collections import ICollection

s = "Hello Python 3 in Grasshopper!"
a = isinstance(s, ICollection)
# ---------- end py3_3 ----------

# ----
not_2 = GateNot(A=ipy2_3)
not_3 = GateNot(A=py3_3)

# ---- group: ICollection (continued)
at_5 = AssertTrue(not_2)
at_6 = AssertTrue(not_3)
