# Grasshopper definition test_params_outputs_python_tuples_and_lists_rc8.14.ghx (Grasshopper 1.0.8)
# Copyright: 2021
# plug-ins: RhinoCodePluginGH

tags_on_2d_plans = ValueList({"Room_Name", "Room_Number", "Average_DF"}, selected=["Room_Name", "Room_Number", "Average_DF"])
tagged_rooms = ValueList({"Req_rooms", "Other_rooms"}, selected=["Req_rooms", "Other_rooms"])
relay = Relay([tags_on_2d_plans, tagged_rooms])
py3 = Python3Script(data=relay)  # -> Room_Name, Room_Number, Average_DF, Req_rooms, Other_rooms; inputs data: list
# ---------- py3: Python ----------
"""Grasshopper Script"""
import System
import Rhino
import Grasshopper

import rhinoscriptsyntax as rs

class MyComponent(Grasshopper.Kernel.GH_ScriptInstance):
    def RunScript(self, data: System.Collections.Generic.List[object]):
        output_names = [o.Name for o in ghenv.Component.Params.Output]
        return [c in data for c in output_names]
# ---------- end py3 ----------
ipy2 = IronPython2Script(data=relay)  # -> Room_Name, Room_Number, Average_DF, Req_rooms, Other_rooms; inputs data: list
# ---------- ipy2: IronPython ----------
import System
import Rhino
import Grasshopper

import rhinoscriptsyntax as rs

class MyComponent(Grasshopper.Kernel.GH_ScriptInstance):
    def RunScript(self, data):
        output_names = [o.Name for o in ghenv.Component.Params.Output]
        return [c in data for c in output_names]
# ---------- end ipy2 ----------
ghpython_script = GhPythonScript(data=[tagged_rooms, relay])  # -> Room_Name, Room_Number, Average_DF, Req_rooms, Other_rooms; inputs data: list
# ---------- ghpython_script: Python ----------
from ghpythonlib.componentbase import executingcomponent as component
import Grasshopper, GhPython
import System
import Rhino
import rhinoscriptsyntax as rs
import scriptcontext as sc
import ghpythonlib as ghp

class ExtractColumns(component): # Grasshopper.Kernel.IGH_VariableParameterComponent


    def RunScript(self, data , *args):

        output_names = [o.Name for o in ghenv.Component.Params.Output]
        return [c in data for c in output_names]
# ---------- end ghpython_script ----------
equals = Equality(FirstNumber=py3.Room_Name, SecondNumber=ghpython_script.Room_Name)  # -> Equality, Inequality
equals_2 = Equality(FirstNumber=py3.Room_Number, SecondNumber=ghpython_script.Room_Number)  # -> Equality, Inequality
equals_3 = Equality(FirstNumber=py3.Average_DF, SecondNumber=ghpython_script.Average_DF)  # -> Equality, Inequality
equals_4 = Equality(FirstNumber=py3.Req_rooms, SecondNumber=ghpython_script.Req_rooms)  # -> Equality, Inequality
equals_5 = Equality(FirstNumber=py3.Other_rooms, SecondNumber=ghpython_script.Other_rooms)  # -> Equality, Inequality
equals_6 = Equality(FirstNumber=ipy2.Room_Name, SecondNumber=ghpython_script.Room_Name)  # -> Equality, Inequality
equals_7 = Equality(FirstNumber=ipy2.Room_Number, SecondNumber=ghpython_script.Room_Number)  # -> Equality, Inequality
equals_8 = Equality(FirstNumber=ipy2.Average_DF, SecondNumber=ghpython_script.Average_DF)  # -> Equality, Inequality
equals_9 = Equality(FirstNumber=ipy2.Req_rooms, SecondNumber=ghpython_script.Req_rooms)  # -> Equality, Inequality
equals_10 = Equality(FirstNumber=ipy2.Other_rooms, SecondNumber=ghpython_script.Other_rooms)  # -> Equality, Inequality
at = AssertTrue([ghpython_script.Room_Name, ghpython_script.Room_Number, ghpython_script.Average_DF, ghpython_script.Req_rooms, ghpython_script.Other_rooms])
at_2 = AssertTrue([equals.Equality, equals_2.Equality, equals_3.Equality, equals_4.Equality, equals_5.Equality])
at_3 = AssertTrue([equals_6.Equality, equals_7.Equality, equals_8.Equality, equals_9.Equality, equals_10.Equality])
python = GhPythonScript(data=relay)  # -> a; inputs data: list
# ---------- python: Python ----------
from ghpythonlib.componentbase import executingcomponent as component
import Grasshopper, GhPython
import System
import Rhino
import rhinoscriptsyntax as rs

class MyComponent(component):
    
    def RunScript(self, data):
        return data
# ---------- end python ----------

# ---- group: Throws Index Error
python_2 = GhPythonScript(data=relay)  # -> a, b; inputs data: list; disabled; same code as python
py3_2 = Python3Script(data=relay)  # -> a, b; inputs data: list; disabled
# ---------- py3_2: Python ----------
import System
import Rhino
import Grasshopper

import rhinoscriptsyntax as rs

class MyComponent(Grasshopper.Kernel.GH_ScriptInstance):
    def RunScript(self, data: System.Collections.Generic.List[object]):
        return data  # same with (data) as it gets expanded into one output
# ---------- end py3_2 ----------
ipy2_2 = IronPython2Script(data=relay)  # -> a, b; inputs data: list; disabled
# ---------- ipy2_2: IronPython ----------
import System
import Rhino
import Grasshopper

import rhinoscriptsyntax as rs

class MyComponent(Grasshopper.Kernel.GH_ScriptInstance):
    def RunScript(self, data):
        return data # same with (data) as it gets expanded into one output
# ---------- end ipy2_2 ----------

# ----
py3_3 = Python3Script(data=relay)  # -> a; inputs data: list
# ---------- py3_3: Python ----------
import System
import Rhino
import Grasshopper

import rhinoscriptsyntax as rs

class MyComponent(Grasshopper.Kernel.GH_ScriptInstance):
    def RunScript(self, data: System.Collections.Generic.List[object]):
        return data # same with (data) as it gets expanded into one output
# ---------- end py3_3 ----------
ipy2_3 = IronPython2Script(data=relay)  # -> a; inputs data: list; same code as ipy2_2
panel = Panel(ipy2_3)
panel_2 = Panel(python)
lng = ListLength(List=python)
panel_3 = Panel(py3_3)
tmatch = MatchText(Text=py3_3, Pattern=python, Case=True)
lng_2 = ListLength(List=py3_3)
tmatch_2 = MatchText(Text=ipy2_3, Pattern=python, Case=True)
lng_3 = ListLength(List=ipy2_3)
equals_11 = Equality(FirstNumber=lng, SecondNumber=lng_2)  # -> Equality, Inequality
equals_12 = Equality(FirstNumber=lng, SecondNumber=lng_3)  # -> Equality, Inequality
at_4 = AssertTrue([tmatch, equals_11.Equality])
at_5 = AssertTrue([tmatch_2, equals_12.Equality])
py3_4 = Python3Script(data=relay)  # -> a; inputs data: list
# ---------- py3_4: Python ----------
import System
import Rhino
import Grasshopper

import rhinoscriptsyntax as rs

class MyComponent(Grasshopper.Kernel.GH_ScriptInstance):
    def RunScript(self, data: System.Collections.Generic.List[object]):
        return (data, None)
# ---------- end py3_4 ----------
py3_5 = Python3Script(data=relay)  # -> a, b; inputs data: list; same code as py3_4

# ---- group: data input is dotnet List
ipy2_4 = IronPython2Script(data=relay)  # -> a; inputs data: list
# ---------- ipy2_4: IronPython ----------
import System
import Rhino
import Grasshopper

import rhinoscriptsyntax as rs

class MyComponent(Grasshopper.Kernel.GH_ScriptInstance):
    def RunScript(self, data):
        return (data, None)
# ---------- end ipy2_4 ----------
panel_4 = Panel(ipy2_4)

# ----
ipy2_5 = IronPython2Script(data=relay)  # -> a, b; inputs data: list; same code as ipy2_4
python_3 = GhPythonScript(data=relay)  # -> a; inputs data: list
# ---------- python_3: Python ----------
from ghpythonlib.componentbase import executingcomponent as component
import Grasshopper, GhPython
import System
import Rhino
import rhinoscriptsyntax as rs

class MyComponent(component):
    
    def RunScript(self, data):
        return (data, None)
# ---------- end python_3 ----------
python_4 = GhPythonScript(data=relay)  # -> a, b; inputs data: list; same code as python_3
panel_5 = Panel(ipy2_5.a)
panel_6 = Panel(py3_4)
panel_7 = Panel(py3_5.a)
panel_8 = Panel(python_3)
lng_4 = ListLength(List=python_3)
panel_9 = Panel(python_4.a)
lng_5 = ListLength(List=python_4.a)
panel_10 = Panel("System\.Collections\.Generic\.List`1\[System\.Object\]")
tmatch_3 = MatchText(Text=py3_5.a, Pattern=python_4.a, Case=True)
lng_6 = ListLength(List=py3_5.a)
tmatch_4 = MatchText(Text=ipy2_5.a, Pattern=python_4.a, Case=True)
lng_7 = ListLength(List=ipy2_5.a)
equals_13 = Equality(FirstNumber=lng_5, SecondNumber=lng_6)  # -> Equality, Inequality
equals_14 = Equality(FirstNumber=lng_5, SecondNumber=lng_7)  # -> Equality, Inequality
item = CherryPicker(panel_4, ListIndex=0)
at_6 = AssertTrue([tmatch_3, equals_13.Equality])
at_7 = AssertTrue([tmatch_4, equals_14.Equality])
item_2 = CherryPicker(panel_6, ListIndex=0)
lng_8 = ListLength(List=py3_4)
lng_9 = ListLength(List=ipy2_4)
tmatch_5 = MatchText(Text=item, RegEx=panel_10, Case=True)
tmatch_6 = MatchText(Text=item_2, RegEx=panel_10, Case=True)
equals_15 = Equality(FirstNumber=lng_4, SecondNumber=lng_8)  # -> Equality, Inequality
equals_16 = Equality(FirstNumber=lng_4, SecondNumber=lng_9)  # -> Equality, Inequality
at_8 = AssertTrue([equals_16.Equality, tmatch_5])
at_9 = AssertTrue([equals_15.Equality, tmatch_6])
