# Grasshopper definition test_params_outputs_python_tuples_and_lists_rc8.14_error.ghx (Grasshopper 1.0.8)
# plug-ins: RhinoCodePluginGH

tags_on_2d_plans = ValueList({"Room_Name", "Room_Number", "Average_DF"}, selected=["Room_Name", "Room_Number", "Average_DF"])
tagged_rooms = ValueList({"Req_rooms", "Other_rooms"}, selected=["Req_rooms", "Other_rooms"])
relay = Relay([tags_on_2d_plans, tagged_rooms])
py3 = Python3Script(data=relay)  # -> a, b; inputs data: list
# ---------- py3: Python ----------
import System
import Rhino
import Grasshopper

import rhinoscriptsyntax as rs

class MyComponent(Grasshopper.Kernel.GH_ScriptInstance):
    def RunScript(self, data: System.Collections.Generic.List[object]):
        return data  # same with (data) as it gets expanded into one output
# ---------- end py3 ----------
ipy2 = IronPython2Script(data=relay)  # -> a, b; inputs data: list
# ---------- ipy2: IronPython ----------
import System
import Rhino
import Grasshopper

import rhinoscriptsyntax as rs

class MyComponent(Grasshopper.Kernel.GH_ScriptInstance):
    def RunScript(self, data):
        return data # same with (data) as it gets expanded into one output
# ---------- end ipy2 ----------
