# Grasshopper definition test_params_point3dList_to_polyline_convert.ghx (Grasshopper 1.0.8)
# plug-ins: RhinoCodePluginGH

pt = Point([Point(-8, -27, 0), Point(-25, -7, 0), Point(-20, 8, 0), Point(-1, 36, 0), Point(17, 17, 0), Point(4, -8, 0)])
pt_2 = Point([Point(-8, -27, 0), Point(-25, -7, 0), Point(-20, 8, 0), Point(-1, 36, 0), Point(17, 17, 0), Point(4, -8, 0)])
entwine = Entwine(Branch00=pt_2, Branch01=pt, FlattenInputs=True)
pline = PolyLine(Vertices=entwine, Closed=False)
# Point3dList -> PolyLine
py3 = Python3Script(points=pline)  # -> out, a
# ---------- py3: Python ----------
print(type(points))
a = points
# ---------- end py3 ----------

# ---- group: NO MARSH OUT
py3_2 = Python3Script(points=pline)  # -> out, a; same code as py3
crv = Curve(py3_2.a)

# ----
# list -> PolyLine
py3_3 = Python3Script(points=entwine)  # -> out, a; inputs points: list of Point3d; same code as py3
# List<Point3d> -> PolyLine
py3_4 = Python3Script(points=entwine)  # -> out, a; inputs points: list of Point3d; same code as py3
panel = Panel("Rhino.Collections.Point3dList'\>")
crv_2 = Curve(py3.a)
crv_3 = Curve(py3_3.a)
crv_4 = Curve(py3_4.a)
tmatch = MatchText(Text=py3.out, RegEx=panel, Case=True)
tmatch_2 = MatchText(Text=py3_2.out, RegEx=panel, Case=True)
tmatch_3 = MatchText(Text=py3_3.out, RegEx="list'\>", Case=True)
tmatch_4 = MatchText(Text=py3_4.out, RegEx="System.Collections.Generic.List\[Point3d\]'\>", Case=True)
python = GhPythonScript(checks=flatten([tmatch, tmatch_3, tmatch_2, tmatch_4]))  # -> all_true; inputs checks: list
# ---------- python: Python ----------
all_true = all(checks)
# ---------- end python ----------
panel_2 = Panel(python)
context_bake = ContextBake(Content=python)
