# Grasshopper definition test_params_python_marshallGuid.ghx (Grasshopper 1.0.8)
# plug-ins: RhinoCodePluginGH

sph = Sphere(Base=PlaneXY(0, 0, 0), Radius=1)
sph_2 = Sphere(Base=PlaneXY(0, 0, 0), Radius=1)

# ---- group: INPUTS ARE MARSHALLED IF USING "ghobject" HINT
python = GhPythonScript(sphere=sph)  # -> out, a
# ---------- python: Python ----------
print(type(sphere))
a = sphere
# ---------- end python ----------
python_2 = GhPythonScript(sphere=sph)  # -> out, a; same code as python

# ---- group: NO MARSHALL ON "No Type Hint"
python_3 = GhPythonScript(sphere=sph_2)  # -> out, a; same code as python
python_4 = GhPythonScript(sphere=sph_2)  # -> out, a; same code as python

# ----
brep = Brep(python_3.a)

# ---- group: AVOID MARSH OUT
brep_2 = Brep(python_4.a)

id = Guid(python_2.a)

# ----
brep_3 = Brep(python.a)
tmatch = MatchText(Text=[python_3.out, python_4.out], RegEx="Brep'\>", Case=True)
py3 = Python3Script(sphere=sph)  # -> out, a; same code as python
py3_2 = Python3Script(sphere=sph)  # -> out, a; same code as python
python_5 = GhPythonScript(sphere=id)  # -> out, a; same code as python
brep_4 = Brep(py3_2.a)
id_2 = Guid(py3.a)
id_3 = Guid(python_5.a)
py3_3 = Python3Script(sphere=id_2)  # -> out, a; same code as python
id_4 = Guid(py3_3.a)
tmatch_2 = MatchText(Text=[py3_2.out, py3.out, py3_3.out, python_5.out, python_2.out, python.out], RegEx="Guid'\>", Case=True)

# ---- group: ALSO NO ERRORS ON PARAMS
python_6 = GhPythonScript(checks=flatten([tmatch_2, tmatch]))  # -> all_true; inputs checks: list
# ---------- python_6: Python ----------
all_true = all(checks)
# ---------- end python_6 ----------
panel = Panel(python_6)
context_bake = ContextBake(Content=python_6)
