# Grasshopper definition test_params_python_marshallGuid_nested.ghx (Grasshopper 1.0.8)
# plug-ins: RhinoCodePluginGH

python = GhPythonScript(r=Slider(12, range=0..100))  # -> a
# ---------- python: Python ----------
import rhinoscriptsyntax as rs

a = rs.AddSphere((1,1,0), r)
# ---------- end python ----------
py3 = Python3Script(r=Slider(12, range=0..100))  # -> a; same code as python
id = Guid(py3)
py3_2 = Python3Script(x=py3)  # -> out, a
# ---------- py3_2: Python ----------
print(type(x))
a = x
# ---------- end py3_2 ----------
id_2 = Guid(python)
python_2 = GhPythonScript(x=python)  # -> out, a; same code as py3_2
srf = Surface(python_2.a)
panel = Panel(python_2.out)
panel_2 = Panel(python_2.a)
panel_3 = Panel(py3_2.out)
panel_4 = Panel(py3_2.a)
# ProxyDocument in new scripting infrastructure is not shared between components.
# 
# ProxyDocument has a .Component property that is supposed to point to the active component. Legacy scripts have a static proxy document and would assign and update this property when a component is being solved. This is fine for Grasshopper as it is not running components in parallel
# 
# https://mcneel.myjetbrains.com/youtrack/issue/RH-81471
id_3 = Guid(py3_2.a)

# ---- group: Expects no errors
at = AssertTrue(Toggle(True))
