# Grasshopper definition test_params_python_marshallGuid_scriptInstance.ghx (Grasshopper 1.0.8)
# plug-ins: RhinoCodePluginGH

number_slider = Slider(55, range=0..100)

# ---- group: RHINOSCRIPTSYNTAX / GHENV IN RUNSCRIPT()
script = Script(x=number_slider, y=number_slider)  # -> out, a
# ---------- script: Python ----------
import System
import Rhino
import Grasshopper

import rhinoscriptsyntax as rs

class MyComponent(Grasshopper.Kernel.GH_ScriptInstance):
    def RunScript(self, x, y):
        return rs.AddSphere((0, 0, 0), 20)
# ---------- end script ----------
script_2 = Script(x=number_slider, y=number_slider)  # -> out, a; same code as script

# ----
brep = Brep(script.a)
id = Guid(script_2.a)

# ---- group: EXPECT NO ERRORS
toggle = BooleanToggle(True)
panel = Panel(toggle)
context_bake = ContextBake(Content=toggle)
