# Grasshopper definition test_params_python_passthru.ghx (Grasshopper 1.0.8)
# plug-ins: RhinoCodePluginGH

panel = Panel("""#! python 3
print(type(V))
print(type(V[0]))""")
panel_2 = Panel("""#! python3
class CustomData:
    def __init__(self, value):
        self.value = value
    
    def __repr__(self):
        return f"<CustomData ={self.value}>"


V = [CustomData(1), CustomData(2), CustomData(3)]""")
pt = Point([Point(2, -8, 0), Point(-1, -1, 0), Point(1, 1, 0), Point(4, 1, 0), Point(8, -6, 0), Point(8, -9, 0)])

# ---- group: AVOID MARSH INPUTS
pt_2 = Point([Point(2, -8, 0), Point(-1, -1, 0), Point(1, 1, 0), Point(4, 1, 0), Point(8, -6, 0), Point(8, -9, 0)])
py3 = Python3Script(script=panel, V=pt_2)  # -> out; inputs V: list
#   port script: Script to execute
# ---------- py3: Python ----------
print(type(V))
print(type(V[0]))
# ---------- end py3 ----------
panel_3 = Panel(py3)

# ----
py3_2 = Python3Script(script=panel, V=pt)  # -> out; inputs V: list; same code as py3
py3_3 = Python3Script(script=panel_2)  # -> V
#   port script: Script to execute
# ---------- py3_3: Python ----------
class CustomData:
    def __init__(self, value):
        self.value = value
    
    def __repr__(self):
        return f"<CustomData ={self.value}>"


V = CustomData(42)
# ---------- end py3_3 ----------

# ---- group: AVOID MARSH OUTPUTS
py3_4 = Python3Script(script=panel_2)  # -> V; same code as py3_3

# ----
panel_4 = Panel("""<class 'System.Collections.Generic.List\[Object\]'>
<class 'Rhino.Geometry.Point3d'>""")
py3_5 = Python3Script(V=py3_3)  # -> v_check
# ---------- py3_5: Python ----------
v_check = isinstance(V.value, int) \
      and 'CustomData' in type(V).__name__
# ---------- end py3_5 ----------
py3_6 = Python3Script(V=py3_4)  # -> v_list_check
# ---------- py3_6: Python ----------
v_list_check = isinstance(V, list)
# ---------- end py3_6 ----------
panel_5 = Panel("""<class 'list'>
<class 'Rhino.Geometry.Point3d'>""")
and = GateAnd(A=py3_5)
tmatch = MatchText(Text=py3_2, RegEx=panel_5, Case=True)
tmatch_2 = MatchText(Text=py3, RegEx=panel_4, Case=True)
python = GhPythonScript(checks=flatten([and, tmatch, tmatch_2]))  # -> all_true; inputs checks: list
# ---------- python: Python ----------
all_true = all([x for x in checks])
# ---------- end python ----------
panel_6 = Panel(python)
context_bake = ContextBake(Content=python)
