# Grasshopper definition test_params_reserved_names.ghx (Grasshopper 1.0.8)
# plug-ins: RhinoCodePluginGH

number_slider = Slider(42, range=0..100)
script = Script(dir12=number_slider)  # -> out, a
# ---------- script: Python ----------
"""Grasshopper Script"""
#! python 3
a = _dir12
# ---------- end script ----------
script_2 = Script(just=number_slider)  # -> out, a
# ---------- script_2: C# ----------
//#! csharp
using System;

a = @just;
# ---------- end script_2 ----------
script_3 = Script(z=number_slider)  # -> out, a
# ---------- script_3: C# ----------
//#! csharp
using System;

a = z;
# ---------- end script_3 ----------
script_4 = Script(x=number_slider)  # -> out, a
# ---------- script_4: Python ----------
"""Grasshopper Script"""
#! python 3
a = x
# ---------- end script_4 ----------
script_5 = Script(x=number_slider)  # -> out, a
# ---------- script_5: Python ----------
"""Grasshopper Script"""
#! python 2
a = x
# ---------- end script_5 ----------
equality = Equality(FirstNumber=number_slider, SecondNumber=script_3.a)  # -> Equality, Inequality
equality_2 = Equality(FirstNumber=number_slider, SecondNumber=script_2.a)  # -> Equality, Inequality
equality_3 = Equality(FirstNumber=number_slider, SecondNumber=script.a)  # -> Equality, Inequality
equality_4 = Equality(FirstNumber=number_slider, SecondNumber=script_4.a)  # -> Equality, Inequality
equality_5 = Equality(FirstNumber=number_slider, SecondNumber=script_5.a)  # -> Equality, Inequality
assert_true = AssertTrue(equality.Equality)
assert_true_2 = AssertTrue(equality_2.Equality)
assert_true_3 = AssertTrue(equality_3.Equality)
assert_true_4 = AssertTrue(equality_4.Equality)
assert_true_5 = AssertTrue(equality_5.Equality)
