# Grasshopper definition test_params_reserved_names_csharp_9just_error.ghx (Grasshopper 1.0.8)
# plug-ins: RhinoCodePluginGH

# ---- group: 9just is invalid
script = Script()  # -> out, a
# ---------- script: C# ----------
//#! csharp
using System;

a = 9just;
# ---------- end script ----------
