# Grasshopper definition test_params_reserved_names_csharp_while_error.ghx (Grasshopper 1.0.8)
# plug-ins: RhinoCodePluginGH

# ---- group: while is keyword
script = Script()  # -> out, a
# ---------- script: C# ----------
//#! csharp
using System;

a = while;
# ---------- end script ----------
