# Grasshopper definition test_params_reserved_names_python_@just_error.ghx (Grasshopper 1.0.8)
# plug-ins: RhinoCodePluginGH

# ---- group: @just is invalid
script = Script()  # -> out, a
# ---------- script: Python ----------
"""Grasshopper Script"""
#! python 3
a = dir
# ---------- end script ----------
ironpython_2_script = IronPython2Script()  # -> out, a
# ---------- ironpython_2_script: IronPython ----------
"""Grasshopper Script"""
a = "Hello IronPython 2 in Grasshopper!"
print(a)
# ---------- end ironpython_2_script ----------
