# Grasshopper definition test_params_reserved_names_python_dir_rc8.8_warning.ghx (Grasshopper 1.0.8)
# plug-ins: RhinoCodePluginGH

number_slider = Slider(48, range=0..100)

# ---- group: dir is keyword
script = Script(dir=number_slider)  # -> out, a
# ---------- script: Python ----------
"""Grasshopper Script"""
#! python 3
a = dir
# ---------- end script ----------
script_2 = Script(dir=number_slider)  # -> out, a
# ---------- script_2: Python ----------
"""Grasshopper Script"""
#! python 2
a = dir
# ---------- end script_2 ----------
