# Grasshopper definition test_params_same_name.ghx (Grasshopper 1.0.8)
# plug-ins: RhinoCodePluginGH

# ---- group: ENSURE OUTPUT VAL DOES NOT OVERRIDE INPUT VAL
int = Integer(Tree({1}: [42, 42], {2}: [42, 42]))
py3 = Python3Script(V=int)  # -> BV, V; inputs V: list
# ---------- py3: Python ----------
"""
this script assigns a value to output "V" which matches
name with input "V". This results the value of "V" being
copied to the RunContext. This test ensures the existing
value in RunContext does not override the input "V" value
on the next run of this component.
https://discourse.mcneel.com/t/rhino-8-3-rc/171538/12
"""
BV = type(V)
V = 0
# ---------- end py3 ----------
panel = Panel(py3.BV)
panel_2 = Panel(py3.V)
tmatch = MatchText(Text=panel, RegEx="class \'list\'", Case=True)

# ----
py3_2 = Python3Script(V=Slider(42, range=0..100))
ipy2 = IronPython2Script(V=Slider(42, range=0..100))
cs = CSharpScript(V=Slider(42, range=0..100))  # -> V
# ---------- cs: C# ----------
using System;
# ---------- end cs ----------
panel_3 = Panel(py3_2)
panel_4 = Panel(ipy2)
panel_5 = Panel(cs)
equals = Equality(FirstNumber=[py3_2, ipy2, cs], SecondNumber=Slider(42, range=0..100))  # -> Equality, Inequality
python = GhPythonScript(checks=flatten([equals.Equality, tmatch]))  # -> all_true; inputs checks: list
# ---------- python: Python ----------
all_true = all(checks)
# ---------- end python ----------
context_bake = ContextBake(Content=python)
panel_6 = Panel(python)
