# Grasshopper definition test_params_scriptinParam_diagnosis_linenumber_rc8.18_py3.9_py3.9_error.ghx (Grasshopper 1.0.9)

# https://mcneel.myjetbrains.com/youtrack/issue/RH-86122
panel = Panel("test_params_scriptinParam_diagnosis_linenumber_rc8.18_py3.9_py3.9_error.py")
py3 = Python3Script(p=panel)  # -> path; inputs p: String
# ---------- py3: Python ----------
path = p
# ---------- end py3 ----------
py3_2 = Python3Script(script=py3)  # -> out; unedited script template
panel_2 = Panel(py3_2)
