# Grasshopper definition test_params_scriptinParam_no_context_override.ghx (Grasshopper 1.0.8)
# plug-ins: RhinoCodePluginGH

# Ensure external scripts do not override the
# context parameters
panel = Panel("""#! python 3
a = 42 + x + y + z""")
number_slider = Slider(1, range=0..10)
number_slider_2 = Slider(2, range=0..10)
number_slider_3 = Slider(3, range=0..10)
panel_2 = Panel("""#! python 2
a = 43 + x + y + z""")
number_slider_4 = Slider(4, range=0..10)
number_slider_5 = Slider(5, range=0..10)
number_slider_6 = Slider(6, range=0..10)
panel_3 = Panel("""// #! csharp
a = 44 + x + y + z;""")
number_slider_7 = Slider(7, range=0..10)
number_slider_8 = Slider(8, range=0..10)
number_slider_9 = Slider(9, range=0..10)
S = Script(
    Script=graft([panel, panel_2, panel_3]),
    X=[number_slider, number_slider_4, number_slider_7],
    Y=[number_slider_2, number_slider_5, number_slider_8],
    Z=[number_slider_3, number_slider_6, number_slider_9])
python = GhPythonScript(
    x=[number_slider, number_slider_4, number_slider_7],
    y=[number_slider_2, number_slider_5, number_slider_8],
    z=[number_slider_3, number_slider_6, number_slider_9])  # -> a
# ---------- python: Python ----------
a = x + y + z
# ---------- end python ----------
addition = Addition(A=graft([Slider(42, range=0..100), Slider(43, range=0..100), Slider(44, range=0..100)]), B=python)
equals = Equality(FirstNumber=S, SecondNumber=addition)  # -> Equality, Inequality
at = AssertTrue(equals.Equality)
