# Grasshopper definition test_params_scriptoutParam_caching_rc8.8.ghx (Grasshopper 1.0.8)
# plug-ins: RhinoCodePluginGH

number_slider = Slider(55, range=0..100)
number_slider_2 = Slider(65, range=0..100)
c_script = CSharpScript(x=number_slider, y=number_slider)  # -> script, out, a; inputs x: Int32, y: Int32
#   port script: Script being executed
# ---------- c_script: C# ----------
using System;

if (x == 65)
{
    Console.WriteLine("Empty Inputs:");
}

Console.WriteLine($"{x.GetType()}: {x}");
Console.WriteLine($"{y.GetType()}: {y}");

a = x + y;
# ---------- end c_script ----------
S = Script(Script=c_script.script, X=number_slider_2, Y=number_slider_2)  # -> Out, A
panel = Panel(c_script.script)
panel_2 = Panel(c_script.out)
panel_3 = Panel(c_script.a)
panel_4 = Panel(S.Out)
panel_5 = Panel(S.A)
equals = Equality(FirstNumber=c_script.a, SecondNumber=Slider(110, range=0..1000))  # -> Equality, Inequality
equals_2 = Equality(FirstNumber=S.A, SecondNumber=Slider(130, range=0..1000))  # -> Equality, Inequality
at = AssertTrue(equals_2.Equality)
at_2 = AssertTrue(equals.Equality)
ds = ScriptSourceDeconstruct(ScriptSource=c_script.script)  # -> Id, LanguageSpec, Title, Text, Signature, Uri, EnvironId, Inputs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
S_2 = ScriptSource(
    panel,
    ExpireOnDiskEvent=False,
    TreatInputAsPath=False,
    SourceLanguageFamilySpec_Taxon="mcneel.roslyn.csharp",
    SourceLanguageFamilySpec_Version="9.*")
tmatch = MatchText(Text=panel_4, RegEx="Empty Inputs:", Case=True)
at_3 = AssertTrue(ds.IsCached)
at_4 = AssertTrue(tmatch)
ds_2 = ScriptSourceDeconstruct(ScriptSource=S_2)  # -> Id, LanguageSpec, Title, Text, Signature, Uri, EnvironId, Inputs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
not = GateNot(A=ds_2.IsCached)
at_5 = AssertTrue(not)
