# Grasshopper definition test_params_scriptoutParam_info_rc8.10.ghx (Grasshopper 1.0.8)
# plug-ins: RhinoCodePluginGH

py3_title = Python3Script()  # -> script, out, a; unedited script template
python = GhPythonScript(script=py3_title.script)  # -> nn, desc
# ---------- python: Python ----------
nn = script.NickName
desc = script.Description
# ---------- end python ----------
panel = Panel("""Py3 Description
Line 2""")
tmatch = MatchText(Text=python.nn, RegEx="Py3 Title", Case=True)
tmatch_2 = MatchText(Text=python.desc, RegEx=panel, Case=True)
at = AssertTrue(tmatch)
at_2 = AssertTrue(tmatch_2)
