# Grasshopper definition test_params_scriptoutParam_mismatched_inputs_rc8.8_warning.ghx (Grasshopper 1.0.8)
# plug-ins: RhinoCodePluginGH

python_3_script = Python3Script()  # -> script, a; unedited script template
c_script = CSharpScript()  # -> script, a
#   port script: Script being executed
# ---------- c_script: C# ----------
// Grasshopper Script Instance
#region Usings
using System;
using System.Linq;
using System.Collections;
using System.Collections.Generic;
using System.Drawing;

using Rhino;
using Rhino.Geometry;

using Grasshopper;
using Grasshopper.Kernel;
using Grasshopper.Kernel.Data;
using Grasshopper.Kernel.Types;
#endregion

public class Script_Instance : GH_ScriptInstance
{
    #region Notes
    /* 
      Members:
        RhinoDoc RhinoDocument
        GH_Document GrasshopperDocument
        IGH_Component Component
        int Iteration

      Methods (Virtual & overridable):
        Print(string text)
        Print(string format, params object[] args)
        Reflect(object obj)
        Reflect(object obj, string method_name)
    */
    #endregion

    private void RunScript(object u, object v, ref object a)
    {
        // Write your logic here
        a = null;
    }
}
# ---------- end c_script ----------
script = Script(Script=[python_3_script.script, c_script.script])  # -> Out, A
