# Grasshopper definition test_params_scriptoutParam_mismatched_inputs_types_rc8.8_warning.ghx (Grasshopper 1.0.8)
# plug-ins: RhinoCodePluginGH

python_3_script = Python3Script()  # -> script, a; inputs x: Int32, y: Curve; unedited script template
python_3_script_2 = Python3Script()  # -> script, a; inputs x: Curve; unedited script template
script = Script(Script=python_3_script.script)  # -> Out, A
script_2 = Script(Script=python_3_script_2.script)  # -> Out, A
