# Grasshopper definition test_params_scriptoutParam_rc8.7.ghx (Grasshopper 1.0.8)
# plug-ins: RhinoCodePluginGH

number_slider = Slider(21, range=0..100)
number_slider_2 = Slider(21, range=0..100)
panel = Panel("""// #! csharp
a = x + y;""")
panel_2 = Panel("""#! python 3
a = x + y""")
panel_3 = Panel("""#! python2
a = x + y""")
py3 = Python3Script(x=number_slider, y=number_slider)  # -> script, a
#   port script: Script being executed
# ---------- py3: Python ----------
a  = x + y
# ---------- end py3 ----------
script = Script(Script=[panel, panel_2, panel_3], X=number_slider_2, Y=number_slider_2)  # -> Script, A
S = Script(Script=py3.script, X=number_slider, Y=number_slider)  # -> Out, A
addition = Addition(A=number_slider, B=number_slider)
panel_4 = Panel(py3.script)
ds = ScriptSourceDeconstruct(ScriptSource=script.Script)  # -> Id, LanguageId, Title, Text, Signature, Uri, EnvironId, Inputs, Outputs
panel_5 = Panel("""mcneel\.roslyn\.csharp
mcneel\.pythonnet\.python
mcneel\.ironpython\.python""")
panel_6 = Panel(S.Out)
equals = Equality(FirstNumber=S.A, SecondNumber=addition)  # -> Equality, Inequality
panel_7 = Panel(ds.LanguageId)
panel_8 = Panel(ds.Id)
equals_2 = Equality(FirstNumber=addition, SecondNumber=script.A)  # -> Equality, Inequality
tmatch = MatchText(Text=ds.LanguageId, RegEx=panel_5, Case=True)
panel_9 = Panel(ds.Inputs)
ds_2 = ScriptSourceDeconstruct(ScriptSource=py3.script)  # -> Id, LanguageId, Title, Text, Signature, Uri, EnvironId, Inputs, Outputs
panel_10 = Panel("""ScriptParam \(x: double\)
ScriptParam \(y: int\)""")
panel_11 = Panel(ds_2.Id)
panel_12 = Panel(ds_2.LanguageId)
panel_13 = Panel(ds_2.Title)
panel_14 = Panel(ds_2.Text)
panel_15 = Panel(ds_2.Signature)
panel_16 = Panel(ds_2.Uri)
panel_17 = Panel(ds_2.EnvironId)
panel_18 = Panel(ds_2.Inputs)
panel_19 = Panel(ds_2.Outputs)
tmatch_2 = MatchText(Text=ds.Inputs, RegEx=panel_10, Case=True)
tmatch_3 = MatchText(Text="d95b115f-5bda-438d-8d9e-dc80af456c5a", Pattern=panel_11, Case=True)
python = GhPythonScript(checks=flatten([equals.Equality, equals_2.Equality, tmatch, tmatch_2, tmatch_3]))  # -> all_true; inputs checks: list
# ---------- python: Python ----------
all_true = all(checks)
# ---------- end python ----------
panel_20 = Panel(python)
context_bake = ContextBake(Content=python)
