# Grasshopper definition test_params_scriptoutParam_rc8.8.ghx (Grasshopper 1.0.8)
# plug-ins: RhinoCodePluginGH

number_slider = Slider(21, range=0..100)
number_slider_2 = Slider(21, range=0..100)
panel = Panel("""// #! csharp
a = x + y;""")
panel_2 = Panel("""#! python 3
a = x + y""")
panel_3 = Panel("""#! python2
a = x + y""")
py3 = Python3Script(x=number_slider, y=number_slider)  # -> script, a
#   port script: Script being executed
# ---------- py3: Python ----------
a  = x + y
# ---------- end py3 ----------
script = Script(Script=[panel, panel_2, panel_3], X=number_slider_2, Y=number_slider_2)  # -> Script, A
S = Script(Script=py3.script, X=number_slider, Y=number_slider)  # -> Out, A
addition = Addition(A=number_slider, B=number_slider)
equals = Equality(FirstNumber=S.A, SecondNumber=addition)  # -> Equality, Inequality
equals_2 = Equality(FirstNumber=addition, SecondNumber=script.A)  # -> Equality, Inequality
ds = ScriptSourceDeconstruct(ScriptSource=script.Script)  # -> Id, LanguageId, Title, Text, Signature, Uri, EnvironId, Inputs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
assert_true = AssertTrue(equals.Equality)
assert_true_2 = AssertTrue(equals_2.Equality)
panel_4 = Panel("""\.csharp
\.python
\.python""")
ds_2 = ScriptSourceDeconstruct(ScriptSource=py3.script)  # -> Id, LanguageId, Title, Text, Signature, Uri, EnvironId, Inputs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
panel_5 = Panel(ds.Id)
panel_6 = Panel(ds.LanguageId)
panel_7 = Panel(ds.Inputs)
tmatch = MatchText(Text=ds.LanguageId, RegEx=panel_4, Case=True)
panel_8 = Panel("""ScriptParam \(x: double\)
ScriptParam \(y: int\)""")
assert_true_3 = AssertTrue(tmatch)

# ---- group: Script ID is generated when created and does not match owning component
panel_9 = Panel(ds_2.Id)
panel_10 = Panel("d95b115f-5bda-438d-8d9e-dc80af456c5a")
tmatch_2 = MatchText(Text=panel_10, Pattern=panel_9, Case=True)

# ----
panel_11 = Panel(ds_2.LanguageId)
panel_12 = Panel(ds_2.Title)
panel_13 = Panel(ds_2.Text)
panel_14 = Panel(ds_2.Signature)
panel_15 = Panel(ds_2.Uri)
panel_16 = Panel(ds_2.EnvironId)
panel_17 = Panel(ds_2.Inputs)
panel_18 = Panel(ds_2.Outputs)
tmatch_3 = MatchText(Text=panel_7, RegEx=panel_8, Case=True)
assert_true_4 = AssertTrue(tmatch_3)

# ---- group: Component id must exist in script URI
tmatch_4 = MatchText(Text=ds_2.Uri, RegEx=panel_10, Case=True)
assert_true_5 = AssertTrue(tmatch_4)
