# Grasshopper definition test_params_unwrap_rc9.0.ghx (Grasshopper 1.0.9)

number_slider = Slider(2, range=0..10)
ironpython_2_script = IronPython2Script()  # -> out, a
# ---------- ironpython_2_script: IronPython ----------
a = {'x': 1, 'y': 2}
# ---------- end ironpython_2_script ----------
python_3_script = Python3Script()  # -> out, a; same code as ironpython_2_script
c_script = CSharpScript()  # -> out, a
# ---------- c_script: C# ----------
using System;
using System.Collections.Generic;
a = new Dictionary<int, int> {
  [1] = 1,
  [2] = 2,
};
# ---------- end c_script ----------
panel = Panel(python_3_script.a)
panel_2 = Panel(ironpython_2_script.a)
panel_3 = Panel(c_script.a)
list_length = ListLength(List=python_3_script.a)
list_length_2 = ListLength(List=ironpython_2_script.a)
list_length_3 = ListLength(List=c_script.a)
equality = Equality(FirstNumber=number_slider, SecondNumber=list_length)  # -> Equality, Inequality
equality_2 = Equality(FirstNumber=number_slider, SecondNumber=list_length_2)  # -> Equality, Inequality
equality_3 = Equality(FirstNumber=number_slider, SecondNumber=list_length_3)  # -> Equality, Inequality
panel_4 = Panel("System.Collections.Generic.Dictionary`2\[System.Object,System.Object\]")
panel_5 = Panel("System.Collections.Generic.Dictionary`2\[System.Object,System.Object\]")
assert_true = AssertTrue(equality.Equality)
assert_true_2 = AssertTrue(equality_2.Equality)
assert_true_3 = AssertTrue(equality_3.Equality)
number_slider_2 = Slider(1, range=0..10)
c_script_2 = CSharpScript()  # -> out, a
# ---------- c_script_2: C# ----------
using System;
using System.Collections.Generic;
a = new Dictionary<object, object> {
  [1] = 1,
  [2] = 2,
};
# ---------- end c_script_2 ----------
ironpython_2_script_2 = IronPython2Script()  # -> out, a; same code as ironpython_2_script
python_3_script_2 = Python3Script()  # -> out, a; same code as ironpython_2_script
panel_6 = Panel(ironpython_2_script_2.a)
panel_7 = Panel(python_3_script_2.a)
panel_8 = Panel(c_script_2.a)
match_text = MatchText(Text=python_3_script_2.a, RegEx=panel_4, Case=True)
match_text_2 = MatchText(Text=ironpython_2_script_2.a, RegEx="IronPython.Runtime.PythonDictionary", Case=True)
list_length_4 = ListLength(List=python_3_script_2.a)
match_text_3 = MatchText(Text=c_script_2.a, RegEx=panel_5, Case=True)
list_length_5 = ListLength(List=ironpython_2_script_2.a)
list_length_6 = ListLength(List=c_script_2.a)
equality_4 = Equality(FirstNumber=number_slider_2, SecondNumber=list_length_4)  # -> Equality, Inequality
equality_5 = Equality(FirstNumber=number_slider_2, SecondNumber=list_length_5)  # -> Equality, Inequality
equality_6 = Equality(FirstNumber=number_slider_2, SecondNumber=list_length_6)  # -> Equality, Inequality
assert_true_4 = AssertTrue(equality_4.Equality)
assert_true_5 = AssertTrue(match_text)
assert_true_6 = AssertTrue(equality_5.Equality)
assert_true_7 = AssertTrue(match_text_2)
assert_true_8 = AssertTrue(equality_6.Equality)
assert_true_9 = AssertTrue(match_text_3)
