# Grasshopper definition test_plugins_builtins.ghx (Grasshopper 1.0.8)
# plug-ins: ScriptInstanceBuiltinsTests.GH

# ---- group: Py3
py3_sdk_ctx = Py3_SDK_Ctx()  # -> Script_id, Script_ctx, I
py3_scr_ctx = Py3_SCR_Ctx()  # -> Script_id, Script_ctx, I
py3sdk = Py3_SDK()  # -> Ghenv, Ghdoc, I
py3scr = Py3_Script()  # -> Ghenv, Ghdoc, I

# ---- group: Py2
ipy2_sdk_ctx = IPy2_SDK_Ctx()  # -> Script_id, Script_ctx, I
ipy2_scr_ctx = IPy2_SCR_Ctx()  # -> Script_id, Script_ctx, I
ipysdk = IPy_SDK()  # -> Ghenv, Ghdoc, I
ipyscr = IPy_Script()  # -> Ghenv, Ghdoc, I

# ---- group: CSharp
csscr = CSharp_Script()  # -> GhEnv, GhDoc
cssdk = CSharp_SDK()  # -> GhEnv, GhDoc

# ----
tmatch = MatchText(Text=[cssdk.GhEnv, cssdk.GhDoc], RegEx="Not Supported", Case=True)

# ---- group: NO ERRORS
id = Guid([py3_sdk_ctx.Script_id, ipy2_sdk_ctx.Script_id, ipy2_scr_ctx.Script_id, py3_scr_ctx.Script_id])

# ----
panel = Panel(tmatch)
relay = Relay([py3sdk.Ghenv, py3scr.Ghenv, ipysdk.Ghenv, ipyscr.Ghenv, csscr.GhEnv])
relay_2 = Relay([py3_sdk_ctx.Script_ctx, py3_scr_ctx.Script_ctx])
relay_3 = Relay([py3sdk.Ghdoc, py3scr.Ghdoc, ipyscr.Ghdoc, ipysdk.Ghdoc, csscr.GhDoc])
panel_2 = Panel(relay)
panel_3 = Panel(relay_2)
panel_4 = Panel(relay_3)
equals = Equality(
    FirstNumber=Slider(2, range=0..10),
    SecondNumber=[py3_sdk_ctx.I, py3sdk.I, py3_scr_ctx.I, py3scr.I, ipysdk.I, ipy2_sdk_ctx.I, ipyscr.I, ipy2_scr_ctx.I])  # -> Equality, Inequality
panel_5 = Panel(equals.Equality)
tmatch_2 = MatchText(Text=relay, RegEx="RhinoCodePlatform.Rhino3D.GH1.Legacy.ProxyScriptEnv", Case=True)
tmatch_3 = MatchText(Text=relay_2, RegEx="Rhino.Runtime.Code.Execution.RunContext", Case=True)
tmatch_4 = MatchText(Text=relay_3, RegEx="RhinoCodePlatform.Rhino3D.GH1.Legacy.ProxyDocument", Case=True)
panel_6 = Panel(tmatch_3)
panel_7 = Panel(tmatch_2)
panel_8 = Panel(tmatch_4)
python = GhPythonScript(checks=flatten([equals.Equality, tmatch_3, tmatch_4, tmatch]))  # -> all_true; inputs checks: list
# ---------- python: Python ----------
all_true = all(checks)
# ---------- end python ----------
panel_9 = Panel(python)
context_bake = ContextBake(Content=python)
