# Grasshopper definition test_plugins_builtins_rc8.10.ghx (Grasshopper 1.0.8)
# plug-ins: RhinoCodePluginGH, ScriptInstanceBuiltinsTests.GH

# ---- group: Py3
py3_sdk_ctx = Py3_SDK_Ctx()  # -> Script_id, Script_ctx, I
py3_scr_ctx = Py3_SCR_Ctx()  # -> Script_id, Script_ctx, I
py3sdk = Py3_SDK()  # -> Ghenv, Ghdoc, I
py3scr = Py3_Script()  # -> Ghenv, Ghdoc, I

# ---- group: Py2
ipy2_sdk_ctx = IPy2_SDK_Ctx()  # -> Script_id, Script_ctx, I
ipy2_scr_ctx = IPy2_SCR_Ctx()  # -> Script_id, Script_ctx, I
ipysdk = IPy_SDK()  # -> Ghenv, Ghdoc, I
ipyscr = IPy_Script()  # -> Ghenv, Ghdoc, I

# ---- group: CSharp
csscr = CSharp_Script()  # -> GhEnv, GhDoc
cssdk = CSharp_SDK()  # -> GhEnv, GhDoc

# ----
tmatch = MatchText(Text=[cssdk.GhEnv, cssdk.GhDoc], RegEx="Not Supported", Case=True)

# ---- group: NO ERRORS
id = Guid([py3_sdk_ctx.Script_id, ipy2_sdk_ctx.Script_id, ipy2_scr_ctx.Script_id, py3_scr_ctx.Script_id])

# ----
at = AssertTrue(tmatch)
relay = Relay([py3sdk.Ghenv, py3scr.Ghenv, ipysdk.Ghenv, ipyscr.Ghenv, csscr.GhEnv])
relay_2 = Relay([py3_sdk_ctx.Script_ctx, py3_scr_ctx.Script_ctx])
relay_3 = Relay([py3sdk.Ghdoc, py3scr.Ghdoc, ipyscr.Ghdoc, ipysdk.Ghdoc, csscr.GhDoc])
panel = Panel("RhinoCodePlatform.Rhino3D.Languages.GH1.Legacy.ProxyDocument")
panel_2 = Panel("RhinoCodePlatform.Rhino3D.Languages.GH1.Legacy.ProxyScriptEnv")
panel_3 = Panel(relay)
panel_4 = Panel(relay_3)
panel_5 = Panel(relay_2)
equals = Equality(
    FirstNumber=Slider(2, range=0..10),
    SecondNumber=[py3_sdk_ctx.I, py3sdk.I, py3_scr_ctx.I, py3scr.I, ipysdk.I, ipy2_sdk_ctx.I, ipyscr.I, ipy2_scr_ctx.I])  # -> Equality, Inequality
at_2 = AssertTrue(equals.Equality)
tmatch_2 = MatchText(Text=relay, RegEx=panel_2, Case=True)
tmatch_3 = MatchText(Text=relay_2, RegEx="Rhino.Runtime.Code.Execution.RunContext", Case=True)
tmatch_4 = MatchText(Text=relay_3, RegEx=panel, Case=True)
at_3 = AssertTrue(tmatch_3)
at_4 = AssertTrue(tmatch_2)
at_5 = AssertTrue(tmatch_4)
python = GhPythonScript(checks=flatten([equals.Equality, tmatch_3, tmatch_4, tmatch]))  # -> all_true; inputs checks: list
# ---------- python: Python ----------
all_true = all(checks)
# ---------- end python ----------
at_6 = AssertTrue(python)
