# Grasshopper definition test_plugins_compswithlibs_rc8.11.ghx (Grasshopper 1.0.8)
# plug-ins: RhinoCodePluginGH, TestLibrariesInGH.Components

testpy2lib = TestPy2Lib()
testcsharplib = TestCSharpLib()  # -> A, B
testpy3lib = TestPy3Lib()  # -> A, B
num = Number(testpy3lib.B)
num_2 = Number(testcsharplib.B)
equals = Equality(FirstNumber=testcsharplib.A, SecondNumber=Slider(52, range=0..100))  # -> Equality, Inequality
equals_2 = Equality(FirstNumber=[testpy2lib, testpy3lib.A], SecondNumber=Slider(42, range=0..100))  # -> Equality, Inequality
at = AssertTrue(equals.Equality)
at_2 = AssertTrue(equals_2.Equality)
