# Grasshopper definition test_plugins_compswithoptionals_rc8.14.ghx (Grasshopper 1.0.8)
# plug-ins: RhinoCodePluginGH, ComponentOptionalInputs_Before8Dot14.Components

# ---- group: X is requried and provided - no warnings
requiredxauto = RequiredXAuto(X=Slider(42, range=0..100))  # -> RequiredX, OptionalY
requiredxmanual = RequiredXManual(X=Slider(42, range=0..100))  # -> RequiredX, OptionalY
at = AssertTrue([requiredxauto.RequiredX, requiredxauto.OptionalY])
at_2 = AssertTrue([requiredxmanual.RequiredX, requiredxmanual.OptionalY])

# ---- group: X and Y are both optional
number_slider = Slider(42, range=0..100)
optionaly = OptionalY(X=Slider(42, range=0..100))  # -> HasX, HasY
optionaly_2 = OptionalY(X=number_slider, Y=number_slider)  # -> HasX, HasY
not = GateNot(A=optionaly.HasY)
at_3 = AssertTrue([optionaly_2.HasX, optionaly_2.HasY])
at_4 = AssertTrue([optionaly.HasX, not])
