# Grasshopper definition test_plugins_contextual_nested_path_rc8.13.ghx (Grasshopper 1.0.8)
# plug-ins: RhinoCodePluginGH, TestNestedPathInContextComp.Components

testnestedpathincontextcomp = TestNestedPathInContextComp(Input=Slider(12, range=0..100))
equals = Equality(FirstNumber=testnestedpathincontextcomp, SecondNumber=Slider(120, range=0..1000))  # -> Equality, Inequality
at = AssertTrue(equals.Equality)
