# Grasshopper definition test_plugins_inputs_rc8.13.ghx (Grasshopper 1.0.8)
# plug-ins: RhinoCodePluginGH, ScriptInputListTree.Components

pt = ConstructPoint(XCoordinate=0, YCoordinate=0, ZCoordinate=0)
pt_2 = ConstructPoint(XCoordinate=0, YCoordinate=0, ZCoordinate=0)
listpoint3d = ListPoint3d(X=[pt, pt_2])
treepoint3d = TreePoint3d(X=[pt, pt_2])
at = AssertTrue(listpoint3d)
at_2 = AssertTrue(treepoint3d)
