# Grasshopper definition test_plugins_params_context_csharp_script_global.ghx (Grasshopper 1.0.8)
# plug-ins: ScriptInstanceGlobalScopeTest.GH

number_slider = Slider(21, range=0..100)
scriptglobalscopetest = ScriptGlobalScopeTest(X=number_slider, Y=number_slider)
equals = Equality(FirstNumber=scriptglobalscopetest, SecondNumber=Slider(42, range=0..100))  # -> Equality, Inequality
panel = Panel(equals.Equality)
context_bake = ContextBake(Content=equals.Equality)
