# Grasshopper definition test_plugins_pythonMarshOutputs_rc8.17.ghx (Grasshopper 1.0.9)
# plug-ins: PythonMarshOutputs.Components

range = Range(Domain=Domain(0, 1), Steps=10)
sph = Sphere(Base=PlaneXY(0, 0, 0), Radius=range)
mesh = Mesh(sph)
pmsh = DoMarsh(Meshes=mesh)
donotmarsh = DoNotMarsh(Meshes=mesh)
panel = Panel(pmsh)
panel_2 = Panel(donotmarsh)
lng = ListLength(List=pmsh)
lng_2 = ListLength(List=donotmarsh)
equals = Equality(FirstNumber=lng, SecondNumber=Slider(11, range=0..100))  # -> Equality, Inequality
equals_2 = Equality(FirstNumber=lng_2, SecondNumber=Slider(1, range=0..1))  # -> Equality, Inequality
at = AssertTrue(equals.Equality)
at_2 = AssertTrue(equals_2.Equality)
