# Grasshopper definition test_prebuild_rc8.10.ghx (Grasshopper 1.0.8)
# plug-ins: RhinoCodePluginGH

test = CSharpScript()  # -> a
# ---------- test: C# ----------
using System;
using System.Linq;
using System.Collections.Generic;

using RhinoCodePlatform.GH;
using RhinoCodePlatform.GH.Context;

var doc = ghenv.Component.OnPingDocument();

var scripts = new List<string>();
foreach (IScriptObject script in doc.Objects
                                    .OfType<IScriptObject>()
                                    .Where(so => so.HasScript))
{
    if (script.Name == "_test_")
        continue;

    scripts.Add(script.Name);
    
    // build the script
    script.ReBuild();
}

a = scripts;
# ---------- end test ----------

# ---- group: NO ERROR
python3 = Python3Script()  # -> out, a; disabled; unedited script template
python2 = IronPython2Script()  # -> out, a; disabled
# ---------- python2: IronPython ----------
"""Grasshopper Script"""
a = "Hello IronPython 2 in Grasshopper!"
print(a)
# ---------- end python2 ----------

# ----
panel = Panel(test)

# ---- group: EXPECT NO ERRORS
toggle = BooleanToggle(True)
panel_2 = Panel(toggle)
context_bake = ContextBake(Content=toggle)
