# Grasshopper definition test_python2_output_tuples_rc8.8.ghx (Grasshopper 1.0.8)
# plug-ins: RhinoCodePluginGH

panel = Panel("""#! python2
d = { "a": (1,2), "b": (3,4) }
a = d.items()""")
panel_2 = Panel("""#! python2
d = { "a": (1,2), "b": (3,4) }
a = d.values()""")
panel_3 = Panel("""#! python2
a = (1,2)""")
panel_4 = Panel("""#! python2
a = [ (1,2), (3,4) ]""")
ironpython_2_script = IronPython2Script(script=panel_3)  # -> a
#   port script: Script to execute
# ---------- ironpython_2_script: IronPython ----------
"""Grasshopper Script"""
a = "Hello IronPython 2 in Grasshopper!"
print(a)
# ---------- end ironpython_2_script ----------
ghpython_script = GhPythonScript(Code=panel_3)
ironpython_2_script_2 = IronPython2Script(script=panel_4)  # -> a; same code as ironpython_2_script
ghpython_script_2 = GhPythonScript(Code=panel_4)
ironpython_2_script_3 = IronPython2Script(script=panel)  # -> a; same code as ironpython_2_script
ironpython_2_script_4 = IronPython2Script(script=panel_2)  # -> a; same code as ironpython_2_script
panel_5 = Panel(ghpython_script)
panel_6 = Panel(ironpython_2_script)
ghpython_script_3 = GhPythonScript(Code=panel)
ghpython_script_4 = GhPythonScript(Code=panel_2)
panel_7 = Panel(ghpython_script_2)
panel_8 = Panel(ironpython_2_script_2)
panel_9 = Panel(ghpython_script_3)
panel_10 = Panel(ironpython_2_script_3)
panel_11 = Panel(ghpython_script_4)
panel_12 = Panel(ironpython_2_script_4)
match_text = MatchText(Text=ironpython_2_script, Pattern=ghpython_script, Case=True)
match_text_2 = MatchText(Text=ironpython_2_script_2, Pattern=ghpython_script_2, Case=True)
match_text_3 = MatchText(Text=ironpython_2_script_3, Pattern=ghpython_script_3, Case=True)
match_text_4 = MatchText(Text=ironpython_2_script_4, Pattern=ghpython_script_4, Case=True)
panel_13 = Panel(match_text)
panel_14 = Panel(match_text_2)
panel_15 = Panel(match_text_3)
panel_16 = Panel(match_text_4)
python = GhPythonScript(checks=flatten([match_text, match_text_2, match_text_3, match_text_4]))  # -> all_true; inputs checks: list
# ---------- python: Python ----------
all_true = all(checks)
# ---------- end python ----------
panel_17 = Panel(python)
context_bake = ContextBake(Content=python)
