# Grasshopper definition test_python3_NONE_error.ghx (Grasshopper 1.0.8)
# plug-ins: RhinoCodePluginGH

# ---- group: CHECK .None Diag in editor. Should say use .NONE
pt = Point([Point(25.52192982, 9.311403509, 0), Point(28.32017544, 13.94298246, 0), Point(37.29385965, 16.98245614, 0), Point(42.69736842, 15.00438596, 0), Point(44.19298246, 10.3245614, 0), Point(46.0745614, 4.149122807, 0), Point(38.59649123, 2.846491228, 0), Point(35.31578947, 5.307017544, 0), Point(29.86403509, 3.280701754, 0)])
intcrv = Interpolate(Vertices=pt, Degree=3, Periodic=Toggle(True), KnotStyle=1)  # -> Curve, Length, Domain
pt_2 = Point(Point(43.92010745, 11.10253433, 0))
S = Script(iCurve=intcrv.Curve, iTestPoint=pt_2)  # -> out, oGeometry; inputs iCurve: Curve, iTestPoint: Point3d
# ---------- S: Python ----------
import Rhino.Geometry as rg

result = iCurve.Offset(rg.Plane.WorldXY, -1, 0.1, rg.CurveOffsetCornerStyle.None)

oGeometry = result
# ---------- end S ----------

# ----
context_bake = ContextBake(Content="invalid syntax  [3:1]")
