# Grasshopper definition test_python3_error_runtime.ghx (Grasshopper 1.0.8)
# plug-ins: RhinoCodePluginGH

num = Number(0.33)
S = Script(x=num)  # -> out, a
# ---------- S: Python ----------
import os

print(12 / 0)
# ---------- end S ----------
