# Grasshopper definition test_python3_pyobject_csharp_interop.ghx (Grasshopper 1.0.8)
# plug-ins: RhinoCodePluginGH

number_slider = Slider(2, range=0..10)
range = Range(Domain=Domain(0, 1), Steps=10)
py3 = Python3Script(x=range)  # -> out, a
# ---------- py3: Python ----------
class Data:
    def __init__(self, value):
        self.value = value
    
    def multiple(self, multiplier):
        return self.value * multiplier


a = Data(x)
# ---------- end py3 ----------
c_script = CSharpScript(x=py3.a, mu=number_slider)  # -> v, m
# ---------- c_script: C# ----------
using System;

dynamic d = x;

v = d.value;
m = d.multiple(mu);
# ---------- end c_script ----------
multiplication = Multiplication(A=range, B=number_slider)
panel = Panel(py3.a)
equals = Equality(FirstNumber=range, SecondNumber=c_script.v)  # -> Equality, Inequality
equals_2 = Equality(FirstNumber=c_script.m, SecondNumber=multiplication)  # -> Equality, Inequality
at = AssertTrue(equals.Equality)
at_2 = AssertTrue(equals_2.Equality)
