# Grasshopper definition test_python_compile_error.ghx (Grasshopper 1.0.8)
# plug-ins: RhinoCodePluginGH

script = Script()  # -> a
# ---------- script: Python ----------
"""My custom script

here are some notes

"""
def Some_Func():
    pass

a = "Hello Python 3 in Grasshopper!"
print(a)

Some_Func()
return
# ---------- end script ----------
ipy2 = IronPython2Script()  # -> a; same code as script
