# Grasshopper definition test_python_diagnose_rc8.7.ghx (Grasshopper 1.0.8)
# plug-ins: RhinoCodePluginGH

py3 = Python3Script()  # -> script, a; unedited script template
python = GhPythonScript(script=py3.script, WARN=Toggle(False), INFO=Toggle(True), HINT=Toggle(False))  # -> diags; inputs WARN: Boolean, INFO: Boolean, HINT: Boolean
# ---------- python: Python ----------
import clr
clr.AddReference('Rhino.Runtime.Code')
from Rhino.Runtime.Code.Languages import DiagnoseOptions

code = script.CreateCode()

opts = DiagnoseOptions()
opts.Errors = True
opts.Warnings = WARN
opts.Infos = INFO
opts.Hints = HINT

diags = list(code.Diagnose(opts))
print(diags)
# ---------- end python ----------
panel = Panel(python)
tmatch = MatchText(Text=python, RegEx="no newline at end of file \(Info W292\:pycodestyles\)", Case=True)
panel_2 = Panel(tmatch)
context_bake = ContextBake(Content=tmatch)
