# Grasshopper definition test_python_env_path_rc8.18.ghx (Grasshopper 1.0.8)

panel = Panel("""#! python 3
# env: {0}
import pythonTest
a = pythonTest.addOne(x)""")
panel_2 = Panel("""#! python 2
# env: {0}
import pythonTest
a = pythonTest.addOne(x)""")
py3 = Python3Script(f="test_python_env_path_rc8.18")  # -> fpath; inputs f: String
# ---------- py3: Python ----------
fpath = f
# ---------- end py3 ----------
panel_3 = Panel(py3)
rep = ReplaceText(Text=[panel, panel_2], Find="{0}", Replace=py3, RecursiveReplace=False)
new_line = Panel("")
split = TextSplit(Text=rep, Separators=new_line, SplitOptions=1)
S = Script(Script=rep, X=Slider(5, range=0..10))  # -> Out, A
item = ListItem(List=split, Index=1, Wrap=True)
panel_4 = Panel(item)
equals = Equality(FirstNumber=S.A, SecondNumber=Slider(6, range=0..10))  # -> Equality, Inequality
at = AssertTrue(equals.Equality)
