# Grasshopper definition test_python_interface_getter_setter_rc8.8.ghx (Grasshopper 1.0.8)
# plug-ins: RhinoCodePluginGH

# https://mcneel.myjetbrains.com/youtrack/issue/RH-82012
# 
# Script changes state of upstream boolean toggle
# Only save this file when solver is off
# and boolean toggle is True
toggle = BooleanToggle(True)
py3 = Python3Script(T=toggle)  # -> out
# ---------- py3: Python ----------
t_input = [i for i in ghenv.Component.Params.Input if i.Name == "T"][0]
t_input_toggle = t_input.Sources[0]

print(t_input_toggle.__class__)

print(t_input_toggle.Value)
t_input_toggle.Value = False
print(t_input_toggle.Value)
# ---------- end py3 ----------
assert_true = AssertTrue(toggle)
panel = Panel(py3)
panel_2 = Panel("""\<class 'Grasshopper\.Kernel\.IGH_Param'\>
True
False""")
match_text = MatchText(Text=panel, RegEx=panel_2, Case=True)
assert_true_2 = AssertTrue(match_text)
