# Grasshopper definition test_python_range.ghx (Grasshopper 1.0.8)
# plug-ins: RhinoCodePluginGH

ironpython_2_script = IronPython2Script()  # -> a
# ---------- ironpython_2_script: IronPython ----------
a = range(0, 10)
# ---------- end ironpython_2_script ----------
python_3_script = Python3Script()  # -> a
# ---------- python_3_script: Python ----------
a = list(range(0, 10))
# ---------- end python_3_script ----------
python_3_script_2 = Python3Script()  # -> a
# ---------- python_3_script_2: Python ----------
a = range(0, 50)
# ---------- end python_3_script_2 ----------
panel = Panel(ironpython_2_script)
panel_2 = Panel(python_3_script_2)
panel_3 = Panel(python_3_script)
match_text = MatchText(Text=python_3_script_2, RegEx="range\(0\, 50\)", Case=True)
assert_true = AssertTrue(match_text)
entwine = Entwine(Branch00=ironpython_2_script, Branch01=python_3_script, FlattenInputs=True)
series = Series(Start=Slider(0, range=0..100), Step=Slider(1, range=0..100), Count=Slider(10, range=0..100))
equality = Equality(FirstNumber=entwine, SecondNumber=series)  # -> Equality, Inequality
assert_true_2 = AssertTrue(equality.Equality)
