# Grasshopper definition test_python_runscript_args_and_kwargs_custom_rc8.14.ghx (Grasshopper 1.0.8)
# plug-ins: RhinoCodePluginGH

number_slider = Slider(12, range=0..100)
number_slider_2 = Slider(12, range=0..100)
python_3_script = Python3Script(x=number_slider, y=number_slider)  # -> out, a; inputs y: list
# ---------- python_3_script: Python ----------
"""Grasshopper Script Instance"""
import System
import Rhino
import Grasshopper

import rhinoscriptsyntax as rs

class MyComponent(Grasshopper.Kernel.GH_ScriptInstance):
    def RunScript(self, *args, **mykwargs):
        print(mykwargs)
        return
# ---------- end python_3_script ----------
ironpython_2_script = IronPython2Script(x=number_slider_2, y=number_slider_2)  # -> out, a; inputs y: list; same code as python_3_script

# ---- group: **kwargs is always empty
panel = Panel(python_3_script.out)
panel_2 = Panel(ironpython_2_script.out)

# ----
match_text = MatchText(Text=[panel, panel_2], RegEx="\{\}", Case=True)
assert_true = AssertTrue(match_text)
