# Grasshopper definition test_python_scriptinstance_runtime_error.ghx (Grasshopper 1.0.8)
# plug-ins: RhinoCodePluginGH

ipy2 = IronPython2Script()  # -> a
# ---------- ipy2: IronPython ----------
import System
import Rhino
import Grasshopper

import rhinoscriptsyntax as rs

class MyComponent(Grasshopper.Kernel.GH_ScriptInstance):
    def RunScript(self):
        pass
        pass
        pass
        raise Exception("Test Error")
        return
# ---------- end ipy2 ----------
py3 = Python3Script()  # -> a; same code as ipy2
