# Grasshopper definition test_python_this.ghx (Grasshopper 1.0.9)

py3 = Python3Script()  # -> a
# ---------- py3: Python ----------
a = __this__.Path
# ---------- end py3 ----------
ipy2 = IronPython2Script()  # -> a; same code as py3
panel = Panel([py3, ipy2])
tmatch = MatchText(Text=[py3, ipy2], RegEx="rhinocode:\\\\\\grasshopper\\1\\.+", Case=True)
at = AssertTrue(tmatch)
