# Grasshopper definition test_python_type_check_rc8.8.ghx (Grasshopper 1.0.8)
# plug-ins: RhinoCodePluginGH

S = Script()  # -> type_is, type_equals, gettype_is, gettype_equals, is_instance, type_is_docobject, type_equals_docobject, gettype_is_docobject, gettype_equals_docobject
# ---------- S: Python ----------
import Grasshopper as gh

# grab the panel on the canvase
obj = ghenv.Document.Objects[0]

type_is = type(obj) is gh.Kernel.Special.GH_Panel
type_equals = type(obj) == gh.Kernel.Special.GH_Panel
gettype_is = obj.GetType() is gh.Kernel.Special.GH_Panel
gettype_equals = obj.GetType() == gh.Kernel.Special.GH_Panel
is_instance = isinstance(obj, gh.Kernel.Special.GH_Panel)

type_is_docobject = type(obj) is gh.Kernel.IGH_DocumentObject
type_equals_docobject = type(obj) == gh.Kernel.IGH_DocumentObject
gettype_is_docobject = obj.GetType() is gh.Kernel.IGH_DocumentObject
gettype_equals_docobject = obj.GetType() == gh.Kernel.IGH_DocumentObject
# ---------- end S ----------
gate_not = GateNot(A=S.type_is)
gate_not_2 = GateNot(A=S.type_equals)
gate_not_3 = GateNot(A=S.gettype_is)
gate_not_4 = GateNot(A=S.gettype_equals)
gate_not_5 = GateNot(A=S.gettype_is_docobject)
gate_not_6 = GateNot(A=S.gettype_equals_docobject)
assert_true = AssertTrue(gate_not)
assert_true_2 = AssertTrue(gate_not_2)
assert_true_3 = AssertTrue(gate_not_3)
assert_true_4 = AssertTrue(gate_not_4)
assert_true_5 = AssertTrue(S.is_instance)
assert_true_6 = AssertTrue(S.type_is_docobject)
assert_true_7 = AssertTrue(S.type_equals_docobject)
assert_true_8 = AssertTrue(gate_not_5)
assert_true_9 = AssertTrue(gate_not_6)
ironpython_2_script = IronPython2Script()  # -> type_is, type_equals, gettype_is, gettype_equals, is_instance, type_is_docobject, type_equals_docobject, gettype_is_docobject, gettype_equals_docobject; same code as S
gate_not_7 = GateNot(A=ironpython_2_script.gettype_is)
gate_not_8 = GateNot(A=ironpython_2_script.type_is_docobject)
gate_not_9 = GateNot(A=ironpython_2_script.type_equals_docobject)
gate_not_10 = GateNot(A=ironpython_2_script.gettype_is_docobject)
gate_not_11 = GateNot(A=ironpython_2_script.gettype_equals_docobject)
assert_true_10 = AssertTrue(ironpython_2_script.type_is)
assert_true_11 = AssertTrue(ironpython_2_script.type_equals)
assert_true_12 = AssertTrue(gate_not_7)
assert_true_13 = AssertTrue(ironpython_2_script.gettype_equals)
assert_true_14 = AssertTrue(ironpython_2_script.is_instance)
assert_true_15 = AssertTrue(gate_not_8)
assert_true_16 = AssertTrue(gate_not_9)
assert_true_17 = AssertTrue(gate_not_10)
assert_true_18 = AssertTrue(gate_not_11)
