# Grasshopper definition test_rhinocommon_clone.ghx (Grasshopper 1.0.8)
# plug-ins: RhinoCodePluginGH

ipy2 = IronPython2Script()  # -> xform
# ---------- ipy2: IronPython ----------
import Rhino
xform = Rhino.Geometry.Transform()
# ---------- end ipy2 ----------
point = Point(Point(1.922934682, -23.99531112, 0))
script = Script(origin=graft([point, ipy2]))  # -> clone, iclonable; inputs origin: Point3d
# ---------- script: Python ----------
import rhinoscriptsyntax as rs
import System

clone = origin.Clone()
iclonable = System.ICloneable.Clone(origin)
# ---------- end script ----------
ghpython_script = GhPythonScript(origin=graft([point, ipy2]))  # -> clone, iclonable; same code as script
script_2 = Script(origin=graft([point, ipy2]))  # -> clone, iclonable; same code as script
script_3 = Script(origin=point)  # -> iclonable; inputs origin: Point3d
# ---------- script_3: C# ----------
using System;

// this does not work in C#
// Point3d implments ICloneable explicitly for ICloneable
// clone = origin.Clone();
iclonable = ((System.ICloneable)origin).Clone();
# ---------- end script_3 ----------
script_4 = Script(origin=ipy2)  # -> clone, iclonable; inputs origin: Transform
# ---------- script_4: C# ----------
using System;

clone = origin.Clone();
iclonable = ((System.ICloneable)origin).Clone();
# ---------- end script_4 ----------
pt = Point(ghpython_script.clone)
pt_2 = Point(ghpython_script.iclonable)
pt_3 = Point(script.clone)
pt_4 = Point(script.iclonable)
pt_5 = Point(script_2.clone)
pt_6 = Point(script_2.iclonable)
pt_7 = Point(script_3)
pt_8 = Point(script_4.clone)
pt_9 = Point(script_4.iclonable)

# ---- group: EXPECT NO ERRORS
toggle = BooleanToggle(True)
panel = Panel(toggle)
context_bake = ContextBake(Content=toggle)
