# Grasshopper definition test_rhinocommon_duplicate.ghx (Grasshopper 1.0.8)
# plug-ins: RhinoCodePluginGH

sph = Sphere(Base=PlaneXY(0, 0, 0), Radius=1)
script = Script(sphere=sph)  # -> dupl; inputs sphere: Brep
# ---------- script: Python ----------
import rhinoscriptsyntax as rs
import System

dupl = sphere.Duplicate()
# ---------- end script ----------
script_2 = Script(sphere=sph)  # -> dupl; inputs sphere: Brep; same code as script
script_3 = Script(sphere=sph)  # -> dupl; inputs sphere: Brep
# ---------- script_3: C# ----------
using System;

dupl = sphere.Duplicate();
# ---------- end script_3 ----------
brep = Brep(script)
brep_2 = Brep(script_2)
brep_3 = Brep(script_3)

# ---- group: EXPECT NO ERRORS
toggle = BooleanToggle(True)
panel = Panel(toggle)
context_bake = ContextBake(Content=toggle)
