# Grasshopper definition test_rhinocommon_flowSpaceMorph.ghx (Grasshopper 1.0.8)
# plug-ins: RhinoCodePluginGH

pt = Point([Point(-19.99400349, -15.12289028, 0), Point(-20.66066307, -4.439635906, 0), Point(-16.55754858, 10.11954266, 0), Point(-5.255405796, 16.40840681, 0), Point(9.717765063, 19.81455343, 0)])
crv = Curve(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)
crv_2 = Curve(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)
c_script = CSharpScript(x=pt, b=crv, t=crv_2)  # -> out, A; inputs x: list of Point3d, b: Curve, t: Curve
# ---------- c_script: C# ----------
using System;
using System.Linq;
using System.Collections;
using System.Collections.Generic;
using System.Drawing;

using Rhino;
using Rhino.Geometry;

using Grasshopper;
using Grasshopper.Kernel;
using Grasshopper.Kernel.Data;
using Grasshopper.Kernel.Types;

public class Script_Instance : GH_ScriptInstance
{
    private void RunScript(List<Point3d> x, Curve b, Curve t, ref object A)
    {
        Rhino.Geometry.Morphs.FlowSpaceMorph myFlow = 
            new Rhino.Geometry.Morphs.FlowSpaceMorph(b, t, false, false, false);

        for(int i = 0; i < x.Count; i++)
            x[i] = myFlow.MorphPoint(x[i]);
        
        A = x;
    }
}
# ---------- end c_script ----------
py3 = Python3Script(x=pt, b=crv, t=crv_2)  # -> out, A; inputs x: list of Point3d, b: Curve, t: Curve
# ---------- py3: Python ----------
import Rhino

my_flow: Rhino.Geometry.Morphs.FlowSpaceMorph = \
    Rhino.Geometry.Morphs.FlowSpaceMorph(b, t, False, False, False);

for i in range(len(x)):
    x[i] = my_flow.MorphPoint(x[i]);

A = x;
# ---------- end py3 ----------
ipy2 = IronPython2Script(x=pt, b=crv, t=crv_2)  # -> out, A; inputs x: list of Point3d, b: Curve, t: Curve
# ---------- ipy2: IronPython ----------
import Rhino

my_flow = Rhino.Geometry.Morphs.FlowSpaceMorph(b, t, False, False, False);

for i in range(len(x)):
    x[i] = my_flow.MorphPoint(x[i]);

A = x;
# ---------- end ipy2 ----------
panel = Panel(c_script.A)
panel_2 = Panel(py3.A)
panel_3 = Panel(ipy2.A)
equals = Equality(FirstNumber=c_script.A, SecondNumber=py3.A)  # -> Equality, Inequality
equals_2 = Equality(FirstNumber=c_script.A, SecondNumber=ipy2.A)  # -> Equality, Inequality
at = AssertTrue(equals.Equality)
at_2 = AssertTrue(equals_2.Equality)
