# Grasshopper definition test_rhinoscriptsyntax_addcircle_closest.ghx (Grasshopper 1.0.8)
# plug-ins: RhinoCodePluginGH

# ---- group: GRAB AND MOVE THIS POINT TO GET CIRCLES
point = Point(Point(13, 0.6120015106, 0))

# ----
point_2 = Point([Point(0, 0, 0), Point(2, 0, 0), Point(4, 0, 0), Point(6, 0, 0), Point(9, 0, 0), Point(13, 0, 0), Point(15, 0, 0), Point(18, 0, 0), Point(21, 0, 0)])
ghpython_script = GhPythonScript(pts=point_2, att=point)  # -> out, a; inputs pts: list
# ---------- ghpython_script: Python ----------
import rhinoscriptsyntax as rs 
a = []
for i in pts:
    if rs.Distance(i, att)<3:
        a.append(rs.AddCircle(i,0.5))
# ---------- end ghpython_script ----------
python_3_script = Python3Script(pts=point_2, att=point)  # -> out, a; inputs pts: list; same code as ghpython_script
python = GhPythonScript(circle=ghpython_script.a)
# ---------- python: Python ----------
if not circle:
    raise Exception("No Circle Received")
# ---------- end python ----------
python_2 = GhPythonScript(circle=python_3_script.a)  # same code as python
circle = Circle(python_3_script.a)
circle_2 = Circle(ghpython_script.a)

# ---- group: EXPECT NO ERRORS
toggle = BooleanToggle(True)
panel = Panel(toggle)
context_bake = ContextBake(Content=toggle)
