# Grasshopper definition test_rhinoscriptsyntax_getobject_error.ghx (Grasshopper 1.0.8)
# plug-ins: RhinoCodePluginGH

py3 = Python3Script()  # -> out, a
# ---------- py3: Python ----------
import rhinoscriptsyntax as rs

objects = rs.GetObjects(message=None)
# ---------- end py3 ----------
python = GhPythonScript()  # -> out, a; same code as py3
