# Grasshopper definition test_runscript_to_params_csharp_string.ghx (Grasshopper 1.0.8)
# plug-ins: RhinoCodePluginGH

c_script = CSharpScript()  # -> script, out, a; inputs x: String
#   port script: Script being executed
# ---------- c_script: C# ----------
using System;
using System.Linq;
using System.Collections;
using System.Collections.Generic;
using System.Drawing;

using Rhino;
using Rhino.Geometry;

using Grasshopper;
using Grasshopper.Kernel;
using Grasshopper.Kernel.Data;
using Grasshopper.Kernel.Types;

public class Script_Instance : GH_ScriptInstance
{
    private void RunScript(string x, ref object a)
    {
        // Write your logic here
        a = null;
    }
}
# ---------- end c_script ----------
ds = ScriptSourceDeconstruct(ScriptSource=c_script.script)  # -> Id, LanguageSpec, Title, Text, Signature, Uri, EnvironId, Inputs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
dsp = ScriptParameterDeconstruct(ScriptInputOutputParameter=ds.Inputs)  # -> Name, PrettyName, Description, Access, Kind, Type
tmatch = MatchText(Text=dsp.Type, RegEx="string", Case=True)
panel = Panel(tmatch)
context_bake = ContextBake(Content=tmatch)
