# Grasshopper definition test_runscript_to_params_python2_str.ghx (Grasshopper 1.0.8)
# plug-ins: RhinoCodePluginGH

ipy2 = IronPython2Script()  # -> script, out, a; inputs x: String
#   port script: Script being executed
# ---------- ipy2: IronPython ----------
import System
import Rhino
import Grasshopper

import rhinoscriptsyntax as rs

class MyComponent(Grasshopper.Kernel.GH_ScriptInstance):
    def RunScript(self, x):
        return
# ---------- end ipy2 ----------
ds = ScriptSourceDeconstruct(ScriptSource=ipy2.script)  # -> Id, LanguageSpec, Title, Text, Signature, Uri, EnvironId, Inputs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
dsp = ScriptParameterDeconstruct(ScriptInputOutputParameter=ds.Inputs)  # -> Name, PrettyName, Description, Access, Kind, Type
panel = Panel(dsp.Type)
tmatch = MatchText(Text=dsp.Type, RegEx="string", Case=True)
panel_2 = Panel(tmatch)
context_bake = ContextBake(Content=tmatch)
