# Grasshopper definition test_runscript_to_params_python3_pathstring_rc8.8.ghx (Grasshopper 1.0.8)
# plug-ins: RhinoCodePluginGH

py3 = Python3Script()  # -> script, out, a; inputs x: String
#   port script: Script being executed
# ---------- py3: Python ----------
import System
import Rhino
import Grasshopper

import rhinoscriptsyntax as rs


class MyComponent(Grasshopper.Kernel.GH_ScriptInstance):
    def RunScript(self, x: str):
        return
# ---------- end py3 ----------
ds = ScriptSourceDeconstruct(ScriptSource=py3.script)  # -> Id, LanguageSpec, Title, Text, Signature, Uri, EnvironId, Inputs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
dsp = ScriptParameterDeconstruct(ScriptInputOutputParameter=ds.Inputs)  # -> Name, PrettyName, Description, Access, Kind, Type
panel = Panel(dsp.Kind)
tmatch = MatchText(Text=dsp.Type, RegEx="string", Case=True)
equals = Equality(FirstNumber=Slider(1, range=0..1), SecondNumber=dsp.Kind)  # -> Equality, Inequality
and = GateAnd(A=equals.Equality, B=tmatch)
panel_2 = Panel(and)
context_bake = ContextBake(Content=and)
