# Grasshopper definition test_runscript_to_params_rc8.8.ghx (Grasshopper 1.0.8)
# plug-ins: RhinoCodePluginGH

# ---- group: Point3d Type Hint
py3 = Python3Script()  # -> script, a; inputs x: Point3d
#   port script: Script being executed
# ---------- py3: Python ----------
import System
import Rhino
import Grasshopper

import rhinoscriptsyntax as rs


class MyComponent(Grasshopper.Kernel.GH_ScriptInstance):
    def RunScript(self, x: Rhino.Geometry.Point3d):
        return
# ---------- end py3 ----------
c_script = CSharpScript()  # -> script, a; inputs x: Point3d
#   port script: Script being executed
# ---------- c_script: C# ----------
using System;
using System.Linq;
using System.Collections;
using System.Collections.Generic;
using System.Drawing;

using Rhino;
using Rhino.Geometry;

using Grasshopper;
using Grasshopper.Kernel;
using Grasshopper.Kernel.Data;
using Grasshopper.Kernel.Types;

public class Script_Instance : GH_ScriptInstance
{
    private void RunScript(Point3d x, ref object a)
    {
        // Write your logic here
        a = null;
    }
}
# ---------- end c_script ----------
ipy2 = IronPython2Script()  # -> script, a; inputs x: Point3d
#   port script: Script being executed
# ---------- ipy2: IronPython ----------
import System
import Rhino
import Grasshopper

import rhinoscriptsyntax as rs


class MyComponent(Grasshopper.Kernel.GH_ScriptInstance):
    def RunScript(self, x):
        return
# ---------- end ipy2 ----------

# ---- group: Guid Type Hint
py3_2 = Python3Script()  # -> script, a; inputs x: Guid
#   port script: Script being executed
# ---------- py3_2: Python ----------
import System
import Rhino
import Grasshopper

import rhinoscriptsyntax as rs


class MyComponent(Grasshopper.Kernel.GH_ScriptInstance):
    def RunScript(self, x: System.Guid):
        return
# ---------- end py3_2 ----------
ipy2_2 = IronPython2Script()  # -> script, a; inputs x: Guid; same code as ipy2
c_script_2 = CSharpScript()  # -> script, a; inputs x: Guid
#   port script: Script being executed
# ---------- c_script_2: C# ----------
using System;
using System.Linq;
using System.Collections;
using System.Collections.Generic;
using System.Drawing;

using Rhino;
using Rhino.Geometry;

using Grasshopper;
using Grasshopper.Kernel;
using Grasshopper.Kernel.Data;
using Grasshopper.Kernel.Types;

public class Script_Instance : GH_ScriptInstance
{
    private void RunScript(Guid x, ref object a)
    {
        // Write your logic here
        a = null;
    }
}
# ---------- end c_script_2 ----------

# ----
merge = Merge(Data1=py3_2.script, Data2=ipy2_2.script, Data3=c_script_2.script)
merge_2 = Merge(Data1=py3.script, Data2=ipy2.script, Data3=c_script.script)
entwine = Entwine(Branch00=merge_2, Branch01=merge, FlattenInputs=True)
ds = ScriptSourceDeconstruct(ScriptSource=entwine)  # -> Id, LanguageSpec, Title, Text, Signature, Uri, EnvironId, Inputs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
panel = Panel("""Rhino\.Geometry\.Point3d
System\.Guid""")
trim = TrimTree(Tree=ds.Inputs, Depth=1)
panel_2 = Panel(trim)
dsp = ScriptParameterDeconstruct(ScriptInputOutputParameter=trim)  # -> Name, PrettyName, Description, Access, Kind, Type
graft = GraftTree(Tree=panel, IncludeEmptyLists=True, IncludeNullItems=True)
tmatch = MatchText(Text=dsp.Type, RegEx=graft, Case=True)
panel_3 = Panel(tmatch)
python = GhPythonScript(checks=flatten(tmatch))  # -> all_true; inputs checks: list
# ---------- python: Python ----------
all_true = all(checks)
# ---------- end python ----------
panel_4 = Panel(python)
context_bake = ContextBake(Content=python)
