# Grasshopper definition test_script_exit_code_rc9.0_error.ghx (Grasshopper 1.0.8)
# plug-ins: RhinoCodePluginGH

py3 = Python3Script()
# ---------- py3: Python ----------
from Rhino.Commands import Result
from Rhino.Runtime.Code.Execution import ExitException

raise ExitException(int(Result.Cancel));
# ---------- end py3 ----------
