# Grasshopper definition test_scriptcontext_doc_objects_rc8.10.ghx (Grasshopper 1.0.8)
# plug-ins: RhinoCodePluginGH

panel = Panel("RhinoCodePlatform\.Rhino3D\.Languages\.GH1\.Legacy\.ProxyObjectTable")
S = Script()  # -> a
# ---------- S: Python ----------
import scriptcontext as sc

a = str(sc.doc.Objects)
# ---------- end S ----------
script = Script()  # -> a; same code as S
tmatch = MatchText(Text=S, RegEx=panel, Case=True)
tmatch_2 = MatchText(Text=script, RegEx=panel, Case=True)
gate_and = GateAnd(A=tmatch, B=tmatch_2)
at = AssertTrue(gate_and)
