# Grasshopper definition test_scriptcontext_doc_rc8.10.ghx (Grasshopper 1.0.8)
# plug-ins: RhinoCodePluginGH

panel = Panel("RhinoCodePlatform\.Rhino3D\.Languages\.GH1\.Legacy\.ProxyDocument")

# ---- group: NO MARSHALL
script = Script()  # -> before, after
# ---------- script: Python ----------
import scriptcontext as sc

before = sc.doc
sc.doc = 12
after = sc.doc
# ---------- end script ----------
script_2 = Script()  # -> before, after; same code as script

# ----
script_3 = Script(x=script.after)  # -> after
# ---------- script_3: Python ----------
import scriptcontext as sc

after = sc.doc
# ---------- end script_3 ----------
script_4 = Script(x=script_2.after)  # -> after; same code as script_3
number_slider = Slider(12, range=0..100)
equals = Equality(FirstNumber=number_slider, SecondNumber=script_2.after)  # -> Equality, Inequality
equals_2 = Equality(FirstNumber=number_slider, SecondNumber=script.after)  # -> Equality, Inequality
and = GateAnd(A=equals_2.Equality, B=equals.Equality)
tmatch = MatchText(Text=script.before, RegEx=panel, Case=True)
tmatch_2 = MatchText(Text=script_3, RegEx=panel, Case=True)
tmatch_3 = MatchText(Text=script_2.before, RegEx=panel, Case=True)
tmatch_4 = MatchText(Text=script_4, RegEx=panel, Case=True)
and_2 = GateAnd(A=tmatch_3, B=tmatch_4)
and_3 = GateAnd(A=tmatch, B=tmatch_2)
at = AssertTrue(and_3)
at_2 = AssertTrue(and_2)
and_4 = GateAnd(B=and_3, C=and, E=and_2)
at_3 = AssertTrue(and_4)
