# Grasshopper definition test_scriptcontext_id.ghx (Grasshopper 1.0.8)
# plug-ins: RhinoCodePluginGH

number_slider = Slider(2, range=0..10)
script = Script()  # -> state
# ---------- script: Python ----------
import scriptcontext as sc

state = sc.id
# ---------- end script ----------
script_2 = Script()  # -> state; same code as script

# ---- group: script class
script_3 = Script()  # -> state
# ---------- script_3: Python ----------
import scriptcontext as sc
import System
import Rhino
import Grasshopper

import rhinoscriptsyntax as rs


class MyComponent(Grasshopper.Kernel.GH_ScriptInstance):
    def RunScript(self):
        return sc.id
# ---------- end script_3 ----------
script_4 = Script()  # -> state; same code as script_3

# ----
equals = Equality(FirstNumber=number_slider, SecondNumber=script)  # -> Equality, Inequality
equals_2 = Equality(FirstNumber=number_slider, SecondNumber=script_2)  # -> Equality, Inequality
equals_3 = Equality(FirstNumber=number_slider, SecondNumber=script_3)  # -> Equality, Inequality
equals_4 = Equality(FirstNumber=number_slider, SecondNumber=script_4)  # -> Equality, Inequality
and = GateAnd(A=equals.Equality, B=equals_2.Equality, C=equals_3.Equality, D=equals_4.Equality)
context_bake = ContextBake(Content=and)
panel = Panel(and)
