# Grasshopper definition test_scriptcontext_sticky.ghx (Grasshopper 1.0.8)
# plug-ins: RhinoCodePluginGH

panel = Panel("""import scriptcontext as sc


sc.sticky["One"] = 1
sc.sticky["Two"] = 2

items  = sc.sticky.items()
keys   = sc.sticky.keys()
values = sc.sticky.values()

iteritems  = sc.sticky.iteritems()
iterkeys   = sc.sticky.iterkeys()
itervalues = sc.sticky.itervalues()

viewitems  = sc.sticky.viewitems()
viewkeys   = sc.sticky.viewkeys()
viewvalues = sc.sticky.viewvalues()

has_key = sc.sticky.has_key("One")""")
script = Script(script=panel)  # -> items, keys, values, iteritems, iterkeys, itervalues, viewitems, viewkeys, viewvalues, has_key
#   port script: Script to execute
# ---------- script: Python ----------
"""Grasshopper Script"""
#! python 3
import scriptcontext as sc


sc.sticky["One"] = 1
sc.sticky["Two"] = 2

items  = sc.sticky.items()
keys   = sc.sticky.keys()
values = sc.sticky.values()
# ---------- end script ----------
script_2 = Script(script=panel)  # -> items, keys, values, iteritems, iterkeys, itervalues, viewitems, viewkeys, viewvalues, has_key
#   port script: Script to execute
# ---------- script_2: Python ----------
"""Grasshopper Script"""
#! python 2
import scriptcontext as sc


sc.sticky["One"] = 1
sc.sticky["Two"] = 2
# ---------- end script_2 ----------
ghpython_script = GhPythonScript(Code=panel)  # -> Items, Keys, Values, Iteritems, Iterkeys, Itervalues, Viewitems, Viewkeys, Viewvalues, Has_key
match_text = MatchText(Text=script.keys, Pattern=ghpython_script.Keys, Case=True)
match_text_2 = MatchText(Text=script.values, Pattern=ghpython_script.Values, Case=True)
match_text_3 = MatchText(Text=script.iteritems, RegEx="dict_items\(\[\('One', 1\), \('Two', 2\)\]\)", Case=True)
match_text_4 = MatchText(Text=script.iterkeys, RegEx="dict_keys\(\['One', 'Two'\]\)", Case=True)
match_text_5 = MatchText(Text=script.itervalues, RegEx="dict_values\(\[1, 2\]\)", Case=True)
match_text_6 = MatchText(Text=script.viewitems, RegEx="dict_items\(\[\('One', 1\), \('Two', 2\)\]\)", Case=True)
match_text_7 = MatchText(Text=script.viewkeys, RegEx="dict_keys\(\['One', 'Two'\]\)", Case=True)
match_text_8 = MatchText(Text=script.viewvalues, RegEx="dict_values\(\[1, 2\]\)", Case=True)
gate_and = GateAnd(A=script.has_key, B=script_2.has_key, C=ghpython_script.Has_key)
boolean = Boolean(flatten([match_text, match_text_2, match_text_3, match_text_4, match_text_5, match_text_6, match_text_7, match_text_8]))
match_text_9 = MatchText(Text=script_2.viewitems, Pattern=ghpython_script.Viewitems, Case=True)
match_text_10 = MatchText(Text=script_2.keys, Pattern=ghpython_script.Keys, Case=True)
match_text_11 = MatchText(Text=script_2.values, Pattern=ghpython_script.Values, Case=True)
match_text_12 = MatchText(Text=script_2.iteritems, Pattern=ghpython_script.Iteritems, Case=True)
match_text_13 = MatchText(Text=script_2.iterkeys, Pattern=ghpython_script.Iterkeys, Case=True)
match_text_14 = MatchText(Text=script_2.itervalues, Pattern=ghpython_script.Itervalues, Case=True)
match_text_15 = MatchText(Text=script_2.viewkeys, Pattern=ghpython_script.Viewkeys, Case=True)
match_text_16 = MatchText(Text=script_2.viewvalues, Pattern=ghpython_script.Viewvalues, Case=True)
match_text_17 = MatchText(Text=script_2.items, Pattern=ghpython_script.Items, Case=True)
panel_2 = Panel(boolean)
boolean_2 = Boolean(flatten([match_text_10, match_text_11, match_text_12, match_text_13, match_text_14, match_text_15, match_text_16, match_text_17, match_text_9]))
panel_3 = Panel(boolean_2)
python = GhPythonScript(checks=flatten([boolean, boolean_2]))  # -> all_true; inputs checks: list
# ---------- python: Python ----------
all_true = all(checks)
# ---------- end python ----------
panel_4 = Panel(python)
context_bake = ContextBake(Content=python)
