# Grasshopper definition test_scriptcontext_sticky_rc8.8.ghx (Grasshopper 1.0.8)
# plug-ins: RhinoCodePluginGH

panel = Panel("""import scriptcontext as sc


sc.sticky["One"] = 1
sc.sticky["Two"] = 2

items  = sorted(sc.sticky.items())
keys   = sorted(sc.sticky.keys())
values = sorted(sc.sticky.values())

iteritems  = sc.sticky.iteritems()
iterkeys   = sc.sticky.iterkeys()
itervalues = sc.sticky.itervalues()

viewitems  = sc.sticky.viewitems()
viewkeys   = sc.sticky.viewkeys()
viewvalues = sc.sticky.viewvalues()

has_key = sc.sticky.has_key("One")""")
script = Script(script=panel)  # -> items, keys, values, iteritems, iterkeys, itervalues, viewitems, viewkeys, viewvalues, has_key
#   port script: Script to execute
# ---------- script: Python ----------
"""Grasshopper Script"""
#! python 3
import scriptcontext as sc


sc.sticky["One"] = 1
sc.sticky["Two"] = 2

items  = sc.sticky.items()
keys   = sc.sticky.keys()
values = sc.sticky.values()
# ---------- end script ----------
script_2 = Script(script=panel)  # -> items, keys, values, iteritems, iterkeys, itervalues, viewitems, viewkeys, viewvalues, has_key
#   port script: Script to execute
# ---------- script_2: Python ----------
"""Grasshopper Script"""
#! python 2
import scriptcontext as sc


sc.sticky["One"] = 1
sc.sticky["Two"] = 2
# ---------- end script_2 ----------
ghpython_script = GhPythonScript(Code=panel)  # -> Items, Keys, Values, Iteritems, Iterkeys, Itervalues, Viewitems, Viewkeys, Viewvalues, Has_key
match_text = MatchText(Text=script.items, Pattern=ghpython_script.Items, Case=True)
match_text_2 = MatchText(Text=script.keys, Pattern=ghpython_script.Keys, Case=True)
match_text_3 = MatchText(Text=script.values, Pattern=ghpython_script.Values, Case=True)
match_text_4 = MatchText(Text=script.iteritems, RegEx="dict_items\(\[\('One', 1\), \('Two', 2\)\]\)", Case=True)
match_text_5 = MatchText(Text=script.iterkeys, RegEx="dict_keys\(\['One', 'Two'\]\)", Case=True)
match_text_6 = MatchText(Text=script.itervalues, RegEx="dict_values\(\[1, 2\]\)", Case=True)
match_text_7 = MatchText(Text=script.viewitems, RegEx="dict_items\(\[\('One', 1\), \('Two', 2\)\]\)", Case=True)
match_text_8 = MatchText(Text=script.viewkeys, RegEx="dict_keys\(\['One', 'Two'\]\)", Case=True)
match_text_9 = MatchText(Text=script.viewvalues, RegEx="dict_values\(\[1, 2\]\)", Case=True)
gate_and = GateAnd(A=script.has_key, B=script_2.has_key, C=ghpython_script.Has_key)
assert_true = AssertTrue(match_text)
assert_true_2 = AssertTrue(match_text_2)
assert_true_3 = AssertTrue(match_text_3)
assert_true_4 = AssertTrue(match_text_4)
assert_true_5 = AssertTrue(match_text_5)
assert_true_6 = AssertTrue(match_text_6)
assert_true_7 = AssertTrue(match_text_7)
assert_true_8 = AssertTrue(match_text_8)
assert_true_9 = AssertTrue(match_text_9)
assert_true_10 = AssertTrue(gate_and)
match_text_10 = MatchText(Text=script_2.items, Pattern=ghpython_script.Items, Case=True)
match_text_11 = MatchText(Text=script_2.keys, Pattern=ghpython_script.Keys, Case=True)
match_text_12 = MatchText(Text=script_2.values, Pattern=ghpython_script.Values, Case=True)
match_text_13 = MatchText(Text=script_2.iteritems, Pattern=ghpython_script.Iteritems, Case=True)
match_text_14 = MatchText(Text=script_2.iterkeys, Pattern=ghpython_script.Iterkeys, Case=True)
match_text_15 = MatchText(Text=script_2.itervalues, Pattern=ghpython_script.Itervalues, Case=True)
match_text_16 = MatchText(Text=script_2.viewitems, Pattern=ghpython_script.Viewitems, Case=True)
match_text_17 = MatchText(Text=script_2.viewkeys, Pattern=ghpython_script.Viewkeys, Case=True)
match_text_18 = MatchText(Text=script_2.viewvalues, Pattern=ghpython_script.Viewvalues, Case=True)
assert_true_11 = AssertTrue(match_text_10)
assert_true_12 = AssertTrue(match_text_11)
assert_true_13 = AssertTrue(match_text_12)
assert_true_14 = AssertTrue(match_text_13)
assert_true_15 = AssertTrue(match_text_14)
assert_true_16 = AssertTrue(match_text_15)
assert_true_17 = AssertTrue(match_text_16)
assert_true_18 = AssertTrue(match_text_17)
assert_true_19 = AssertTrue(match_text_18)
final_check = AssertTrue([assert_true, assert_true_2, assert_true_3, assert_true_4, assert_true_5, assert_true_6, assert_true_7, assert_true_8, assert_true_9, assert_true_11, assert_true_12, assert_true_13, assert_true_14, assert_true_15, assert_true_16, assert_true_17, assert_true_18, assert_true_19, assert_true_10])
