# Grasshopper definition test_scriptingAPI_createScriptComponents_rc8.8.ghx (Grasshopper 1.0.8)

ghpython_script = GhPythonScript()  # -> a
# ---------- ghpython_script: Python ----------
import clr
clr.AddReference('RhinoCodePluginGH')
from RhinoCodePluginGH.Components import ScriptComponent as SC
from System import Guid
from System.Drawing import PointF
from Grasshopper import Instances

doc = ghdoc.Component.OnPingDocument()

number = None
for ao in doc.Objects:
    if ao.NickName == "Check":
        number = ao

x = ghenv.Component.Attributes.Pivot.X
y = ghenv.Component.Attributes.Pivot.Y + ghenv.Component.Attributes.Bounds.Height + 15
c = SC.Create("Test Python 3", "#! python 3\na = 42")
c.Attributes.Pivot = PointF(x, y)
c.Params.Input.Remove(c.Params.Input[1])
c.MarshGuids = False
c.UsingStandardOutputParam = False
doc.AddObject(c, False)
number.AddSource(c.Params.Output[0])

y += c.Attributes.Bounds.Height + 10

c = SC.Create("Test Python 2", "#! python 2\na = 42")
c.Attributes.Pivot = PointF(x, y)
c.Params.Input.Remove(c.Params.Input[1])
c.UsingStandardOutputParam = False
doc.AddObject(c, False)
number.AddSource(c.Params.Output[0])

y += c.Attributes.Bounds.Height + 10

c = SC.Create("Test CSharp", "// #! csharp\na = 42;")
c.Attributes.Pivot = PointF(x, y)
c.Params.Input.Remove(c.Params.Input[1])
c.UsingStandardOutputParam = False
doc.AddObject(c, False)
number.AddSource(c.Params.Output[0])

a = 42
# ---------- end ghpython_script ----------
ghpython_script_2 = GhPythonScript()  # -> a
# ---------- ghpython_script_2: Python ----------
import clr
clr.AddReference('RhinoCodePluginGH')
from RhinoCodePluginGH.Components import Python3Component as PY3C
from RhinoCodePluginGH.Components import IronPython2Component as IPY2C
from RhinoCodePluginGH.Components import CSharpComponent as CSC
from System.Drawing import PointF
from Grasshopper import Instances

doc = ghdoc.Component.OnPingDocument()

number = None
for ao in doc.Objects:
    if ao.NickName == "Check":
        number = ao

x = ghenv.Component.Attributes.Pivot.X
y = ghenv.Component.Attributes.Pivot.Y + ghenv.Component.Attributes.Bounds.Height + 15
c = PY3C.Create("Test Python 3", "a = 42")
c.Attributes.Pivot = PointF(x, y)
c.Params.Input.Remove(c.Params.Input[1])
c.MarshGuids = False
c.UsingStandardOutputParam = False
doc.AddObject(c, False)
number.AddSource(c.Params.Output[0])

y += c.Attributes.Bounds.Height + 10

c = IPY2C.Create("Test Python 2", "a = 42")
c.Attributes.Pivot = PointF(x, y)
c.Params.Input.Remove(c.Params.Input[1])
c.UsingStandardOutputParam = False
doc.AddObject(c, False)
number.AddSource(c.Params.Output[0])

y += c.Attributes.Bounds.Height + 10

c = CSC.Create("Test CSharp", "a = 42;")
c.Attributes.Pivot = PointF(x, y)
c.Params.Input.Remove(c.Params.Input[1])
c.UsingStandardOutputParam = False
doc.AddObject(c, False)
number.AddSource(c.Params.Output[0])

a = 42
# ---------- end ghpython_script_2 ----------
ghpython_script_3 = GhPythonScript()  # -> a
# ---------- ghpython_script_3: Python ----------
import clr
clr.AddReference('RhinoCodePluginGH')
from RhinoCodePluginGH.Components import ScriptComponent as SC
from System.Drawing import PointF
from Grasshopper import Instances

doc = ghdoc.Component.OnPingDocument()

number = None
py3_script = None
py2_script = None
cs_script = None
for ao in doc.Objects:
    if ao.NickName == "Check":
        number = ao
    elif ao.NickName == "py3Script":
        py3_script = ao
    elif ao.NickName == "py2Script":
        py2_script = ao
    elif ao.NickName == "csScript":
        cs_script = ao

x = ghenv.Component.Attributes.Pivot.X + 250
y = ghenv.Component.Attributes.Pivot.Y + 50
c = SC()
c.Name = "Test Script"
c.UsingScriptInputParam = True
c.Attributes.Pivot = PointF(x + 37, y)
c.Params.Input.Remove(c.Params.Input[2])
c.UsingStandardOutputParam = False
doc.AddObject(c, False)

x_param = c.Params.Input[0]
x_param.AddSource(py3_script)
x_param.AddSource(py2_script)
x_param.AddSource(cs_script)

number.AddSource(c.Params.Output[0])

a  = 42
# ---------- end ghpython_script_3 ----------
py3script = Panel("""#! python 3
a = 42""")
py2script = Panel("""#! python 2
a = 42""")
csscript = Panel("""// #! csharp
a = 42;""")
check = Number()
equality = Equality(FirstNumber=[ghpython_script, ghpython_script_2, ghpython_script_3], SecondNumber=check)  # -> Equality, Inequality
python = GhPythonScript(checks=flatten(equality.Equality))  # -> all_true; inputs checks: list
# ---------- python: Python ----------
all_true = checks and all(checks)
# ---------- end python ----------
panel = Panel(python)
context_bake = ContextBake(Content=python)
