# Grasshopper definition test_sharedScripts_scriptOut_rc8.7.ghx (Grasshopper 1.0.8)
# plug-ins: RhinoCodePluginGH

number_slider = Slider(0, range=0..100)
number_slider_2 = Slider(12, range=0..100)
number_slider_3 = Slider(12, range=0..100)
py3 = Python3Script(x=number_slider, y=number_slider)  # -> script, a
#   port script: Script being executed
# ---------- py3: Python ----------
#! python 3
a = x + y
# ---------- end py3 ----------
c_script = CSharpScript(x=number_slider, y=number_slider)  # -> script, a
#   port script: Script being executed
# ---------- c_script: C# ----------
// #! csharp
using System;

a = Math.Abs((double)x) + Math.Abs((double)y);
# ---------- end c_script ----------
addition = Addition(A=number_slider_3, B=number_slider_2)
script = Script(Script=py3.script, X=number_slider_3, Y=number_slider_2)  # -> Out, A
script_2 = Script(Script=c_script.script, X=number_slider_3, Y=number_slider_2)  # -> Out, A
equality = Equality(FirstNumber=addition, SecondNumber=script.A)  # -> Equality, Inequality
equality_2 = Equality(FirstNumber=addition, SecondNumber=script_2.A)  # -> Equality, Inequality
python = GhPythonScript(checks=flatten([equality.Equality, equality_2.Equality]))  # -> all_true; inputs checks: list
# ---------- python: Python ----------
all_true = all(checks)
# ---------- end python ----------
panel = Panel(python)
context_bake = ContextBake(Content=python)
