# Grasshopper definition test_sharedScripts_scriptSource.ghx (Grasshopper 1.0.8)
# plug-ins: RhinoCodePluginGH

panel = Panel("""// #! csharp
using System;

a = Math.Abs((double)x) + Math.Abs((double)y);""")
script = Panel("""#! python 3
a = x + y""")
number_slider = Slider(12, range=0..100)
number_slider_2 = Slider(12, range=0..100)
addition = Addition(A=number_slider, B=number_slider_2)
script_2 = Script(Script=script, X=number_slider, Y=number_slider_2)  # -> Out, A
script_3 = Script(Script=panel, X=number_slider, Y=number_slider_2)  # -> Out, A
equality = Equality(FirstNumber=addition, SecondNumber=script_2.A)  # -> Equality, Inequality
equality_2 = Equality(FirstNumber=addition, SecondNumber=script_3.A)  # -> Equality, Inequality
python = GhPythonScript(checks=flatten([equality.Equality, equality_2.Equality]))  # -> all_true; inputs checks: list
# ---------- python: Python ----------
all_true = all(checks)
# ---------- end python ----------
panel_2 = Panel(python)
context_bake = ContextBake(Content=python)
