# Grasshopper definition test_sharedScripts_sideScript.ghx (Grasshopper 1.0.8)
# plug-ins: RhinoCodePluginGH

number_slider = Slider(12, range=0..100)
number_slider_2 = Slider(12, range=0..100)
script_path_relative = Panel("external.py")
script = Script(Script=script_path_relative, X=number_slider, Y=number_slider_2)  # -> Out, A
script_2 = Script(Script=script_path_relative, X=number_slider, Y=number_slider_2)  # -> Out, A
addition = Addition(A=number_slider, B=number_slider_2)
equality = Equality(FirstNumber=script_2.A, SecondNumber=addition)  # -> Equality, Inequality
equality_2 = Equality(FirstNumber=script.A, SecondNumber=addition)  # -> Equality, Inequality
python = GhPythonScript(checks=flatten([equality_2.Equality, equality.Equality]))  # -> all_true; inputs checks: list
# ---------- python: Python ----------
all_true = all(checks)
# ---------- end python ----------
panel = Panel(python)
context_bake = ContextBake(Content=python)
