# Grasshopper definition test_special_params_rc8.15.ghx (Grasshopper 1.0.8)
# plug-ins: RhinoCodePluginGH

c_script = CSharpScript()  # -> command, doc, mode, isInteractive
# ---------- c_script: C# ----------
using System;

command  = __rhino_command__;
doc  = __rhino_doc__;
mode  = __rhino_runmode__;
isInteractive  = __is_interactive__;
# ---------- end c_script ----------
panel = Panel(c_script.command)
panel_2 = Panel(c_script.doc)
panel_3 = Panel(c_script.mode)
panel_4 = Panel(c_script.isInteractive)
bool = Boolean(c_script.isInteractive)
py3 = Python3Script(c=c_script.command)  # -> cid, cname
# ---------- py3: Python ----------
import Rhino.Commands as RC

cmd: RC.Command = c

cid = cmd.CommandId
cname = cmd.EnglishName
# ---------- end py3 ----------
panel_5 = Panel(py3.cname)
panel_6 = Panel(py3.cid)
panel_7 = Panel("RhinoCodePlatform.Rhino3D.Projects.Plugin.ProjectCommand_0000000")
tmatch = MatchText(Text=panel, RegEx=panel_7, Case=True)
tmatch_2 = MatchText(Text=panel_2, RegEx="Rhino.RhinoDoc", Case=True)
tmatch_3 = MatchText(Text=panel_3, RegEx="Interactive", Case=True)
tmatch_4 = MatchText(Text=panel_6, RegEx="00000000-0000-0000-0000-000000000000", Case=True)
tmatch_5 = MatchText(Text=panel_5, RegEx="MockCommand", Case=True)
at = AssertTrue([tmatch, tmatch_3, tmatch_4, tmatch_5, tmatch_2, bool])
