# Grasshopper definition test_stdout_compile_rc8.7_py3.9_py3.9_error.ghx (Grasshopper 1.0.8)
# plug-ins: RhinoCodePluginGH

relay = Relay([Slider(1, range=0..1), Slider(2, range=0..10)])
expression = Expression(x=relay, Expression="Format(\"{0}, {1}\", , y)")

# ---- group: BUILD ERROR
csharp_script = CSharpScript(x=relay)  # -> out, a
# ---------- csharp_script: C# ----------
// Grasshopper Script Instance
using System;
using System.Collections;
using System.Collections.Generic;
using System.Drawing;

using Rhino;
using Rhino.Geometry;

using Grasshopper;
using Grasshopper.Kernel;
using Grasshopper.Kernel.Data;
using Grasshopper.Kernel.Types;

public class Script_Instance : GH_ScriptInstance
{
  /* 
    Members:
      RhinoDoc RhinoDocument
      GH_Document GrasshopperDocument
      IGH_Component Component
      int Iteration

    Methods (Virtual & overridable):
      Print(string text)
      Print(string format, params object[] args)
      Reflect(object obj)
      Reflect(object obj, string method_name)
  */
  
  private void RunScript(object x, ref object a)
  {
    //ERROR: attempt to create an instance of the abstract "Curve" class
      Rhino.Geometry.Curve crv = new Rhino.Geometry.Curve();
  }
}
# ---------- end csharp_script ----------
c_script = CSharpScript(x=relay)  # -> out, a
# ---------- c_script: C# ----------
in m = "str";
# ---------- end c_script ----------
py3 = Python3Script(x=relay)  # -> out, a
# ---------- py3: Python ----------
import
# ---------- end py3 ----------
py3_2 = Python3Script(x=relay)  # -> out, a
# ---------- py3_2: Python ----------
import System
import Rhino
import Grasshopper

import rhinoscriptsyntax as rs


class MyComponent(Grasshopper.Kernel.GH_ScriptInstance):
    def RunScript(self, x):
    return
# ---------- end py3_2 ----------
ipy2 = IronPython2Script(x=relay)  # -> out, a; same code as py3
ipy2_2 = IronPython2Script(x=relay)  # -> out, a; same code as py3_2
panel = Panel(csharp_script.out)
panel_2 = Panel(c_script.out)
panel_3 = Panel(py3.out)
panel_4 = Panel(py3_2.out)
panel_5 = Panel(ipy2.out)
panel_6 = Panel(ipy2_2.out)
panel_7 = Panel("invalid syntax")
panel_8 = Panel("expected an indented block")
panel_9 = Panel("unexpected token")
panel_10 = Panel("The name 'm' does not exist in the current context")
panel_11 = Panel("expected an indented block")
panel_12 = Panel("'Curve' does not contain a constructor that takes 0 arguments")
item = CherryPicker(panel, ListIndex=0)
item_2 = CherryPicker(panel_2, ListIndex=0)
item_3 = CherryPicker(panel_3, ListIndex=0)
item_4 = CherryPicker(panel_4, ListIndex=0)
item_5 = CherryPicker(panel_5, ListIndex=0)
item_6 = CherryPicker(panel_6, ListIndex=0)

# ----
python = GhPythonScript(x=relay)  # -> out, a; same code as py3
panel_13 = Panel(python.out)

lng = ListLength(List=c_script.a)
lng_2 = ListLength(List=csharp_script.a)
lng_3 = ListLength(List=py3.a)
lng_4 = ListLength(List=py3_2.a)
lng_5 = ListLength(List=ipy2_2.a)
lng_6 = ListLength(List=ipy2.a)
panel_14 = Panel(expression)
lng_7 = ListLength(List=expression)
equals = Equality(FirstNumber=lng_7, SecondNumber=lng)  # -> Equality, Inequality
equals_2 = Equality(FirstNumber=lng_7, SecondNumber=lng_2)  # -> Equality, Inequality
equals_3 = Equality(FirstNumber=lng_7, SecondNumber=lng_3)  # -> Equality, Inequality
equals_4 = Equality(FirstNumber=lng_7, SecondNumber=lng_4)  # -> Equality, Inequality
equals_5 = Equality(FirstNumber=lng_7, SecondNumber=lng_5)  # -> Equality, Inequality
equals_6 = Equality(FirstNumber=lng_7, SecondNumber=lng_6)  # -> Equality, Inequality
tmatch = MatchText(Text=item, RegEx=panel_12, Case=True)
tmatch_2 = MatchText(Text=item_2, RegEx=panel_10, Case=True)
tmatch_3 = MatchText(Text=item_3, RegEx=panel_7, Case=True)
tmatch_4 = MatchText(Text=item_4, RegEx=panel_8, Case=True)
tmatch_5 = MatchText(Text=item_5, RegEx=panel_9, Case=True)
tmatch_6 = MatchText(Text=item_6, RegEx=panel_11, Case=True)
and = GateAnd(
    A=equals_2.Equality,
    B=equals.Equality,
    C=equals_3.Equality,
    D=equals_4.Equality,
    E=equals_6.Equality,
    F=equals_5.Equality)
python_2 = GhPythonScript(checks=flatten([tmatch, tmatch_2, tmatch_3, tmatch_4, tmatch_5, and]))  # -> all_true; inputs checks: list
# ---------- python_2: Python ----------
all_true = all(checks)
# ---------- end python_2 ----------
python_3 = GhPythonScript(result=python_2)
# ---------- python_3: Python ----------
if not result:
    raise Exception("Unit Test Failed")
# ---------- end python_3 ----------
