# Grasshopper definition test_stdout_multiline.ghx (Grasshopper 1.0.8)
# plug-ins: RhinoCodePluginGH

range = Range(Domain=Domain(0, 1), Steps=10)
ghpython_script = GhPythonScript()  # -> out
# ---------- ghpython_script: Python ----------
print("First")
print("Second")
# ---------- end ghpython_script ----------
python_3_script = Python3Script()  # -> out; same code as ghpython_script

# ---- group: NO GRAFTING
python_3_script_2 = Python3Script()  # -> out; same code as ghpython_script
panel = Panel(python_3_script_2)

# ----
python_3_script_3 = Python3Script(x=range)  # -> out
# ---------- python_3_script_3: Python ----------
print(x)
# ---------- end python_3_script_3 ----------
ghpython_script_2 = GhPythonScript(x=range)  # -> out; same code as python_3_script_3
ironpython_2_script = IronPython2Script(x=range)  # -> out; same code as python_3_script_3
panel_2 = Panel(ghpython_script)
panel_3 = Panel(python_3_script)
panel_4 = Panel(python_3_script_3)
panel_5 = Panel(ironpython_2_script)
list_length = ListLength(List=ghpython_script)
list_length_2 = ListLength(List=python_3_script)
list_length_3 = ListLength(List=python_3_script_2)
list_length_4 = ListLength(List=ghpython_script_2)
list_length_5 = ListLength(List=ironpython_2_script)
list_length_6 = ListLength(List=python_3_script_3)
equality = Equality(FirstNumber=list_length_4, SecondNumber=list_length_5)  # -> Equality, Inequality
equality_2 = Equality(FirstNumber=list_length_6, SecondNumber=list_length_4)  # -> Equality, Inequality
number_slider = Slider(2, range=0..10)
equality_3 = Equality(FirstNumber=number_slider, SecondNumber=list_length_2)  # -> Equality, Inequality
equality_4 = Equality(FirstNumber=number_slider, SecondNumber=list_length)  # -> Equality, Inequality
equality_5 = Equality(FirstNumber=list_length_3, SecondNumber=Slider(1, range=0..10))  # -> Equality, Inequality
python = GhPythonScript(checks=flatten([equality_2.Equality, equality_3.Equality, equality_4.Equality, equality.Equality, equality_5.Equality]))  # -> all_true; inputs checks: list
# ---------- python: Python ----------
all_true = all(checks)
# ---------- end python ----------
panel_6 = Panel(python)
context_bake = ContextBake(Content=python)
