# Grasshopper definition test_stdout_runtime_rc8.7_error.ghx (Grasshopper 1.0.8)
# plug-ins: RhinoCodePluginGH

relay = Relay([Slider(1, range=0..1), Slider(2, range=0..10)])

# ---- group: RUN ERROR
c_script = CSharpScript(x=relay)  # -> out, a
# ---------- c_script: C# ----------
// Grasshopper Script Instance
#region Usings
using System;
using System.Linq;
using System.Collections;
using System.Collections.Generic;
using System.Drawing;

using Rhino;
using Rhino.Geometry;

using Grasshopper;
using Grasshopper.Kernel;
using Grasshopper.Kernel.Data;
using Grasshopper.Kernel.Types;
#endregion

public class Script_Instance : GH_ScriptInstance
{
    #region Notes
    /* 
      Members:
        RhinoDoc RhinoDocument
        GH_Document GrasshopperDocument
        IGH_Component Component
        int Iteration

      Methods (Virtual & overridable):
        Print(string text)
        Print(string format, params object[] args)
        Reflect(object obj)
        Reflect(object obj, string method_name)
    */
    #endregion

    private void RunScript(object x, ref object a)
    {
        // Write your logic here
        a = null;
        throw new Exception("Test");
    }
}
# ---------- end c_script ----------
c_script_2 = CSharpScript(x=relay)  # -> out, a
# ---------- c_script_2: C# ----------
using System;

throw new Exception("Test");
# ---------- end c_script_2 ----------
py3 = Python3Script(x=relay)  # -> out, a
# ---------- py3: Python ----------
a = 42
raise Exception("Test")
# ---------- end py3 ----------
ipy2 = IronPython2Script(x=relay)  # -> out, a; same code as py3
panel = Panel(c_script.out)
panel_2 = Panel(c_script.a)
panel_3 = Panel(py3.out)
panel_4 = Panel(py3.a)
panel_5 = Panel(ipy2.out)
panel_6 = Panel(ipy2.a)
panel_7 = Panel(c_script_2.a)

# ----
py3_2 = Python3Script(x=relay)  # -> out, a
# ---------- py3_2: Python ----------
import System
import Rhino
import Grasshopper

import rhinoscriptsyntax as rs


class MyComponent(Grasshopper.Kernel.GH_ScriptInstance):
    def RunScript(self, x):
        raise Exception("Test")
# ---------- end py3_2 ----------
ipy2_2 = IronPython2Script(x=relay)  # -> out, a; same code as py3_2

# ---- group: LEGACY SCRIPT DOES NOT KEEP OUTPUT TOPOOLOGY
python = GhPythonScript(x=relay)  # -> out, a; same code as py3
panel_8 = Panel(python.a)
panel_9 = Panel(python.out)

# ----
panel_10 = Panel(c_script_2.out)
panel_11 = Panel(py3_2.out)
panel_12 = Panel(py3_2.a)
panel_13 = Panel(ipy2_2.out)
panel_14 = Panel(ipy2_2.a)

# ---- group: NULL OUT ON EVERY RUN
deplane = DeconstructPlane(Plane=relay)  # -> Origin, XAxis, YAxis, ZAxis
panel_15 = Panel(deplane.Origin)

# ----
lng = ListLength(List=c_script_2.a)
lng_2 = ListLength(List=c_script.a)
lng_3 = ListLength(List=py3_2.a)
lng_4 = ListLength(List=py3.a)
lng_5 = ListLength(List=ipy2.a)
lng_6 = ListLength(List=ipy2_2.a)
lng_7 = ListLength(List=deplane.Origin)
equals = Equality(FirstNumber=lng_7, SecondNumber=lng)  # -> Equality, Inequality
equals_2 = Equality(FirstNumber=lng_7, SecondNumber=lng_2)  # -> Equality, Inequality
equals_3 = Equality(FirstNumber=lng_7, SecondNumber=lng_3)  # -> Equality, Inequality
equals_4 = Equality(FirstNumber=lng_7, SecondNumber=lng_4)  # -> Equality, Inequality
equals_5 = Equality(FirstNumber=lng_7, SecondNumber=lng_5)  # -> Equality, Inequality
equals_6 = Equality(FirstNumber=lng_7, SecondNumber=lng_6)  # -> Equality, Inequality
tmatch = MatchText(Text=panel, RegEx="Exception: Test", Case=True)
tmatch_2 = MatchText(Text=panel_10, RegEx="Exception: Test", Case=True)
tmatch_3 = MatchText(Text=panel_11, RegEx="Exception: Test", Case=True)
tmatch_4 = MatchText(Text=panel_3, RegEx="Exception: Test", Case=True)
tmatch_5 = MatchText(Text=panel_13, RegEx="Exception: Test", Case=True)
tmatch_6 = MatchText(Text=panel_5, RegEx="Exception: Test", Case=True)
and = GateAnd(
    A=equals_2.Equality,
    B=equals.Equality,
    C=equals_3.Equality,
    D=equals_4.Equality,
    E=equals_6.Equality,
    F=equals_5.Equality)
python_2 = GhPythonScript(checks=flatten([tmatch, tmatch_2, tmatch_3, tmatch_4, tmatch_5, tmatch_6, and, Toggle(True)]))  # -> all_true; inputs checks: list
# ---------- python_2: Python ----------
all_true = all(checks)
# ---------- end python_2 ----------
python_3 = GhPythonScript(result=python_2)
# ---------- python_3: Python ----------
if not result:
    raise Exception("Unit Test Failed")
# ---------- end python_3 ----------
