# Grasshopper definition test_stdout_scriptinstance.ghx (Grasshopper 1.0.8)
# plug-ins: RhinoCodePluginGH

range = Range(Domain=Domain(0, 1), Steps=Slider(1, range=0..10))
range_2 = Range(Domain=Domain(0, 1), Steps=Slider(2, range=0..10))
c_script = CSharpScript(x=range)  # -> out
# ---------- c_script: C# ----------
    Print("Solve " + Iteration.ToString());
# ---------- end c_script ----------
c_script_2 = CSharpScript(x=range)  # -> out
# ---------- c_script_2: C# ----------
using System;

using Rhino;
using Rhino.Geometry;

public class Script_Instance : GH_ScriptInstance
{
    private void RunScript(object x)
    {
        Console.WriteLine($"Solve {Iteration}");
    }

    public override void BeforeRunScript()
    {
    }

    public override void AfterRunScript()
    {
    }
}
# ---------- end c_script_2 ----------
c_script_3 = CSharpScript(x=range)  # -> out
# ---------- c_script_3: C# ----------
using System;

using Rhino;
using Rhino.Geometry;

public class Script_Instance : GH_ScriptInstance
{
    private void RunScript(object x)
    {
        Console.WriteLine($"Solve {Iteration}");
    }

    public override void BeforeRunScript()
    {
        Console.WriteLine();
    }

    public override void AfterRunScript()
    {
        Console.WriteLine();
    }
}
# ---------- end c_script_3 ----------
c_script_4 = CSharpScript(x=range)  # -> out
# ---------- c_script_4: C# ----------
using System;

using Rhino;
using Rhino.Geometry;

public class Script_Instance : GH_ScriptInstance
{
    private void RunScript(object x)
    {
        Console.WriteLine($"Solve {Iteration}");
    }

    public override void BeforeRunScript()
    {
        Console.WriteLine("Before");
        Console.WriteLine("----");
    }

    public override void AfterRunScript()
    {
        Console.WriteLine("----");
        Console.WriteLine("After");
    }
}
# ---------- end c_script_4 ----------
c_script_5 = CSharpScript(x=range_2)  # -> out; same code as c_script
c_script_6 = CSharpScript(x=range_2)  # -> out; same code as c_script_2
c_script_7 = CSharpScript(x=range_2)  # -> out; same code as c_script_3
c_script_8 = CSharpScript(x=range_2)  # -> out; same code as c_script_4
c_script_9 = CSharpScript(x=range)  # -> out
# ---------- c_script_9: C# ----------
using System;

using Rhino;
using Rhino.Geometry;

public class Script_Instance : GH_ScriptInstance
{
    private void RunScript(object x)
    {
    }

    public override void BeforeRunScript()
    {
        Console.WriteLine();
    }

    public override void AfterRunScript()
    {
        Console.WriteLine();
    }
}
# ---------- end c_script_9 ----------
c_script_10 = CSharpScript(x=range)  # -> out
# ---------- c_script_10: C# ----------
using System;

using Rhino;
using Rhino.Geometry;

public class Script_Instance : GH_ScriptInstance
{
    private void RunScript(object x)
    {
    }

    public override void BeforeRunScript()
    {
        Console.WriteLine("Before");
        Console.WriteLine("----");
    }

    public override void AfterRunScript()
    {
        Console.WriteLine("----");
        Console.WriteLine("After");
    }
}
# ---------- end c_script_10 ----------
c_script_11 = CSharpScript(x=range)  # -> out; same code as c_script_2
# last line is “Solve1\n” but GH is not printing a new line after \n.
# This is standard behaviour. See python above
c_script_12 = CSharpScript(x=range)  # -> out; same code as c_script_3
c_script_13 = CSharpScript(x=range)  # -> out; same code as c_script_4
c_script_14 = CSharpScript(x=range)  # -> out; same code as c_script_9
c_script_15 = CSharpScript(x=range)  # -> out; same code as c_script_10
c_script_16 = CSharpScript(x=range_2)  # -> out; same code as c_script_2
# last line is “Solve2\n” but GH is not printing a new line after \n.
# This is standard behaviour. See python above
c_script_17 = CSharpScript(x=range_2)  # -> out; same code as c_script_3
c_script_18 = CSharpScript(x=range_2)  # -> out; same code as c_script_4
panel = Panel(c_script)
panel_2 = Panel(c_script_2)
panel_3 = Panel(c_script_3)
panel_4 = Panel(c_script_4)
panel_5 = Panel(c_script_5)
panel_6 = Panel(c_script_6)
panel_7 = Panel(c_script_7)
panel_8 = Panel(c_script_8)
panel_9 = Panel(c_script_9)
panel_10 = Panel(c_script_10)
panel_11 = Panel(c_script_11)
panel_12 = Panel(c_script_12)
panel_13 = Panel(c_script_13)
panel_14 = Panel(c_script_14)
panel_15 = Panel(c_script_15)
panel_16 = Panel(c_script_16)
panel_17 = Panel(c_script_17)
panel_18 = Panel(c_script_18)
python_3_script = Python3Script(x=range)  # -> out
# ---------- python_3_script: Python ----------
print()
print("Solve")
print()
# ---------- end python_3_script ----------
panel_19 = Panel(python_3_script)
number_slider = Slider(2, range=0..10)
branch = TreeBranch(Tree=c_script_7, Path="{0;0;0}", MaintainPaths=True)
branch_2 = TreeBranch(Tree=c_script_7, Path="{0;0;2}", MaintainPaths=True)
branch_3 = TreeBranch(Tree=c_script_8, Path="{0;0;0}", MaintainPaths=True)
branch_4 = TreeBranch(Tree=c_script_8, Path="{0;0;2}", MaintainPaths=True)
lng = ListLength(List=flatten(c_script))
lng_2 = ListLength(List=flatten(c_script_2))
lng_3 = ListLength(List=flatten(c_script_5))
lng_4 = ListLength(List=flatten(c_script_6))
lng_5 = ListLength(List=c_script_3)
lng_6 = ListLength(List=c_script_4)
lng_7 = ListLength(List=[branch, branch_2])
lng_8 = ListLength(List=[branch_3, branch_4])
lng_9 = ListLength(List=c_script_9)
lng_10 = ListLength(List=c_script_10)
lng_11 = ListLength(List=c_script_11)
lng_12 = ListLength(List=c_script_12)
lng_13 = ListLength(List=c_script_13)
lng_14 = ListLength(List=c_script_14)
lng_15 = ListLength(List=c_script_15)
lng_16 = ListLength(List=c_script_16)
lng_17 = ListLength(List=c_script_17)
lng_18 = ListLength(List=c_script_18)
equals = Equality(FirstNumber=lng, SecondNumber=number_slider)  # -> Equality, Inequality
equals_2 = Equality(FirstNumber=lng_2, SecondNumber=number_slider)  # -> Equality, Inequality
equals_3 = Equality(FirstNumber=lng_5, SecondNumber=number_slider)  # -> Equality, Inequality
equals_4 = Equality(FirstNumber=lng_6, SecondNumber=Slider(3, range=0..10))  # -> Equality, Inequality
equals_5 = Equality(FirstNumber=lng_3, SecondNumber=Slider(3, range=0..10))  # -> Equality, Inequality
equals_6 = Equality(FirstNumber=lng_4, SecondNumber=Slider(3, range=0..10))  # -> Equality, Inequality
equals_7 = Equality(FirstNumber=lng_7, SecondNumber=Slider(2, range=0..10))  # -> Equality, Inequality
equals_8 = Equality(FirstNumber=lng_8, SecondNumber=Slider(3, range=0..10))  # -> Equality, Inequality
equals_9 = Equality(FirstNumber=lng_9, SecondNumber=Slider(1, range=0..10))  # -> Equality, Inequality
equals_10 = Equality(FirstNumber=lng_10, SecondNumber=Slider(2, range=0..10))  # -> Equality, Inequality
equals_11 = Equality(FirstNumber=lng_11, SecondNumber=Slider(2, range=0..10))  # -> Equality, Inequality
equals_12 = Equality(FirstNumber=lng_12, SecondNumber=Slider(2, range=0..10))  # -> Equality, Inequality
equals_13 = Equality(FirstNumber=lng_13, SecondNumber=Slider(2, range=0..10))  # -> Equality, Inequality
equals_14 = Equality(FirstNumber=lng_14, SecondNumber=Slider(2, range=0..10))  # -> Equality, Inequality
equals_15 = Equality(FirstNumber=lng_15, SecondNumber=Slider(2, range=0..10))  # -> Equality, Inequality
equals_16 = Equality(FirstNumber=lng_16, SecondNumber=Slider(3, range=0..10))  # -> Equality, Inequality
equals_17 = Equality(FirstNumber=lng_17, SecondNumber=Slider(3, range=0..10))  # -> Equality, Inequality
equals_18 = Equality(FirstNumber=lng_18, SecondNumber=Slider(3, range=0..10))  # -> Equality, Inequality
panel_20 = Panel(equals.Equality)
panel_21 = Panel(equals_2.Equality)
panel_22 = Panel(equals_3.Equality)
panel_23 = Panel(equals_4.Equality)
panel_24 = Panel(equals_5.Equality)
panel_25 = Panel(equals_6.Equality)
panel_26 = Panel(equals_7.Equality)
panel_27 = Panel(equals_8.Equality)
panel_28 = Panel(equals_9.Equality)
panel_29 = Panel(equals_10.Equality)
panel_30 = Panel(equals_11.Equality)
panel_31 = Panel(equals_12.Equality)
panel_32 = Panel(equals_13.Equality)
panel_33 = Panel(equals_14.Equality)
panel_34 = Panel(equals_15.Equality)
panel_35 = Panel(equals_16.Equality)
panel_36 = Panel(equals_17.Equality)
panel_37 = Panel(equals_18.Equality)
bool = Boolean(Tree({0}: [True, False, True], {1}: [True, False, True]))
bool_2 = Boolean(Tree({0}: [False, True], {1}: [True], {2}: [True, False]))
bool_3 = Boolean(Tree({0}: [False, True], {1}: [True, False]))
bool_4 = Boolean(Tree({0}: [True, False, True], {1}: [True], {2}: [True, False, True]))
cull = CullPattern(List=c_script_3, CullPattern=bool_3)
cull_2 = CullPattern(List=c_script_4, CullPattern=bool)
cull_3 = CullPattern(List=c_script_7, CullPattern=bool_2)
cull_4 = CullPattern(List=c_script_8, CullPattern=bool_4)
tmatch = MatchText(Text=python_3_script, RegEx="^\nSolve$", Case=True)
tmatch_2 = MatchText(Text=c_script, RegEx="Solve (0|1)", Case=True)
tmatch_3 = MatchText(Text=c_script_2, RegEx="Solve (0|1)", Case=True)
tmatch_4 = MatchText(Text=cull, RegEx="Solve (0|1)", Case=True)
tmatch_5 = MatchText(Text=cull_2, RegEx="(Solve (0|1)|Before|After)", Case=True)
tmatch_6 = MatchText(Text=c_script_5, RegEx="Solve (0|1|2)", Case=True)
tmatch_7 = MatchText(Text=c_script_6, RegEx="Solve (0|1|2)", Case=True)
tmatch_8 = MatchText(Text=cull_3, RegEx="Solve (0|1|2)", Case=True)
tmatch_9 = MatchText(Text=cull_4, RegEx="(Solve (0|1|2)|Before|After)", Case=True)
tmatch_10 = MatchText(Text=c_script_10, RegEx="(Before|After|----)", Case=True)
tmatch_11 = MatchText(Text=c_script_11, RegEx="Solve (0|1)\r?", Case=True)
tmatch_12 = MatchText(Text=c_script_12, RegEx="Solve (0|1)\r?", Case=True)
tmatch_13 = MatchText(Text=c_script_13, RegEx=["^Before\r?\n----\r?\nSolve 0\r?$", "^Solve 1\r?\n----\r?\nAfter\r?$"], Case=True)
tmatch_14 = MatchText(Text=c_script_15, RegEx=["^Before\r?\n----\r?$", "^----\r?\nAfter\r?$"], Case=True)
tmatch_15 = MatchText(Text=c_script_16, RegEx="Solve (0|1|2)\r?", Case=True)
tmatch_16 = MatchText(Text=c_script_17, RegEx=["^\r?\nSolve 0\r?$", "^Solve 1\r?$", "^Solve 2\r?$"], Case=True)
tmatch_17 = MatchText(
    Text=c_script_18,
    RegEx=["^Before\r?\n----\r?\nSolve 0\r?$", "^Solve 1\r?$", "^Solve 2\r?\n----\r?\nAfter\r?$"],
    Case=True)
panel_38 = Panel(tmatch)
panel_39 = Panel(tmatch_5)
panel_40 = Panel(tmatch_10)
panel_41 = Panel(tmatch_16)
panel_42 = Panel(tmatch_2)
panel_43 = Panel(tmatch_3)
panel_44 = Panel(tmatch_4)
panel_45 = Panel(tmatch_6)
panel_46 = Panel(tmatch_7)
panel_47 = Panel(tmatch_8)
panel_48 = Panel(tmatch_9)
panel_49 = Panel(tmatch_11)
panel_50 = Panel(tmatch_12)
panel_51 = Panel(tmatch_13)
panel_52 = Panel(tmatch_14)
panel_53 = Panel(tmatch_15)
panel_54 = Panel(tmatch_17)
bool_5 = Boolean(flatten([equals_11.Equality, equals_12.Equality, equals_13.Equality, equals_14.Equality, equals_15.Equality, equals_16.Equality, equals_17.Equality, equals_18.Equality]))
bool_6 = Boolean(flatten([tmatch_17, tmatch_16, tmatch_15, tmatch_14, tmatch_11, tmatch_12, tmatch_13]))
bool_7 = Boolean(flatten([tmatch_2, tmatch_3, tmatch_4, tmatch_5, tmatch_6, tmatch_7, tmatch_8, tmatch_9, tmatch_10]))
bool_8 = Boolean(flatten([equals.Equality, equals_2.Equality, equals_3.Equality, equals_4.Equality, equals_7.Equality, equals_8.Equality, equals_5.Equality, equals_6.Equality, equals_9.Equality, equals_10.Equality]))
python = GhPythonScript(checks=flatten([tmatch, bool_7, bool_8, bool_6, bool_5]))  # -> all_true; inputs checks: list
# ---------- python: Python ----------
all_true = all(checks)
# ---------- end python ----------
context_bake = ContextBake(Content=python)
panel_55 = Panel(python)
