# Grasshopper definition test_storageSites_defaultHttp.ghx (Grasshopper 1.0.8)
# plug-ins: RhinoCodePluginGH

# ---- group: HTTP Storage
panel = Panel("https://github.com/eirannejad/pyRevit/raw/master/pyrevitlib/pyrevit/api.py")
S = RhinoCodeScript(
    panel,
    ExpireOnDiskEvent=False,
    TreatInputAsPath=True,
    SourceLanguageFamilySpec_Taxon="*.*.python",
    SourceLanguageFamilySpec_Version="*.*")
panel_2 = Panel(S)
drcs = RhinoCodeScriptDeconstruct(RhinoCodeScript=S)  # -> Id, LanguageId, Title, Text, Signature, StorageUri, StageStorageUri, EnvironId, Inputs
panel_3 = Panel([drcs.Id, drcs.LanguageId, drcs.Title, drcs.StorageUri])

# ----
tmatch = MatchText(Text=drcs.LanguageId, RegEx="\*\.\*\.python\@\*\.\*", Case=True)
panel_4 = Panel(tmatch)
context_bake = ContextBake(Content=tmatch)
