# Grasshopper definition test_userobject.ghx (Grasshopper 1.0.8)
# plug-ins: RhinoCodePluginGH

templatescript = TemplateScript()  # -> out, a
# ---------- templatescript: Python ----------
# this is my template
a = 42
# ---------- end templatescript ----------
equality = Equality(FirstNumber=templatescript.a, SecondNumber=Slider(42, range=0..100))  # -> Equality, Inequality
panel = Panel(equality.Equality)
context_bake = ContextBake(Content=equality.Equality)
