# Grasshopper definition hops_python2.ghx (Grasshopper 1.0.8)
# plug-ins: RhinoCodePluginGH

input = GetInteger(Slider(7, range=0..10), AtLeast=1, AtMost=1, Maximum=2147483647, Minimum=-2147483648, TreeAccess=False)
ipy2 = IronPython2Script(x=input, y=Slider(12, range=0..100))  # -> out, result
# ---------- ipy2: IronPython ----------
result = x + y - 1
# ---------- end ipy2 ----------
context_print = ContextPrint(Result=ipy2.result)
