# Grasshopper definition ComponentOptionalInputs.ghx (Grasshopper 1.0.8)
# plug-ins: RhinoCodePluginGH

number_slider = Slider(42, range=0..100)
number_slider_2 = Slider(42, range=0..100)
number_slider_3 = Slider(42, range=0..100)
optionaly = Python3Script(x=number_slider, y=number_slider)  # -> hasX, hasY
# ---------- optionaly: Python ----------
ghenv.Component.Params.Input[1].Optional = True

hasX = x is not None
hasY = y is not None
# ---------- end optionaly ----------
optionaly_2 = Python3Script(x=Slider(42, range=0..100))  # -> hasX, hasY; same code as optionaly
requiredxmanual = Python3Script(x=number_slider_2, y=number_slider_2)  # -> requiredX, optionalY
# ---------- requiredxmanual: Python ----------
requiredX = not ghenv.Component.Params.Input[0].Optional
optionalY = ghenv.Component.Params.Input[1].Optional
# ---------- end requiredxmanual ----------
requiredxauto = Python3Script(x=number_slider_3, y=number_slider_3)  # -> requiredX, optionalY
# ---------- requiredxauto: Python ----------
ghenv.Component.Params.Input[0].Optional = False

requiredX = not ghenv.Component.Params.Input[0].Optional
optionalY = ghenv.Component.Params.Input[1].Optional
# ---------- end requiredxauto ----------
not = GateNot(A=optionaly_2.hasY)
at = AssertTrue([optionaly.hasX, optionaly.hasY])
at_2 = AssertTrue([optionaly_2.hasX, not])
at_3 = AssertTrue([requiredxmanual.optionalY, requiredxmanual.requiredX])
at_4 = AssertTrue([requiredxauto.optionalY, requiredxauto.requiredX])
