# Grasshopper definition ComponentOptionalInputs_Before8.14.ghx (Grasshopper 1.0.8)
# plug-ins: RhinoCodePluginGH

optionalxy = Python3Script(x=Slider(42, range=0..100))
# ---------- optionalxy: Python ----------
ghenv.Component.Params.Input[0].Optional = True
ghenv.Component.Params.Input[1].Optional = True
# ---------- end optionalxy ----------
