# Grasshopper definition ComponentsWithLibraries.ghx (Grasshopper 1.0.8)
# plug-ins: RhinoCodePluginGH

testcsharplib = CSharpScript()  # -> a, b
# ---------- testcsharplib: C# ----------
using System;
using TestAssembly.Math;

var m = new DoMath();
a = m.Add(21, 21);
b = m.Solve();
# ---------- end testcsharplib ----------
testpy3lib = Python3Script()  # -> a, b
# ---------- testpy3lib: Python ----------
from importlib import reload
from testmodule import riazi

a = riazi.add(21, 21)
b = riazi.numpy_random()
# ---------- end testpy3lib ----------
testpy2lib = IronPython2Script()  # -> a
# ---------- testpy2lib: IronPython ----------
import testipymodule
from testipymodule import riazi

a = riazi.add(21, 21)
# ---------- end testpy2lib ----------
