# Grasshopper definition PythonMarshOutputs.ghx (Grasshopper 1.0.9)

range = Range(Domain=Domain(0, 1), Steps=10)
sph = Sphere(Base=PlaneXY(0, 0, 0), Radius=range)
mesh = Mesh(sph)
donotmarsh = Python3Script(meshes=mesh)  # -> geoms; inputs meshes: list
# ---------- donotmarsh: Python ----------
geoms = list(meshes)
# ---------- end donotmarsh ----------
domarsh = Python3Script(meshes=mesh)  # -> geoms; inputs meshes: list; same code as donotmarsh
panel = Panel(donotmarsh)
panel_2 = Panel(domarsh)
