# Grasshopper definition ScriptInputListTree.ghx (Grasshopper 1.0.8)
# plug-ins: RhinoCodePluginGH

pt = ConstructPoint(XCoordinate=0, YCoordinate=0, ZCoordinate=0)
pt_2 = ConstructPoint(XCoordinate=0, YCoordinate=0, ZCoordinate=0)

# ---- group: List Point3d
listpoint3d = CSharpScript(x=[pt, pt_2])  # -> a; inputs x: list of Point3d
# ---------- listpoint3d: C# ----------
using System;
using System.Linq;
using System.Collections;
using System.Collections.Generic;
using System.Drawing;

using Rhino;
using Rhino.Geometry;

using Grasshopper;
using Grasshopper.Kernel;
using Grasshopper.Kernel.Data;
using Grasshopper.Kernel.Types;

public class Script_Instance : GH_ScriptInstance
{
    private void RunScript(List<Point3d> x, ref object a)
    {
        a = x.Count == 2;
    }
}
# ---------- end listpoint3d ----------

# ---- group: Tree Point3d
treepoint3d = CSharpScript(x=[pt, pt_2])  # -> a; inputs x: tree of Point3d
# ---------- treepoint3d: C# ----------
using System;
using System.Linq;
using System.Collections;
using System.Collections.Generic;
using System.Drawing;

using Rhino;
using Rhino.Geometry;

using Grasshopper;
using Grasshopper.Kernel;
using Grasshopper.Kernel.Data;
using Grasshopper.Kernel.Types;

public class Script_Instance : GH_ScriptInstance
{
    private void RunScript(DataTree<Point3d> x, ref object a)
    {
        a = x.BranchCount == 1 && x.Branch(0).Count == 2;
    }
}
# ---------- end treepoint3d ----------

# ----
panel = Panel([listpoint3d, treepoint3d])
