# Grasshopper definition ScriptInstanceBuiltinsTests.ghx (Grasshopper 1.0.9)

# ---- group: SDK-MODE
py3 = Python3Script()  # -> ghenv, ghdoc, i
# ---------- py3: Python ----------
import System
import Rhino
import Grasshopper

import rhinoscriptsyntax as rs
import scriptcontext


class MyComponent(Grasshopper.Kernel.GH_ScriptInstance):
    def RunScript(self):
        return ghenv, ghdoc, scriptcontext.id
# ---------- end py3 ----------
ipy2 = IronPython2Script()  # -> ghenv, ghdoc, i; same code as py3
c_script = CSharpScript()  # -> ghEnv, ghDoc
# ---------- c_script: C# ----------
using System;
using System.Linq;
using System.Collections;
using System.Collections.Generic;
using System.Drawing;

using Rhino;
using Rhino.Geometry;

using Grasshopper;
using Grasshopper.Kernel;
using Grasshopper.Kernel.Data;
using Grasshopper.Kernel.Types;

public class Script_Instance : GH_ScriptInstance
{
    private void RunScript(ref object ghEnv, ref object ghDoc)
    {
        // Does not exist
        ghEnv = "Not Supported";
        ghDoc = "Not Supported";
    }
}
# ---------- end c_script ----------
panel = Panel([py3.ghenv, py3.ghdoc, py3.i])
panel_2 = Panel([ipy2.ghenv, ipy2.ghdoc, ipy2.i])
panel_3 = Panel([c_script.ghEnv, c_script.ghDoc])
py3_sdk_ctx = Python3Script()  # -> script_id, script_ctx, i
# ---------- py3_sdk_ctx: Python ----------
import System
import Rhino
import Grasshopper

import rhinoscriptsyntax as rs
import scriptcontext


class MyComponent(Grasshopper.Kernel.GH_ScriptInstance):
    def RunScript(self):
        _, ctx = __this__.TryGetContext()
        return __id__, ctx, scriptcontext.id
# ---------- end py3_sdk_ctx ----------
ipy2_sdk_ctx = IronPython2Script()  # -> script_id, script_ctx, i; same code as py3_sdk_ctx
panel_4 = Panel([py3_sdk_ctx.script_id, py3_sdk_ctx.script_ctx, py3_sdk_ctx.i])
panel_5 = Panel([ipy2_sdk_ctx.script_id, ipy2_sdk_ctx.script_ctx, ipy2_sdk_ctx.i])

# ---- group: SCRIPT-MODE
py3_2 = Python3Script()  # -> ghenv, ghdoc, i
# ---------- py3_2: Python ----------
import scriptcontext

i = scriptcontext.id
# ---------- end py3_2 ----------
ipy2_2 = IronPython2Script()  # -> ghenv, ghdoc, i; same code as py3_2
c_script_2 = CSharpScript()  # -> ghEnv, ghDoc
# ---------- c_script_2: C# ----------
using System;

ghEnv = ghenv;
ghDoc = ghdoc;
# ---------- end c_script_2 ----------
panel_6 = Panel([py3_2.ghenv, py3_2.ghdoc, py3_2.i])
panel_7 = Panel([ipy2_2.ghenv, ipy2_2.ghdoc, ipy2_2.i])
panel_8 = Panel([c_script_2.ghEnv, c_script_2.ghDoc])
py3_scr_ctx = Python3Script()  # -> script_id, script_ctx, i
# ---------- py3_scr_ctx: Python ----------
import scriptcontext

script_id = __id__
_, script_ctx = __this__.TryGetContext()
i = scriptcontext.id
# ---------- end py3_scr_ctx ----------
ipy2_scr_ctx = IronPython2Script()  # -> script_id, script_ctx, i; same code as py3_scr_ctx
panel_9 = Panel([py3_scr_ctx.script_id, py3_scr_ctx.script_ctx, py3_scr_ctx.i])
panel_10 = Panel([ipy2_scr_ctx.script_id, ipy2_scr_ctx.script_ctx, ipy2_scr_ctx.i])
