# Grasshopper definition ScriptInstanceGlobalScopeTest.ghx (Grasshopper 1.0.8)
# plug-ins: RhinoCodePluginGH

c_script = CSharpScript()  # -> out, a
# ---------- c_script: C# ----------
// Grasshopper Script Instance
#region Usings
using System;
using System.Linq;
using System.Collections;
using System.Collections.Generic;
using System.Drawing;

using Rhino;
using Rhino.Geometry;

using Grasshopper;
using Grasshopper.Kernel;
using Grasshopper.Kernel.Data;
using Grasshopper.Kernel.Types;
#endregion

a = x + y;

public class Script_Instance : GH_ScriptInstance
{
    #region Notes
    /* 
      Members:
        RhinoDoc RhinoDocument
        GH_Document GrasshopperDocument
        IGH_Component Component
        int Iteration

      Methods (Virtual & overridable):
        Print(string text)
        Print(string format, params object[] args)
        Reflect(object obj)
        Reflect(object obj, string method_name)
    */
    #endregion

    private void RunScript(object x, object y, ref object a)
    {
        // Write your logic here
        a = null;
    }
}
# ---------- end c_script ----------
c_script_2 = CSharpScript()  # -> out, a; inputs x: Double, y: Double
# ---------- c_script_2: C# ----------
a = x + y;
# ---------- end c_script_2 ----------
