# Grasshopper definition ScriptInstancePreviews_Context.ghx (Grasshopper 1.0.8)
# plug-ins: RhinoCodePluginGH

get_number = GetNumber(Slider(1, range=0..1), AtLeast=1, AtMost=1, Maximum=1.797693135e+308, Minimum=-1.797693135e+308, TreeAccess=False)

# ---- group: PreviewsOn
outpreviewone = RhinoCode(x=get_number, y=get_number)  # -> a; inputs x: Int32, y: Double
# ---------- outpreviewone: C# ----------
#r "System.Drawing"

using System;
using System.Collections;
using System.Collections.Generic;
using System.Drawing;

using Rhino;
using Rhino.Geometry;

using Grasshopper;
using Grasshopper.Kernel;
using Grasshopper.Kernel.Data;
using Grasshopper.Kernel.Types;

public class Script_Instance : GH_ScriptInstance
{
  Point3d o = new Point3d(5, 5, 0);
  float vectorScale;

  private void RunScript(int x, double y, ref object a)
  {
    a = new Rhino.Geometry.Sphere(o, x);
    vectorScale = Convert.ToSingle(y);
  }

  public override BoundingBox ClippingBox =>
    new BoundingBox(new Point3d(5, 5, 0), new Point3d(10, 10, 5));

  public override void DrawViewportWires(IGH_PreviewArgs args)
  {
    args.Display.DrawDirectionArrow(o, new Vector3f(vectorScale, .5f, 0f), Color.Blue);
    args.Display.DrawDirectionArrow(o, new Vector3f(.5f, vectorScale, 0f), Color.Red);
    args.Display.DrawDirectionArrow(o, new Vector3f(0f, 1f, vectorScale), Color.Green);
  }
}
# ---------- end outpreviewone ----------
outpreviewone_2 = RhinoCode(x=get_number, y=get_number)  # -> a; inputs x: Int32, y: Double
# ---------- outpreviewone_2: C# ----------
using System;

using Rhino;
using Rhino.Geometry;

a = new Rhino.Geometry.Sphere(new Point3d(5, 15, 0), x);
# ---------- end outpreviewone_2 ----------

# ---- group: PreviewsOff
outpreviewone_3 = RhinoCode(x=get_number, y=get_number)  # -> a; inputs x: Int32, y: Double
# ---------- outpreviewone_3: C# ----------
#r "System.Drawing"

using System;
using System.Collections;
using System.Collections.Generic;
using System.Drawing;

using Rhino;
using Rhino.Geometry;

using Grasshopper;
using Grasshopper.Kernel;
using Grasshopper.Kernel.Data;
using Grasshopper.Kernel.Types;

public class Script_Instance : GH_ScriptInstance
{
  Point3d o = new Point3d(15, 5, 0);
  float vectorScale;

  private void RunScript(int x, double y, ref object a)
  {
    a = new Rhino.Geometry.Sphere(o, x);
    vectorScale = Convert.ToSingle(y);
  }

  public override BoundingBox ClippingBox =>
    new BoundingBox(new Point3d(15, 5, 0), new Point3d(20, 10, 5));
  
  public override void DrawViewportWires(IGH_PreviewArgs args)
  {
    args.Display.DrawDirectionArrow(o, new Vector3f(vectorScale, .5f, 0f), Color.Blue);
    args.Display.DrawDirectionArrow(o, new Vector3f(.5f, vectorScale, 0f), Color.Red);
    args.Display.DrawDirectionArrow(o, new Vector3f(0f, 1f, vectorScale), Color.Green);

    var b = new Rhino.Geometry.Box(new Rhino.Geometry.BoundingBox(15, 5, 0, 20, 10, 5));
    Rhino.Geometry.Mesh[] m = Rhino.Geometry.Mesh.CreateFromBrep(b.ToBrep());
    foreach(var mesh in m)
        args.Display.DrawMeshWires(mesh, Color.Green);
  }
}
# ---------- end outpreviewone_3 ----------
outpreviewone_4 = RhinoCode(x=get_number, y=get_number)  # -> a; inputs x: Int32, y: Double
# ---------- outpreviewone_4: C# ----------
using System;

using Rhino;
using Rhino.Geometry;

a = new Rhino.Geometry.Sphere(new Point3d(15, 15, 0), x);
# ---------- end outpreviewone_4 ----------

# ----
panel = Panel(outpreviewone)
panel_2 = Panel(outpreviewone_2)
panel_3 = Panel(outpreviewone_3)
panel_4 = Panel(outpreviewone_4)
context_bake = ContextBake(Content=outpreviewone)
context_bake_2 = ContextBake(Content=outpreviewone_2)
context_bake_3 = ContextBake(Content=outpreviewone_3)
context_bake_4 = ContextBake(Content=outpreviewone_4)
