# Grasshopper definition ScriptInstancePreviews_Single.ghx (Grasshopper 1.0.8)
# plug-ins: RhinoCodePluginGH

number_slider = Slider(1, range=0..1)

# ---- group: PreviewsOn
outpreviewsdkwithpreview = RhinoCode(x=number_slider, y=number_slider)  # -> a; inputs x: Int32, y: Double
# ---------- outpreviewsdkwithpreview: C# ----------
#r "System.Drawing"

using System;
using System.Collections;
using System.Collections.Generic;
using System.Drawing;

using Rhino;
using Rhino.Geometry;

using Grasshopper;
using Grasshopper.Kernel;
using Grasshopper.Kernel.Data;
using Grasshopper.Kernel.Types;

public class Script_Instance : GH_ScriptInstance
{
  Point3d o = new Point3d(5, 5, 0);
  float vectorScale;

  private void RunScript(int x, double y, ref object a)
  {
    a = new Rhino.Geometry.Sphere(o, x);
    vectorScale = Convert.ToSingle(y);
  }

  public override BoundingBox ClippingBox =>
    new BoundingBox(new Point3d(5, 5, 0), new Point3d(10, 10, 5));

  public override void DrawViewportWires(IGH_PreviewArgs args)
  {
    args.Display.DrawDirectionArrow(o, new Vector3f(vectorScale, .5f, 0f), Color.Blue);
    args.Display.DrawDirectionArrow(o, new Vector3f(.5f, vectorScale, 0f), Color.Red);
    args.Display.DrawDirectionArrow(o, new Vector3f(0f, 1f, vectorScale), Color.Green);
  }
}
# ---------- end outpreviewsdkwithpreview ----------
outpreviewscriptwithpreview = RhinoCode(x=number_slider, y=number_slider)  # -> a; inputs x: Int32, y: Double
# ---------- outpreviewscriptwithpreview: C# ----------
using System;

using Rhino;
using Rhino.Geometry;

a = new Rhino.Geometry.Sphere(new Point3d(5, 15, 0), x);
# ---------- end outpreviewscriptwithpreview ----------

# ---- group: PreviewsOff
outpreviewsdknopreview = RhinoCode(x=number_slider, y=number_slider)  # -> a; inputs x: Int32, y: Double
# ---------- outpreviewsdknopreview: C# ----------
#r "System.Drawing"

using System;
using System.Collections;
using System.Collections.Generic;
using System.Drawing;

using Rhino;
using Rhino.Geometry;

using Grasshopper;
using Grasshopper.Kernel;
using Grasshopper.Kernel.Data;
using Grasshopper.Kernel.Types;

public class Script_Instance : GH_ScriptInstance
{
  Point3d o = new Point3d(15, 5, 0);
  float vectorScale;

  private void RunScript(int x, double y, ref object a)
  {
    a = new Rhino.Geometry.Sphere(o, x);
    vectorScale = Convert.ToSingle(y);
  }

  public override BoundingBox ClippingBox =>
    new BoundingBox(new Point3d(15, 5, 0), new Point3d(20, 10, 5));
  
  public override void DrawViewportWires(IGH_PreviewArgs args)
  {
    args.Display.DrawDirectionArrow(o, new Vector3f(vectorScale, .5f, 0f), Color.Blue);
    args.Display.DrawDirectionArrow(o, new Vector3f(.5f, vectorScale, 0f), Color.Red);
    args.Display.DrawDirectionArrow(o, new Vector3f(0f, 1f, vectorScale), Color.Green);

    var b = new Rhino.Geometry.Box(new Rhino.Geometry.BoundingBox(15, 5, 0, 20, 10, 5));
    Rhino.Geometry.Mesh[] m = Rhino.Geometry.Mesh.CreateFromBrep(b.ToBrep());
    foreach(var mesh in m)
        args.Display.DrawMeshWires(mesh, Color.Green);
  }
}
# ---------- end outpreviewsdknopreview ----------
outpreviewscriptnopreview = RhinoCode(x=number_slider, y=number_slider)  # -> a; inputs x: Int32, y: Double
# ---------- outpreviewscriptnopreview: C# ----------
using System;

using Rhino;
using Rhino.Geometry;

a = new Rhino.Geometry.Sphere(new Point3d(15, 15, 0), x);
# ---------- end outpreviewscriptnopreview ----------

# ----
panel = Panel(outpreviewsdkwithpreview)
panel_2 = Panel(outpreviewscriptwithpreview)
panel_3 = Panel(outpreviewsdknopreview)
panel_4 = Panel(outpreviewscriptnopreview)
