# Grasshopper definition ScriptInstanceProgressReporter_Context.ghx (Grasshopper 1.0.8)
# plug-ins: RhinoCodePluginGH

inp = GetBoolean(Toggle(True), AtLeast=1, AtMost=1, FalseValue="False", TreeAccess=False, TrueValue="True")
py3 = Python3Script(inp=inp)  # -> outp
# ---------- py3: Python ----------
# r: scipy
# venv: test_restore_progress_context

import scipy

outp = str(scipy) if inp else "Empty"
# ---------- end py3 ----------
panel = Panel(py3)
context_print = ContextPrint(Text=py3)
