# Grasshopper definition ScriptInstanceProgressReporter_Single.ghx (Grasshopper 1.0.8)
# plug-ins: RhinoCodePluginGH

py3 = Python3Script(inp=Toggle(True))  # -> outp
# ---------- py3: Python ----------
# r: scipy
# venv: test_restore_progress_single

import scipy

outp = str(scipy) if inp else "Empty"
# ---------- end py3 ----------
panel = Panel(py3)
