# Grasshopper definition TestNestedPathInContextComp.ghx (Grasshopper 1.0.8)
# plug-ins: RhinoCodePluginGH

input = GetInteger(AtLeast=1, AtMost=1, Maximum=2147483647, Minimum=-2147483648, TreeAccess=False)
S = Script(Script="code.gh", Input=input)
context_bake = ContextBake(Content=S)
