# Grasshopper definition test_csharp_runScriptAsync_rc8.15.ghx (Grasshopper 1.0.8)
# plug-ins: RhinoCodePluginGH

# ---- group: before await
number_slider = Slider(21, range=0..100)
c_script = CSharpScript(x=number_slider, y=number_slider)  # inputs x: Int32, y: Int32
# ---------- c_script: C# ----------
using System;
using System.Linq;
using System.Collections;
using System.Collections.Generic;
using System.Drawing;
using System.Threading.Tasks;
using System.Net.Http;

using Rhino;
using Rhino.Geometry;

using Grasshopper;
using Grasshopper.Kernel;
using Grasshopper.Kernel.Data;
using Grasshopper.Kernel.Types;
using Grasshopper.Kernel.Parameters;

public class Script_Instance : GH_ScriptInstance
{
    private async void RunScript(int x, int y)
    {
        int m = x + y;
        
        var client = new HttpClient();
        
        await Task.Delay(3 * 1000);

        foreach(var dobj in GrasshopperDocument.Objects)
        {
            if (dobj.NickName == "Result")
            {
                try
                {
                    Param_Number p = (Param_Number)dobj;
                    p.AddVolatileData(new GH_Path(0), 0, new GH_Number(m));

                    foreach (var dest in p.Recipients)
                    {
                        dest.ExpireSolution(true);
                    }
                }
                catch (Exception ex)
                {
                    Component.AddRuntimeMessage(GH_RuntimeMessageLevel.Error, $"Error: {ex}");
                }
            }
        }
    }
}
# ---------- end c_script ----------

# ---- group: after await
addition = Addition(A=number_slider, B=number_slider)
result = Number()
R = Panel(result)
equality = Equality(FirstNumber=result, SecondNumber=addition)  # -> Equality, Inequality

# ----
assert_true = AssertTrue(equality.Equality)
