# Grasshopper definition test_notkeepingvalue_rc8.8.ghx (Grasshopper 1.0.8)
# plug-ins: RhinoCodePluginGH

# This is here to connect to an x input and check if the test actually fails
number_slider = Slider(12, range=0..100)
# Test case deletes this parameter
input = Panel("Test")
ghpython_script = GhPythonScript(x=input)  # -> out, a, a_test
# ---------- ghpython_script: Python ----------
a = x
a_test = a is None
# ---------- end ghpython_script ----------
py3 = Script(x=input)  # -> out, a, a_test; same code as ghpython_script
cs = Script(x=input)  # -> out, a, a_test
# ---------- cs: C# ----------
a = x;
a_test = a is null;
# ---------- end cs ----------
ipy2 = IronPython2Script(x=input)  # -> out, a, a_test; same code as ghpython_script
# Test case reads error messages on this assert
assert = AssertTrue([py3.a_test, cs.a_test, ipy2.a_test, ghpython_script.a_test])
