# Grasshopper definition test_plugins_package_install_progress_context_rc8.10.ghx (Grasshopper 1.0.8)
# plug-ins: RhinoCodePluginGH, ScriptInstanceProgressReporter.GH

panel = Panel("\<module \'scipy\' from \'.+\.rhinocode\\\\py39-rh8\\\\site-envs\\\\.+\\\\scipy\\\\__init__\.py\'\>")
pts = ProgressTest_Context(Inp=Toggle(True))
panel_2 = Panel(pts)
tmatch = MatchText(Text=pts, RegEx=panel, Case=True)
at = AssertTrue(tmatch)
