# Grasshopper definition test_rir_compile.ghx (Grasshopper 1.0.8)
# plug-ins: RhinoCodePluginGH

ipy2 = IronPython2Script()  # -> out, a
# ---------- ipy2: IronPython ----------
from Autodesk.Revit.DB import Element

print(Element)
# ---------- end ipy2 ----------
py3 = Python3Script()  # -> out, a; same code as ipy2
c_script = CSharpScript()  # -> out, a
# ---------- c_script: C# ----------
// Grasshopper Script Instance
#region Usings
using System;
using System.Linq;
using System.Collections;
using System.Collections.Generic;
using System.Drawing;

using Rhino;
using Rhino.Geometry;

using Grasshopper;
using Grasshopper.Kernel;
using Grasshopper.Kernel.Data;
using Grasshopper.Kernel.Types;

using Autodesk.Revit.DB;
#endregion

public class Script_Instance : GH_ScriptInstance
{
    #region Notes
    /* 
      Members:
        RhinoDoc RhinoDocument
        GH_Document GrasshopperDocument
        IGH_Component Component
        int Iteration

      Methods (Virtual & overridable):
        Print(string text)
        Print(string format, params object[] args)
        Reflect(object obj)
        Reflect(object obj, string method_name)
    */
    #endregion

    private void RunScript(object x, object y, ref object a)
    {
        Print(typeof(Element).ToString());
        a = null;
    }
}
# ---------- end c_script ----------
panel = Panel(ipy2.out)
panel_2 = Panel(py3.out)
panel_3 = Panel(c_script.out)
tmatch = MatchText(Text=panel, RegEx="type 'Element'", Case=True)
tmatch_2 = MatchText(Text=[panel_3, panel_2], RegEx="Autodesk\.Revit\.DB\.Element", Case=True)
at = AssertTrue(tmatch)
at_2 = AssertTrue(tmatch_2)
