# Grasshopper definition test_rir_compile_guards_rc8.15.ghx (Grasshopper 1.0.8)
# plug-ins: RhinoCodePluginGH

# ---- group: 2018_OR_GREATER
c_script = CSharpScript()  # -> out, m
# ---------- c_script: C# ----------
using System;

m = -1;

#if REVIT_2018_OR_GREATER
m = 42;
#endif
# ---------- end c_script ----------

# ----
equals = Equality(FirstNumber=c_script.m, SecondNumber=Slider(42, range=0..100))  # -> Equality, Inequality
at = AssertTrue(equals.Equality)
