# Grasshopper definition test_rir_converters_element.ghx (Grasshopper 1.0.8)
# plug-ins: RhinoCodePluginGH, Rhino.Inside for Autodesk Revit

graphical_element = GraphicalElement(<wall referenced from the Revit model>)
graphical_element_2 = GraphicalElement(<wall referenced from the Revit model>)
py3 = Python3Script(x=graphical_element)  # -> out; inputs x: ElementId
#   port x: Converts DB.Element to DB.ElementId
# ---------- py3: Python ----------
print(type(x))
# ---------- end py3 ----------
py3_2 = Python3Script(x=graphical_element_2)  # -> out; same code as py3
panel = Panel(py3)
panel_2 = Panel(py3_2)
tmatch = MatchText(Text=panel, RegEx="class 'Autodesk\.Revit\.DB\.ElementId'", Case=True)
tmatch_2 = MatchText(Text=panel_2, RegEx="class 'Autodesk\.Revit\.DB\.Wall'", Case=True)
at = AssertTrue(tmatch)
at_2 = AssertTrue(tmatch_2)
