# Grasshopper definition test_rir_invariant_culture.ghx (Grasshopper 1.0.8)
# plug-ins: RhinoCodePluginGH, Rhino.Inside for Autodesk Revit

# Test this on Non-English Revit
# With a few walls
active_document = ActiveDocument()
c_script = CSharpScript(d=active_document)  # -> out, isInvariant, isThreadInvariant
# ---------- c_script: C# ----------
using System;
#r "RevitAPI.dll"
#r "RevitAPIUI.dll"
using System.Globalization;
using System.Threading;

using Autodesk.Revit.DB;
using Autodesk.Revit.UI;
using Autodesk.Revit.Attributes;
using Autodesk.Revit.UI.Selection;

isInvariant = CultureInfo.CurrentCulture == CultureInfo.InvariantCulture;
isThreadInvariant = Thread.CurrentThread.CurrentCulture == CultureInfo.InvariantCulture;

double desiredHeight = 10;

Document doc = (Document)d;

try
{
    // Start a transaction
    using (Transaction transaction = new Transaction(doc, "Set Wall Heights"))
    {
        transaction.Start();

        // Get all walls in the document
        FilteredElementCollector collector = new FilteredElementCollector(doc);
        collector.OfClass(typeof(Wall));

        foreach (Element element in collector)
        {
            Wall wall = element as Wall;
            if (wall != null)
            {
                // Get the wall type's height parameter
                Parameter unconnectedHeightParam = wall.get_Parameter(BuiltInParameter.WALL_USER_HEIGHT_PARAM);

                if (unconnectedHeightParam != null && !unconnectedHeightParam.IsReadOnly)
                {
                    // Set the height
                    unconnectedHeightParam.Set(desiredHeight);
                }
            }
        }

        // Commit the transaction
        transaction.Commit();
    }
}
catch (Exception ex)
{
}
# ---------- end c_script ----------
is_invariant = AssertTrue(c_script.isInvariant)
is_thread_invariant = AssertTrue(c_script.isThreadInvariant)
