# Grasshopper definition components.ghx (Grasshopper 1.0.8)
# plug-ins: RhinoCodePluginGH

first = CSharpScript()  # -> out, a
# ---------- first: C# ----------
// Grasshopper Script Instance
#region Usings
using System;
using System.Linq;
using System.Collections;
using System.Collections.Generic;
using System.Drawing;

using Rhino;
using Rhino.Geometry;

using Grasshopper;
using Grasshopper.Kernel;
using Grasshopper.Kernel.Data;
using Grasshopper.Kernel.Types;
#endregion

public class Script_Instance : GH_ScriptInstance
{
    #region Notes
    /* 
      Members:
        RhinoDoc RhinoDocument
        GH_Document GrasshopperDocument
        IGH_Component Component
        int Iteration

      Methods (Virtual & overridable):
        Print(string text)
        Print(string format, params object[] args)
        Reflect(object obj)
        Reflect(object obj, string method_name)
    */
    #endregion

    private void RunScript(object x, object y, ref object a)
    {
        // Write your logic here
        a = null;
    }
}
# ---------- end first ----------
third = IronPython2Script()  # -> out, a
# ---------- third: IronPython ----------
"""Grasshopper Script"""
a = "Hello IronPython 2 in Grasshopper!"
print(a)
# ---------- end third ----------
second = Python3Script()  # -> out, a; unedited script template
