# Grasshopper definition components_r7.ghx (Grasshopper 1.0.8)
# plug-ins: RhinoCodePluginGH

second = IronPython2Script()  # -> out, a
# ---------- second: IronPython ----------
"""Grasshopper Script"""
a = "Hello IronPython 2 in Grasshopper!"
print(a)
# ---------- end second ----------
first = IronPython2Script()  # -> out, a; same code as second
