# Grasshopper definition test_self.gh (Grasshopper 1.0.7)

number_slider = Slider(10, range=0..10)
addition = Addition(A=number_slider, B=number_slider)
equality = Equality(FirstNumber=addition, SecondNumber=Slider(42, range=0..100))  # -> Equality, Inequality
result = ContextBake(Content=equality.Equality)
