# Grasshopper definition user_objects_source.ghx (Grasshopper 1.0.8)
# plug-ins: RhinoCodePluginGH

newpy3 = Python3Script()  # -> out, a
# ---------- newpy3: Python ----------
print("Converted successfully")
a = 42
# ---------- end newpy3 ----------
newcs = CSharpScript()  # -> out, a
# ---------- newcs: C# ----------
using System;

Console.WriteLine("Converted successfully");
a = 42;
# ---------- end newcs ----------
panel = Panel([newpy3.out, newpy3.a])
panel_2 = Panel([newcs.out, newcs.a])
