# Grasshopper definition user_objects_source_legacy.ghx (Grasshopper 1.0.8)

legacypython = GhPythonScript()  # -> out, a
# ---------- legacypython: Python ----------
print("Converted successfully")
a = 42
# ---------- end legacypython ----------
legacycsharp = CSharpScript()  # -> out, A
# ---------- legacycsharp: C# ----------
    Print("Converted successfully");
    A = 42;
# ---------- end legacycsharp ----------
legacyvb = VBScript()  # -> out, A
# ---------- legacyvb: C# ----------
    Print("Converted successfully")
    A = 42
# ---------- end legacyvb ----------
panel = Panel([legacypython.out, legacypython.a])
ghpython_script = GhPythonScript()
ghpython_script_2 = GhPythonScript()
ghpython_script_3 = GhPythonScript()  # -> a; inputs y: Brep
# ---------- ghpython_script_3: Python ----------
from ghpythonlib.componentbase import executingcomponent as component
import Grasshopper, GhPython
import System
import Rhino
import rhinoscriptsyntax as rs

class MyComponent(component):
    
    def RunScript(self, x, y):
        """Provides a scripting component.
            Inputs:
                x: The x script variable
                y: The y script variable
            Output:
                a: The a output variable"""
        
        __author__ = "ein"
        __version__ = "2024.09.12"
        
        import rhinoscriptsyntax as rs
        
        # return outputs if you have them; here I try it for you:
        return a
# ---------- end ghpython_script_3 ----------
